# Grasshopper definition Forward_Surrogate.gh (Grasshopper 1.0.8)
# plug-ins: Heteroptera, PTComponentLibrary, Flexibility

# ---- group: Model Parameters
model_path_24_layers = Panel("C:\Gal_Msc\Ipublic-repo\inverse-model-frustrated-composites\saved_models\glowing-river.pkl")
number_slider = Slider(3, range=0..10)
max = Panel("""20.4
20.4
20.0""")
min = Panel("""-20.4
-20.4
-0.2""")
number_slider_2 = Slider(1, range=0..1)

# ---- group: Simulation Parameters
# Testing Model Results  - Inverse
genes = GenePool(Decimals=0, Maximum=180, Minimum=1, Value=[145, 38, 127, 116, 148, 58])
X = Slider(20, range=1..40)
Y = Slider(30, range=1..40)
patch_size = Slider(10, range=1..40)

# ----
multiplication = Multiplication(A=X, B=Y)
sqr = Square(Value=patch_size)
division = Division(A=multiplication, B=sqr)
# only z / all xyz from forward model!!!
pool_controller = GenePoolController(GenePool=genes, Count=division, Randomness=0.1)

pt = ConstructPoint(
    XCoordinate=Slider(-12.526, range=-100..101),
    YCoordinate=Slider(28.359, range=-100..101),
    ZCoordinate=Slider(-39.689, range=-100..101))
forward_optimization_xyz = Python3Script(
    labels_max=max,
    labels_min=min,
    x_cm=X,
    y_cm=Y,
    patch_x=patch_size,
    patch_y=patch_size,
    n_of_features_channels=number_slider,
    n_of_labels_channels=number_slider_2,
    model_path=model_path_24_layers,
    angles=genes)  # -> out, pred_prev, target_prev, angles_out; inputs labels_max: list of Double, labels_min: list of Double, x_cm: Int32, y_cm: Int32, patch_x: Int32, patch_y: Int32, n_of_features_channels: Int32, n_of_labels_channels: Int32, angles: list
# ---------- forward_optimization_xyz: Python ----------
# ┌───────────────────────────────────────────────────────────────────────────┐
# │                      Imports and Definitions                              │
# └───────────────────────────────────────────────────────────────────────────┘
# venv: forward_prediction_XYZ
# r: numpy, torch, matplotlib, pathlib, open3d, wandb

import time
import os

import wandb
import numpy as np
import torch 
import torch.nn as nn
from torch.optim.lr_scheduler import ReduceLROnPlateau
from Grasshopper import DataTree
from Grasshopper.Kernel.Data import GH_Path
import matplotlib
import matplotlib.pyplot as plt
matplotlib.use('Agg')  # Use a non-interactive backend
from pathlib import Path
import torch.nn.functional as F
import Rhino.Geometry as rg
import open3d as o3d
from scipy.stats import qmc

features_channels = n_of_labels_channels 
labels_channels =  n_of_features_channels 

step_num = 10000

# ┌───────────────────────────────────────────────────────────────────────────┐
# │                               Functions                                   │
# └───────────────────────────────────────────────────────────────────────────┘

def duplicate_pixel_data(input_data, x_cm, y_cm, patch_x, patch_y, fortran_order=False):
    """
    Duplicates coarse grid values into patches in a larger tensor.
    
    Args:
        input_data (list, np.ndarray, or torch.Tensor): Either flat or 2D grid of values.
        x_cm (int): Width of output grid.
        y_cm (int): Height of output grid.
        patch_x (int): Width of each patch.
        patch_y (int): Height of each patch.
        fortran_order (bool): Whether to interpret flat input in column-major (Fortran) order.

    Returns:
        torch.Tensor: 4D tensor of shape (1, 1, y_cm, x_cm) with duplicated values.
    """
    num_patches_y = y_cm // patch_y
    num_patches_x = x_cm // patch_x
    expected_size = num_patches_y * num_patches_x

    # Convert input to torch tensor
    if isinstance(input_data, torch.Tensor):
        tensor_input = input_data
    elif isinstance(input_data, np.ndarray):
        tensor_input = torch.tensor(input_data, dtype=torch.float32)
    elif isinstance(input_data, list):
        tensor_input = torch.tensor(input_data, dtype=torch.float32)
    else:
        raise TypeError("Unsupported input type")

    # Handle flat input: reshape into 2D grid
    if tensor_input.dim() == 1:
        assert tensor_input.numel() == expected_size, f"Expected {expected_size} values, got {tensor_input.numel()}"
        if fortran_order:
            np_input = tensor_input.numpy().reshape((num_patches_y, num_patches_x), order='F')
            tensor_input = torch.tensor(np_input, dtype=torch.float32)
        else:
            tensor_input = tensor_input.view(num_patches_y, num_patches_x)

    final_tensor = torch.zeros((1, 1, y_cm, x_cm), dtype=torch.float32)

    for i in range(num_patches_y):
        for j in range(num_patches_x):
            row_start = i * patch_y
            row_end = row_start + patch_y
            col_start = j * patch_x
            col_end = col_start + patch_x
            final_tensor[:, 0, row_start:row_end, col_start:col_end] = tensor_input[i, j]


    return final_tensor


def duplicate_pixel_data_torch(input_data, x_cm, y_cm, patch_x, patch_y, fortran_order=False):
    num_patches_y = y_cm // patch_y
    num_patches_x = x_cm // patch_x
    expected_size = num_patches_y * num_patches_x

    # --- 1. Convert input to tensor (keeps gradient if it's already a Parameter)
    if not isinstance(input_data, torch.Tensor):
        tensor_input = torch.tensor(input_data, dtype=torch.float32)
    else:
        tensor_input = input_data

    # --- 2. Reshape flat input to 2D grid if needed
    if tensor_input.dim() == 1:
        assert tensor_input.numel() == expected_size, \
            f"Expected {expected_size} values, got {tensor_input.numel()}"
        if fortran_order:
            tensor_input = tensor_input.view(num_patches_x, num_patches_y).T
        else:
            tensor_input = tensor_input.view(num_patches_y, num_patches_x)

    # --- 3. Expand each value into its patch (vectorized)
    # Add channel/batch dims: (1, 1, num_patches_y, num_patches_x)
    tensor_input = tensor_input.unsqueeze(0).unsqueeze(0)

    # Expand along height and width
    tensor_expanded = tensor_input.repeat_interleave(patch_y, dim=2).repeat_interleave(patch_x, dim=3)
    # tensor_expanded now has shape (1, 1, y_cm, x_cm)

    return tensor_expanded


def tensor_to_spatial_tree(tensor):
    """
    Converts a [1, C, H, W] tensor into a DataTree[float] with each {h,w} as a branch
    containing C channel values.
    """
    tree = DataTree[float]()
    tensor = tensor.detach().squeeze(0)  # shape: [C, H, W]
    C, H, W = tensor.shape
    print(f"tensor shape before conversion: {C}, {H}, {W}")

    for y in range(H):
        for x in range(W):
            path = GH_Path(y, x)
            for ch in range(C):
                tree.Add(float(tensor[ch, y, x]), path)

    return tree

def chamfer_loss_with_registration(predicted, target):
    # Flatten from (1,3,x,y) to (N,3)
    P = predicted.permute(0, 2, 3, 1).reshape(-1, 3)
    Q = target.permute(0, 2, 3, 1).reshape(-1, 3)

    # Align predicted to target  - Simple
    P_aligned = rough_align(P, Q)
    # P_aligned, R, t = torch_icp(P, Q, iters=8, blend=0.3)
    # P_aligned = P


    # Compute Chamfer
    diff = P_aligned.unsqueeze(1) - Q.unsqueeze(0)  # (N, N, 3)
    dist = torch.sum(diff**2, dim=2)
    min_P_to_Q = dist.min(dim=1)[0]
    min_Q_to_P = dist.min(dim=0)[0]
    loss = min_P_to_Q.mean() + min_Q_to_P.mean()

    #  RESHAPE back to (1, 3, y, x) for preview
    y_dim, x_dim = predicted.shape[2], predicted.shape[3]
    prediction_aligned_grid = P_aligned.T.reshape(1, 3, y_dim, x_dim)

    return loss, prediction_aligned_grid

def chamfer_loss_weighted_edges(predicted, target, edge_weight=25.0):
    """
    Chamfer loss with additional emphasis on edge points.
    `edge_weight`: multiplier applied to loss for boundary points only.
    """
    # Flatten from (1, 3, H, W) to (N, 3)
    B, C, H, W = predicted.shape
    P = predicted.permute(0, 2, 3, 1).reshape(-1, 3)  # (B*H*W, 3)
    Q = target.permute(0, 2, 3, 1).reshape(-1, 3)

    # Align predicted to target
    P_aligned = rough_align(P, Q)

    # Create edge masks (1 if boundary, 0 otherwise) for both predicted and target
    edge_mask = torch.zeros((H, W), dtype=torch.bool, device=predicted.device)
    edge_mask[0, :] = edge_mask[-1, :] = edge_mask[:, 0] = edge_mask[:, -1] = True
    edge_mask_flat = edge_mask.flatten()

    # Compute Chamfer distances
    diff = P_aligned.unsqueeze(1) - Q.unsqueeze(0)  # (N, N, 3)
    dist = torch.sum(diff**2, dim=2)

    min_P_to_Q = dist.min(dim=1)[0]
    min_Q_to_P = dist.min(dim=0)[0]

    # Apply weights to boundary points
    weights_P = torch.ones_like(min_P_to_Q)
    weights_P[edge_mask_flat] *= edge_weight

    weights_Q = torch.ones_like(min_Q_to_P)
    weights_Q[edge_mask_flat] *= edge_weight

    loss = (min_P_to_Q * weights_P).mean() + (min_Q_to_P * weights_Q).mean()

    # Reshape aligned prediction back for visualization
    prediction_aligned_grid = P_aligned.T.reshape(1, 3, H, W)

    return loss, prediction_aligned_grid


def rough_align(P, Q):
    """
    Roughly aligns P to Q by:
    - Matching centers
    - Building orientation from P only
    - Reusing orientation for Q (so identical clouds don’t get rotated)
    """

    # print("\n--- Rough Farthest-Edge Align (Safe) Debug ---")

    # 1. Compute centers
    P_center = P.mean(0, keepdim=True)
    Q_center = Q.mean(0, keepdim=True)
    # P_centered = P - P_center
    # Q_centered = Q - Q_center
    P_centered = P 
    Q_centered = Q 

    # 2. Use farthest point pair on P to define primary axis
    diffP = P_centered.unsqueeze(1) - P_centered.unsqueeze(0)
    distP = torch.sum(diffP ** 2, dim=2)
    iP, jP = torch.nonzero(distP == distP.max(), as_tuple=True)
    idxP1, idxP2 = iP[0].item(), jP[0].item()

    xP = (P_centered[idxP2] - P_centered[idxP1])
    xP = xP / torch.norm(xP)

    # 3. Secondary axis from P
    maskP = torch.ones(len(P_centered), dtype=torch.bool)
    maskP[[idxP1, idxP2]] = False
    subP = P_centered[maskP]
    diffP2 = subP.unsqueeze(1) - subP.unsqueeze(0)
    distP2 = torch.sum(diffP2 ** 2, dim=2)
    iP2, jP2 = torch.nonzero(distP2 == distP2.max(), as_tuple=True)
    idxP3, idxP4 = iP2[0].item(), jP2[0].item()
    yP_raw = subP[idxP4] - subP[idxP3]

    yP = yP_raw - torch.dot(yP_raw, xP) * xP
    yP = yP / torch.norm(yP)

    # 4. Build right-handed frame from P
    zP = torch.cross(xP, yP)
    frame_P = torch.stack([xP, yP, zP], dim=1)

    # ✅ Use the SAME frame for Q (no recalculation)
    frame_Q = frame_P.clone()

    # print("Frame P:\n", frame_P)
    # print("Frame Q (reused):\n", frame_Q)

    # 5. Rotation (now guaranteed identity if geometry is identical)
    R = frame_Q @ frame_P.T
    # print("Rotation matrix R:\n", R)
    # print("det(R):", torch.det(R).item())

    # 6. Translation
    t = Q_center - P_center @ R
    # print("Translation vector t:", t.tolist())

    # 7. Apply
    P_aligned = P @ R + t

    return P_aligned

def pointlist3d_to_tensor_grid(pointlist3d, x, y):
    """
    Converts a Point3d list into a (1, 3, x, y) tensor.
    Assumes point list is ordered row-major or column-major to match the grid.
    """
    coords = [[pt.X, pt.Y, pt.Z] for pt in pointlist3d]
    tensor = torch.tensor(coords, dtype=torch.float32)   # (N, 3)
    tensor = tensor.T.reshape(1, 3, y, x)  # now matches model output shape
    return tensor

def register_pointclouds_gh(P_list, Q_list, distance_threshold=0.01):
    """
    Aligns point cloud P onto Q using:
      1. Center translation
      2. Fast Global Registration
      3. ICP refinement

    Inputs:
        P_list: list of rg.Point3d (source)
        Q_list: list of rg.Point3d (target)
        distance_threshold: ICP max correspondence distance

    Outputs:
        aligned_points: list of rg.Point3d (P aligned to Q)
        final_transformation: 4x4 numpy array
    """

    print("\n--- GH Registration Debug ---")

    # --- 1. Convert GH points to numpy arrays ---
    P_np = np.array([[pt.X, pt.Y, pt.Z] for pt in P_list], dtype=np.float64)
    Q_np = np.array([[pt.X, pt.Y, pt.Z] for pt in Q_list], dtype=np.float64)

    # --- 2. Compute centers ---
    P_center = P_np.mean(axis=0)
    Q_center = Q_np.mean(axis=0)
    print("P center:", P_center, "Q center:", Q_center)

    P_centered = P_np - P_center
    Q_centered = Q_np - Q_center

    # --- 3. Build Open3D point clouds ---
    pcd_P = o3d.geometry.PointCloud()
    pcd_Q = o3d.geometry.PointCloud()
    pcd_P.points = o3d.utility.Vector3dVector(P_centered)
    pcd_Q.points = o3d.utility.Vector3dVector(Q_centered)

    # --- 4. Estimate normals (for registration) ---
    pcd_P.estimate_normals(o3d.geometry.KDTreeSearchParamHybrid(radius=0.1, max_nn=30))
    pcd_Q.estimate_normals(o3d.geometry.KDTreeSearchParamHybrid(radius=0.1, max_nn=30))

    # --- 5. Compute FPFH features for Fast Global Registration ---
    radius_feature = 0.25
    pcd_P_fpfh = o3d.pipelines.registration.compute_fpfh_feature(
        pcd_P, o3d.geometry.KDTreeSearchParamHybrid(radius=radius_feature, max_nn=100)
    )
    pcd_Q_fpfh = o3d.pipelines.registration.compute_fpfh_feature(
        pcd_Q, o3d.geometry.KDTreeSearchParamHybrid(radius=radius_feature, max_nn=100)
    )

    # --- 6. Fast Global Registration ---
    fgr_result = o3d.pipelines.registration.registration_fgr_based_on_feature_matching(
        pcd_P, pcd_Q, pcd_P_fpfh, pcd_Q_fpfh,
        o3d.pipelines.registration.FastGlobalRegistrationOption(
            maximum_correspondence_distance=distance_threshold
        )
    )
    print("FGR transformation:\n", fgr_result.transformation)

    # --- 7. ICP refinement ---
    icp_result = o3d.pipelines.registration.registration_icp(
        pcd_P, pcd_Q, distance_threshold,
        fgr_result.transformation,
        o3d.pipelines.registration.TransformationEstimationPointToPlane()
    )
    print("ICP refined transformation:\n", icp_result.transformation)

    # --- 8. Apply final transformation ---
    P_registered = np.asarray(pcd_P.points)
    P_registered_h = np.hstack((P_registered, np.ones((P_registered.shape[0], 1))))  # (N,4)
    P_transformed = (icp_result.transformation @ P_registered_h.T).T[:, :3]

    # --- 9. Add back Q’s center (since we centered earlier) ---
    P_aligned = P_transformed + Q_center

    # --- 10. Convert back to GH Point3d ---
    aligned_points = [rg.Point3d(float(x), float(y), float(z)) for x, y, z in P_aligned]

    return aligned_points, icp_result.transformation


def one_time_open3d_align(predicted, target):
    """
    Runs Open3D once to coarsely align target to predicted.
    Returns: transformed_target (torch.Tensor, same shape as target)
    """
    # Flatten from (1, 3, x, y) -> (N, 3)
    P = predicted.permute(0, 2, 3, 1).reshape(-1, 3).detach().cpu().numpy()
    Q = target.permute(0, 2, 3, 1).reshape(-1, 3).detach().cpu().numpy()

    # Convert to GH Point3d for the existing registration function
    P_points = [rg.Point3d(float(x), float(y), float(z)) for x, y, z in P]
    Q_points = [rg.Point3d(float(x), float(y), float(z)) for x, y, z in Q]

    aligned_points, transform = register_pointclouds_gh(P_points, Q_points)

    # Convert aligned target back to Torch tensor
    Q_aligned_np = np.array([[pt.X, pt.Y, pt.Z] for pt in aligned_points], dtype=np.float32)
    Q_aligned = torch.tensor(Q_aligned_np, dtype=target.dtype, device=target.device)

    # Reshape back to (1, 3, y, x)
    y_dim, x_dim = target.shape[2], target.shape[3]
    Q_aligned_grid = Q_aligned.T.reshape(1, 3, y_dim, x_dim)

    return Q_aligned_grid


def torch_icp(P, Q, iters=3, blend=0.2):
    """
    Differentiable ICP with controllable step size.
    blend: 0-1, fraction of ICP transform to apply each iteration.
    """
    R_total = torch.eye(3, device=P.device, dtype=P.dtype)
    t_total = torch.zeros(1, 3, device=P.device, dtype=P.dtype)

    P_aligned = P

    for i in range(iters):
        # Find correspondences
        diff = P_aligned.unsqueeze(1) - Q.unsqueeze(0)
        dist = (diff**2).sum(dim=2)
        idx = dist.argmin(dim=1)
        Q_matched = Q[idx]

        # Centroids
        P_mean = P_aligned.mean(0, keepdim=True)
        Q_mean = Q_matched.mean(0, keepdim=True)

        # Solve for R, t
        P_centered = P_aligned - P_mean
        Q_centered = Q_matched - Q_mean
        H = P_centered.T @ Q_centered
        U, S, Vt = torch.linalg.svd(H)
        R = Vt.T @ U.T
        if torch.det(R) < 0:
            Vt[-1, :] *= -1
            R = Vt.T @ U.T
        t = Q_mean - P_mean @ R

        # ✅ Blended update
        R_step = (1-blend) * torch.eye(3, device=P.device) + blend * R
        t_step = blend * t

        # Apply the “partial” transform
        P_aligned = P_aligned @ R_step + t_step

        # Accumulate transform
        R_total = R_step @ R_total
        t_total = (t_step @ R_total) + t_total

    return P_aligned, R_total, t_total

def wrap_angles_to_180(angles):
    angles_mod = torch.remainder(angles, 360.0)
    wrapped = torch.where(angles_mod > 180.0, 360.0 - angles_mod, angles_mod)
    return wrapped


def lhs_generate_candidates(num_candidates, num_angles):
    """
    Generate candidate angle sets in [0,180] using Latin Hypercube Sampling.
    """
    sampler = qmc.LatinHypercube(d=num_angles)
    samples = sampler.random(num_candidates)  # values in [0,1]
    angles = torch.tensor(samples * 180.0, dtype=torch.float32)
    return angles

def evaluate_candidates(angles_candidates, model, target_normalized):
    """
    Evaluate each LHS candidate by computing the loss through the model.
    Return the best angle set and its loss.
    """
    best_loss = float("inf")
    best_angles = None

    for i in range(angles_candidates.shape[0]):
        candidate = angles_candidates[i]

        # Prepare input grid
        candidate_grid = duplicate_pixel_data_torch(
            candidate,
            x_cm=x_cm,
            y_cm=y_cm,
            patch_x=patch_x,
            patch_y=patch_y,
            fortran_order=True
        )

        # Forward pass
        prediction = model(candidate_grid / 180.0)

        # Compute loss
        # loss, _ = chamfer_loss_with_registration(prediction, target_normalized)
        loss, _ = chamfer_loss_weighted_edges(prediction, target_normalized)
        loss = loss * 100
        loss_val = loss.item()

        if loss_val < best_loss:
            best_loss = loss_val
            best_angles = candidate.clone()

    return best_angles, best_loss


def tensors_to_pointlists(prediction, target):
    """
    Convert model prediction and target (shape: (1, 3, y, x)) into
    two flat lists of Rhino Point3d for Grasshopper visualization.

    Args:
        prediction: torch.Tensor of shape (1, 3, y, x)
        target: torch.Tensor of shape (1, 3, y, x)

    Returns:
        pred_points (list[rg.Point3d]), target_points (list[rg.Point3d])
    """
    # Move to CPU and remove batch dim
    pred_np = prediction.detach().cpu().numpy().squeeze()   # (3, y, x)
    target_np = target.detach().cpu().numpy().squeeze()     # (3, y, x)

    y_dim, x_dim = pred_np.shape[1], pred_np.shape[2]
    pred_points, target_points = [], []

    for i in range(y_dim):
        for j in range(x_dim):
            # predicted point
            px, py, pz = pred_np[:, i, j]
            pred_points.append(rg.Point3d(float(px), float(py), float(pz)))

            # target point
            tx, ty, tz = target_np[:, i, j]
            target_points.append(rg.Point3d(float(tx), float(ty), float(tz)))

    return pred_points, target_points


def tensor_to_pointlist(prediction):
    """
    Convert model prediction and target (shape: (1, 3, y, x)) into
    two flat lists of Rhino Point3d for Grasshopper visualization.

    Args:
        prediction: torch.Tensor of shape (1, 3, y, x)
        target: torch.Tensor of shape (1, 3, y, x)

    Returns:
        pred_points (list[rg.Point3d]), target_points (list[rg.Point3d])
    """
    # Move to CPU and remove batch dim
    pred_np = prediction.detach().cpu().numpy().squeeze()   # (3, y, x)


    y_dim, x_dim = pred_np.shape[1], pred_np.shape[2]
    pred_points = []

    for i in range(y_dim):
        for j in range(x_dim):
            # predicted point
            px, py, pz = pred_np[:, i, j]
            pred_points.append(rg.Point3d(float(px), float(py), float(pz)))


    return pred_points
# ┌───────────────────────────────────────────────────────────────────────────┐
# │                             Model Class                                   │
# └───────────────────────────────────────────────────────────────────────────┘

class OurVgg16InstanceNorm2d24lay(torch.nn.Module):
    def __init__(self, dropout=0.3):
        super().__init__()
        self.features = torch.nn.Sequential(
            # Stage 1
            self.block(features_channels, 64),
            self.block(64, 64),
            self.block(64, 64),
            self.block(64, 64, dropout),

            # Stage 2
            self.block(64, 128),
            self.block(128, 128),
            self.block(128, 128),
            self.block(128, 128, dropout),

            # Stage 3
            self.block(128, 256),
            self.block(256, 256),
            self.block(256, 256),
            self.block(256, 256, dropout),

            # Stage 4
            self.block(256, 512),
            self.block(512, 512),
            self.block(512, 512),
            self.block(512, 512, dropout),

            # Stage 5
            self.block(512, 768),
            self.block(768, 768),
            self.block(768, 768),
            self.block(768, 768, dropout),

            # Stage 6
            self.block(768, 1024),
            self.block(1024, 1024),
            self.block(1024, 1024),
            self.block(1024, 1024, dropout),
        )
        self.output_conv = torch.nn.Conv2d(1024, labels_channels, 3, padding=1)
        self.sigmoid = torch.nn.Sigmoid()

    def block(self, in_ch, out_ch, apply_dropout=False):
        layers = [
            torch.nn.Conv2d(in_ch, out_ch, kernel_size=3, padding=1),
            torch.nn.InstanceNorm2d(out_ch),
            torch.nn.ReLU()
        ]
        if apply_dropout:
            layers.append(torch.nn.Dropout())
        return torch.nn.Sequential(*layers)

    def forward(self, x):
        x = self.features(x)
        x = self.output_conv(x)
        x = self.sigmoid(x)
        return x
# ┌───────────────────────────────────────────────────────────────────────────┐
# │                        Main Code - Optimization                           │
# └───────────────────────────────────────────────────────────────────────────┘

gh_has_run = False

torch.manual_seed(42)
import random, numpy as np
random.seed(42)
np.random.seed(42)


# Make sure component only runs once
if gh_has_run == False:
    print("✅ First run – running optimization loop")
    gh_has_run = True



    device = torch.device("cuda" if torch.cuda.is_available() else "cpu")
    print(f"Using device: {device}")

    # Define the Model

    model = OurVgg16InstanceNorm2d24lay()
    model.load_state_dict(torch.load(model_path, map_location=device))
    model.eval()  # ensure correct evaluation mode
    model.to(device)


    # Convert target to tensor
    # target = pointlist3d_to_tensor_grid(target, x=x_cm, y=y_cm)

    # Normalize the target
    # labels_max_tensor = torch.tensor(labels_max, dtype=torch.float32).view(1, -1, 1, 1)
    # labels_min_tensor = torch.tensor(labels_min, dtype=torch.float32).view(1, -1, 1, 1)

    # target_normalized = (target - labels_min_tensor) / (labels_max_tensor - labels_min_tensor + 1e-8)
    # target_normalized = target_normalized.to(device)

    # print(target.shape)
    # print(target_normalized)

    # # Step 3: Model inference

    # # 1. Initialize angles 
    # num_angles = int((x_cm / patch_x) * (y_cm / patch_y))
    # print("num angles" , num_angles)

    # # LHS
    # # Step 1: Generate candidates
    # num_candidates = 5000
    # angles_candidates = lhs_generate_candidates(num_candidates, num_angles).to(device)

    # Step 2: Evaluate candidates
    # print("Evaluating LHS candidates...")
    # best_angles, best_loss = evaluate_candidates(angles_candidates, model, target_normalized)
    # print(best_angles)
    

    # print(f"✅ Best candidate found with loss={best_loss:.6f}")
    # Step 3: Use best_angles to initialize optimizer
    # angles = torch.nn.Parameter(best_angles, requires_grad=True)

    #  Initiate with "angles"
    angles_tensor = torch.tensor(angles, dtype=torch.float32, device=device)
    angles = torch.nn.Parameter(angles_tensor)


    # 🔹 Run Open3D once
    angles_grid_temp = duplicate_pixel_data_torch(angles, 
                                        x_cm=x_cm, 
                                        y_cm=y_cm, 
                                        patch_x=patch_x, 
                                        patch_y=patch_y, 
                                        fortran_order=True).to(device)

    prediction = model(angles_grid_temp/180.0) 
    # target_aligned = one_time_open3d_align(prediction, target_normalized)

    # print("✅ Target point cloud aligned once with Open3D")

    # Init prediction_alinged so it's not local 
    # prediction_aligned = None

    # Stage 1: Adam exploration
    # pre_lr = 0.01
    # best_loss = 1000
    # optimizer = torch.optim.Adam([angles], lr=pre_lr, amsgrad=True)
    # wandb.config.update({"pre optimizer": optimizer.__class__.__name__, "pre lr": pre_lr}, allow_val_change=True)
    # for step in range(step_num):
    #     optimizer.zero_grad()
    #     wrapped_angles = wrap_angles_to_180(angles)

    #     prediction = model(duplicate_pixel_data_torch(
    #                                                 wrapped_angles,
    #                                                 x_cm=x_cm,
    #                                                 y_cm=y_cm,
    #                                                 patch_x=patch_x,
    #                                                 patch_y=patch_y,
    #                                                 fortran_order=True) / 180.0)

        # loss, prediction_aligned = chamfer_loss_with_registration(prediction, target_normalized)
        # loss, prediction_aligned = chamfer_loss_weighted_edges(prediction, target_normalized)

    #     loss = loss * 100
    #     loss.backward()
    #     optimizer.step()

    #     # Track best result
    #     if loss.item() < best_loss:
    #         best_loss = loss.item()
    #         best_angles = angles.clone()
    #         best_prediction = prediction_aligned
            
    #     if step % 100 == 0:
    #         print(f"Adam step: {step}, loss: {loss}")
    # print(f"loss after Adam: {best_loss}")


    # # 2. Set up main optimizer
    # lr = 0.001
    # momentum = 0.9
    # max_iter = 20
    # history_size = 10

    # optimizer = torch.optim.LBFGS([angles], lr=lr, max_iter=max_iter, history_size=history_size)


    # # 🔢 store optimizer info in wandb
    # wandb.config.update({"optimizer": optimizer.__class__.__name__, "momentum": momentum, "lr": lr, "history size optimizer": history_size, "max iter optimizer": max_iter}, allow_val_change=True)
    
    
    # # # 4. Optimization loop
    # for step in range(step_num):
    #     # 🔹 LBFGS requires a closure it can call many times internally
    #     def closure():
    #         optimizer.zero_grad()
            
    #         # Build input grid
    #         angles_grid = duplicate_pixel_data_torch(
    #             angles,
    #             x_cm=x_cm,
    #             y_cm=y_cm,
    #             patch_x=patch_x,
    #             patch_y=patch_y,
    #             fortran_order=True
    #         )
    #         normalized_tensor = angles_grid / 180.0

    #         # Forward + loss
    #         prediction = model(normalized_tensor)

    #         # loss, _ = chamfer_loss_with_registration(prediction, target_normalized)
    #         loss, _ = chamfer_loss_weighted_edges(prediction, target_normalized)
            
    #         loss = loss * 100

    #         loss.backward()

    #         with torch.no_grad():
    #             angles.clamp_(0.0, 180.0)

    #         return loss

    #     # ✅ LBFGS step (closure will be called many times internally)
    #     final_loss = optimizer.step(closure)

    #     # # ✅ Clamp angles after step
    #     # with torch.no_grad():
    #     #     angles.clamp_(0.0, 180.0)

    #     # 🔁 Recompute prediction ONCE per step (final output after LBFGS step)
    #     angles_grid = duplicate_pixel_data_torch(
    #         angles,
    #         x_cm=x_cm,
    #         y_cm=y_cm,
    #         patch_x=patch_x,
    #         patch_y=patch_y,
    #         fortran_order=True
    #     )
    #     prediction = model(angles_grid / 180.0)
    #     # loss, prediction_aligned = chamfer_loss_with_registration(prediction, target_normalized)
    #     loss, prediction_aligned = chamfer_loss_weighted_edges(prediction, target_normalized)
        
    #     loss = loss * 100

    #     # 📊 Print/log only ONCE per step
    #     if step % 50 == 0:
    #         print(f"Step {step}: loss={loss.item():.6f}")
    #     wandb.log({"step": step, "loss": loss.item()})


    # 3. Preview
    scale_factor = 40
    # prediction_aligned = best_prediction
    prediction_aligned = prediction

    prediction_aligned = prediction_aligned.float() * scale_factor
    # target_normalized = target_normalized.float() * scale_factor
    pred_prev = tensor_to_pointlist(prediction_aligned)


    # end_time = time.time()

    # angles = best_angles
    # optimized_angles = angles.detach().cpu().numpy()  # convert to numpy
    # print(f"optimized angles: {optimized_angles}")


    # print(f"Optimization time: {end_time - start_time:.4f} seconds")

    # 🔚 Log final results
    # wandb.log({"final_loss": loss.item(), "total_time_sec": end_time - start_time, "angles":optimized_angles})

    # wandb.finish()

    # ✅ Wrap angles so they are in [0,180]
    final_angles = wrap_angles_to_180(angles)

    # ✅ Round to nearest int
    rounded_angles = torch.round(final_angles).to(torch.int)

    # ✅ Convert to Python list for Grasshopper
    angles_out = rounded_angles.cpu().numpy().tolist()


else:
    print("♻️ GH re-ran component but skipping loop")
# ---------- end forward_optimization_xyz ----------
xy = XYPlane(Origin=pt)
division_2 = Division(A=Y, B=patch_size)
division_3 = Division(A=X, B=patch_size)
recgrid = Rectangular(Plane=xy, SizeX=patch_size, SizeY=patch_size, ExtentX=division_3, ExtentY=division_2)  # -> flatten(Cells), Points

# ---- group: Scale is slightly wrong
partition = PartitionList(List=forward_optimization_xyz.pred_prev, Size=X)
predicted_pt = Point(partition)
ptgridsrf = SurfaceFromGrid(Grid=predicted_pt, Through=False)
preview = CustomPreview(Geometry=ptgridsrf, Material=ColourSwatch(SwatchColor=RGBA(0, 0, 0, 140)))

# ----
rad = Radians(Degrees=genes)

gradient = Gradient(
    LowerLimit=0,
    UpperLimit=180,
    Parameter=genes,
    stops=[0: RGB(243, 57, 0), 0.1: RGB(236, 27, 60), 0.2: RGB(210, 0, 118), 0.3: RGB(103, 0, 120), 0.4: RGB(39, 72, 161), 0.5: RGB(1, 192, 229), 0.6: RGB(18, 178, 90), 0.7: RGB(79, 186, 8), 0.8: RGB(220, 237, 32), 0.9: RGB(247, 159, 20), 1: RGB(243, 57, 0)])
boundary = BoundarySurfaces(Edges=recgrid.Cells)
hatch = ModelHatch(
    Boundary=boundary,
    HatchPattern={Lines=1, Path="Hatch1", Offset=(0, 0.125), Segments=[]},
    Rotation=rad,
    Scale=Slider(9, range=1..10))  # -> Hatch, Boundary, Plane, HatchPattern, BasePoint, Rotation, Scale, ShowBoundary, Background, FillStyle
preview_2 = CustomPreview(Geometry=boundary, Material=gradient)

number_slider_3 = Slider(8, range=0..10)
number_slider_4 = Slider(6, range=1..10)
swatch = ColourSwatch(SwatchColor=RGB(0, 0, 0))
swatch_2 = ColourSwatch(SwatchColor=RGB(0, 0, 0))
area = Area(Geometry=boundary)  # -> Area, Centroid
tag = TextTag3D(Location=area.Centroid, Text=genes, Size=Slider(2, range=1..10), Colour=swatch, Justification=5)
preview_3 = CustomPreview(Geometry=hatch.Hatch, Material=swatch)

curvepreview = CurvePreview(Curve=recgrid.Cells, Width=Slider(5.6, range=0..10), Color=swatch_2, Mode=0, TopMost=False)
curvepreview_2 = CurvePreview(Curve=recgrid.Cells, Width=number_slider_3, Color=swatch_2, Mode=0, TopMost=False)

curvepreview_3 = CurvePreview(Curve=hatch.Hatch, Width=number_slider_3, Color=swatch_2, Mode=0, TopMost=False)
