# Grasshopper definition angles-graphics.gh (Grasshopper 1.0.8)

# ---- group: Inputs
genes = GenePool(Decimals=0, Maximum=180, Minimum=0, Value=[143, 60, 27, 143, 51, 34])
angles = GetNumber(genes, AtLeast=1, AtMost=100, Maximum=1.797693135e+308, Minimum=-1.797693135e+308, TreeAccess=True)
hatch_scale = GetNumber(Slider(10, range=1..10), AtLeast=1, AtMost=1, Maximum=1.797693135e+308, Minimum=-1.797693135e+308, TreeAccess=False)
tag_scale = GetNumber(Slider(2, range=1..10), AtLeast=1, AtMost=1, Maximum=1.797693135e+308, Minimum=-1.797693135e+308, TreeAccess=False)
x_size = GetNumber(
    Slider(20, range=0..100),
    AtLeast=1,
    AtMost=1,
    Maximum=1.797693135e+308,
    Minimum=-1.797693135e+308,
    Prompt="X size",
    TreeAccess=False)
y_size = GetNumber(Slider(30, range=0..100), AtLeast=1, AtMost=1, Maximum=1.797693135e+308, Minimum=-1.797693135e+308, TreeAccess=False)
patch_size = GetNumber(Slider(10, range=0..10), AtLeast=1, AtMost=1, Maximum=1.797693135e+308, Minimum=-1.797693135e+308, TreeAccess=False)

# ---- group: Get boundary
rectangle = Rectangle(Plane=PlaneXY(0, 0, 0), XSize=x_size, YSize=y_size, Radius=0)  # -> Rectangle, Length

# ---- group: Get Cells
division = Division(A=y_size, B=patch_size)
division_2 = Division(A=x_size, B=patch_size)
recgrid = Rectangular(Plane=PlaneXY(0, 0, 0), SizeX=patch_size, SizeY=patch_size, ExtentX=division_2, ExtentY=division)  # -> flatten(Cells), Points
boundary = BoundarySurfaces(Edges=recgrid.Cells)

# ---- group: Previews
rad = Radians(Degrees=angles)
swatch = ColourSwatch(SwatchColor=RGB(0, 0, 0))
gradient = Gradient(
    LowerLimit=0,
    UpperLimit=180,
    Parameter=angles,
    stops=[0: RGB(243, 57, 0), 0: RGB(44, 6, 252), 0.1: RGB(236, 27, 60), 0.2: RGB(210, 0, 118), 0.3: RGB(103, 0, 120), 0.4: RGB(39, 72, 161), 0.5: RGB(1, 192, 229), 0.6: RGB(18, 178, 90), 0.7: RGB(79, 186, 8), 0.8: RGB(220, 237, 32), 0.9: RGB(247, 159, 20), 1: RGB(243, 57, 0)])
hatch = ModelHatch(
    Boundary=recgrid.Cells,
    HatchPattern={Lines=1, Path="Hatch1", Offset=(0, 0.125), Segments=[]},
    Rotation=rad,
    Scale=hatch_scale)  # -> Hatch, Boundary, Plane, HatchPattern, BasePoint, Rotation, Scale, ShowBoundary, Background, FillStyle
area = Area(Geometry=recgrid.Cells)  # -> Area, Centroid
preview = CustomPreview(Geometry=boundary, Material=gradient)
tag = TextTag3D(Location=area.Centroid, Text=angles, Size=tag_scale, Colour=swatch, Justification=5)
preview_2 = CustomPreview(Geometry=hatch.Hatch, Material=swatch)
preview_3 = CustomPreview(Geometry=[recgrid.Cells, rectangle.Rectangle], Material=swatch)
