# Grasshopper definition Plugin-example.gh (Grasshopper 1.0.8)
# plug-ins: Pufferfish, Self-Shaping Composites.Components

patch_size = Slider(10, range=0..10)

# ---- group: Recommended Direction of UV
# If the orientation of the surface doesn't match the orientation of the angle map -
# use "dir" command in rhino or grasshopper to flip the UV
image = ImageSampler(
    FilePath="C:\Gal_Msc\Ipublic-repo\inverse-model-frustrated-composites\Plugin-components\recommended dir.png",
    Filter="Colour",
    Interpolate=False,
    Umax=1,
    Umin=0,
    Vmax=1,
    Vmin=0,
    Wrap=1)

# ----
# Set Parameters
set_target_surface = Surface(<surface referenced from the Rhino model>)

panel = Panel("C:\Gal_Msc\Ipublic-repo\inverse-model-frustrated-composites\saved_models\glowing-river.pkl")
optimize_angles = Inverse_for_websiteGh(Surface=set_target_surface, ModelPath=patch_size, ModelPath_2=panel)  # -> Angles, TargetPreview, PredictionPreview, Log

# ---- group: Preview prediction - in incorrect scale
pt = Point(optimize_angles.PredictionPreview)
pt_2 = Point(optimize_angles.TargetPreview)
preview = CustomPreview(Geometry=pt_2, Material=ColourSwatch(SwatchColor=RGB(255, 0, 0)))
preview_2 = CustomPreview(Geometry=pt, Material=ColourSwatch(SwatchColor=RGB(0, 60, 255)))

# ---- group: Get dimensions of target surface
dim = Dimensions(Surface=set_target_surface)  # -> UDimension, VDimension
roundf = RoundToFactor(NumberX=dim.VDimension, Factor=patch_size, RoundType=0)  # -> Rounded, Difference, MultiplierR, MultiplierX
roundf_2 = RoundToFactor(NumberX=dim.UDimension, Factor=patch_size, RoundType=0)  # -> Rounded, Difference, MultiplierR, MultiplierX
Y = Number(roundf.Rounded)
X = Number(roundf_2.Rounded)

# ----
simulate = SimulationGh(PatchSize=patch_size, Angles=optimize_angles.Angles, XSize=X, YSize=Y)  # -> Surface, TopFibers
preview_3 = AnglesGraphicsGh(Angles=optimize_angles.Angles, HatchScale=10, TagScale=3, PatchSize=patch_size, XSize=X, YSize=Y)

# ---- group: Preview resulting surface
area = Area(Geometry=simulate.Surface)  # -> Area, Centroid
area_2 = Area(Geometry=set_target_surface)  # -> Area, Centroid
orient = Orient(Geometry=simulate.Surface, Source=area.Centroid, Target=area_2.Centroid)  # -> Geometry, Transform
orient_2 = Orient(Geometry=simulate.TopFibers, Source=area.Centroid, Target=area_2.Centroid)  # -> Geometry, Transform
preview_4 = CustomPreview(Geometry=orient.Geometry, Material=ColourSwatch(SwatchColor=RGB(255, 255, 255)))
preview_5 = CustomPreview(Geometry=orient_2.Geometry, Material=ColourSwatch(SwatchColor=RGB(0, 0, 0)))
