# Grasshopper definition Inverse_Prediction.gh (Grasshopper 1.0.8)
# plug-ins: Heteroptera, MeshEdit Components, Pufferfish, PTComponentLibrary, LunchBox, Flexibility

# Testing Model Results  - Inverse
# 1. Set Surface
srf = Surface(<surface referenced from the Rhino model>)
flipdirection = FlipDirection(Surface=srf, Direction=Slider(0, range=0..5), Flip=Toggle(False), Size=1)

# ---- group: This is to shorten optimization time
number_slider = Slider(3, range=0..10)
number_slider_2 = Slider(5, range=0..10)
rebsrf = RebuildSurface(Surface=flipdirection, CountU=number_slider_2, CountV=number_slider_2, DegreeU=number_slider, DegreeV=number_slider)

# ---- group: Approximate Developable Surface
pow = Power(A=Slider(0.1, range=0..0.1), B=Slider(8, range=0..10))
developable_surface_optimization = Python3Script(
    surface_id=rebsrf,
    n_of_u_samples=Slider(12, range=0..100),
    n_of_v_samples=Slider(12, range=0..100),
    max_iterations=Slider(100, range=0..1000),
    ftol=pow)  # -> out, nurbs_surface, iterations, average_distance; inputs surface_id: Surface, n_of_u_samples: Int32, n_of_v_samples: Int32, max_iterations: Int32; disabled
# ---------- developable_surface_optimization: Python ----------
# venv: developable_surface_optimization
# requirements: scipy, numpy

import Rhino
import scipy
import numpy as np
from scipy.optimize import minimize

# Compute Gaussian curvature at surface UV points
def gaussian_curvature(surface, u, v):
    srf = surface.ToNurbsSurface()
    props = srf.CurvatureAt(u, v)
    return props.Gaussian

# Objective function minimizing max(gc^2) + sum(gc^2)
def objective(ctrl_pts_flat, surface, u_samples, v_samples, nurbs_surface, initial_ctrl_pts):
    num_pts_u, num_pts_v, _ = nurbs_surface.Points.CountU, nurbs_surface.Points.CountV, 3
    ctrl_pts = ctrl_pts_flat.reshape((num_pts_u, num_pts_v, 3))

    # Update control points
    for i in range(num_pts_u):
        for j in range(num_pts_v):
            nurbs_surface.Points.SetControlPoint(i, j, Rhino.Geometry.ControlPoint(Rhino.Geometry.Point3d(*ctrl_pts[i, j])))

    curvatures = []
    for u in u_samples:
        for v in v_samples:
            gc = gaussian_curvature(nurbs_surface, u, v)
            curvatures.append(abs(gc))

    max_gc2 = max(curvatures)
    sum_gc2 = sum(curvatures)
    total = max_gc2 + sum_gc2

    print(f"Current total curvature: {total} (max: {max_gc2}, sum: {sum_gc2})")
    return total

# Main function to approximate a Rhino surface with developable surface
def approximate_developable(surface):
    print("Starting approximation...")
    nurbs_surface = surface.ToNurbsSurface()

    u_samples = np.linspace(nurbs_surface.Domain(0)[0], nurbs_surface.Domain(0)[1], n_of_u_samples)
    v_samples = np.linspace(nurbs_surface.Domain(1)[0], nurbs_surface.Domain(1)[1], n_of_v_samples)

    print("Sampling domains:", u_samples, v_samples)

    # Initial control points
    num_pts_u, num_pts_v = nurbs_surface.Points.CountU, nurbs_surface.Points.CountV
    ctrl_pts = np.array([[[pt.Location.X, pt.Location.Y, pt.Location.Z] for pt in [nurbs_surface.Points.GetControlPoint(i, j) for j in range(num_pts_v)]] for i in range(num_pts_u)])

    print("Initial control points retrieved")

    # Flatten control points array for optimizer
    ctrl_pts_flat = ctrl_pts.flatten()

    # Run optimization
    print("Starting optimization...")
    result = minimize(objective, ctrl_pts_flat, args=(surface, u_samples, v_samples, nurbs_surface, ctrl_pts), method='L-BFGS-B', options={'maxiter': max_iterations, 'ftol': ftol})

    print("Optimization finished")
    print(f"Optimization success: {result.success}, message: {result.message}")
    print(f"Total iterations performed: {result.nit}")
    iterations = result.nit

    # Update NURBS with optimized control points
    optimized_ctrl_pts = result.x.reshape((num_pts_u, num_pts_v, 3))
    for i in range(num_pts_u):
        for j in range(num_pts_v):
            nurbs_surface.Points.SetControlPoint(i, j, Rhino.Geometry.ControlPoint(Rhino.Geometry.Point3d(*optimized_ctrl_pts[i, j])))

    print("Control points updated with optimized values")

    # Duplicate surface to ensure updated geometry is returned
    new_surface = nurbs_surface.Duplicate()

    # Compute average distance moved by control points
    distances = np.linalg.norm(optimized_ctrl_pts - ctrl_pts, axis=2)
    average_distance = np.mean(distances)
    print(f"Average control point movement: {average_distance}")

    return nurbs_surface, iterations, average_distance

# Example usage
if surface_id:
    print(surface_id)
    nurbs_surface, iterations, average_distance = approximate_developable(surface_id)
# ---------- end developable_surface_optimization ----------
iterations = Panel(developable_surface_optimization.iterations)

# ---- group: Srr curvature
number_slider_3 = Slider(10, range=0..10)
sdivide = DivideSurface(Surface=developable_surface_optimization.nurbs_surface, UCount=10, VCount=10)  # -> Points, Normals, Parameters
curvature = SurfaceCurvature(Surface=developable_surface_optimization.nurbs_surface, Point=sdivide.Parameters)  # -> Frame, Gaussian, Mean
tag = TextTag(Location=sdivide.Points, Text=curvature.Gaussian)

# ----
panel = Panel(developable_surface_optimization.out)
srf_2 = Surface(flipdirection)

# ---- group: How different is it
sdivide_2 = DivideSurface(Surface=rebsrf, UCount=10, VCount=10)  # -> Points, Normals, Parameters
sdivide_3 = DivideSurface(Surface=srf_2, UCount=10, VCount=10)  # -> Points, Normals, Parameters
dist = Distance(PointA=sdivide_2.Points, PointB=sdivide_3.Points)
avr = Average(Input=flatten(dist))
panel_2 = Panel(avr)

# ---- group: Orient Surface to XY plane
number_slider_4 = Slider(5, range=0..10)
divide_surface = DivideSurface(Surface=srf_2, UCount=number_slider_4, VCount=number_slider_4)  # -> Points, Normals, Parameters
area = Area(Geometry=srf_2)  # -> Area, Centroid
evalsrf = EvaluateSurface(Surface=srf_2, Point=divide_surface.Parameters)  # -> Point, Normal, UDirection, VDirection, Frame
average_plane = AveragePlane(Planes=flatten(evalsrf.Frame))
xy = XYPlane(Origin=Point(0, 0, 0))
orient = Orient(Geometry=srf_2, Source=area.Centroid, Target=xy)  # -> Geometry, Transform

# ---- group: Get Curvature / Test
dim = Dimensions(Surface=orient.Geometry)  # -> UDimension, VDimension
rebuildsrf = RebuildSurface(Surface=orient.Geometry, UDegree=3, VDegree=3, UNumber=dim.UDimension, VNumber=dim.VDimension)

# ---- group: Move if needed
Y = UnitY(Factor=Slider(0, range=-100..100))
move = Move(Geometry=orient.Geometry, Motion=Y)  # -> Geometry, Transform

# ----
swatch = ColourSwatch(SwatchColor=RGB(0, 0, 0))
model_path_lab_pc = Panel("C:\Gal_Msc\Ipublic-repo\inverse-model-frustrated-composites\saved_models\zesty-disco.pkl")

# ---- group: Inputs
# Model Path - Home PC: C:\Users\user\OneDrive - Technion\Masters\Inverse Design Model\saved_models\60-67_20250324.pkl
model_path_lab_pc_2 = Panel("C:\Gal_Msc\Ipublic-repo\inverse-model-frustrated-composites\saved_models\60-67_20250324.pkl")
number_slider_5 = Slider(8, range=0..10)
patch_size = Slider(10, range=0..10)
path = FilePath(model_path_lab_pc)

# ----
model_path_lab_pc_3 = Panel("C:\Gal_Msc\Ipublic-repo\inverse-model-frustrated-composites\saved_models\60-67_savgol_1_smooth_20250331.pkl")

# ---- group: Means For Confidence Score
dataset_feature_channel_standard_deviati = Panel("""0.078282430768013
0.03384111449122429
0.6024342179298401
0.5587598085403442
0.2731313109397888
0.5877172946929932
0.5973491668701172
0.1981414556503296""")  # "Dataset Feature Channel Standard Deviations"
# 2. Define Inputs
dataset_feature_channel_means = Panel("""0.02039089985191822
0.002440694021061063
-0.020841138437390327
-0.1037399172782898
-0.000704956182744354
-0.026657000184059143
0.13685230910778046
0.0005106868920847774""")

# ----
number_slider_6 = Slider(3, range=0..10)
number_slider_7 = Slider(5, range=0..10)
rebsrf_2 = RebuildSurface(Surface=flipdirection, CountU=number_slider_7, CountV=number_slider_7, DegreeU=number_slider_6, DegreeV=number_slider_6)

# ---- group: Optimization Parameters
model_path_lab_pc_4 = Panel("C:\Gal_Msc\Ipublic-repo\inverse-model-frustrated-composites\saved_models\worthy-night.pkl")
number_slider_8 = Slider(1, range=0..1)
number_slider_9 = Slider(100, range=1..1000000)
number_slider_10 = Slider(0.001, range=0..0.001)
number_slider_11 = Slider(0.005, range=0..0.01)
number_slider_12 = Slider(1000, range=0..1000)
panel_3 = Panel("ByCurvature")
number_slider_13 = Slider(1, range=1..10)
number_slider_14 = Slider(0.2, range=0..1)

# ----
model_path_lab_pc_5 = Panel("C:\Gal_Msc\Ipublic-repo\inverse-model-frustrated-composites\saved_models\resilient-dream-404.pkl")

# ---- group: Inputs / Normalization Values - should match training
min_og = Panel("""-2
-1.0
-1.0
-1.0
-1.0
-1.0
-1.0
-1.0""")
max_og = Panel("""2
1.0
1.0
1.0
1.0
1.0
1.0
1.0""")
min_smooth = Panel("""-0.25
-0.25
-0.25
-0.25
-0.25
-0.25
-0.25
-0.25""")
max_smooth = Panel("""0.25
0.25
0.25
0.25
0.25
0.25
0.25
0.25""")
min_smooth_2 = Panel("""-0.3
-0.3
-0.3
-0.3
-0.3
-0.3
-0.3
-0.3""")
max_smooth_2 = Panel("""0.3
0.3
0.3
0.3
0.3
0.3
0.3
0.3""")

# ---- group: Inputs / Should match training set
number_slider_15 = Slider(1, range=0..2)
number_slider_16 = Slider(5, range=0..20)
smoothing_method = Panel("uniform")

# ----
min_smooth_3 = Panel("""-20.4
-20.4
-0.2""")
max_smooth_3 = Panel("""20.4
20.4
20.0""")
genes = GenePool(Decimals=0, Maximum=180, Minimum=1, Value=[180, 76, 1, 39, 172, 16, 90.5, 90.5])
number_slider_17 = Slider(5, range=0..10)
panel_4 = Panel("""* weighted average
* 0-180 target surfaces""")
# 3.Predict
py3 = Python3Script()  # -> out, a
# ---------- py3: Python ----------
print("hello")
# ---------- end py3 ----------

# ---- group: Get Average Per Patch / bigger = more weight to the center of the patch
w = Slider(5, range=0.1..50)

# ---- group: Test with 2 surfaces
input_surface_optimization = BooleanToggle(False)
srf_3 = Surface(<surface referenced from the Rhino model>)
srf_4 = Surface(<surface referenced from the Rhino model>)
sdivide_4 = DivideSurface(Surface=srf_4, UCount=10, VCount=10)  # -> Points, Normals, Parameters
sdivide_5 = DivideSurface(Surface=srf_3, UCount=10, VCount=10)  # -> Points, Normals, Parameters

# ----
points = PointList(Points=flatten(sdivide_4.Points))
swatch_2 = ColourSwatch(SwatchColor=RGB(0, 0, 0))
galapagos = Galapagos(fitness=geodesic_distance, gene=genes)
panel_5 = Panel("""0
0
0
0
0
0""")

# ---- group: Make Surface a loft
number_slider_18 = Slider(1, range=0..5)  # disabled
boolean_toggle = BooleanToggle(False)  # disabled
boolean_toggle_2 = BooleanToggle(True)  # disabled
boolean_toggle_3 = BooleanToggle(False)  # disabled
loft_options = LoftOptions(Closed=boolean_toggle, Adjust=boolean_toggle_2, Rebuild=boolean_toggle_3, Refit=0, Type=number_slider_18)  # disabled

# ---- group: Get Curvature
dim_2 = Dimensions(Surface=rebuildsrf)  # -> UDimension, VDimension
roundf = RoundToFactor(NumberX=dim_2.UDimension, Factor=patch_size, RoundType=0)  # -> Rounded, Difference, MultiplierR, MultiplierX
roundf_2 = RoundToFactor(NumberX=dim_2.VDimension, Factor=patch_size, RoundType=0)  # -> Rounded, Difference, MultiplierR, MultiplierX
panel_6 = Panel(roundf.Rounded)
panel_7 = Panel(roundf_2.Rounded)

# ---- group: Make Surface a loft (continued)
divide_surface_2 = DivideSurface(Surface=srf_2, UCount=roundf.Rounded, VCount=roundf_2.Rounded)  # -> Points, Normals, Parameters; disabled
intcrv = Interpolate(Vertices=divide_surface_2.Points, Degree=4, Periodic=False, KnotStyle=1)  # -> Curve, Length, Domain; disabled
loft = Loft(Curves=flatten(intcrv.Curve), Options=loft_options)  # disabled

# ----
ptsrfdomnum = SurfaceDomainNumber(Surface=orient.Geometry, UNumber=roundf.Rounded, VNumber=roundf_2.Rounded)
flip = FlipMatrix(Data=ptsrfdomnum)

# ---- group: Get Curvature (continued)
ptcenter = CenterGrid(Grid=flip, Surface=orient.Geometry)
points_2 = PointList(Points=flatten(flip))

# ----
panel_8 = Panel(ptcenter)

# ---- group: Get Curvature / Only neede for "classic" inverse - not smooth
srf_cp = SurfaceClosestPoint(Point=ptcenter, Surface=move.Geometry)  # -> Point, UVPoint, Distance
curvature_2 = PrincipalCurvature(Surface=move.Geometry, Point=srf_cp.UVPoint)  # -> Frame, flatten(Maximum), flatten(Minimum), flatten(MaxDirection), flatten(MinDirection)
devec_min = DeconstructVector(Vector=flatten(curvature_2.MinDirection))  # -> XComponent, YComponent, ZComponent
devec_max = DeconstructVector(Vector=flatten(curvature_2.MaxDirection))  # -> XComponent, YComponent, ZComponent
merge_all = Merge(
    Data1=graft(curvature_2.Maximum),
    Data2=graft(curvature_2.Minimum),
    Data3=graft(devec_max.XComponent),
    Data4=graft(devec_max.YComponent),
    Data5=graft(devec_max.ZComponent),
    Data6=graft(devec_min.XComponent),
    Data7=graft(devec_min.YComponent),
    Data8=graft(devec_min.ZComponent))

# ---- group: Visualize Vectors
number_slider_19 = Slider(8, range=0..100)
multiplication = Multiplication(A=curvature_2.Minimum, B=number_slider_19)
multiplication_2 = Multiplication(A=curvature_2.Maximum, B=number_slider_19)
amp = Amplitude(Vector=curvature_2.MinDirection, Amplitude=multiplication)
amp_2 = Amplitude(Vector=curvature_2.MaxDirection, Amplitude=multiplication_2)
vdisex = VectorDisplayEx(Point=flatten(srf_cp.Point), Vector=amp, Colour=swatch, Width=2)
vdisex_2 = VectorDisplayEx(Point=flatten(srf_cp.Point), Vector=amp_2, Colour=swatch, Width=2)

# ---- group: Genepool control
division = Division(A=roundf.Rounded, B=patch_size)
division_2 = Division(A=roundf_2.Rounded, B=patch_size)
multiplication_3 = Multiplication(A=division, B=division_2)
pool_controller = GenePoolController(GenePool=genes, Count=multiplication_3, Randomness=0.1)

# ----
flip_2 = FlipMatrix(Data=merge_all)  # -> simplify(Data)
forward_prediction_smooth = Python3Script(
    labels_max=max_smooth_2,
    labels_min=min_smooth_2,
    x_cm=roundf.Rounded,
    y_cm=roundf_2.Rounded,
    n_of_features_channels=number_slider_5,
    n_of_labels_channels=number_slider_8,
    model_path=model_path_lab_pc_4,
    xyz=simplify(ptcenter),
    sigma=number_slider_15,
    smoothing_method=smoothing_method,
    max_iterations=number_slider_9,
    desired_threshold=number_slider_10,
    learning_rate=number_slider_11,
    patience=number_slider_12,
    start_point=Slider(0.5, range=0..1),
    num_initializations=number_slider_13,
    noise_strength=number_slider_14,
    surface=rebuildsrf,
    angles=genes,
    patch_x=patch_size,
    patch_y=patch_size,
    rebuild_divide=number_slider_16)  # -> out, prediction, Z_smooth_out, predicted_out; inputs labels_max: list of Double, labels_min: list of Double, x_cm: Int32, y_cm: Int32, n_of_features_channels: Int32, n_of_labels_channels: Int32, xyz: tree of Point3d, sigma: Double, max_iterations: Int32, patience: Int32, num_initializations: Int32, noise_strength: Double, surface: Surface, angles: list of Int32, patch_x: Int32, patch_y: Int32, rebuild_divide: Int32; disabled
# ---------- forward_prediction_smooth: Python ----------
# ┌───────────────────────────────────────────────────────────────────────────┐
# │                      Imports and Definitions                              │
# └───────────────────────────────────────────────────────────────────────────┘
# venv: forward_prediction_curvature
# r: numpy, pandas, torch, scipy, , matplotlib, pathlib

import math

import ghpythonlib.treehelpers as th
import numpy as np
import torch 
import pandas as pd
import scipy
from scipy.optimize import minimize
from scipy.ndimage import gaussian_filter
from scipy.ndimage import uniform_filter
from scipy.signal import savgol_filter
import torch.nn as nn
import torch.optim as optim
from torch.optim.lr_scheduler import ReduceLROnPlateau
import matplotlib
import matplotlib.pyplot as plt
matplotlib.use('Agg')  # Use a non-interactive backend
from pathlib import Path
from scipy.interpolate import RectBivariateSpline

from Grasshopper import DataTree
from Grasshopper.Kernel.Data import GH_Path


features_channels = n_of_labels_channels 
labels_channels =  n_of_features_channels 

# ANSI escape codes for colors
RED = '\033[31m'
GREEN = '\033[32m'
YELLOW = '\033[33m'
BLUE = '\033[34m'
PURPLE = '\033[35m'
CYAN = '\033[36m'
RESET = '\033[0m'  # Reset to default color

# ┌───────────────────────────────────────────────────────────────────────────┐
# │                               Functions                                   │
# └───────────────────────────────────────────────────────────────────────────┘

def get_shape(lst):
    shape = []
    while isinstance(lst, list):
        shape.append(len(lst))
        lst = lst[0] if lst else []
    return tuple(shape)

def smooth_savgol(Z, sigma):
    window = int(2 * sigma + 1)
    if window % 2 == 0:
        window += 1
    Z_smooth = savgol_filter(Z, window_length=window, polyorder=2, axis=0)
    Z_smooth = savgol_filter(Z_smooth, window_length=window, polyorder=2, axis=1)
    # print(Z_smooth)
    return Z_smooth

# def smooth_bilateral(Z, sigma):
#     # Normalize and convert to 8-bit for OpenCV
#     Z_norm = (Z - np.min(Z)) / (np.max(Z) - np.min(Z)) * 255
#     Z_8bit = np.uint8(Z_norm)
#     smoothed = cv2.bilateralFilter(Z_8bit, d=9, sigmaColor=75, sigmaSpace=sigma)
#     return smoothed.astype(float) / 255 * (np.max(Z) - np.min(Z)) + np.min(Z)

def calculate_angles(feature_array):
    """
    Calculates the angles between 3D vectors and the X-axis for a (H, W, C) array
    using channels 2, 3, and 4 as the x, y, and z components.

    Parameters:
    - feature_array (np.ndarray): Input array of shape (H, W, C), where C >= 5.

    Returns:
    - np.ndarray: Array of shape (H, W, 1) with the calculated angles.
    """
    H, W, C = feature_array.shape
    assert C > 4, "Input array must have at least 5 channels."

    # Extract x, y, z components from channels 2, 3, 4
    x = feature_array[:, :, 2]
    y = feature_array[:, :, 3]
    z = feature_array[:, :, 4]

    # Compute angle at each location relative to the X-axis
    angle_array = np.zeros((H, W, 1))
    for i in range(H):
        for j in range(W):
            angle_array[i, j, 0] = angle_with_x_axis(x[i, j], y[i, j], z[i, j])

    return angle_array

def angle_with_x_axis(x, y, z):
    # Calculate the magnitude of the vector
    magnitude = math.sqrt(x ** 2 + y ** 2 + z ** 2)

    # Avoid division by zero if the vector is zero
    if magnitude == 0:
        return 0.0

    # Calculate the cosine of the angle
    cos_theta = x / magnitude

    # Calculate the angle in radians and then convert to degrees
    angle_radians = math.acos(cos_theta)
    angle_degrees = math.degrees(angle_radians)

    # If the vector points in the negative X direction, adjust the angle
    # if x < 0:
    #     angle_degrees = 180 - angle_degrees

    return angle_degrees

def duplicate_pixel_data(input_data, x_cm, y_cm, patch_x, patch_y, fortran_order=False):
    """
    Duplicates coarse grid values into patches in a larger tensor.
    
    Args:
        input_data (list, np.ndarray, or torch.Tensor): Either flat or 2D grid of values.
        x_cm (int): Width of output grid.
        y_cm (int): Height of output grid.
        patch_x (int): Width of each patch.
        patch_y (int): Height of each patch.
        fortran_order (bool): Whether to interpret flat input in column-major (Fortran) order.

    Returns:
        torch.Tensor: 4D tensor of shape (1, 1, y_cm, x_cm) with duplicated values.
    """
    num_patches_y = y_cm // patch_y
    num_patches_x = x_cm // patch_x
    expected_size = num_patches_y * num_patches_x

    # Convert input to torch tensor
    if isinstance(input_data, torch.Tensor):
        tensor_input = input_data
    elif isinstance(input_data, np.ndarray):
        tensor_input = torch.tensor(input_data, dtype=torch.float32)
    elif isinstance(input_data, list):
        tensor_input = torch.tensor(input_data, dtype=torch.float32)
    else:
        raise TypeError("Unsupported input type")

    # Handle flat input: reshape into 2D grid
    if tensor_input.dim() == 1:
        assert tensor_input.numel() == expected_size, f"Expected {expected_size} values, got {tensor_input.numel()}"
        if fortran_order:
            np_input = tensor_input.numpy().reshape((num_patches_y, num_patches_x), order='F')
            tensor_input = torch.tensor(np_input, dtype=torch.float32)
        else:
            tensor_input = tensor_input.view(num_patches_y, num_patches_x)

    final_tensor = torch.zeros((1, 1, y_cm, x_cm), dtype=torch.float32)

    for i in range(num_patches_y):
        for j in range(num_patches_x):
            row_start = i * patch_y
            row_end = row_start + patch_y
            col_start = j * patch_x
            col_end = col_start + patch_x
            flipped_i = num_patches_y - 1 - i
            final_tensor[:, 0, row_start:row_end, col_start:col_end] = tensor_input[flipped_i, j]


    return final_tensor

def tensor_to_tree(tensor):
    """
    Converts a [1, C, H, W] tensor into a DataTree[float] with each channel as a branch,
    outputting values column-by-column (left to right), and within each column from bottom to top.
    """
    tree = DataTree[float]()
    tensor = tensor.detach().squeeze(0)  # shape: [C, H, W]
    
    H, W = tensor.shape[1], tensor.shape[2]

    for ch in range(tensor.shape[0]):
        path = GH_Path(ch)
        for x in range(W):  # Columns (left to right)
            for y in reversed(range(H)):  # Bottom to top
                tree.Add(float(tensor[ch, y, x]), path)

    return tree

def rebuild_full_surface_and_resample(X, Y, Z, coarse_shape):
    """
    Rebuilds the full surface Z using a coarse bivariate spline,
    and resamples it back to the original resolution using that smoothed fit.

    Parameters:
    - X, Y, Z: Original surface arrays (shape nx x ny)
    - coarse_shape: Tuple (u, v) — resolution of the smoothing surface

    Returns:
    - X_resampled, Y_resampled, Z_smooth: All shape (nx, ny)
    """
    nx, ny = X.shape

    u = max(3, coarse_shape[0])
    v = max(3, coarse_shape[1])

    # Extract coordinate vectors (structured grid assumption)
    x_vec = X[0, :]
    y_vec = Y[:, 0]

    # Step 1: Interpolate original surface
    spline_orig = RectBivariateSpline(y_vec, x_vec, Z)

    # Step 2: Sample coarse version of the surface
    x_coarse = np.linspace(x_vec.min(), x_vec.max(), u)
    y_coarse = np.linspace(y_vec.min(), y_vec.max(), v)
    Z_coarse = spline_orig(y_coarse, x_coarse)

    # Step 3: Fit new spline on coarse grid (this becomes the smoothed surface)
    kx = min(3, len(x_coarse) - 1)
    ky = min(3, len(y_coarse) - 1)
    spline_smooth = RectBivariateSpline(y_coarse, x_coarse, Z_coarse, kx=kx, ky=ky)


    # Step 4: Resample smoothed surface on original fine grid
    Z_smooth = spline_smooth(y_vec, x_vec)

    return X.copy(), Y.copy(), Z_smooth

# ┌───────────────────────────────────────────────────────────────────────────┐
# │                             Model Class                                   │
# └───────────────────────────────────────────────────────────────────────────┘
class OurVgg16(torch.nn.Module):
    """
    Custom VGG-style model with conv-only architecture, no fully connected layers.
    Outputs a single-channel prediction (e.g., fiber orientation).
    """
    def __init__(self, dropout=0.3):
        super(OurVgg16, self).__init__()

        self.conv_1 = torch.nn.Conv2d(in_channels=features_channels, out_channels=64, kernel_size=3, padding=1)
        self.conv_2 = torch.nn.Conv2d(in_channels=64, out_channels=128, kernel_size=3, padding=1)
        self.conv_3 = torch.nn.Conv2d(in_channels=128, out_channels=128, kernel_size=3, padding=1)
        self.conv_4 = torch.nn.Conv2d(in_channels=128, out_channels=256, kernel_size=3, padding=1)
        self.conv_5 = torch.nn.Conv2d(in_channels=256, out_channels=256, kernel_size=3, padding=1)
        self.conv_6 = torch.nn.Conv2d(in_channels=256, out_channels=512, kernel_size=3, padding=1)
        self.conv_7 = torch.nn.Conv2d(in_channels=512, out_channels=512, kernel_size=3, padding=1)
        self.conv_8 = torch.nn.Conv2d(in_channels=512, out_channels=512, kernel_size=3, padding=1)
        self.conv_9 = torch.nn.Conv2d(in_channels=512, out_channels=512, kernel_size=3, padding=1)
        self.conv_10 = torch.nn.Conv2d(in_channels=512, out_channels=256, kernel_size=3, padding=1)
        self.conv_11 = torch.nn.Conv2d(in_channels=256, out_channels=256, kernel_size=3, padding=1)
        self.conv_12 = torch.nn.Conv2d(in_channels=256, out_channels=128, kernel_size=3, padding=1)
        self.conv_13 = torch.nn.Conv2d(in_channels=128, out_channels=128, kernel_size=3, padding=1)
        self.conv_14 = torch.nn.Conv2d(in_channels=128, out_channels=labels_channels, kernel_size=3, padding=1)  # final output

        self.batch_norm_1 = torch.nn.BatchNorm2d(64)
        self.batch_norm_2 = torch.nn.BatchNorm2d(128)
        self.batch_norm_3 = torch.nn.BatchNorm2d(128)
        self.batch_norm_4 = torch.nn.BatchNorm2d(256)
        self.batch_norm_5 = torch.nn.BatchNorm2d(256)
        self.batch_norm_6 = torch.nn.BatchNorm2d(512)
        self.batch_norm_7 = torch.nn.BatchNorm2d(512)
        self.batch_norm_8 = torch.nn.BatchNorm2d(512)
        self.batch_norm_9 = torch.nn.BatchNorm2d(512)
        self.batch_norm_10 = torch.nn.BatchNorm2d(256)
        self.batch_norm_11 = torch.nn.BatchNorm2d(256)
        self.batch_norm_12 = torch.nn.BatchNorm2d(128)
        self.batch_norm_13 = torch.nn.BatchNorm2d(128)


        self.relu = torch.nn.ReLU()
        self.dropout = torch.nn.Dropout(p=dropout)
        self.sigmoid = torch.nn.Sigmoid()

    def forward(self, x):
        x = self.conv_1(x); x = self.batch_norm_1(x); x = self.relu(x)
        x = self.conv_2(x); x = self.batch_norm_2(x); x = self.relu(x)
        x = self.conv_3(x); x = self.batch_norm_3(x); x = self.relu(x)
        x = self.conv_4(x); x = self.batch_norm_4(x); x = self.relu(x)
        x = self.conv_5(x); x = self.batch_norm_5(x); x = self.relu(x)
        x = self.conv_6(x); x = self.batch_norm_6(x); x = self.relu(x)
        x = self.dropout(x);
        x = self.conv_7(x); x = self.batch_norm_7(x); x = self.relu(x)
        x = self.conv_8(x); x = self.batch_norm_8(x); x = self.relu(x)
        x = self.dropout(x);
        x = self.conv_9(x); x = self.batch_norm_9(x); x = self.relu(x)
        x = self.conv_10(x); x = self.batch_norm_10(x); x = self.relu(x)
        x = self.dropout(x);
        x = self.conv_11(x); x = self.batch_norm_11(x); x = self.relu(x)
        x = self.conv_12(x); x = self.batch_norm_12(x); x = self.relu(x)
        x = self.dropout(x);
        x = self.conv_13(x); x = self.batch_norm_13(x); x = self.relu(x)
        x = self.conv_14(x);
        # x = self.sigmoid(x)
        x = torch.clamp(x, 0.0, 1.0)
        return x

# ┌───────────────────────────────────────────────────────────────────────────┐
# │                           Main Code                                       │
# └───────────────────────────────────────────────────────────────────────────┘

# # Flatten XYZ tree to list of Point3d
# xyz_flat = [pt for i in range(xyz.BranchCount) for pt in xyz.Branch(i)]
# xyz_array = np.array([[pt.X, pt.Y, pt.Z] for pt in xyz_flat])

# X = xyz_array[:, 0].reshape((y_cm, x_cm), order='F')
# Y = xyz_array[:, 1].reshape((y_cm, x_cm), order='F')
# Z = xyz_array[:, 2].reshape((y_cm, x_cm), order='F')

# # Smooth Z using selected method
# if smoothing_method == 'gaussian':
#     Z_smooth = gaussian_filter(Z, sigma=sigma)
#     # print("    Applied Gaussian smoothing")
# elif smoothing_method == 'uniform':
#     Z_smooth = uniform_filter(Z, size=int(2 * sigma + 1))
#     # print("    Applied uniform smoothing")
# elif smoothing_method == 'median':
#     # Z_smooth = median_filter(Z, size=int(2 * sigma + 1))
#     print("    Applied median smoothing")
# elif smoothing_method == 'savgol':
#     Z_smooth = smooth_savgol(Z, sigma)
#     print("    Applied savgol smoothing")
# elif smoothing_method == 'bilateral':
#     # Z_smooth = smooth_bilateral(Z, sigma)
#     Z_smooth = Z
#     print("can't smooth bilateral. handle imports")
# elif smoothing_method == 'anisotropic':
#     # Z_smooth = denoise_tv_chambolle(Z, weight=sigma)
#     print("can't smooth anisotpropic. handle imports")
# elif smoothing_method == 'rebuild':
#     rebuild_shape = (x_cm // rebuild_divide, y_cm // rebuild_divide)
#     X, Y, Z_smooth = rebuild_full_surface_and_resample(X, Y, Z, rebuild_shape)
# else:
#     raise ValueError(f"Unsupported smoothing method: {smoothing_method}")

# print(Z_smooth.shape)
# Z_smooth_out = th.list_to_tree(Z_smooth.tolist())
# X_out = th.list_to_tree(X.tolist())
# Y_out = th.list_to_tree(Y.tolist())

# # UV parameter extraction
# uv_flat = [surface.ClosestPoint(pt) for pt in xyz_flat]
# uv_array = np.array([[uv[1], uv[2]] for uv in uv_flat])

# U = uv_array[:, 0].reshape((y_cm, x_cm), order='F')
# V = uv_array[:, 1].reshape((y_cm, x_cm), order='F')

# # Derivatives in U,V parameterization
# du = dv = 1.0
# Zu, Zv = np.gradient(Z_smooth, du, dv)
# Zuu, Zuv = np.gradient(Zu, du, dv)
# _, Zvv = np.gradient(Zv, du, dv)

# # Fundamental forms (U,V)
# E = Zu**2 + 1
# F = Zu * Zv
# G = Zv**2 + 1
# L = Zuu
# M = Zuv
# N = Zvv

# # Curvature computation

# denom = E * G - F**2
# sqrt_term = np.sqrt(np.clip((L * G - 2 * M * F + N * E)**2 - 4 * denom * (L * N - M**2), a_min=0, a_max=None))
# k1 = ((L * G - 2 * M * F + N * E) + sqrt_term) / (2 * denom)
# k2 = ((L * G - 2 * M * F + N * E) - sqrt_term) / (2 * denom)

# # Max/Min curvature and vectors
# k1_flat = k1.flatten(order='F')
# k2_flat = k2.flatten(order='F')
# use_k1_as_max = np.abs(k1_flat) >= np.abs(k2_flat)
# max_curv = np.where(use_k1_as_max, k1_flat, k2_flat)
# min_curv = np.where(use_k1_as_max, k2_flat, k1_flat)

# # Principal directions remain XYZ-based for simplicity
# # (original XYZ-based derivatives Zx,Zy needed here)
# dx = dy = 1.0
# Zx, Zy = np.gradient(Z_smooth, dx, dy)
# Zxx, Zxy = np.gradient(Zx, dx, dy)
# _, Zyy = np.gradient(Zy, dx, dy)

# principal_dirs_max = np.zeros((y_cm, x_cm, 3))
# principal_dirs_min = np.zeros((y_cm, x_cm, 3))

# for ix in range(y_cm):
#     for iy in range(x_cm):
#         H = np.array([[Zxx[ix, iy], Zxy[ix, iy]], [Zxy[ix, iy], Zyy[ix, iy]]])
#         eigvals, eigvecs = np.linalg.eigh(H)
#         idx = np.argsort(np.abs(eigvals))[::-1]
#         v_max = eigvecs[:, idx[0]]
#         v_min = eigvecs[:, idx[1]]
#         dzdx, dzdy = Zx[ix, iy], Zy[ix, iy]
#         normal = np.array([-dzdx, -dzdy, 1.0])
#         normal /= np.linalg.norm(normal)
#         d_max = np.array([v_max[0], v_max[1], v_max[0]*dzdx + v_max[1]*dzdy])
#         d_min = np.array([v_min[0], v_min[1], v_min[0]*dzdx + v_min[1]*dzdy])
#         d_max -= np.dot(d_max, normal) * normal
#         d_min -= np.dot(d_min, normal) * normal
#         principal_dirs_max[ix, iy] = d_max / np.linalg.norm(d_max)
#         principal_dirs_min[ix, iy] = d_min / np.linalg.norm(d_min)
# max_vecs = (principal_dirs_max * np.abs(max_curv).reshape((y_cm, x_cm), order='F')[:, :, np.newaxis]).reshape(-1, 3, order='F')
# min_vecs = (principal_dirs_min * np.abs(min_curv).reshape((y_cm, x_cm), order='F')[:, :, np.newaxis]).reshape(-1, 3, order='F')

# # Rebuild curvature array
# curvature_array = np.zeros((len(xyz_flat), 8))
# curvature_array[:, 0] = max_curv
# curvature_array[:, 1] = min_curv
# curvature_array[:, 2:5] = max_vecs
# curvature_array[:, 5:8] = min_vecs
# print("Curvature array shape:", curvature_array.shape)

# # Reshape and stack
# reshaped_channels = [np.reshape(curvature_array[:, i], (y_cm, x_cm), order='F') for i in range(n_of_features_channels)]
# feature_array = np.stack(reshaped_channels, axis=-1)
# print("Feature array shape (H, W, C):", feature_array.shape)

# # Convert to Tensor
# feature_tensor = torch.from_numpy(feature_array).unsqueeze(0).permute(0, 3, 1, 2).float()
# print("Feature tensor shape (B, C, H, W):", feature_tensor.shape)

# # Normalize
# min_tensor = torch.tensor(labels_min).view(1,labels_channels, 1, 1)
# max_tensor = torch.tensor(labels_max).view(1, labels_channels, 1, 1)
# feature_tensor = (feature_tensor - min_tensor) / (max_tensor - min_tensor)
# print("Normalization complete.")



# ┌───────────────────────────────────────────────────────────────────────────┐
# │                                 Main Code                                 │
# └───────────────────────────────────────────────────────────────────────────┘

device = torch.device("cuda" if torch.cuda.is_available() else "cpu")
print(f"device:{device}")
# Define the Model
model = OurVgg16()
model.load_state_dict(torch.load(model_path, map_location=device))
model.to(device)

# Step 1: Prepare input grid
angles_grid = duplicate_pixel_data(angles, x_cm=x_cm, y_cm=y_cm, patch_x=patch_x, patch_y=patch_y, fortran_order=True)

print("\n--- angles_grid ---")
print("Shape:", angles_grid.shape)
print("Min:", angles_grid.min().item(), "Max:", angles_grid.max().item())

# Step 2: Normalize input
normalized_tensor = angles_grid / 180.0

print("\n--- normalized_tensor ---")
print("Min:", normalized_tensor.min().item(), "Max:", normalized_tensor.max().item())


# Build and plot
plt.imshow(angles_grid[0, 0], cmap='plasma', origin='upper')
plt.title("Input Angles Grid (Fortran Order)")
plt.colorbar()

# Get path to Desktop
desktop = Path.home() / "Desktop"
output_path = desktop / "angles_grid_input.png"

#plot
plt.savefig(str(output_path))
plt.close()


# Step 3: Model inference
model.eval()  # ensure correct evaluation mode
predicted = model(normalized_tensor)

print("\n--- predicted (raw model output) ---")
print("Shape:", predicted.shape)
print("Min:", predicted.min().item(), "Max:", predicted.max().item())

# Step 4: Prepare label range tensors
labels_max_tensor = torch.tensor(labels_max, dtype=torch.float32).view(1, -1, 1, 1)
labels_min_tensor = torch.tensor(labels_min, dtype=torch.float32).view(1, -1, 1, 1)


print("\n--- labels_min / labels_max ---")
print("labels_min:", labels_min)
print("labels_max:", labels_max)

# Step 5: Denormalize
denormalized = torch.empty_like(predicted)

for c in range(predicted.shape[1]):
    scale = labels_max[c] - labels_min[c] + 1e-8
    denormalized[:, c] = predicted[:, c] * scale + labels_min[c]
    
    # Debug print
    print(f"Channel {c} - Predicted range: {predicted[:, c].min().item():.4f} to {predicted[:, c].max().item():.4f}")
    print(f"Channel {c} - Denormalized range: {denormalized[:, c].min().item():.4f} to {denormalized[:, c].max().item():.4f}")



print("\n--- denormalized ---")
print("Shape:", denormalized.shape)
print("Min:", denormalized.min().item(), "Max:", denormalized.max().item())
print("Sample [0,0,0,0]:", denormalized[0, 0, 0, 0].item())


# Remove batch dimension: [C, H, W]
denorm = denormalized.detach().squeeze(0)

# Step 6: Convert to list/tree output
predicted_out = tensor_to_tree(denorm)
predicted_out_b = tensor_to_tree(predicted)  # only for checking raw output if needed


# Loop through channels and save each as an image
for ch in range(denorm.shape[0]):
    data = denorm[ch].numpy()
    fig, ax = plt.subplots(figsize=(6, 9))
    img = ax.imshow(data, cmap='viridis', origin='upper')
    ax.set_title(f"Predicted Channel {ch}")
    plt.colorbar(img, ax=ax)
    plt.tight_layout()

    output_path = desktop / f"predicted_channel_{ch}.png"
    plt.savefig(str(output_path))
    plt.close()
# ---------- end forward_prediction_smooth ----------

rectangle = Rectangle(Plane=PlaneXY(0, 0, 0), XSize=roundf.Rounded, YSize=roundf_2.Rounded, Radius=0)  # -> Rectangle, Length
sdivide_6 = DivideSurface(Surface=rectangle.Rectangle, UCount=roundf.Rounded, VCount=roundf_2.Rounded)  # -> Points, Normals, Parameters
ptcenter_2 = CenterGrid(Grid=sdivide_6.Points)
pdecon = Deconstruct(Point=ptcenter_2)  # -> XComponent, YComponent, ZComponent
flip_3 = FlipMatrix(Data=pdecon.XComponent)  # -> simplify(flatten(Data))
flip_4 = FlipMatrix(Data=pdecon.YComponent)  # -> flatten(Data)

inverse_prediction_smooth = Python3Script(
    features_max=max_og,
    features_min=min_og,
    dataset_mean=dataset_feature_channel_means,
    dataset_std=dataset_feature_channel_standard_deviati,
    x_cm=roundf.Rounded,
    y_cm=roundf_2.Rounded,
    n_of_features_channels=number_slider_5,
    model_path=path,
    xyz=simplify(ptcenter),
    sigma=number_slider_15,
    smoothing_method=smoothing_method,
    surface=rebuildsrf,
    rebuild_divide=number_slider_16)  # -> out, prediction, similarity_score, confidence_score, Z_smooth_out, X_out, Y_out; inputs features_max: list of Double, features_min: list of Double, dataset_mean: list of Double, dataset_std: list of Double, x_cm: Int32, y_cm: Int32, n_of_features_channels: Int32, xyz: tree of Point3d, sigma: Double, surface: Surface, rebuild_divide: Int32
# ---------- inverse_prediction_smooth: Python ----------
# ┌───────────────────────────────────────────────────────────────────────────┐
# │                      Imports and Definitions                              │
# └───────────────────────────────────────────────────────────────────────────┘
# venv: inverse_prediction_smooth
# r: numpy, pandas, torch, scipy
import ghpythonlib.treehelpers as th
import numpy as np
import torch 
import pandas as pd
from torch import nn
from scipy.ndimage import gaussian_filter
from scipy.ndimage import uniform_filter
from scipy.signal import savgol_filter
from scipy.interpolate import RectBivariateSpline
import torch.nn.functional as Functional

features_channels = n_of_features_channels 



# ┌───────────────────────────────────────────────────────────────────────────┐
# │                               Functions                                   │
# └───────────────────────────────────────────────────────────────────────────┘

def get_shape(lst):
    shape = []
    while isinstance(lst, list):
        shape.append(len(lst))
        lst = lst[0] if lst else []
    return tuple(shape)

def smooth_savgol(Z, sigma):
    window = int(2 * sigma + 1)
    if window % 2 == 0:
        window += 1
    Z_smooth = savgol_filter(Z, window_length=window, polyorder=2, axis=0)
    Z_smooth = savgol_filter(Z_smooth, window_length=window, polyorder=2, axis=1)
    # print(Z_smooth)
    return Z_smooth

def smooth_bilateral(Z, sigma):
    # Normalize and convert to 8-bit for OpenCV
    Z_norm = (Z - np.min(Z)) / (np.max(Z) - np.min(Z)) * 255
    Z_8bit = np.uint8(Z_norm)
    smoothed = cv2.bilateralFilter(Z_8bit, d=9, sigmaColor=75, sigmaSpace=sigma)
    return smoothed.astype(float) / 255 * (np.max(Z) - np.min(Z)) + np.min(Z)


def rebuild_full_surface_and_resample(X, Y, Z, coarse_shape):
    """
    Rebuilds the full surface Z using a coarse bivariate spline,
    and resamples it back to the original resolution using that smoothed fit.

    Parameters:
    - X, Y, Z: Original surface arrays (shape nx x ny)
    - coarse_shape: Tuple (u, v) — resolution of the smoothing surface

    Returns:
    - X_resampled, Y_resampled, Z_smooth: All shape (nx, ny)
    """
    nx, ny = X.shape

    u = max(3, coarse_shape[0])
    v = max(3, coarse_shape[1])

    # Extract coordinate vectors (structured grid assumption)
    x_vec = X[0, :]
    y_vec = Y[:, 0]

    # Step 1: Interpolate original surface
    spline_orig = RectBivariateSpline(y_vec, x_vec, Z)

    # Step 2: Sample coarse version of the surface
    x_coarse = np.linspace(x_vec.min(), x_vec.max(), u)
    y_coarse = np.linspace(y_vec.min(), y_vec.max(), v)
    Z_coarse = spline_orig(y_coarse, x_coarse)

    # Step 3: Fit new spline on coarse grid (this becomes the smoothed surface)
    kx = min(3, len(x_coarse) - 1)
    ky = min(3, len(y_coarse) - 1)
    spline_smooth = RectBivariateSpline(y_coarse, x_coarse, Z_coarse, kx=kx, ky=ky)


    # Step 4: Resample smoothed surface on original fine grid
    Z_smooth = spline_smooth(y_vec, x_vec)

    return X.copy(), Y.copy(), Z_smooth

def pad_tensor(max_h,max_w,tensor):

    """
    Pads a tensor of shape [1, C, H, W] to [1, C, 40, 40] using zero-padding.
    """


    _, _, h, w = tensor.shape
    pad_h = max_h - h
    pad_w = max_w - w

    return Functional.pad(tensor, (0, pad_w, 0, pad_h), mode='constant', value=0)

# ┌───────────────────────────────────────────────────────────────────────────┐
# │                             Model Class                                   │
# └───────────────────────────────────────────────────────────────────────────┘

class OurVgg16Old(torch.nn.Module):
    def __init__(self, dropout=0.3):
        super(OurVgg16, self).__init__()

        self.conv_1 = torch.nn.Conv2d(in_channels=features_channels, out_channels=64, kernel_size=3, padding=1)
        self.conv_2 = torch.nn.Conv2d(in_channels=64, out_channels=128, kernel_size=3, padding=1)
        self.conv_3 = torch.nn.Conv2d(in_channels=128, out_channels=128, kernel_size=3, padding=1)
        self.conv_4 = torch.nn.Conv2d(in_channels=128, out_channels=256, kernel_size=3, padding=1)
        self.conv_5 = torch.nn.Conv2d(in_channels=256, out_channels=256, kernel_size=3, padding=1)
        self.conv_6 = torch.nn.Conv2d(in_channels=256, out_channels=512, kernel_size=3, padding=1)
        self.conv_7 = torch.nn.Conv2d(in_channels=512, out_channels=512, kernel_size=3, padding=1)
        self.conv_8 = torch.nn.Conv2d(in_channels=512, out_channels=512, kernel_size=3, padding=1)
        self.conv_9 = torch.nn.Conv2d(in_channels=512, out_channels=512, kernel_size=3, padding=1)
        self.conv_10 = torch.nn.Conv2d(in_channels=512, out_channels=256, kernel_size=3, padding=1)
        self.conv_11 = torch.nn.Conv2d(in_channels=256, out_channels=256, kernel_size=3, padding=1)
        self.conv_12 = torch.nn.Conv2d(256, 128, kernel_size=3, padding=1)
        self.conv_13 = torch.nn.Conv2d(128, 128, kernel_size=3, padding=1)
        self.conv_14 = torch.nn.Conv2d(128, 1, kernel_size=3, padding=1)

        self.batch_norm_1 = torch.nn.BatchNorm2d(num_features=64)
        self.batch_norm_2 = torch.nn.BatchNorm2d(num_features=128)
        self.batch_norm_3 = torch.nn.BatchNorm2d(num_features=128)
        self.batch_norm_4 = torch.nn.BatchNorm2d(num_features=256)
        self.batch_norm_5 = torch.nn.BatchNorm2d(num_features=256)
        self.batch_norm_6 = torch.nn.BatchNorm2d(num_features=512)
        self.batch_norm_7 = torch.nn.BatchNorm2d(num_features=512)
        self.batch_norm_8 = torch.nn.BatchNorm2d(num_features=512)
        self.batch_norm_9 = torch.nn.BatchNorm2d(num_features=512)
        self.batch_norm_10 = torch.nn.BatchNorm2d(num_features=256)
        self.batch_norm_11 = torch.nn.BatchNorm2d(num_features=256)
        self.batch_norm_12 = torch.nn.BatchNorm2d(num_features=128)
        self.batch_norm_13 = torch.nn.BatchNorm2d(num_features=128)
        self.batch_norm_14 = torch.nn.BatchNorm2d(num_features=1)

        self.relu = torch.nn.ReLU()
        self.dropout = torch.nn.Dropout(p=dropout)
        self.sigmoid = nn.Sigmoid()

    def forward(self, x):
        x = self.conv_1(x); x = self.batch_norm_1(x); x = self.relu(x)
        x = self.conv_2(x); x = self.batch_norm_2(x); x = self.relu(x)
        x = self.conv_3(x); x = self.batch_norm_3(x); x = self.relu(x)
        x = self.conv_4(x); x = self.batch_norm_4(x); x = self.relu(x)
        x = self.conv_5(x); x = self.batch_norm_5(x); x = self.relu(x)
        x = self.conv_6(x); x = self.batch_norm_6(x); x = self.relu(x)
        x = self.conv_7(x); x = self.batch_norm_7(x); x = self.relu(x)
        x = self.conv_8(x); x = self.batch_norm_8(x); x = self.relu(x)
        x = self.conv_9(x); x = self.batch_norm_9(x); x = self.relu(x)
        x = self.conv_10(x); x = self.batch_norm_10(x); x = self.relu(x)
        x = self.conv_11(x); x = self.batch_norm_11(x); x = self.relu(x)
        x = self.conv_12(x); x = self.batch_norm_12(x); x = self.relu(x)
        x = self.conv_13(x); x = self.batch_norm_13(x); x = self.relu(x)
        x = self.conv_14(x); x = self.sigmoid(x)
        return x

class OurVgg16(torch.nn.Module):
    def __init__(self, dropout=0.3):
        super(OurVgg16, self).__init__()

        self.conv_1 = torch.nn.Conv2d(in_channels=features_channels, out_channels=64, kernel_size=3, padding=1)
        self.conv_2 = torch.nn.Conv2d(in_channels=64, out_channels=128, kernel_size=3, padding=1)
        self.conv_3 = torch.nn.Conv2d(in_channels=128, out_channels=128, kernel_size=3, padding=1)
        self.conv_4 = torch.nn.Conv2d(in_channels=128, out_channels=256, kernel_size=3, padding=1)
        self.conv_5 = torch.nn.Conv2d(in_channels=256, out_channels=256, kernel_size=3, padding=1)
        self.conv_6 = torch.nn.Conv2d(in_channels=256, out_channels=512, kernel_size=3, padding=1)
        self.conv_7 = torch.nn.Conv2d(in_channels=512, out_channels=512, kernel_size=3, padding=1)
        self.conv_8 = torch.nn.Conv2d(in_channels=512, out_channels=512, kernel_size=3, padding=1)
        self.conv_9 = torch.nn.Conv2d(in_channels=512, out_channels=512, kernel_size=3, padding=1)
        self.conv_10 = torch.nn.Conv2d(in_channels=512, out_channels=256, kernel_size=3, padding=1)
        self.conv_11 = torch.nn.Conv2d(in_channels=256, out_channels=256, kernel_size=3, padding=1)
        self.conv_12 = torch.nn.Conv2d(256, 128, kernel_size=3, padding=1)
        self.conv_13 = torch.nn.Conv2d(128, 128, kernel_size=3, padding=1)
        # self.conv_14 = torch.nn.Conv2d(128, labels_channels, kernel_size=3, padding=1)

        # Testing FC layer
        self.conv_fc1 = torch.nn.Conv2d(128, 512, kernel_size=3, padding=1)
        self.norm_fc1 = torch.nn.BatchNorm2d(512)
        self.relu_fc1 = torch.nn.ReLU()
        self.drop_fc1 = torch.nn.Dropout(p=dropout)
        self.conv_fc2 = torch.nn.Conv2d(512, labels_channels, kernel_size=1)


        self.batch_norm_1 = torch.nn.BatchNorm2d(num_features=64)
        self.batch_norm_2 = torch.nn.BatchNorm2d(num_features=128)
        self.batch_norm_3 = torch.nn.BatchNorm2d(num_features=128)
        self.batch_norm_4 = torch.nn.BatchNorm2d(num_features=256)
        self.batch_norm_5 = torch.nn.BatchNorm2d(num_features=256)
        self.batch_norm_6 = torch.nn.BatchNorm2d(num_features=512)
        self.batch_norm_7 = torch.nn.BatchNorm2d(num_features=512)
        self.batch_norm_8 = torch.nn.BatchNorm2d(num_features=512)
        self.batch_norm_9 = torch.nn.BatchNorm2d(num_features=512)
        self.batch_norm_10 = torch.nn.BatchNorm2d(num_features=256)
        self.batch_norm_11 = torch.nn.BatchNorm2d(num_features=256)
        self.batch_norm_12 = torch.nn.BatchNorm2d(num_features=128)
        self.batch_norm_13 = torch.nn.BatchNorm2d(num_features=128)
        # self.batch_norm_14 = torch.nn.BatchNorm2d(num_features=1)


        self.relu = torch.nn.ReLU()
        self.dropout = torch.nn.Dropout(p=dropout)

        self.sigmoid = nn.Sigmoid()

    def forward(self, x):
        x = self.conv_1(x)
        x = self.batch_norm_1(x)
        x = self.relu(x)
        # x = self.dropout(x)

        x = self.conv_2(x)
        x = self.batch_norm_2(x)
        x = self.relu(x)
        # x = self.dropout(x)

        x = self.conv_3(x)
        x = self.batch_norm_3(x)
        x = self.relu(x)
        # x = self.dropout(x)

        x = self.conv_4(x)
        x = self.batch_norm_4(x)
        x = self.relu(x)
        # x = self.dropout(x)

        x = self.conv_5(x)
        x = self.batch_norm_5(x)
        x = self.relu(x)
        # x = self.dropout(x)

        x = self.conv_6(x)
        x = self.batch_norm_6(x)
        x = self.relu(x)
        # x = self.dropout(x)

        x = self.conv_7(x)
        x = self.batch_norm_7(x)
        x = self.relu(x)
        # x = self.dropout(x)

        x = self.conv_8(x)
        x = self.batch_norm_8(x)
        x = self.relu(x)
        # x = self.dropout(x)

        x = self.conv_9(x)
        x = self.batch_norm_9(x)
        x = self.relu(x)
        # x = self.dropout(x)

        x = self.conv_10(x)
        x = self.batch_norm_10(x)
        x = self.relu(x)
        # x = self.dropout(x)

        x = self.conv_11(x)
        x = self.batch_norm_11(x)
        x = self.relu(x)
        # x = self.dropout(x)

        x = self.conv_12(x)
        x = self.batch_norm_12(x)
        x = self.relu(x)
        # x = self.dropout(x)

        x = self.conv_13(x)
        x = self.batch_norm_13(x)
        x = self.relu(x)
        # x = self.dropout(x)
        # print(f"after conv13 {x.shape}")

        # x = self.conv_14(x)
        # x = self.batch_norm_14(x)
        # x = self.relu(x)
        # x = self.dropout(x)
        # print(f"after conv14 {x.shape}")

        # Testing FC layer
        x = self.conv_fc1(x)
        x = self.norm_fc1(x)
        x = self.relu_fc1(x)
        x = self.drop_fc1(x)
        x = self.conv_fc2(x)

        x = self.sigmoid(x)


        return x

# ┌───────────────────────────────────────────────────────────────────────────┐
# │                           Main Code                                       │
# └───────────────────────────────────────────────────────────────────────────┘

labels_channels = 1
# Flatten XYZ tree to list of Point3d
xyz_flat = [pt for i in range(xyz.BranchCount) for pt in xyz.Branch(i)]
xyz_array = np.array([[pt.X, pt.Y, pt.Z] for pt in xyz_flat])

X = xyz_array[:, 0].reshape((y_cm, x_cm), order='F')
Y = xyz_array[:, 1].reshape((y_cm, x_cm), order='F')
Z = xyz_array[:, 2].reshape((y_cm, x_cm), order='F')

# Smooth Z using selected method
if smoothing_method == 'gaussian':
    Z_smooth = gaussian_filter(Z, sigma=sigma)
    # print("    Applied Gaussian smoothing")
elif smoothing_method == 'uniform':
    Z_smooth = uniform_filter(Z, size=int(2 * sigma + 1))
    # print("    Applied uniform smoothing")
elif smoothing_method == 'median':
    Z_smooth = median_filter(Z, size=int(2 * sigma + 1))
    # print("    Applied median smoothing")
elif smoothing_method == 'savgol':
    Z_smooth = smooth_savgol(Z, sigma)
    print("    Applied savgol smoothing")
elif smoothing_method == 'bilateral':
    Z_smooth = smooth_bilateral(Z, sigma)
elif smoothing_method == 'anisotropic':
    Z_smooth = denoise_tv_chambolle(Z, weight=sigma)
elif smoothing_method == 'rebuild':
    rebuild_shape = (x_cm // rebuild_divide, y_cm // rebuild_divide)
    X, Y, Z_smooth = rebuild_full_surface_and_resample(X, Y, Z, rebuild_shape)
else:
    raise ValueError(f"Unsupported smoothing method: {smoothing_method}")

print(Z_smooth.shape)
Z_smooth_out = th.list_to_tree(Z_smooth.tolist())
X_out = th.list_to_tree(X.tolist())
Y_out = th.list_to_tree(Y.tolist())

# UV parameter extraction
uv_flat = [surface.ClosestPoint(pt) for pt in xyz_flat]
uv_array = np.array([[uv[1], uv[2]] for uv in uv_flat])

U = uv_array[:, 0].reshape((y_cm, x_cm), order='F')
V = uv_array[:, 1].reshape((y_cm, x_cm), order='F')

# Derivatives in U,V parameterization
du = dv = 1.0
Zu, Zv = np.gradient(Z_smooth, du, dv)
Zuu, Zuv = np.gradient(Zu, du, dv)
_, Zvv = np.gradient(Zv, du, dv)

# Fundamental forms (U,V)
E = Zu**2 + 1
F = Zu * Zv
G = Zv**2 + 1
L = Zuu
M = Zuv
N = Zvv

# Curvature computation

denom = E * G - F**2
sqrt_term = np.sqrt(np.clip((L * G - 2 * M * F + N * E)**2 - 4 * denom * (L * N - M**2), a_min=0, a_max=None))
k1 = ((L * G - 2 * M * F + N * E) + sqrt_term) / (2 * denom)
k2 = ((L * G - 2 * M * F + N * E) - sqrt_term) / (2 * denom)

# Max/Min curvature and vectors
k1_flat = k1.flatten(order='F')
k2_flat = k2.flatten(order='F')
use_k1_as_max = np.abs(k1_flat) >= np.abs(k2_flat)
max_curv = np.where(use_k1_as_max, k1_flat, k2_flat)
min_curv = np.where(use_k1_as_max, k2_flat, k1_flat)

# Principal directions remain XYZ-based for simplicity
# (original XYZ-based derivatives Zx,Zy needed here)
dx = dy = 1.0
Zx, Zy = np.gradient(Z_smooth, dx, dy)
Zxx, Zxy = np.gradient(Zx, dx, dy)
_, Zyy = np.gradient(Zy, dx, dy)

principal_dirs_max = np.zeros((y_cm, x_cm, 3))
principal_dirs_min = np.zeros((y_cm, x_cm, 3))

for ix in range(y_cm):
    for iy in range(x_cm):
        H = np.array([[Zxx[ix, iy], Zxy[ix, iy]], [Zxy[ix, iy], Zyy[ix, iy]]])
        eigvals, eigvecs = np.linalg.eigh(H)
        idx = np.argsort(np.abs(eigvals))[::-1]
        v_max = eigvecs[:, idx[0]]
        v_min = eigvecs[:, idx[1]]
        dzdx, dzdy = Zx[ix, iy], Zy[ix, iy]
        normal = np.array([-dzdx, -dzdy, 1.0])
        normal /= np.linalg.norm(normal)
        d_max = np.array([v_max[0], v_max[1], v_max[0]*dzdx + v_max[1]*dzdy])
        d_min = np.array([v_min[0], v_min[1], v_min[0]*dzdx + v_min[1]*dzdy])
        d_max -= np.dot(d_max, normal) * normal
        d_min -= np.dot(d_min, normal) * normal
        principal_dirs_max[ix, iy] = d_max / np.linalg.norm(d_max)
        principal_dirs_min[ix, iy] = d_min / np.linalg.norm(d_min)
max_vecs = (principal_dirs_max * np.abs(max_curv).reshape((y_cm, x_cm), order='F')[:, :, np.newaxis]).reshape(-1, 3, order='F')
min_vecs = (principal_dirs_min * np.abs(min_curv).reshape((y_cm, x_cm), order='F')[:, :, np.newaxis]).reshape(-1, 3, order='F')

# Rebuild curvature array
curvature_array = np.zeros((len(xyz_flat), 8))
curvature_array[:, 0] = max_curv
curvature_array[:, 1] = min_curv
curvature_array[:, 2:5] = max_vecs
curvature_array[:, 5:8] = min_vecs
print("Curvature array shape:", curvature_array.shape)

# Reshape and stack
reshaped_channels = [np.reshape(curvature_array[:, i], (y_cm, x_cm), order='F') for i in range(n_of_features_channels)]
feature_array = np.stack(reshaped_channels, axis=-1)
print("Feature array shape (H, W, C):", feature_array.shape)

# Convert to Tensor
feature_tensor = torch.from_numpy(feature_array).unsqueeze(0).permute(0, 3, 1, 2).float()
print("Feature tensor shape (B, C, H, W):", feature_tensor.shape)

# Normalize
min_tensor = torch.tensor(features_min).view(1, 8, 1, 1)
max_tensor = torch.tensor(features_max).view(1, 8, 1, 1)
feature_tensor = (feature_tensor - min_tensor) / (max_tensor - min_tensor)
print("Normalization complete.")

# 🟡 Save original size before padding
_, _, orig_h, orig_w = feature_tensor.shape


# Pad normalized input to match training shape
feature_tensor = pad_tensor(40,40, feature_tensor)

# Load and predict
model = OurVgg16()
model.load_state_dict(torch.load(model_path, map_location=torch.device('cpu')))
model.eval()
print("Model loaded and set to eval mode.")

with torch.no_grad():
    prediction = model(feature_tensor)
    print("Prediction shape:", prediction.shape)

# crop
prediction = prediction[:, :, :orig_h, :orig_w]


denorm_prediction = prediction * 180.0
prediction_np = denorm_prediction.squeeze().numpy()
prediction = prediction_np.flatten(order='F').tolist()
print("Prediction complete and flattened.")
# ---------- end inverse_prediction_smooth ----------

# ---- group: no smoothing
inverse_prediction_regular = Python3Script(
    curvature=merge_all,
    features_max=max_og,
    features_min=min_og,
    dataset_mean=dataset_feature_channel_means,
    dataset_std=dataset_feature_channel_standard_deviati,
    x_cm=roundf.Rounded,
    y_cm=roundf_2.Rounded,
    n_of_features_channels=number_slider_5,
    model_path=path)  # -> out, prediction, similarity_score, confidence_score; inputs curvature: tree of Double, features_max: list of Double, features_min: list of Double, dataset_mean: list of Double, dataset_std: list of Double, x_cm: Int32, y_cm: Int32, n_of_features_channels: Int32; disabled
# ---------- inverse_prediction_regular: Python ----------
# ┌───────────────────────────────────────────────────────────────────────────┐
# │                      Imports and Definitions                              |
# └───────────────────────────────────────────────────────────────────────────┘
# venv: inverse_prediction_regular
# r: numpy, pandas, torch
import ghpythonlib.treehelpers as th
import numpy as np
import torch 
import pandas as pd
from torch import nn

features_channels = n_of_features_channels 
# ┌───────────────────────────────────────────────────────────────────────────┐
# │                               Functions                                   |
# └───────────────────────────────────────────────────────────────────────────┘

def get_shape(lst):
    shape = []
    while isinstance(lst, list):
        shape.append(len(lst))
        lst = lst[0] if lst else []
    return tuple(shape)

# ┌───────────────────────────────────────────────────────────────────────────┐
# │                             Model Class                                   |
# └───────────────────────────────────────────────────────────────────────────┘

class OurVgg16(torch.nn.Module):
    def __init__(self, dropout=0.3):
        super(OurVgg16, self).__init__()

        self.conv_1 = torch.nn.Conv2d(in_channels=features_channels, out_channels=64, kernel_size=3, padding=1)
        self.conv_2 = torch.nn.Conv2d(in_channels=64, out_channels=128, kernel_size=3, padding=1)
        self.conv_3 = torch.nn.Conv2d(in_channels=128, out_channels=128, kernel_size=3, padding=1)
        self.conv_4 = torch.nn.Conv2d(in_channels=128, out_channels=256, kernel_size=3, padding=1)
        self.conv_5 = torch.nn.Conv2d(in_channels=256, out_channels=256, kernel_size=3, padding=1)
        self.conv_6 = torch.nn.Conv2d(in_channels=256, out_channels=512, kernel_size=3, padding=1)
        self.conv_7 = torch.nn.Conv2d(in_channels=512, out_channels=512, kernel_size=3, padding=1)
        self.conv_8 = torch.nn.Conv2d(in_channels=512, out_channels=512, kernel_size=3, padding=1)
        self.conv_9 = torch.nn.Conv2d(in_channels=512, out_channels=512, kernel_size=3, padding=1)
        self.conv_10 = torch.nn.Conv2d(in_channels=512, out_channels=256, kernel_size=3, padding=1)
        self.conv_11 = torch.nn.Conv2d(in_channels=256, out_channels=256, kernel_size=3, padding=1)
        self.conv_12 = torch.nn.Conv2d(256, 128, kernel_size=3, padding=1)
        self.conv_13 = torch.nn.Conv2d(128, 128, kernel_size=3, padding=1)
        self.conv_14 = torch.nn.Conv2d(128, 1, kernel_size=3, padding=1)


        self.batch_norm_1 = torch.nn.BatchNorm2d(num_features=64)
        self.batch_norm_2 = torch.nn.BatchNorm2d(num_features=128)
        self.batch_norm_3 = torch.nn.BatchNorm2d(num_features=128)
        self.batch_norm_4 = torch.nn.BatchNorm2d(num_features=256)
        self.batch_norm_5 = torch.nn.BatchNorm2d(num_features=256)
        self.batch_norm_6 = torch.nn.BatchNorm2d(num_features=512)
        self.batch_norm_7 = torch.nn.BatchNorm2d(num_features=512)
        self.batch_norm_8 = torch.nn.BatchNorm2d(num_features=512)
        self.batch_norm_9 = torch.nn.BatchNorm2d(num_features=512)
        self.batch_norm_10 = torch.nn.BatchNorm2d(num_features=256)
        self.batch_norm_11 = torch.nn.BatchNorm2d(num_features=256)
        self.batch_norm_12 = torch.nn.BatchNorm2d(num_features=128)
        self.batch_norm_13 = torch.nn.BatchNorm2d(num_features=128)
        self.batch_norm_14 = torch.nn.BatchNorm2d(num_features=1)


        self.relu = torch.nn.ReLU()
        self.dropout = torch.nn.Dropout(p=dropout)

        self.sigmoid = nn.Sigmoid()


    def forward(self, x):
        x = self.conv_1(x)
        x = self.batch_norm_1(x)
        x = self.relu(x)
        # x = self.dropout(x)

        x = self.conv_2(x)
        x = self.batch_norm_2(x)
        x = self.relu(x)
        # x = self.dropout(x)

        x = self.conv_3(x)
        x = self.batch_norm_3(x)
        x = self.relu(x)
        # x = self.dropout(x)

        x = self.conv_4(x)
        x = self.batch_norm_4(x)
        x = self.relu(x)
        # x = self.dropout(x)

        x = self.conv_5(x)
        x = self.batch_norm_5(x)
        x = self.relu(x)
        # x = self.dropout(x)

        x = self.conv_6(x)
        x = self.batch_norm_6(x)
        x = self.relu(x)
        # x = self.dropout(x)

        x = self.conv_7(x)
        x = self.batch_norm_7(x)
        x = self.relu(x)
        # x = self.dropout(x)

        x = self.conv_8(x)
        x = self.batch_norm_8(x)
        x = self.relu(x)
        # x = self.dropout(x)

        x = self.conv_9(x)
        x = self.batch_norm_9(x)
        x = self.relu(x)
        # x = self.dropout(x)

        x = self.conv_10(x)
        x = self.batch_norm_10(x)
        x = self.relu(x)
        # x = self.dropout(x)

        x = self.conv_11(x)
        x = self.batch_norm_11(x)
        x = self.relu(x)
        # x = self.dropout(x)

        x = self.conv_12(x)
        x = self.batch_norm_12(x)
        x = self.relu(x)
        # x = self.dropout(x)

        x = self.conv_13(x)
        x = self.batch_norm_13(x)
        x = self.relu(x)
        # x = self.dropout(x)
        # print(f"after conv13 {x.shape}")

        x = self.conv_14(x)
        # x = self.batch_norm_14(x)
        # x = self.relu(x)
        # x = self.dropout(x)
        # print(f"after conv14 {x.shape}")

        x = self.sigmoid(x)
        return x


# ┌───────────────────────────────────────────────────────────────────────────┐
# │                           Main Code                                       |
# └───────────────────────────────────────────────────────────────────────────┘

# Convert tree to nested list
curvature = th.tree_to_list(curvature)
print("Initial nested list shape:", get_shape(curvature))  

# Convert to Numpy
arr = np.array(curvature)  
print("NumPy array shape:", arr.shape)  

# Reshape
reshaped_channels = [np.reshape(arr[:, i], (y_cm, x_cm), order='F') for i in range(n_of_features_channels)]

# Stack into a 3D array
feature_array = np.stack(reshaped_channels, axis=-1)  
print("Feature array shape (H, W, C):", feature_array.shape)  # Should be (x_cm, y_cm, 8)


# Convert to Tensor
feature_tensor = torch.from_numpy(feature_array).unsqueeze(0).permute(0, 3, 1, 2).float()  
print("Feature tensor shape (B, C, H, W):", feature_tensor.shape)  # Should be (1, 8, x_cm, y_cm)


# Normalize
min_tensor = torch.tensor(features_min).view(1, 8, 1, 1)
max_tensor = torch.tensor(features_max).view(1, 8, 1, 1)

feature_tensor = (feature_tensor - min_tensor) / (max_tensor - min_tensor)

# Check feature min/max tensor shapes
print("features_min:", features_min)
print("features_max:", features_max)

print("min_tensor shape:", min_tensor.shape)
print("max_tensor shape:", max_tensor.shape)

# Final check before model input
print("Feature tensor ready for model:", feature_tensor.shape)

# Define model
features_channels = n_of_features_channels
model = OurVgg16()
model.load_state_dict(torch.load(model_path, map_location=torch.device('cpu')))
model.eval()

# Get confidence
dataset_mean = np.array(dataset_mean)
dataset_std  = np.array(dataset_std)

# Compute mean & std of the input tensor (per channel)
input_mean = feature_tensor.mean(dim=(2,3)).squeeze().numpy()
input_std  = feature_tensor.std(dim=(2,3)).squeeze().numpy()

# Compute similarity score
mean_diff = np.linalg.norm(input_mean - dataset_mean)
std_diff  = np.linalg.norm(input_std - dataset_std)
similarity_score = mean_diff + std_diff
confidence_score = 1 / (1 + similarity_score)

print("Input similarity score (lower = better):", similarity_score)
print("Estimated confidence (0–1):", confidence_score)

# Predict
with torch.no_grad():
    prediction = model(feature_tensor)
    print("Prediction shape:", prediction.shape)

# Denormalize
denorm_prediction = prediction * 180.0  


# Convert to NumPy
prediction_np = denorm_prediction.squeeze().numpy()  

# Flatten 
prediction = prediction_np.flatten(order='F').tolist()
# ---------- end inverse_prediction_regular ----------

# ----
smooth_only = Python3Script(
    x_cm=roundf.Rounded,
    y_cm=roundf_2.Rounded,
    xyz=simplify(ptcenter),
    sigma=number_slider_15,
    smoothing_method=smoothing_method,
    surface=rebuildsrf,
    n_of_features_channels=Slider(8, range=0..10))  # -> out, prediction, similarity_score, confidence_score, Z_smooth_out, X_out, Y_out, simplify(Curv_out); inputs x_cm: Int32, y_cm: Int32, xyz: tree of Point3d, sigma: Double, surface: Surface, n_of_features_channels: Int32
# ---------- smooth_only: Python ----------
# ┌───────────────────────────────────────────────────────────────────────────┐
# │                      Imports and Definitions                              │
# └───────────────────────────────────────────────────────────────────────────┘
# venv: inverse_prediction_smooth
# r: numpy, pandas, torch, scipy
import ghpythonlib.treehelpers as th
import numpy as np
import torch 
import pandas as pd
from torch import nn
from scipy.ndimage import gaussian_filter
from scipy.ndimage import uniform_filter
from scipy.signal import savgol_filter

features_channels = n_of_features_channels 



# ┌───────────────────────────────────────────────────────────────────────────┐
# │                               Functions                                   │
# └───────────────────────────────────────────────────────────────────────────┘

def get_shape(lst):
    shape = []
    while isinstance(lst, list):
        shape.append(len(lst))
        lst = lst[0] if lst else []
    return tuple(shape)

def smooth_savgol(Z, sigma):
    window = int(2 * sigma + 1)
    if window % 2 == 0:
        window += 1
    Z_smooth = savgol_filter(Z, window_length=window, polyorder=2, axis=0)
    Z_smooth = savgol_filter(Z_smooth, window_length=window, polyorder=2, axis=1)
    # print(Z_smooth)
    return Z_smooth

def smooth_bilateral(Z, sigma):
    # Normalize and convert to 8-bit for OpenCV
    Z_norm = (Z - np.min(Z)) / (np.max(Z) - np.min(Z)) * 255
    Z_8bit = np.uint8(Z_norm)
    smoothed = cv2.bilateralFilter(Z_8bit, d=9, sigmaColor=75, sigmaSpace=sigma)
    return smoothed.astype(float) / 255 * (np.max(Z) - np.min(Z)) + np.min(Z)

# ┌───────────────────────────────────────────────────────────────────────────┐
# │                             Model Class                                   │
# └───────────────────────────────────────────────────────────────────────────┘

class OurVgg16Old(torch.nn.Module):
    def __init__(self, dropout=0.3):
        super(OurVgg16, self).__init__()

        self.conv_1 = torch.nn.Conv2d(in_channels=features_channels, out_channels=64, kernel_size=3, padding=1)
        self.conv_2 = torch.nn.Conv2d(in_channels=64, out_channels=128, kernel_size=3, padding=1)
        self.conv_3 = torch.nn.Conv2d(in_channels=128, out_channels=128, kernel_size=3, padding=1)
        self.conv_4 = torch.nn.Conv2d(in_channels=128, out_channels=256, kernel_size=3, padding=1)
        self.conv_5 = torch.nn.Conv2d(in_channels=256, out_channels=256, kernel_size=3, padding=1)
        self.conv_6 = torch.nn.Conv2d(in_channels=256, out_channels=512, kernel_size=3, padding=1)
        self.conv_7 = torch.nn.Conv2d(in_channels=512, out_channels=512, kernel_size=3, padding=1)
        self.conv_8 = torch.nn.Conv2d(in_channels=512, out_channels=512, kernel_size=3, padding=1)
        self.conv_9 = torch.nn.Conv2d(in_channels=512, out_channels=512, kernel_size=3, padding=1)
        self.conv_10 = torch.nn.Conv2d(in_channels=512, out_channels=256, kernel_size=3, padding=1)
        self.conv_11 = torch.nn.Conv2d(in_channels=256, out_channels=256, kernel_size=3, padding=1)
        self.conv_12 = torch.nn.Conv2d(256, 128, kernel_size=3, padding=1)
        self.conv_13 = torch.nn.Conv2d(128, 128, kernel_size=3, padding=1)
        self.conv_14 = torch.nn.Conv2d(128, 1, kernel_size=3, padding=1)

        self.batch_norm_1 = torch.nn.BatchNorm2d(num_features=64)
        self.batch_norm_2 = torch.nn.BatchNorm2d(num_features=128)
        self.batch_norm_3 = torch.nn.BatchNorm2d(num_features=128)
        self.batch_norm_4 = torch.nn.BatchNorm2d(num_features=256)
        self.batch_norm_5 = torch.nn.BatchNorm2d(num_features=256)
        self.batch_norm_6 = torch.nn.BatchNorm2d(num_features=512)
        self.batch_norm_7 = torch.nn.BatchNorm2d(num_features=512)
        self.batch_norm_8 = torch.nn.BatchNorm2d(num_features=512)
        self.batch_norm_9 = torch.nn.BatchNorm2d(num_features=512)
        self.batch_norm_10 = torch.nn.BatchNorm2d(num_features=256)
        self.batch_norm_11 = torch.nn.BatchNorm2d(num_features=256)
        self.batch_norm_12 = torch.nn.BatchNorm2d(num_features=128)
        self.batch_norm_13 = torch.nn.BatchNorm2d(num_features=128)
        self.batch_norm_14 = torch.nn.BatchNorm2d(num_features=1)

        self.relu = torch.nn.ReLU()
        self.dropout = torch.nn.Dropout(p=dropout)
        self.sigmoid = nn.Sigmoid()

    def forward(self, x):
        x = self.conv_1(x); x = self.batch_norm_1(x); x = self.relu(x)
        x = self.conv_2(x); x = self.batch_norm_2(x); x = self.relu(x)
        x = self.conv_3(x); x = self.batch_norm_3(x); x = self.relu(x)
        x = self.conv_4(x); x = self.batch_norm_4(x); x = self.relu(x)
        x = self.conv_5(x); x = self.batch_norm_5(x); x = self.relu(x)
        x = self.conv_6(x); x = self.batch_norm_6(x); x = self.relu(x)
        x = self.conv_7(x); x = self.batch_norm_7(x); x = self.relu(x)
        x = self.conv_8(x); x = self.batch_norm_8(x); x = self.relu(x)
        x = self.conv_9(x); x = self.batch_norm_9(x); x = self.relu(x)
        x = self.conv_10(x); x = self.batch_norm_10(x); x = self.relu(x)
        x = self.conv_11(x); x = self.batch_norm_11(x); x = self.relu(x)
        x = self.conv_12(x); x = self.batch_norm_12(x); x = self.relu(x)
        x = self.conv_13(x); x = self.batch_norm_13(x); x = self.relu(x)
        x = self.conv_14(x); x = self.sigmoid(x)
        return x

class OurVgg16(torch.nn.Module):
    def __init__(self, dropout=0.3):
        super(OurVgg16, self).__init__()

        self.conv_1 = torch.nn.Conv2d(in_channels=features_channels, out_channels=64, kernel_size=3, padding=1)
        self.conv_2 = torch.nn.Conv2d(in_channels=64, out_channels=128, kernel_size=3, padding=1)
        self.conv_3 = torch.nn.Conv2d(in_channels=128, out_channels=128, kernel_size=3, padding=1)
        self.conv_4 = torch.nn.Conv2d(in_channels=128, out_channels=256, kernel_size=3, padding=1)
        self.conv_5 = torch.nn.Conv2d(in_channels=256, out_channels=256, kernel_size=3, padding=1)
        self.conv_6 = torch.nn.Conv2d(in_channels=256, out_channels=512, kernel_size=3, padding=1)
        self.conv_7 = torch.nn.Conv2d(in_channels=512, out_channels=512, kernel_size=3, padding=1)
        self.conv_8 = torch.nn.Conv2d(in_channels=512, out_channels=512, kernel_size=3, padding=1)
        self.conv_9 = torch.nn.Conv2d(in_channels=512, out_channels=512, kernel_size=3, padding=1)
        self.conv_10 = torch.nn.Conv2d(in_channels=512, out_channels=256, kernel_size=3, padding=1)
        self.conv_11 = torch.nn.Conv2d(in_channels=256, out_channels=256, kernel_size=3, padding=1)
        self.conv_12 = torch.nn.Conv2d(256, 128, kernel_size=3, padding=1)
        self.conv_13 = torch.nn.Conv2d(128, 128, kernel_size=3, padding=1)
        # self.conv_14 = torch.nn.Conv2d(128, labels_channels, kernel_size=3, padding=1)

        # Testing FC layer
        self.conv_fc1 = torch.nn.Conv2d(128, 512, kernel_size=3, padding=1)
        self.norm_fc1 = torch.nn.BatchNorm2d(512)
        self.relu_fc1 = torch.nn.ReLU()
        self.drop_fc1 = torch.nn.Dropout(p=dropout)
        self.conv_fc2 = torch.nn.Conv2d(512, labels_channels, kernel_size=1)


        self.batch_norm_1 = torch.nn.BatchNorm2d(num_features=64)
        self.batch_norm_2 = torch.nn.BatchNorm2d(num_features=128)
        self.batch_norm_3 = torch.nn.BatchNorm2d(num_features=128)
        self.batch_norm_4 = torch.nn.BatchNorm2d(num_features=256)
        self.batch_norm_5 = torch.nn.BatchNorm2d(num_features=256)
        self.batch_norm_6 = torch.nn.BatchNorm2d(num_features=512)
        self.batch_norm_7 = torch.nn.BatchNorm2d(num_features=512)
        self.batch_norm_8 = torch.nn.BatchNorm2d(num_features=512)
        self.batch_norm_9 = torch.nn.BatchNorm2d(num_features=512)
        self.batch_norm_10 = torch.nn.BatchNorm2d(num_features=256)
        self.batch_norm_11 = torch.nn.BatchNorm2d(num_features=256)
        self.batch_norm_12 = torch.nn.BatchNorm2d(num_features=128)
        self.batch_norm_13 = torch.nn.BatchNorm2d(num_features=128)
        # self.batch_norm_14 = torch.nn.BatchNorm2d(num_features=1)


        self.relu = torch.nn.ReLU()
        self.dropout = torch.nn.Dropout(p=dropout)

        self.sigmoid = nn.Sigmoid()

    def forward(self, x):
        x = self.conv_1(x)
        x = self.batch_norm_1(x)
        x = self.relu(x)
        # x = self.dropout(x)

        x = self.conv_2(x)
        x = self.batch_norm_2(x)
        x = self.relu(x)
        # x = self.dropout(x)

        x = self.conv_3(x)
        x = self.batch_norm_3(x)
        x = self.relu(x)
        # x = self.dropout(x)

        x = self.conv_4(x)
        x = self.batch_norm_4(x)
        x = self.relu(x)
        # x = self.dropout(x)

        x = self.conv_5(x)
        x = self.batch_norm_5(x)
        x = self.relu(x)
        # x = self.dropout(x)

        x = self.conv_6(x)
        x = self.batch_norm_6(x)
        x = self.relu(x)
        # x = self.dropout(x)

        x = self.conv_7(x)
        x = self.batch_norm_7(x)
        x = self.relu(x)
        # x = self.dropout(x)

        x = self.conv_8(x)
        x = self.batch_norm_8(x)
        x = self.relu(x)
        # x = self.dropout(x)

        x = self.conv_9(x)
        x = self.batch_norm_9(x)
        x = self.relu(x)
        # x = self.dropout(x)

        x = self.conv_10(x)
        x = self.batch_norm_10(x)
        x = self.relu(x)
        # x = self.dropout(x)

        x = self.conv_11(x)
        x = self.batch_norm_11(x)
        x = self.relu(x)
        # x = self.dropout(x)

        x = self.conv_12(x)
        x = self.batch_norm_12(x)
        x = self.relu(x)
        # x = self.dropout(x)

        x = self.conv_13(x)
        x = self.batch_norm_13(x)
        x = self.relu(x)
        # x = self.dropout(x)
        # print(f"after conv13 {x.shape}")

        # x = self.conv_14(x)
        # x = self.batch_norm_14(x)
        # x = self.relu(x)
        # x = self.dropout(x)
        # print(f"after conv14 {x.shape}")

        # Testing FC layer
        x = self.conv_fc1(x)
        x = self.norm_fc1(x)
        x = self.relu_fc1(x)
        x = self.drop_fc1(x)
        x = self.conv_fc2(x)

        x = self.sigmoid(x)


        return x

# ┌───────────────────────────────────────────────────────────────────────────┐
# │                           Main Code                                       │
# └───────────────────────────────────────────────────────────────────────────┘

labels_channels = 1
# Flatten XYZ tree to list of Point3d
xyz_flat = [pt for i in range(xyz.BranchCount) for pt in xyz.Branch(i)]
xyz_array = np.array([[pt.X, pt.Y, pt.Z] for pt in xyz_flat])

X = xyz_array[:, 0].reshape((y_cm, x_cm), order='F')
Y = xyz_array[:, 1].reshape((y_cm, x_cm), order='F')
Z = xyz_array[:, 2].reshape((y_cm, x_cm), order='F')

# Smooth Z using selected method
if smoothing_method == 'gaussian':
    Z_smooth = gaussian_filter(Z, sigma=sigma)
    # print("    Applied Gaussian smoothing")
elif smoothing_method == 'uniform':
    Z_smooth = uniform_filter(Z, size=int(2 * sigma + 1))
    # print("    Applied uniform smoothing")
elif smoothing_method == 'median':
    Z_smooth = median_filter(Z, size=int(2 * sigma + 1))
    # print("    Applied median smoothing")
elif smoothing_method == 'savgol':
    Z_smooth = smooth_savgol(Z, sigma)
    print("    Applied savgol smoothing")
elif smoothing_method == 'bilateral':
    Z_smooth = smooth_bilateral(Z, sigma)
elif smoothing_method == 'anisotropic':

    Z_smooth = denoise_tv_chambolle(Z, weight=sigma)
else:
    raise ValueError(f"Unsupported smoothing method: {smoothing_method}")

print(Z_smooth.shape)
Z_smooth_out = th.list_to_tree(Z_smooth.tolist())
X_out = th.list_to_tree(X.tolist())
Y_out = th.list_to_tree(Y.tolist())

# UV parameter extraction
uv_flat = [surface.ClosestPoint(pt) for pt in xyz_flat]
uv_array = np.array([[uv[1], uv[2]] for uv in uv_flat])

U = uv_array[:, 0].reshape((y_cm, x_cm), order='F')
V = uv_array[:, 1].reshape((y_cm, x_cm), order='F')

# Derivatives in U,V parameterization
du = dv = 1.0
Zu, Zv = np.gradient(Z_smooth, du, dv)
Zuu, Zuv = np.gradient(Zu, du, dv)
_, Zvv = np.gradient(Zv, du, dv)

# Fundamental forms (U,V)
E = Zu**2 + 1
F = Zu * Zv
G = Zv**2 + 1
L = Zuu
M = Zuv
N = Zvv

# Curvature computation

denom = E * G - F**2
sqrt_term = np.sqrt(np.clip((L * G - 2 * M * F + N * E)**2 - 4 * denom * (L * N - M**2), a_min=0, a_max=None))
k1 = ((L * G - 2 * M * F + N * E) + sqrt_term) / (2 * denom)
k2 = ((L * G - 2 * M * F + N * E) - sqrt_term) / (2 * denom)

# Max/Min curvature and vectors
k1_flat = k1.flatten(order='F')
k2_flat = k2.flatten(order='F')
use_k1_as_max = np.abs(k1_flat) >= np.abs(k2_flat)
max_curv = np.where(use_k1_as_max, k1_flat, k2_flat)
min_curv = np.where(use_k1_as_max, k2_flat, k1_flat)

# Principal directions remain XYZ-based for simplicity
# (original XYZ-based derivatives Zx,Zy needed here)
dx = dy = 1.0
Zx, Zy = np.gradient(Z_smooth, dx, dy)
Zxx, Zxy = np.gradient(Zx, dx, dy)
_, Zyy = np.gradient(Zy, dx, dy)

principal_dirs_max = np.zeros((y_cm, x_cm, 3))
principal_dirs_min = np.zeros((y_cm, x_cm, 3))

for ix in range(y_cm):
    for iy in range(x_cm):
        H = np.array([[Zxx[ix, iy], Zxy[ix, iy]], [Zxy[ix, iy], Zyy[ix, iy]]])
        eigvals, eigvecs = np.linalg.eigh(H)
        idx = np.argsort(np.abs(eigvals))[::-1]
        v_max = eigvecs[:, idx[0]]
        v_min = eigvecs[:, idx[1]]
        dzdx, dzdy = Zx[ix, iy], Zy[ix, iy]
        normal = np.array([-dzdx, -dzdy, 1.0])
        normal /= np.linalg.norm(normal)
        d_max = np.array([v_max[0], v_max[1], v_max[0]*dzdx + v_max[1]*dzdy])
        d_min = np.array([v_min[0], v_min[1], v_min[0]*dzdx + v_min[1]*dzdy])
        d_max -= np.dot(d_max, normal) * normal
        d_min -= np.dot(d_min, normal) * normal
        principal_dirs_max[ix, iy] = d_max / np.linalg.norm(d_max)
        principal_dirs_min[ix, iy] = d_min / np.linalg.norm(d_min)
max_vecs = (principal_dirs_max * np.abs(max_curv).reshape((y_cm, x_cm), order='F')[:, :, np.newaxis]).reshape(-1, 3, order='F')
min_vecs = (principal_dirs_min * np.abs(min_curv).reshape((y_cm, x_cm), order='F')[:, :, np.newaxis]).reshape(-1, 3, order='F')

# Rebuild curvature array
curvature_array = np.zeros((len(xyz_flat), 8))
curvature_array[:, 0] = max_curv
curvature_array[:, 1] = min_curv
curvature_array[:, 2:5] = max_vecs
curvature_array[:, 5:8] = min_vecs
print("Curvature array shape:", curvature_array.shape)

# Reshape and stack
reshaped_channels = [np.reshape(curvature_array[:, i], (y_cm, x_cm), order='F') for i in range(n_of_features_channels)]
feature_array = np.stack(reshaped_channels, axis=-1)
print("Feature array shape (H, W, C):", feature_array.shape)


Curv_out = th.list_to_tree(feature_array.tolist())
# ---------- end smooth_only ----------
flip_5 = FlipMatrix(Data=srf_cp.Point)  # -> flatten(Data)
bang = ExplodeTree(Data=forward_prediction_smooth.predicted_out)  # -> Branch0, Branch1, Branch2, Branch3, Branch4, Branch5, Branch6, Branch7
points_3 = PointList(Points=flatten(srf_cp.Point))
panel_9 = Panel(flip_2)
points_4 = PointList(Points=flip_5)
pdecon_2 = Deconstruct(Point=flip_5)  # -> XComponent, YComponent, ZComponent
vec = VectorXYZ(XComponent=bang.Branch3, YComponent=bang.Branch2, ZComponent=bang.Branch4)  # -> Vector, Length
panel_10 = Panel(forward_prediction_smooth.out)
panel_11 = Panel(inverse_prediction_regular.out)
prediction = Number(inverse_prediction_smooth.prediction)
circle = CircleCNR(Center=srf_cp.Point, Normal=Vector(0, 0, 1), Radius=Slider(0.26, range=0..1))

# ---- group: max curvature
item = ListItem(List=smooth_only.Curv_out, Index=Slider(0, range=0..10), Wrap=True)
item_2 = ListItem(List=smooth_only.Curv_out, Index=Slider(2, range=0..10), Wrap=True)
item_3 = ListItem(List=smooth_only.Curv_out, Index=Slider(3, range=0..10), Wrap=True)
item_4 = ListItem(List=smooth_only.Curv_out, Index=Slider(4, range=0..10), Wrap=True)
trim = TrimTree(Tree=item_2, Depth=1)
flip_6 = FlipMatrix(Data=trim)

# ----
subtraction = Subtraction(B=flip_2)

# ---- group: Get Average Per Patch
item_5 = ListItem(List=flatten(flip), Index=0, Wrap=True)
int = Integer(roundf.Rounded)
int_2 = Integer(roundf_2.Rounded)
int_3 = Integer(prediction)
patch_average = Python3Script(
    angles=int_3,
    x_cm=int,
    y_cm=int_2,
    patch_x=patch_size,
    patch_y=patch_size,
    is_weighted=Toggle(True),
    weight=w,
    is_concentric=Toggle(False))  # -> out, patches_avgs, flat_avg; inputs angles: list of Double, x_cm: Int32, patch_x: Int32, patch_y: Int32, is_weighted: Boolean, weight: Double, is_concentric: Boolean
# ---------- patch_average: Python ----------
# r: numpy
# venv: patch_average

"""
Compute averaged values over patches in a 2D angle grid, with optional spatial weighting.

This script processes a flattened list of angles arranged in a (y_cm, x_cm) grid, dividing it into patches of size (patch_y, patch_x). 
Each patch's average is computed, optionally using either concentric (layered) or Gaussian-like spatial weighting.

Parameters:
- angles: flat list of angle values (0–180), ordered column-first (Fortran-style).
- y_cm, x_cm: dimensions of the grid.
- patch_y, patch_x: height and width of each patch.
- is_weighted: if True, use weighted averaging; otherwise, use simple mean.
- weight: float value > 0 controlling how strongly the weighting favors the patch center.
    - For concentric: higher = more center-heavy decay by layer.
    - For radial (Gaussian-like): higher = sharper falloff from center to edges.
- is_concentric: 
    - If True: uses concentric shell (layer-based) weighting — all pixels in a ring around the center have the same weight.
    - If False: uses radial (Euclidean distance) Gaussian-style decay.

Returns:
- flat_avg: list of patch-averaged values, flattened column-first.
- Prints patch locations, involved indices, raw values, and calculated averages for debugging.
"""

import numpy as np

grid = np.array(angles).reshape((y_cm, x_cm), order='F')  # (15, 20)

patch_avgs = []
for i in range(0, y_cm, patch_y):
    row = []
    for j in range(0, x_cm, patch_x):
        patch = grid[i:i+patch_y, j:j+patch_x]
        if is_concentric:
            if is_weighted:
                cy, cx = patch.shape[0] // 2, patch.shape[1] // 2
                yy, xx = np.meshgrid(np.arange(patch.shape[0]), np.arange(patch.shape[1]), indexing='ij')
                
                # Compute concentric "layer" distances (Manhattan shells)
                layer = np.maximum(np.abs(yy - cy), np.abs(xx - cx))  # same layer = same weight
                
                # Assign weights: inner layers get higher weights
                decay = np.power(1.0 / weight, layer)
                
                # Normalize so the sum of weights is 1
                decay /= np.sum(decay)
                
                # Weighted average
                avg = np.sum(patch * decay)
            else:
                avg = np.mean(patch)
        else:
            if is_weighted:
                cy, cx = patch.shape[0] // 2, patch.shape[1] // 2
                yy, xx = np.meshgrid(np.arange(patch.shape[0]), np.arange(patch.shape[1]), indexing='ij')
                distances = np.sqrt((yy - cy)**2 + (xx - cx)**2)
                max_dist = np.sqrt(cy**2 + cx**2) or 1
                decay = np.exp(-weight * (distances / max_dist)**2)
                decay /= np.sum(decay)  # normalize to sum=1
                avg = np.sum(patch * decay)
            else:
                avg = np.mean(patch)


        # Calculate original flat indices from angles
        indices = []
        for dy in range(patch_y):
            for dx in range(patch_x):
                iy = i + dy
                jx = j + dx
                if iy < y_cm and jx < x_cm:
                    flat_index = iy * x_cm + jx
                    indices.append(flat_index)

        print(f"Patch (row={i//patch_y}, col={j//patch_x})")
        print(f"  Flat indices: {indices}")
        print(f"  Values: {[angles[k] for k in indices]}")
        print(f"  Average: {avg}")
        row.append(avg)
    patch_avgs.append(row)

flat_avg = np.array(patch_avgs).flatten(order='F').tolist()
# ---------- end patch_average ----------
division_3 = Division(A=roundf.Rounded, B=patch_size)
division_4 = Division(A=roundf_2.Rounded, B=patch_size)
recgrid = Rectangular(Plane=item_5, SizeX=patch_size, SizeY=patch_size, ExtentX=division_3, ExtentY=division_4)  # -> flatten(Cells), flatten(Points)
area_2 = Area(Geometry=recgrid.Cells)  # -> Area, Centroid
panel_12 = Panel(patch_average.flat_avg)
round = Round(Number=patch_average.flat_avg)  # -> Nearest, Floor, Ceiling

# ---- group: Get Flat Grid
rectangle_2 = Rectangle(Plane=item_5, XSize=roundf.Rounded, YSize=roundf_2.Rounded, Radius=0)  # -> Rectangle, Length
sdivide_7 = DivideSurface(Surface=rectangle_2.Rectangle, UCount=roundf.Rounded, VCount=roundf_2.Rounded)  # -> Points, Normals, Parameters
ptcell = Cellulate(Grid=sdivide_7.Points)  # -> Wires, Cells, flatten(Meshes)
area_3 = MeshArea(Mesh=ptcell.Meshes)  # -> Area, Centroid

# ----
abs = Absolute(Value=subtraction)  # -> flatten(Result)
gradient = Gradient(LowerLimit=0, UpperLimit=1, Parameter=bang.Branch2, stops=[0.15: RGB(255, 130, 160), 0.85: RGB(220, 0, 40)])
avr_2 = Average(Input=abs)
preview = CustomPreview(Geometry=circle, Material=gradient)
flip_7 = FlipMatrix(Data=srf_cp.Point)  # -> simplify(Data)
panel_13 = Panel(avr_2)
bang_2 = ExplodeTree(Data=flip_7)  # -> Branch0, Branch1, Branch2, Branch3, Branch4, Branch5, Branch6, Branch7
simulation = Simulation_2(num=roundf.Rounded, num_2=roundf_2.Rounded, B_2=patch_size, B=patch_size, connect_angles=genes)  # -> L, number_slider_6, number_slider_7; disabled
vec_2 = VectorXYZ(XComponent=bang_2.Branch2, YComponent=bang_2.Branch3, ZComponent=bang_2.Branch4)  # -> Vector, Length
vec_3 = VectorXYZ(XComponent=item_3, YComponent=item_2, ZComponent=item_4)  # -> Vector, Length
amp_3 = Amplitude(Vector=vec_2.Vector, Amplitude=bang_2.Branch0)
trim_2 = TrimTree(Tree=item, Depth=1)
trim_3 = TrimTree(Tree=vec_3.Vector, Depth=1)
flip_8 = FlipMatrix(Data=trim_2)
vdisex_3 = VectorDisplayEx(Point=flatten(srf_cp.Point), Vector=amp_3, Colour=RGB(0, 0, 0), Width=2)
flip_9 = FlipMatrix(Data=trim_3)
patch_predictions = Integer(round.Nearest)
panel_14 = Panel(patch_predictions)
forward_prediction_xyz = Python3Script(
    labels_max=max_smooth_3,
    labels_min=min_smooth_3,
    x_cm=roundf.Rounded,
    y_cm=roundf_2.Rounded,
    patch_x=patch_size,
    patch_y=patch_size,
    n_of_features_channels=Slider(3, range=0..10),
    n_of_labels_channels=number_slider_8,
    model_path=model_path_lab_pc_5,
    angles=patch_predictions)  # -> out, predicted_out, predicted_out_spatial, predicted_out_b; inputs labels_max: list of Double, labels_min: list of Double, x_cm: Int32, y_cm: Int32, patch_x: Int32, patch_y: Int32, n_of_features_channels: Int32, n_of_labels_channels: Int32, angles: list of Double
# ---------- forward_prediction_xyz: Python ----------
# ┌───────────────────────────────────────────────────────────────────────────┐
# │                      Imports and Definitions                              │
# └───────────────────────────────────────────────────────────────────────────┘
# venv: forward_prediction_XYZ
# r: numpy, torch, matplotlib, pathlib


import numpy as np
import torch 
import torch.nn as nn
from torch.optim.lr_scheduler import ReduceLROnPlateau
from Grasshopper import DataTree
from Grasshopper.Kernel.Data import GH_Path
import matplotlib
import matplotlib.pyplot as plt
matplotlib.use('Agg')  # Use a non-interactive backend
from pathlib import Path
import torch.nn.functional as F

features_channels = n_of_labels_channels 
labels_channels =  n_of_features_channels 



# ┌───────────────────────────────────────────────────────────────────────────┐
# │                               Functions                                   │
# └───────────────────────────────────────────────────────────────────────────┘

def duplicate_pixel_data(input_data, x_cm, y_cm, patch_x, patch_y, fortran_order=False):
    """
    Duplicates coarse grid values into patches in a larger tensor.
    
    Args:
        input_data (list, np.ndarray, or torch.Tensor): Either flat or 2D grid of values.
        x_cm (int): Width of output grid.
        y_cm (int): Height of output grid.
        patch_x (int): Width of each patch.
        patch_y (int): Height of each patch.
        fortran_order (bool): Whether to interpret flat input in column-major (Fortran) order.

    Returns:
        torch.Tensor: 4D tensor of shape (1, 1, y_cm, x_cm) with duplicated values.
    """
    num_patches_y = y_cm // patch_y
    num_patches_x = x_cm // patch_x
    expected_size = num_patches_y * num_patches_x

    # Convert input to torch tensor
    if isinstance(input_data, torch.Tensor):
        tensor_input = input_data
    elif isinstance(input_data, np.ndarray):
        tensor_input = torch.tensor(input_data, dtype=torch.float32)
    elif isinstance(input_data, list):
        tensor_input = torch.tensor(input_data, dtype=torch.float32)
    else:
        raise TypeError("Unsupported input type")

    # Handle flat input: reshape into 2D grid
    if tensor_input.dim() == 1:
        assert tensor_input.numel() == expected_size, f"Expected {expected_size} values, got {tensor_input.numel()}"
        if fortran_order:
            np_input = tensor_input.numpy().reshape((num_patches_y, num_patches_x), order='F')
            tensor_input = torch.tensor(np_input, dtype=torch.float32)
        else:
            tensor_input = tensor_input.view(num_patches_y, num_patches_x)

    final_tensor = torch.zeros((1, 1, y_cm, x_cm), dtype=torch.float32)

    for i in range(num_patches_y):
        for j in range(num_patches_x):
            row_start = i * patch_y
            row_end = row_start + patch_y
            col_start = j * patch_x
            col_end = col_start + patch_x

            final_tensor[:, 0, row_start:row_end, col_start:col_end] = tensor_input[i, j]


    return final_tensor

def tensor_to_tree(tensor):
    """
    Converts a [1, C, H, W] tensor into a DataTree[float] with each channel as a branch,
    """
    tree = DataTree[float]()
    tensor = tensor.detach().squeeze(0)  # shape: [C, H, W]
    C = tensor.shape[0]
    H = tensor.shape[1]
    W = tensor.shape[2]
    print(f"tensor shape before conversion to tree: {C}, {H}, {W}")

    for ch in range(C):
        path = GH_Path(ch)
        for y in range(H):
            for x in range(W):
                tree.Add(float(tensor[ch, y, x]), path)

    return tree

def tensor_to_spatial_tree(tensor):
    """
    Converts a [1, C, H, W] tensor into a DataTree[float] with each {h,w} as a branch
    containing C channel values.
    """
    tree = DataTree[float]()
    tensor = tensor.detach().squeeze(0)  # shape: [C, H, W]
    C, H, W = tensor.shape
    print(f"tensor shape before conversion: {C}, {H}, {W}")

    for y in range(H):
        for x in range(W):
            path = GH_Path(y, x)
            for ch in range(C):
                tree.Add(float(tensor[ch, y, x]), path)

    return tree

def pad_tensor(max_h,max_w,tensor):

    """
    Pads a tensor of shape [1, C, H, W] to [1, C, 40, 40] using zero-padding.
    """
    _, _, h, w = tensor.shape
    pad_h = max_h - h
    pad_w = max_w - w
    return F.pad(tensor, (0, pad_w, 0, pad_h), mode='constant', value=0)


# ┌───────────────────────────────────────────────────────────────────────────┐
# │                             Model Class                                   │
# └───────────────────────────────────────────────────────────────────────────┘

class OurVgg16InstanceNorm2d(torch.nn.Module):
    """
    Custom VGG-style model with conv-only architecture, no fully connected layers.
    Outputs a single-channel prediction (e.g., fiber orientation).
    """
    def __init__(self, dropout=0.3):
        super(OurVgg16InstanceNorm2d, self).__init__()

        self.conv_1 = torch.nn.Conv2d(in_channels=features_channels, out_channels=64, kernel_size=3, padding=1)
        self.conv_2 = torch.nn.Conv2d(in_channels=64, out_channels=128, kernel_size=3, padding=1)
        self.conv_3 = torch.nn.Conv2d(in_channels=128, out_channels=128, kernel_size=3, padding=1)
        self.conv_4 = torch.nn.Conv2d(in_channels=128, out_channels=256, kernel_size=3, padding=1)
        self.conv_5 = torch.nn.Conv2d(in_channels=256, out_channels=256, kernel_size=3, padding=1)
        self.conv_6 = torch.nn.Conv2d(in_channels=256, out_channels=512, kernel_size=3, padding=1)
        self.conv_7 = torch.nn.Conv2d(in_channels=512, out_channels=512, kernel_size=3, padding=1)
        self.conv_8 = torch.nn.Conv2d(in_channels=512, out_channels=512, kernel_size=3, padding=1)
        self.conv_9 = torch.nn.Conv2d(in_channels=512, out_channels=512, kernel_size=3, padding=1)
        self.conv_10 = torch.nn.Conv2d(in_channels=512, out_channels=256, kernel_size=3, padding=1)
        self.conv_11 = torch.nn.Conv2d(in_channels=256, out_channels=256, kernel_size=3, padding=1)
        self.conv_12 = torch.nn.Conv2d(in_channels=256, out_channels=128, kernel_size=3, padding=1)
        self.conv_13 = torch.nn.Conv2d(in_channels=128, out_channels=128, kernel_size=3, padding=1)
        self.conv_14 = torch.nn.Conv2d(in_channels=128, out_channels=labels_channels, kernel_size=3, padding=1)  # final output

        self.instance_norm_1 = torch.nn.InstanceNorm2d(64)
        self.instance_norm_2 = torch.nn.InstanceNorm2d(128)
        self.instance_norm_3 = torch.nn.InstanceNorm2d(128)
        self.instance_norm_4 = torch.nn.InstanceNorm2d(256)
        self.instance_norm_5 = torch.nn.InstanceNorm2d(256)
        self.instance_norm_6 = torch.nn.InstanceNorm2d(512)
        self.instance_norm_7 = torch.nn.InstanceNorm2d(512)
        self.instance_norm_8 = torch.nn.InstanceNorm2d(512)
        self.instance_norm_9 = torch.nn.InstanceNorm2d(512)
        self.instance_norm_10 = torch.nn.InstanceNorm2d(256)
        self.instance_norm_11 = torch.nn.InstanceNorm2d(256)
        self.instance_norm_12 = torch.nn.InstanceNorm2d(128)
        self.instance_norm_13 = torch.nn.InstanceNorm2d(128)


        self.relu = torch.nn.ReLU()
        self.dropout = torch.nn.Dropout(p=dropout)
        self.sigmoid = torch.nn.Sigmoid()

    def forward(self, x):
        x = self.conv_1(x); x = self.instance_norm_1(x); x = self.relu(x)
        x = self.conv_2(x); x = self.instance_norm_2(x); x = self.relu(x)
        x = self.dropout(x);
        x = self.conv_3(x); x = self.instance_norm_3(x); x = self.relu(x)
        x = self.conv_4(x); x = self.instance_norm_4(x); x = self.relu(x)
        x = self.dropout(x);
        x = self.conv_5(x); x = self.instance_norm_5(x); x = self.relu(x)
        x = self.conv_6(x); x = self.instance_norm_6(x); x = self.relu(x)
        x = self.dropout(x);
        x = self.conv_7(x); x = self.instance_norm_7(x); x = self.relu(x)
        x = self.conv_8(x); x = self.instance_norm_8(x); x = self.relu(x)
        x = self.dropout(x);
        x = self.conv_9(x); x = self.instance_norm_9(x); x = self.relu(x)
        x = self.conv_10(x); x = self.instance_norm_10(x); x = self.relu(x)
        x = self.dropout(x);
        x = self.conv_11(x); x = self.instance_norm_11(x); x = self.relu(x)
        x = self.conv_12(x); x = self.instance_norm_12(x); x = self.relu(x)
        x = self.dropout(x);
        x = self.conv_13(x); x = self.instance_norm_13(x); x = self.relu(x)
        x = self.conv_14(x);
        x = self.sigmoid(x)
        # x = torch.clamp(x, 0.0, 1.0)
        return x




class OurVgg16(torch.nn.Module):
    """
    Custom VGG-style model with conv-only architecture, no fully connected layers.
    Outputs a single-channel prediction (e.g., fiber orientation).
    """
    def __init__(self, dropout=0.3):
        super(OurVgg16, self).__init__()

        self.conv_1 = torch.nn.Conv2d(in_channels=features_channels, out_channels=64, kernel_size=3, padding=1)
        self.conv_2 = torch.nn.Conv2d(in_channels=64, out_channels=128, kernel_size=3, padding=1)
        self.conv_3 = torch.nn.Conv2d(in_channels=128, out_channels=128, kernel_size=3, padding=1)
        self.conv_4 = torch.nn.Conv2d(in_channels=128, out_channels=256, kernel_size=3, padding=1)
        self.conv_5 = torch.nn.Conv2d(in_channels=256, out_channels=256, kernel_size=3, padding=1)
        self.conv_6 = torch.nn.Conv2d(in_channels=256, out_channels=512, kernel_size=3, padding=1)
        self.conv_7 = torch.nn.Conv2d(in_channels=512, out_channels=512, kernel_size=3, padding=1)
        self.conv_8 = torch.nn.Conv2d(in_channels=512, out_channels=512, kernel_size=3, padding=1)
        self.conv_9 = torch.nn.Conv2d(in_channels=512, out_channels=512, kernel_size=3, padding=1)
        self.conv_10 = torch.nn.Conv2d(in_channels=512, out_channels=256, kernel_size=3, padding=1)
        self.conv_11 = torch.nn.Conv2d(in_channels=256, out_channels=256, kernel_size=3, padding=1)
        self.conv_12 = torch.nn.Conv2d(in_channels=256, out_channels=128, kernel_size=3, padding=1)
        self.conv_13 = torch.nn.Conv2d(in_channels=128, out_channels=128, kernel_size=3, padding=1)
        self.conv_14 = torch.nn.Conv2d(in_channels=128, out_channels=labels_channels, kernel_size=3, padding=1)  # final output

        self.batch_norm_1 = torch.nn.BatchNorm2d(64)
        self.batch_norm_2 = torch.nn.BatchNorm2d(128)
        self.batch_norm_3 = torch.nn.BatchNorm2d(128)
        self.batch_norm_4 = torch.nn.BatchNorm2d(256)
        self.batch_norm_5 = torch.nn.BatchNorm2d(256)
        self.batch_norm_6 = torch.nn.BatchNorm2d(512)
        self.batch_norm_7 = torch.nn.BatchNorm2d(512)
        self.batch_norm_8 = torch.nn.BatchNorm2d(512)
        self.batch_norm_9 = torch.nn.BatchNorm2d(512)
        self.batch_norm_10 = torch.nn.BatchNorm2d(256)
        self.batch_norm_11 = torch.nn.BatchNorm2d(256)
        self.batch_norm_12 = torch.nn.BatchNorm2d(128)
        self.batch_norm_13 = torch.nn.BatchNorm2d(128)


        self.relu = torch.nn.ReLU()
        self.dropout = torch.nn.Dropout(p=dropout)
        self.sigmoid = torch.nn.Sigmoid()

    def forward(self, x):
        x = self.conv_1(x); x = self.batch_norm_1(x); x = self.relu(x)
        x = self.conv_2(x); x = self.batch_norm_2(x); x = self.relu(x)
        x = self.conv_3(x); x = self.batch_norm_3(x); x = self.relu(x)
        x = self.conv_4(x); x = self.batch_norm_4(x); x = self.relu(x)
        x = self.conv_5(x); x = self.batch_norm_5(x); x = self.relu(x)
        x = self.conv_6(x); x = self.batch_norm_6(x); x = self.relu(x)
        x = self.dropout(x);
        x = self.conv_7(x); x = self.batch_norm_7(x); x = self.relu(x)
        x = self.conv_8(x); x = self.batch_norm_8(x); x = self.relu(x)
        x = self.dropout(x);
        x = self.conv_9(x); x = self.batch_norm_9(x); x = self.relu(x)
        x = self.conv_10(x); x = self.batch_norm_10(x); x = self.relu(x)
        x = self.dropout(x);
        x = self.conv_11(x); x = self.batch_norm_11(x); x = self.relu(x)
        x = self.conv_12(x); x = self.batch_norm_12(x); x = self.relu(x)
        x = self.dropout(x);
        x = self.conv_13(x); x = self.batch_norm_13(x); x = self.relu(x)
        x = self.conv_14(x);
        x = self.sigmoid(x)
        # x = torch.clamp(x, 0.0, 1.0)
        return x


# ┌───────────────────────────────────────────────────────────────────────────┐
# │                        Main Code - Optimization                           │
# └───────────────────────────────────────────────────────────────────────────┘

print("PyTorch version:", torch.__version__)
print("CUDA version:", torch.version.cuda)
print("CUDA available:", torch.cuda.is_available())
device = torch.device("cuda" if torch.cuda.is_available() else "cpu")
print(f"device:{device}")

# Define the Model
model = OurVgg16InstanceNorm2d()
model.load_state_dict(torch.load(model_path, map_location=device))
model.eval()  # ensure correct evaluation mode
model.to(device)


# Step 1: Prepare input grid
angles_grid = duplicate_pixel_data(angles, x_cm=x_cm, y_cm=y_cm, patch_x=patch_x, patch_y=patch_y, fortran_order=True)

print("\n--- angles_grid ---")
print("Shape:", angles_grid.shape)
print("Min:", angles_grid.min().item(), "Max:", angles_grid.max().item())

# Step 2: Normalize input
normalized_tensor = angles_grid / 180.0

# 🟡 Save original size before padding
# _, _, orig_h, orig_w = normalized_tensor.shape

# Pad normalized input to match training shape
# normalized_tensor = pad_tensor(40,40, normalized_tensor)

print("\n--- normalized_tensor ---")
print("Min:", normalized_tensor.min().item(), "Max:", normalized_tensor.max().item(), "Shape:", normalized_tensor.shape)

# Build and plot
plt.imshow(angles_grid[0, 0], cmap='plasma', origin='upper')
plt.title("Input Angles Grid (Fortran Order)")
plt.colorbar()

# Get path to Desktop
desktop = Path.home() / "Desktop"
output_path = desktop / "angles_grid_input.png"

#plot
plt.savefig(str(output_path))
plt.close()


# Step 3: Model inference
predicted = model(normalized_tensor)

# crop
# predicted = predicted[:, :, :orig_h, :orig_w]


print("\n--- predicted (raw model output) ---")
print("Shape:", predicted.shape)
print("Min:", predicted.min().item(), "Max:", predicted.max().item())
print(predicted)

# Save to a .csv file for Excel viewing
with open("C:/Gal_Msc/tensor_output.csv", "w") as f:
    batch = predicted[0]
    for c in range(batch.size(0)):
        f.write(f"Channel {c}\n")
        for row in batch[c]:
            row_str = ",".join(str(x.item()) for x in row)
            f.write(row_str + "\n")
        f.write("\n")


# Step 4: Prepare label range tensors
labels_max_tensor = torch.tensor(labels_max, dtype=torch.float32).view(1, -1, 1, 1)
labels_min_tensor = torch.tensor(labels_min, dtype=torch.float32).view(1, -1, 1, 1)


print("\n--- labels_min / labels_max ---")
print("labels_min:", labels_min)
print("labels_max:", labels_max)

# Step 5: Denormalize
denormalized = torch.empty_like(predicted)

for c in range(predicted.shape[1]):
    scale = labels_max[c] - labels_min[c] + 1e-8
    denormalized[:, c] = predicted[:, c] * scale + labels_min[c]
    
    # Debug print
    print(f"Channel {c} - Predicted range: {predicted[:, c].min().item():.4f} to {predicted[:, c].max().item():.4f}")
    print(f"Channel {c} - Denormalized range: {denormalized[:, c].min().item():.4f} to {denormalized[:, c].max().item():.4f}")



print("\n--- denormalized ---")
print("Shape:", denormalized.shape)
print("Min:", denormalized.min().item(), "Max:", denormalized.max().item())
print("Sample [0,0,0,0]:", denormalized[0, 0, 0, 0].item())


# Step 6: Convert to list/tree output
predicted_out = tensor_to_tree(denormalized)
predicted_out_spatial = tensor_to_spatial_tree(denormalized)
predicted_out_b = tensor_to_tree(predicted)  # only for checking raw output if needed

# Remove batch dimension: [C, H, W]
denorm = denormalized.detach().squeeze(0)

# Loop through channels and save each as an image
for ch in range(denorm.shape[0]):
    data = denorm[ch].numpy()
    fig, ax = plt.subplots(figsize=(6, 9))
    img = ax.imshow(data, cmap='viridis', origin='upper')
    ax.set_title(f"Predicted Channel {ch}")
    plt.colorbar(img, ax=ax)
    plt.tight_layout()

    output_path = desktop / f"predicted_channel_{ch}.png"
    plt.savefig(str(output_path))
    plt.close()
# ---------- end forward_prediction_xyz ----------
flip_10 = FlipMatrix(Data=forward_prediction_xyz.predicted_out)
panel_15 = Panel(forward_prediction_xyz.predicted_out)
panel_16 = Panel(forward_prediction_xyz.predicted_out_b)
bang_3 = ExplodeTree(Data=forward_prediction_xyz.predicted_out)  # -> Branch0, Branch1, Branch2
pt = ConstructPoint(XCoordinate=flatten(bang_3.Branch0), YCoordinate=flatten(bang_3.Branch1), ZCoordinate=flatten(bang_3.Branch2))
points_5 = PointList(Points=pt)
dist_2 = Distance(PointA=flatten(srf_cp.Point), PointB=pt)
cp = ClosestPoint(Point=pt, Cloud=flip_5)  # -> ClosestPoint, CPIndex, Distance

# ---- group: number of sample points affects the difference / Predicted Pt
item_6 = ListItem(List=forward_prediction_xyz.predicted_out_spatial, Index=0, Wrap=True)
item_7 = ListItem(List=forward_prediction_xyz.predicted_out_spatial, Index=1, Wrap=True)
item_8 = ListItem(List=forward_prediction_xyz.predicted_out_spatial, Index=2, Wrap=True)
pt_2 = ConstructPoint(XCoordinate=item_6, YCoordinate=item_7, ZCoordinate=item_8)

# ----
avr_3 = Average(Input=cp.Distance)
tag_2 = TextTag(Location=pt, Text=dist_2)

# ---- group: Visulization Per Pixel
round_2 = Round(Number=prediction)  # -> Nearest, Floor, Ceiling
gradient_2 = Gradient(
    LowerLimit=0,
    UpperLimit=180,
    Parameter=round_2.Nearest,
    stops=[0: RGB(243, 57, 0), 0.1: RGB(236, 27, 60), 0.2: RGB(210, 0, 118), 0.3: RGB(103, 0, 120), 0.4: RGB(39, 72, 161), 0.5: RGB(1, 192, 229), 0.6: RGB(18, 178, 90), 0.7: RGB(79, 186, 8), 0.8: RGB(220, 237, 32), 0.9: RGB(247, 159, 20), 1: RGB(243, 57, 0)])
# 4. Preview Fiber Prediction
ptcell_2 = Cellulate(Grid=flip)  # -> Wires, Cells, flatten(Meshes)
preview_2 = CustomPreview(Geometry=flatten(ptcell.Meshes), Material=gradient_2)
tag_3 = TextTag(Location=flatten(area_3.Centroid), Text=round_2.Nearest, Colour=swatch_2)

# ---- group: Visualization Per Patch(Average)
gradient_3 = Gradient(
    LowerLimit=0,
    UpperLimit=180,
    Parameter=patch_predictions,
    stops=[0: RGB(243, 57, 0), 0.1: RGB(236, 27, 60), 0.2: RGB(210, 0, 118), 0.3: RGB(103, 0, 120), 0.4: RGB(39, 72, 161), 0.5: RGB(1, 192, 229), 0.6: RGB(18, 178, 90), 0.7: RGB(79, 186, 8), 0.8: RGB(220, 237, 32), 0.9: RGB(247, 159, 20), 1: RGB(243, 57, 0)])
srf_5 = Surface(recgrid.Cells)
preview_3 = CustomPreview(Geometry=srf_5, Material=gradient_3)
tag_4 = TextTag(Location=area_2.Centroid, Text=patch_predictions, Colour=swatch_2)

# ---- group: Confidence
# ~0: Very similar
# >2 or 3: Outlier
similarity_to_dataset = Panel(inverse_prediction_smooth.similarity_score)

# 1 = High Confidence
# 0 = Low Confidence
confidence = Panel(inverse_prediction_smooth.confidence_score)

# ---- group: Optimize curvature / Target Curvature
amp_4 = Amplitude(Vector=flip_9, Amplitude=expr("x*5", flip_8))

# ----
multiplication_4 = Multiplication(A=bang.Branch0, B=curvature_2.Maximum)
# 5. Simulation
simulation_2 = Simulation(num=roundf.Rounded, num_2=roundf_2.Rounded, B_2=patch_size, B=patch_size, connect_angles=patch_predictions)  # -> L, number_slider_6, number_slider_7

# ---- group: Get differences
number_slider_20 = Slider(0, range=0..100)
vec_4 = VectorXYZ(XComponent=number_slider_20, YComponent=number_slider_20, ZComponent=0)  # -> Vector, Length
area_4 = Area(Geometry=move.Geometry)  # -> Area, Centroid
# 6. Analyse Results
move_2 = Move(Geometry=simulation_2.L, Motion=vec_4.Vector)  # -> Geometry, Transform
area_5 = Area(Geometry=move_2.Geometry)  # -> Area, Centroid
orient_2 = Orient(Geometry=move_2.Geometry, Source=area_5.Centroid, Target=area_4.Centroid)  # -> Geometry, Transform
sdivide_8 = DivideSurface(Surface=orient_2.Geometry, UCount=roundf.Rounded, VCount=roundf_2.Rounded)  # -> Points, Normals, Parameters
ptcell_3 = Cellulate(Grid=sdivide_8.Points)  # -> Wires, Cells, Meshes
mesh = Mesh(ptcell_2.Meshes)
area_6 = MeshArea(Mesh=ptcell_3.Meshes)  # -> Area, Centroid
area_7 = MeshArea(Mesh=mesh)  # -> Area, Centroid
dist_3 = Distance(PointA=area_7.Centroid, PointB=flatten(area_6.Centroid))

# ----
sdivide_9 = DivideSurface(Surface=move_2.Geometry, UCount=20, VCount=30)  # -> Points, Normals, Parameters
ptcenter_3 = CenterGrid(Grid=sdivide_9.Points)
srf_cp_2 = SurfaceClosestPoint(Point=ptcenter_3, Surface=move_2.Geometry)  # -> Point, UVPoint, Distance
curvature_3 = PrincipalCurvature(Surface=move_2.Geometry, Point=srf_cp_2.UVPoint)  # -> Frame, Maximum, Minimum, MaxDirection, MinDirection

amp_5 = Amplitude(Vector=curvature_3.MaxDirection, Amplitude=expr("x*5", curvature_3.Maximum))  # -> flatten(Vector)
vdisex_4 = VectorDisplayEx(Point=flatten(srf_cp.Point), Vector=amp_5, Colour=ColourSwatch(SwatchColor=RGB(255, 0, 247)), Width=2)

# ---- group: Display Smoothing / Middle
preview_4 = CustomPreview(Geometry=ptcenter, Material=ColourSwatch(SwatchColor=RGB(0, 17, 255)))

# ----
gradient_4 = Gradient(
    LowerLimit=Slider(0, range=0..100),
    UpperLimit=Slider(1, range=0..100),
    Parameter=dist_3,
    stops=[0: RGB(0, 128, 0), 0.5: RGB(255, 255, 0), 1: RGB(255, 0, 0)])
preview_5 = CustomPreview(Geometry=flatten(ptcell_3.Meshes), Material=flatten(gradient_4))

# ---- group: Original Surface Curvature
ptsrfdomnum_2 = SurfaceDomainNumber(Surface=srf, UNumber=roundf.Rounded, VNumber=roundf_2.Rounded)
ptcenter_4 = CenterGrid(Grid=ptsrfdomnum_2)
srf_cp_3 = SurfaceClosestPoint(Point=ptcenter_4, Surface=srf)  # -> Point, UVPoint, Distance
curvature_4 = PrincipalCurvature(Surface=srf, Point=srf_cp_3.UVPoint)  # -> Frame, flatten(Maximum), flatten(Minimum), flatten(MaxDirection), flatten(MinDirection)
swatch_3 = ColourSwatch(SwatchColor=RGB(255, 0, 0))
vdisex_5 = VectorDisplayEx(Point=flatten(srf_cp.Point), Vector=amp, Colour=swatch_3, Width=2)

# ----
multiplication_5 = Multiplication(A=curvature_4.Maximum, B=number_slider_19)
multiplication_6 = Multiplication(A=curvature_4.Minimum, B=number_slider_19)
amp_6 = Amplitude(Vector=curvature_4.MinDirection, Amplitude=multiplication_6)
amp_7 = Amplitude(Vector=curvature_4.MaxDirection, Amplitude=multiplication_5)

# ---- group: Original Surface Curvature (continued)
vdisex_6 = VectorDisplayEx(Point=flatten(srf_cp.Point), Vector=amp_7, Colour=swatch_3, Width=2)

# ---- group: Display Smoothing
pt_3 = ConstructPoint(
    XCoordinate=inverse_prediction_smooth.X_out,
    YCoordinate=inverse_prediction_smooth.Y_out,
    ZCoordinate=inverse_prediction_smooth.Z_smooth_out)
orient_3 = Orient(Geometry=ptcenter_4, Source=area.Centroid, Target=xy)  # -> Geometry, Transform
dist_4 = Distance(PointA=simplify(orient_3.Geometry), PointB=simplify(pt_3))  # -> flatten(Distance)
gradient_5 = Gradient(
    LowerLimit=Slider(0, range=0..100),
    UpperLimit=Slider(0.5, range=0..1),
    Parameter=dist_4,
    stops=[0: RGB(0, 128, 0), 0.5: RGB(255, 255, 0), 1: RGB(255, 0, 0)])
preview_6 = CustomPreview(Geometry=flatten(pt_3), Material=flatten(gradient_5))

# ---- group: Display Smoothing / OG
preview_7 = CustomPreview(Geometry=orient_3.Geometry, Material=ColourSwatch(SwatchColor=RGB(187, 255, 0)))

# ---- group: Display Smoothing / After Smoothing
preview_8 = CustomPreview(Geometry=pt_3, Material=ColourSwatch(SwatchColor=RGB(188, 153, 224)))

# ---- group: number of sample points affects the difference
target_pt = Point(ptcenter)
trim_4 = TrimTree(Tree=pt_2, Depth=1)
flip_11 = FlipMatrix(Data=target_pt)

# ----
filter = StreamFilter(Gate=input_surface_optimization, Stream0=trim_4, Stream1=sdivide_4.Points)
filter_2 = StreamFilter(Gate=input_surface_optimization, Stream0=flip_11, Stream1=sdivide_5.Points)

# ---- group: Step size 1 = no decrease
step_size = Slider(1, range=1..10)
decrease_resolution = DecreaseResolution(pt=simplify(filter), int=step_size)
decrease_resolution_2 = DecreaseResolution(pt=simplify(filter_2), int=step_size)

# ---- group: Fotran
flip_12 = FlipMatrix(Data=decrease_resolution)
flip_13 = FlipMatrix(Data=decrease_resolution_2)

# ---- group: number of sample points affects the difference (continued)
geodesic_distance = Python3Script(points1=simplify(flip_12), points2=simplify(flip_13))  # -> out, diff; inputs points1: tree of Point3d, points2: tree of Point3d
# ---------- geodesic_distance: Python ----------
# venv: geodesic-distance-matrix
# r: numpy, networkx, scipy
import rhinoscriptsyntax as rs
import numpy as np
import networkx as nx
from scipy.spatial.distance import euclidean
from Grasshopper import DataTree
from Grasshopper.Kernel.Data import GH_Path
import Rhino
import System

def normalize_surface(points: np.ndarray):
    """
    Normalize point grid to unit scale and centered at origin.
    """
    flat = points.reshape(-1, 3)
    centroid = np.mean(flat, axis=0)
    flat -= centroid
    scale = np.linalg.norm(flat, axis=1).max()
    if scale > 0:
        flat /= scale
    return flat.reshape(points.shape)


def convert_points_to_numpy(grid):
    """
    Convert a nested list of Rhino Point3d objects to a NumPy array (H, W, 3).
    """
    H = len(grid)
    W = len(grid[0]) if H > 0 else 0

    arr = np.zeros((H, W, 3), dtype=np.float64)
    for i in range(H):
        for j in range(W):
            pt = grid[i][j]
            arr[i, j] = [pt.X, pt.Y, pt.Z]
    return arr

def tree_to_nested_list(tree):
    """
    Convert a Grasshopper DataTree of Point3d or GUIDs to a nested list of [x, y, z] coordinates.
    """
    nested = []
    all_paths = list(tree.Paths)
    all_paths.sort(key=lambda p: list(p.Indices))

    for path in all_paths:
        branch = tree.Branch(path)
        row = []

        for item in branch:
            # Case 1: item is already a Point3d
            if hasattr(item, 'X') and hasattr(item, 'Y') and hasattr(item, 'Z'):
                row.append([item.X, item.Y, item.Z])

            # Case 2: item is a GUID → fetch point from document
            elif isinstance(item, System.Guid):
                obj = Rhino.RhinoDoc.ActiveDoc.Objects.Find(item)
                if obj and hasattr(obj.Geometry, "Location"):
                    pt = obj.Geometry.Location
                    row.append([pt.X, pt.Y, pt.Z])
                else:
                    raise ValueError("GUID does not reference a Point object.")
            else:
                raise TypeError("Unsupported data type in tree: " + str(type(item)))

        nested.append(row)

    return nested

def build_grid_graph(points: np.ndarray, shape: tuple):
    """
    Build a 2D grid graph from an (H, W, 3) array of 3D points.
    Edges are built between 4-connected neighbors.
    """
    H, W = shape
    G = nx.Graph()

    def idx(u, v): return u * W + v

    for i in range(H):
        for j in range(W):
            node = idx(i, j)
            G.add_node(node, pos=points[i, j])
            for di, dj in [(0, 1), (1, 0)]:  # 4-neighbors
                ni, nj = i + di, j + dj
                if 0 <= ni < H and 0 <= nj < W:
                    neighbor = idx(ni, nj)
                    dist = euclidean(points[i, j], points[ni, nj])
                    G.add_edge(node, neighbor, weight=dist)
    return G

def compute_geodesic_matrix_grid(points: np.ndarray):
    """
    Compute full geodesic distance matrix from an (H, W, 3) grid of points.
    Optionally normalizes the matrix so distances are scale-invariant.
    """
    H, W = points.shape[:2]
    G = build_grid_graph(points, (H, W))

    D = np.zeros((H*W, H*W))
    for i in range(H*W):
        lengths = nx.single_source_dijkstra_path_length(G, i)
        for j, d in lengths.items():
            D[i, j] = d

    return D

def compare_distance_matrices(D1, D2, method='mse'):
    """
    Compare two geodesic distance matrices with configurable metric.
    Supported: 'mse', 'rmse', 'frobenius', 'cosine'.
    """
    if method == 'mse':
        return np.mean((D1 - D2) ** 2)
    elif method == 'rmse':
        return np.sqrt(np.mean((D1 - D2) ** 2))
    elif method == 'frobenius':
        return np.linalg.norm(D1 - D2)
    elif method == 'fro_normed':
        return np.linalg.norm(D1 - D2) / np.sqrt(D1.size)  # RMSE equivalent
    elif method == 'cosine':
        flat1 = D1.flatten()
        flat2 = D2.flatten()
        return 1 - np.dot(flat1, flat2) / (np.linalg.norm(flat1) * np.linalg.norm(flat2))
    else:
        raise ValueError(f"Unknown comparison method: {method}")

# === MAIN ===

# Convert Grasshopper trees to nested lists
print(f"Input tree paths: {len(points1.Paths)} branches")
points1_list = tree_to_nested_list(points1)
points2_list = tree_to_nested_list(points2)

print(f"Grid shape: {len(points1_list)} rows × {len(points1_list[0])} cols")

# Convert to NumPy arrays
points1_np = np.array(points1_list, dtype=np.float64)
points2_np = np.array(points2_list, dtype=np.float64)

# Normalize Surfaces
points1_np = normalize_surface(points1_np)
points2_np = normalize_surface(points2_np)


# Compute geodesic distance matrices
print("Computing geodesic distance matrices...")
D1 = compute_geodesic_matrix_grid(points1_np)
D2 = compute_geodesic_matrix_grid(points2_np)

# Compare surfaces using Frobenius norm
diff = compare_distance_matrices(D1, D2, method='frobenius')
print(f"Geodesic distance difference: {diff:.4f}")
# ---------- end geodesic_distance ----------
panel_17 = Panel(geodesic_distance.diff)

# ---- group: number of sample points affects the difference / Check Order
points_6 = PointList(Points=flip_12)
points_7 = PointList(Points=flip_13)

# ----
intcrv_2 = Interpolate(Vertices=flip_12, Degree=3, Periodic=False, KnotStyle=1)  # -> Curve, Length, Domain
loft_2 = Loft(
    Curves=flatten(intcrv_2.Curve),
    Options={Adjust=False, Closed=False, LoftEnds=0, LoftSimp=0, LoftType=0, Rebuild=10, Refit=0.01})
preview_9 = CustomPreview(Geometry=flip_12, Material=ColourSwatch(SwatchColor=RGB(255, 77, 77)))
preview_10 = CustomPreview(Geometry=flip_13, Material=ColourSwatch(SwatchColor=RGB(77, 255, 184)))

# ---- group: Optimize curvature
amp_8 = Amplitude(Vector=vec.Vector, Amplitude=expr("x*5", bang.Branch0))
swatch_4 = ColourSwatch(SwatchColor=RGB(255, 0, 0))
swatch_5 = ColourSwatch(SwatchColor=RGB(0, 85, 255))
toggle = BooleanToggle(True)
dprod = DotProduct(VectorA=vec.Vector, VectorB=curvature_2.MaxDirection, Unitize=toggle)
number_slider_21 = Slider(1, range=0..1)

# ---- group: Optimize curvature / predicted maximum curvature
vdisex_7 = VectorDisplayEx(Point=flatten(srf_cp.Point), Vector=amp_8, Colour=swatch_4, Width=2)

# ---- group: Optimize curvature / target maximum curvature
vdisex_8 = VectorDisplayEx(Point=flatten(srf_cp.Point), Vector=flatten(amp_4), Colour=swatch_5, Width=2)

# ----
dprod_2 = DotProduct(VectorA=vec.Vector, VectorB=curvature_2.MaxDirection, Unitize=toggle)
division_5 = Division(A=dprod, B=multiplication_4)
abs_2 = Absolute(Value=dprod_2)
subtraction_2 = Subtraction(A=number_slider_21, B=dprod_2)

# ---- group: Optimize curvature (continued)
subtraction_3 = Subtraction(A=number_slider_21, B=division_5)
roundd = RoundToDecimalPlace(NumberX=subtraction_3, DecimalPlace=Slider(1, range=0..1), RoundType=0)  # -> Rounded, Difference
tag_5 = TextTag(Location=flatten(srf_cp.Point), Text=roundd.Rounded)
cosine_similarity = Panel(subtraction_3)
ma = MassAddition(Input=subtraction_2)  # -> Result, PartialResults
panel_18 = Panel(ma.Result)

# ----
abs_dot_product_minimize = Panel(subtraction_2)

# ==== cluster Simulation

# ---- group: Simulation
swatch = ColourSwatch(SwatchColor=RGBA(0, 72, 255, 179))
swatch_2 = ColourSwatch(SwatchColor=RGBA(255, 196, 0, 179))
swatch_3 = ColourSwatch(SwatchColor=RGBA(191, 194, 201, 201))
setgroup = SetGroupProperties(
    Group=["Grasshopper.Kernel.Types.GH_ObjectWrapper", "Grasshopper.Kernel.Types.GH_ObjectWrapper", "Grasshopper.Kernel.Types.GH_ObjectWrapper", "Grasshopper.Kernel.Types.GH_ObjectWrapper", "Grasshopper.Kernel.Types.GH_ObjectWrapper"],
    Color=ColourSwatch(SwatchColor=RGBA(255, 0, 153, 179)))

number_of_columns = Slider(2, range=1..10)
number_of_rows = Slider(4, range=1..10)

# ---- group: Simulation / Shrinkage Amounts
thickness = Slider(0.32, range=0.2..0.5)

# ---- group: Simulation / Basic Shape Inputs
list = ValueList({"Plate": 0, "Ribbon": 1, "Free-Form": 2}, selected="Ribbon")
list_2 = ValueList({"Pixelization": 0, "Adaptive Pattern": 1}, selected="Pixelization")
free_form_curve = Curve(<curve referenced from the Rhino model>)

# ---- group: Simulation
surface_x_size = Slider(20, range=1..100)
surface_y_size = Slider(40, range=1..101)

# ---- group: Simulation / Shrinkage Amounts
matrix_shrinkage_factor_top = Slider(0.976, range=0..1)
fiber_shrinkage_factor_top = Slider(1, range=0..1.1)

fiber_shrinkage_factor_bottom = Slider(1, range=0..1.1)
matrix_shrinkage_factor_bottom = Slider(0.977, range=0..1)

# ----
B = ClusterInput()
num = ClusterInput()
B_2 = ClusterInput()
num_2 = ClusterInput()

# ---- group: Simulation / Simulation Parameters / Fiber Factors
axialfiber = Slider(40, range=0..50)
bendingfiber = Slider(10, range=0..50)

# ---- group: Simulation / Simulation Parameters / Matrix Factors
axialmatrix = Slider(50, range=0..100)
bendingmatrix = Slider(10, range=0..50)

# ---- group: Simulation / Simulation Parameters / Web Factors
axialweb = Slider(100, range=0..1000)
bendingweb = Slider(50, range=0..50)

# ---- group: Simulation / Solver Parameters
pattern_scale = Slider(12, range=4..20)
tolerance_factor_10_x = Slider(6, range=1..20)
threshold_factor_10_x = Slider(12, range=8..20)

# ----
connect_angles = ClusterInput()

# ---- group: Simulation / Matrix Strengh
number_slider = Slider(0, range=0..100)
num_3 = Number(axialmatrix)
subtraction = Subtraction(A=num_3, B=number_slider)
addition = Addition(A=num_3, B=number_slider)
dom = ConstructDomain(DomainStart=addition, DomainEnd=subtraction)

# ---- group: Simulation / Sample Points / accuracy of sample points depends on this
number_slider_2 = Slider(10, range=0..10)

# ---- group: Simulation / Match
number_slider_3 = Slider(25, range=0..100)

# ---- group: Move
number_slider_4 = Slider(36, range=0..1000)
number_slider_5 = Slider(38, range=0..1000)

# ----
number_slider_6 = ClusterOutput(number_slider_4)
number_slider_7 = ClusterOutput(number_slider_5)

# ---- group: Simulation
# SELF-MORPHING SIMULATOR
# Insert Fiber Orientation
normal = Number()
distance = Number()
average_dot_product_of_normals = Panel(normal)
mesh = Mesh(<mesh referenced from the Rhino model>)
z_difference = Panel()
swatch_4 = ColourSwatch(SwatchColor=RGB(0, 0, 0))
chamfer_distance = Panel(distance)
num_4 = Number(num)
division = Division(A=num_4, B=B_2)
num_5 = Number(num_2)
division_2 = Division(A=num_5, B=B)
num_6 = Number(division)
num_7 = Number(division_2)
connect_angles_2 = Number(connect_angles)
circular_variance = Python3Script(angles=connect_angles_2)  # -> out, variance; inputs angles: list of Double
# ---------- circular_variance: Python ----------
import math


def circular_variance(angles):
    if not angles:
        return 0  # Handle empty list

    # Map angles to [0, 180) and double them to handle 0° = 180°
    doubled_radians = [math.radians((a % 180) * 2) for a in angles]
    
    # Calculate the sum of unit vectors
    sum_sin = sum(math.sin(r) for r in doubled_radians)
    sum_cos = sum(math.cos(r) for r in doubled_radians)
    
    # Calculate mean resultant length
    R = math.sqrt(sum_sin**2 + sum_cos**2) / len(angles)
    
    # Circular variance (0 = no variation, 1 = max variation)
    variance = 1 - R
    return variance


variance = circular_variance(angles)
# ---------- end circular_variance ----------
sqr = Square(Value=circular_variance.variance)
subtraction_2 = Subtraction(A=Slider(1, range=0..1), B=sqr)
multiplication = Multiplication(A=axialweb, B=subtraction_2)
panel = Panel(multiplication)
subtraction_3 = Subtraction(A=Slider(180, range=0..1000), B=connect_angles_2)
panel_2 = Panel(subtraction_2)
number_slider_8 = Slider(10, range=0..10)
bar_graph = BarGraph(BarColor=RGB(255, 0, 90))
bar_graph_2 = BarGraph(BarColor=RGB(255, 0, 90))
rod = Rod(LengthFactor=1, AngleFactor=1, AxialStrength=10, BendStrength=1)
_1_h = Slider(5000000, range=0..10000000)
_8_m = Slider(1000000, range=0..1000000)
_4_m = Slider(500000, range=0..1000000)
_50_s = Slider(100000, range=0..1000000)
_25_s = Slider(50000, range=0..1000000)
_10_s = Slider(20000, range=0..100000)
_5_s = Slider(10000, range=0..10000)
raise_by_power = RaiseByPower(A=threshold_factor_10_x)
raise_by_power_2 = RaiseByPower(A=tolerance_factor_10_x)

# ---- group: Simulation / Final Fiber Orientation
connect_fiber_orientation_here = Panel(connect_angles_2)
addition_2 = Addition(A=connect_fiber_orientation_here, B=Slider(90, range=0..100))
_90_to_everythin = Panel(addition_2)
num_8 = Number(connect_fiber_orientation_here)
num_9 = Number(_90_to_everythin)

# ---- group: Simulation
multiplication_2 = Multiplication(A=num_6, B=num_7)
genes = GenePool(Decimals=0, Maximum=180, Minimum=0, Value=[0, 90, 90, 90, 90, 90, 90, 90])
pool_controller = GenePoolController(GenePool=genes, Count=multiplication_2, Range=Slider(180, range=0..1000), Decimal=0, Randomness=0.1)

cluster = Cluster(
    srfxsize=num_4,
    base_shape_idx=list,
    srfysize=num_5,
    thickness=thickness,
    pattern_values_top=num_8,
    B=num_6,
    pattern_values_bottom=num_9,
    ex=num_6,
    ey=num_7,
    free_form_crv=free_form_curve,
    B_2=num_7)  # -> B_3, thickness_3, pattern_values_top_3, C, pattern_values_bottom_3
gate_cluster = GateCluster(
    G_6=list_2,
    _0_6=cluster.C,
    G=list_2,
    _0=cluster.pattern_values_top_3,
    G_2=list_2,
    _0_2=cluster.pattern_values_bottom_3,
    G_3=list_2,
    _0_3=num_7,
    G_4=list_2,
    _0_4=num_6,
    G_5=list_2,
    _0_5=cluster.B_3)  # -> s_0_6, s_0, s_0_2, s_0_3, s_0_4, s_0_5
boundry = Curve(cluster.B_3)

# ---- group: Simulation / Moves layer according to thickness
Z = UnitZ(Factor=expr("-x/2", cluster.thickness_3))
move_bottom = Move(Geometry=gate_cluster.s_0_6, Motion=Z)  # -> Geometry, Transform

# ---- group: Simulation / Top Layer Processing / Moves layer according to thickness
Z_2 = UnitZ(Factor=expr("x/2", cluster.thickness_3))
move_top = Move(Geometry=gate_cluster.s_0_6, Motion=Z_2)  # -> Geometry, Transform

# ---- group: Simulation / Sample Points / Sample Points Input
sdivide = DivideSurface(Surface=gate_cluster.s_0_5, UCount=num_4, VCount=num_5)  # -> Points, Normals, Parameters

# ---- group: Simulation / Top Layer Processing
expression = Expression(x=gate_cluster.s_0, Expression="(x+90)%180")
hatchtopfiber = GhPythonScript(
    n_rows=gate_cluster.s_0_3,
    n_cols=gate_cluster.s_0_4,
    boundaries=move_top.Geometry,
    scale=pattern_scale,
    angles=gate_cluster.s_0)  # -> out, boundary_curves, pattern, scale, angles, names, news, geos; inputs boundaries: list of Curve, angles: list
# ---------- hatchtopfiber: Python ----------
__author__ = "Yitzchak Vaknin"
__version__ = "2023.08.31"

import Rhino.Geometry as rg
import Rhino as rh
import rhinoscriptsyntax as rs
import Grasshopper as gh
import scriptcontext as sc
import inspect
import math

#hatche patterns:
hatches = ["Solid","Single Line","Double Line",
"Triple Line","Dashed Line",
"Square Grid","Triangle Grid",
"Plus Grid", "Squares"]


def listToTree(nestedList):
    """Convert a nested python iterable to a datatree."""
    dt = gh.DataTree[object]()
    for i,l in enumerate(nestedList):
        dt.AddRange(l,gh.Kernel.Data.GH_Path(i))
    return dt

def listToTree_2D(nestedList):
    """Convert a nested python iterable to a datatree."""
    dt = gh.DataTree[object]()
    for i,l in enumerate(nestedList):
        for j,val in enumerate(l):
            dt.AddRange(val,gh.Kernel.Data.GH_Path(i))
    return dt

def HatchInfo(rows, cols):
    sc.doc = rh.RhinoDoc.ActiveDoc
    pattern = 1
    hname = hatches[pattern]
    geos = list()
    news = list()
    # iterate on cells:
    for i in range(0, int(rows*cols)):
        local_boundary_curves = list()
        local_geos = list()
        new = rg.Hatch.Create(boundaries[i], pattern, math.radians(angles[i]), scale)
        news.append(new)
        for j, n in enumerate(new):
            g = rg.Hatch.CreateDisplayGeometry(n, rh.DocObjects.HatchPattern.Defaults.Hatch1, 1)
            local_geos.append(g[1])
        geos.append(local_geos)
    geos = listToTree_2D(geos)
    return boundaries, pattern, scale, angles, hname, news, geos

boundary_curves, pattern, scale, angles, names, news, geos = HatchInfo(n_rows, n_cols)
# ---------- end hatchtopfiber ----------
hatchtopmatrix = GhPythonScript(
    n_rows=gate_cluster.s_0_3,
    n_cols=gate_cluster.s_0_4,
    boundaries=move_top.Geometry,
    scale=pattern_scale,
    angles=expression)  # -> out, boundary_curves, pattern, scale, angles, names, news, geos; inputs boundaries: list of Curve, angles: list; same code as hatchtopfiber
merge = Merge(Data1=hatchtopfiber.geos, Data2=hatchtopmatrix.geos)

# ---- group: Simulation (continued)
area = Area(Geometry=hatchtopfiber.boundary_curves)  # -> Area, Centroid

# ---- group: Simulation / Bottom Layer Processing
expression_2 = Expression(x=gate_cluster.s_0_2, Expression="(x+90)%180")
hatchbotfiber = GhPythonScript(
    n_rows=gate_cluster.s_0_3,
    n_cols=gate_cluster.s_0_4,
    boundaries=move_bottom.Geometry,
    scale=pattern_scale,
    angles=expression_2)  # -> out, boundary_curves, pattern, scale, angles, names, news, geos; inputs boundaries: list of Curve, angles: list; same code as hatchtopfiber
hatchbotfiber_2 = GhPythonScript(
    n_rows=gate_cluster.s_0_3,
    n_cols=gate_cluster.s_0_4,
    boundaries=move_bottom.Geometry,
    scale=pattern_scale,
    angles=gate_cluster.s_0_2)  # -> out, boundary_curves, pattern, scale, angles, names, news, geos; inputs boundaries: list of Curve, angles: list; same code as hatchtopfiber
merge_2 = Merge(Data1=hatchbotfiber_2.geos, Data2=hatchbotfiber.geos)

# ---- group: Simulation / Frame Intersection
explode = Explode(Curve=simplify(graft(hatchtopfiber.boundary_curves)), Recursive=True)  # -> flatten(Segments), Vertices
python = GhPythonScript(boundary_lines=explode.Segments)  # -> filtered_boundaries; inputs boundary_lines: list of Curve
# ---------- python: Python ----------
__author__ = "Yitzchak Vaknin"
__version__ = "2023.02.26"

import rhinoscriptsyntax as rs

def filter_duplicate_boundaries(boundary_lines):
    filtered_boundaries = dict()
    for j, frame_line in enumerate(boundary_lines):
        edges = [rs.CurveStartPoint(frame_line), rs.CurveEndPoint(frame_line)]
        sorted_edges = sorted(edges, key=lambda x: (x[0], x[1]))
        frame_key = str(sorted_edges[0]) + "_" + str(sorted_edges[1])
#        print("frame line number {}, {}".format(j, frame_key))
        if frame_key not in filtered_boundaries:
            filtered_boundaries[frame_key] = frame_line
    return list(filtered_boundaries.values())

filtered_boundaries = filter_duplicate_boundaries(boundary_lines)
# ---------- end python ----------
python_2 = GhPythonScript(boundaries=python, pattern_lines=flatten(merge))  # -> intersection_pts; inputs boundaries: list of Curve, pattern_lines: list of Curve
# ---------- python_2: Python ----------
__author__ = "Yitzchak Vaknin"
__version__ = "2023.02.11"

import rhinoscriptsyntax as rs
import Grasshopper as gh

def listToTree(nestedList):
    """Convert a nested python iterable to a datatree."""
    dt = gh.DataTree[object]()
    for i,l in enumerate(nestedList):
        dt.AddRange(l,gh.Kernel.Data.GH_Path(i))
    return dt

def listToTree_2D(nestedList):
    """Convert a nested python iterable to a datatree."""
    dt = gh.DataTree[object]()
    for i,l in enumerate(nestedList):
        for j,val in enumerate(l):
            dt.AddRange(val,gh.Kernel.Data.GH_Path(i))
    return dt

def ccx_old(boundary, pattern_lines):
#    boundary_ctrl_pts = rs.CurvePoints(boundary)
    splited_lines = rs.ExplodeCurves(boundary)
    intersection_pts = list()
    for j, frame_line in enumerate(splited_lines):
        print("frame line number {}, {}".format(j, frame_line))
        local_intersection_pts = list()
        start = rs.CurveStartPoint(frame_line)
        local_intersection_pts.append(start)
        for i, pattern_line in enumerate(pattern_lines):
            print("pattern line number {}, {}".format(i, pattern_line))
            intersection_list = rs.CurveCurveIntersection(frame_line, pattern_line)
            if intersection_list is None:
                print "Selected curves do not intersect."
            else:
                for intersection in intersection_list:
                    local_intersection_pts.append(intersection[1])
                    if intersection[0] == 1:
                        print "Point"
                        print "Intersection point on first curve: ", intersection[1]
                        print "Intersection point on second curve: ", intersection[3]
                        print "First curve parameter: ", intersection[5]
                        print "Second curve parameter: ", intersection[7]
                    else:
                        print "Overlap"
                        print "Intersection start point on first curve: ", intersection[1]
                        print "Intersection end point on first curve: ", intersection[2]
                        print "Intersection start point on second curve: ", intersection[3]
                        print "Intersection end point on second curve: ", intersection[4]
                        print "First curve parameter range: ", intersection[5], " to ", intersection[6]
                        print "Second curve parameter range: ", intersection[7], " to ", intersection[8]
        intersection_pts.append(local_intersection_pts)
    return intersection_pts
#    return intersection_pts, splited_lines

def ccx_test(boundary, pattern_lines):
    intersection_pts = list()
    for j, frame_line in enumerate(boundary):
#        print("frame line number {}, {}".format(j, frame_line))
        local_intersection_pts = list()
        start = rs.CurveStartPoint(frame_line)
        local_intersection_pts.append(start)
        for i, pattern_line in enumerate(pattern_lines):
#            print("pattern line number {}, {}".format(i, pattern_line))
            intersection_list = rs.CurveCurveIntersection(frame_line, pattern_line)
            if intersection_list is None:
                x = 1
#                print "Selected curves do not intersect."
            else:
                for intersection in intersection_list:
                    local_intersection_pts.append(intersection[1])
#                    if intersection[0] == 1:
#                        print "Point"
#                        print "Intersection point on first curve: ", intersection[1]
#                        print "Intersection point on second curve: ", intersection[3]
#                        print "First curve parameter: ", intersection[5]
#                        print "Second curve parameter: ", intersection[7]
#                    else:
#                        print "Overlap"
#                        print "Intersection start point on first curve: ", intersection[1]
#                        print "Intersection end point on first curve: ", intersection[2]
#                        print "Intersection start point on second curve: ", intersection[3]
#                        print "Intersection end point on second curve: ", intersection[4]
#                        print "First curve parameter range: ", intersection[5], " to ", intersection[6]
#                        print "Second curve parameter range: ", intersection[7], " to ", intersection[8]
        intersection_pts.append(local_intersection_pts)
    return intersection_pts

def ccx(boundary_lines, pattern_lines):
    intersection_pts = dict()
    for j, frame_line in enumerate(boundary_lines):
        frame_key = str(rs.CurveStartPoint(frame_line)) + "_" + str(rs.CurveEndPoint(frame_line))
        print("frame line number {}, {}".format(j, frame_key))
        local_intersection_pts = list()
#        start = rs.CurveStartPoint(frame_line)
        local_intersection_pts.append(start)
        for i, pattern_line in enumerate(pattern_lines):
#            print("pattern line number {}, {}".format(i, pattern_line))
            intersection_list = rs.CurveCurveIntersection(frame_line, pattern_line)
            if intersection_list is None:
                print "Selected curves do not intersect."
            else:
                for intersection in intersection_list:
                    local_intersection_pts.append(intersection[1])
                    if intersection[0] == 1:
                        print "Point"
                        print "Intersection point on first curve: ", intersection[1]
                        print "Intersection point on second curve: ", intersection[3]
                        print "First curve parameter: ", intersection[5]
                        print "Second curve parameter: ", intersection[7]
                    else:
                        print "Overlap"
                        print "Intersection start point on first curve: ", intersection[1]
                        print "Intersection end point on first curve: ", intersection[2]
                        print "Intersection start point on second curve: ", intersection[3]
                        print "Intersection end point on second curve: ", intersection[4]
                        print "First curve parameter range: ", intersection[5], " to ", intersection[6]
                        print "Second curve parameter range: ", intersection[7], " to ", intersection[8]
        intersection_pts.append(local_intersection_pts)
    return intersection_pts

intersection_pts = listToTree(ccx_test(boundaries, pattern_lines))
# ---------- end python_2 ----------

# ---- group: Simulation / Zipper
explode_2 = Explode(Curve=simplify(graft(hatchbotfiber_2.boundary_curves)), Recursive=True)  # -> flatten(Segments), Vertices
python_3 = GhPythonScript(boundary_lines=explode_2.Segments)  # -> filtered_boundaries; inputs boundary_lines: list of Curve; same code as python
python_4 = GhPythonScript(boundaries=python_3, pattern_lines=flatten(merge_2))  # -> intersection_pts; inputs boundaries: list of Curve, pattern_lines: list of Curve; same code as python_2

# ---- group: Simulation / Fiber-Matrix Intersection
python_5 = GhPythonScript(fiber_lines=hatchtopfiber.geos, matrix_lines=hatchtopmatrix.geos)  # -> fiber_intersection_pts, matrix_intersection_pts; inputs fiber_lines: list of Curve, matrix_lines: list of Curve
# ---------- python_5: Python ----------
__author__ = "Yitzchak Vaknin"
__version__ = "2023.02.11"

import rhinoscriptsyntax as rs
import Grasshopper as gh
import copy
import ghpythonlib.treehelpers as th

def listToTree(nestedList):
    """Convert a nested python iterable to a datatree."""
    dt = gh.DataTree[object]()
    for i,l in enumerate(nestedList):
        dt.AddRange(l,gh.Kernel.Data.GH_Path(i))
    return dt

def listToTree_2D(nestedList):
    """Convert a nested python iterable to a datatree."""
    dt = gh.DataTree[object]()
    for i,l in enumerate(nestedList):
        print(i)
        for j,val in enumerate(l):
            dt.AddRange(val, gh.Kernel.Data.GH_Path(i, j))
    return dt

def ccx_matrix(fiber_lines, matrix_lines):
    intersection_pts_cycle = list()
    intersection_pts = list()
    for j, matrix_line in enumerate(matrix_lines):
        curve_intersection_pts = list()
        for i, fiber_line in enumerate(fiber_lines):
            intersection_list = rs.CurveCurveIntersection(matrix_line, fiber_line)
            if intersection_list is None:
                x = 1
            else:
                for intersection in intersection_list:
                    curve_intersection_pts.append(intersection[1])
        intersection_pts.append(curve_intersection_pts)
    intersection_pts_cycle.append(copy.copy(intersection_pts))
    for _ in range(len(intersection_pts)):
        intersection_pts.pop(0)
    return intersection_pts_cycle[0]

def ccx_fiber(fiber_lines, matrix_lines):
    intersection_pts_cycle = list()
    intersection_pts = list()
    for i, fiber_line in enumerate(fiber_lines):
        curve_intersection_pts = list()
        for j, matrix_line in enumerate(matrix_lines):
            intersection_list = rs.CurveCurveIntersection(matrix_line, fiber_line)
            if intersection_list is None:
                x = 1
            else:
                for intersection in intersection_list:
                    curve_intersection_pts.append(intersection[1])
        intersection_pts.append(curve_intersection_pts)
    intersection_pts_cycle.append(copy.copy(intersection_pts))
    for _ in range(len(intersection_pts)):
        intersection_pts.pop(0)
    return intersection_pts_cycle[0]
#intersection_pts = th.list_to_tree(ccx_matrix(fiber_lines, matrix_lines)[0])
#th.list_to_tree()
#print(len(intersection_pts[0]))
fiber_intersection_pts = ccx_fiber(fiber_lines, matrix_lines)
matrix_intersection_pts = ccx_matrix(fiber_lines, matrix_lines)
# ---------- end python_5 ----------
graft = GraftTree(Tree=hatchtopmatrix.geos, IncludeEmptyLists=True, IncludeNullItems=True)
c_script = CSharpScript(x=python_5.matrix_intersection_pts)  # -> A
# ---------- c_script: C# ----------
    A = x;
# ---------- end c_script ----------
graft_2 = GraftTree(Tree=hatchtopfiber.geos, IncludeEmptyLists=True, IncludeNullItems=True)
c_script_2 = CSharpScript(x=python_5.fiber_intersection_pts)  # -> A; same code as c_script
crv_cp = CurveClosestPoint(Point=c_script, Curve=graft)  # -> Point, Parameter, Distance
crv_cp_2 = CurveClosestPoint(Point=c_script_2, Curve=graft_2)  # -> Point, Parameter, Distance
shatter = Shatter(Curve=graft, Parameters=crv_cp.Parameter)  # -> simplify(Segments)
shatter_2 = Shatter(Curve=graft_2, Parameters=crv_cp_2.Parameter)  # -> simplify(Segments)

# ---- group: Simulation / Bottom Layer Processing / Fiber-Matrix Intersection
python_6 = GhPythonScript(fiber_lines=hatchbotfiber_2.geos, matrix_lines=hatchbotfiber.geos)  # -> fiber_intersection_pts, matrix_intersection_pts; inputs fiber_lines: list of Curve, matrix_lines: list of Curve; same code as python_5
graft_3 = GraftTree(Tree=hatchbotfiber.geos, IncludeEmptyLists=True, IncludeNullItems=True)
c_script_3 = CSharpScript(x=python_6.matrix_intersection_pts)  # -> A; same code as c_script
graft_4 = GraftTree(Tree=hatchbotfiber_2.geos, IncludeEmptyLists=True, IncludeNullItems=True)
c_script_4 = CSharpScript(x=python_6.fiber_intersection_pts)  # -> A; same code as c_script
crv_cp_3 = CurveClosestPoint(Point=c_script_3, Curve=graft_3)  # -> Point, Parameter, Distance
crv_cp_4 = CurveClosestPoint(Point=c_script_4, Curve=graft_4)  # -> Point, Parameter, Distance
shatter_3 = Shatter(Curve=graft_3, Parameters=crv_cp_3.Parameter)  # -> simplify(Segments)
shatter_4 = Shatter(Curve=graft_4, Parameters=crv_cp_4.Parameter)  # -> simplify(Segments)

# ---- group: Simulation / Middle Mesh
removeduplicatepoints = GhPythonScript(x=flatten(python_2))  # -> pts; inputs x: list of Point3d
# ---------- removeduplicatepoints: Python ----------
__author__ = "Yitzchak Vaknin"
__version__ = "2023.09.10"

import rhinoscriptsyntax as rs

def filter_duplicate_points(pts_lst):
    filtered_pts = dict()
    for i, pt in enumerate(pts_lst):
        pt_key = str(pt[0]) + "_" + str(pt[1]) + "_" + str(pt[2])
        if pt_key not in filtered_pts:
            filtered_pts[pt_key] = pt
    return list(filtered_pts.values())

pts = filter_duplicate_points(x)
# ---------- end removeduplicatepoints ----------
removeduplicatepoints_2 = GhPythonScript(x=flatten(python_4))  # -> pts; inputs x: list of Point3d; same code as removeduplicatepoints
pt = Point(flatten([removeduplicatepoints, crv_cp_2.Point]))
pt_2 = Point(flatten([removeduplicatepoints_2, crv_cp_4.Point]))
cps = ClosestPoints(Point=flatten(pt_2), Cloud=flatten(pt), Count=Slider(10, range=0..10))  # -> simplify(ClosestPoint), CPIndex, Distance
ln = Line(StartPoint=simplify(graft(pt_2)), EndPoint=cps.ClosestPoint)  # -> flatten(Line)

# ---- group: Simulation / Sample Points
srf_cp = SurfaceClosestPoint(Point=sdivide.Points, Surface=cluster.B_3)  # -> Point, UVPoint, Distance
pt_3 = Point([pt, pt_2])
cps_2 = ClosestPoints(Point=flatten(sdivide.Points), Cloud=flatten(pt_3), Count=number_slider_2)  # -> simplify(ClosestPoint), CPIndex, Distance
ln_2 = Line(StartPoint=simplify(graft(sdivide.Points)), EndPoint=cps_2.ClosestPoint)
rodbotzipper = Rod(
    Polyline=ln_2,
    LengthFactor=1,
    AngleFactor=1,
    AxialStrength=Slider(0.001, range=0..1),
    BendStrength=Slider(0.001, range=0..50))

# ---- group: Simulation / Floor
scale = Scale(Geometry=gate_cluster.s_0_5, Center=Point(0, 0, 0), Factor=Slider(2, range=-10..10))  # -> Geometry, Transform
dom_2 = ConstructDomain(DomainStart=Slider(-10, range=-10..10), DomainEnd=Slider(0, range=-10..10))
merge_3 = Merge(Data1=crv_cp_2.Point, Data2=crv_cp.Point, Data3=cps.ClosestPoint, Data4=pt, Data5=crv_cp_4.Point, Data6=crv_cp_3.Point)  # -> flatten(Result)
boxrec = BoxRectangle(Rectangle=scale.Geometry, Height=dom_2)
duppt = RemoveDuplicatePts(Points=merge_3, Tolerance=0.01)
box_corners = BoxCorners(Box=boxrec)  # -> CornerA, CornerB, CornerC, CornerD, CornerE, CornerF, CornerG, CornerH
merge_4 = Merge(Data1=box_corners.CornerE, Data2=box_corners.CornerF, Data3=box_corners.CornerG, Data4=box_corners.CornerH)
anchor = Anchor(Point=merge_4, Strength=Slider(100000000, range=0..100000000))
spc = SolidPointCollide(Points=duppt, Solid=boxrec, Interior=False, Unidirectional=True, Strength=1)

# ---- group: Simulation / Gravity
Z_3 = UnitZ(Factor=Slider(0.0001, range=0..1))
rev = Reverse(Vector=Z_3)
load = Load(Point=duppt, ForceVector=rev, Weighting=1)

# ---- group: Simulation / Web Strengh
number_slider_9 = Slider(100, range=0..200)
num_10 = Number(axialweb)
subtraction_4 = Subtraction(A=num_10, B=number_slider_9)
addition_3 = Addition(A=num_10, B=number_slider_9)

# ---- group: Simulation (continued)
clip_1 = Python3Script(d1=subtraction_4, d2=addition_3)  # -> out, d1, d2; inputs d1: Int32, d2: Int32
# ---------- clip_1: Python ----------
"""Grasshopper Script"""
a = "Hello Python 3 in Grasshopper!"
print(a)
if d1 < 1:
    d1 = 1
    print("d1 = 1")

if d2 < 1:
    d2 = 1
    print("d2 = 1")
# ---------- end clip_1 ----------
mat_bot = Curve(shatter_3)
mat_top = Curve(shatter)

# ---- group: Simulation / Web Strengh (continued)
dom_3 = ConstructDomain(DomainStart=clip_1.d1, DomainEnd=clip_1.d2)

# ---- group: Simulation / Mat Strength
map_shrinkage = MapShrinkage(curve=mat_top, curve_2=boundry, target=dom)

# ---- group: Simulation / Mat Strengh
map_shrinkage_2 = MapShrinkage(curve=mat_bot, curve_2=boundry, target=dom)

# ---- group: Simulation / Web Strengh
map_shrinkage_3 = MapShrinkage(curve=ln, curve_2=boundry, target=dom_3)

# ---- group: Simulation (continued)
bar_graph_3 = BarGraph(map_shrinkage, BarColor=RGB(255, 0, 90))

# ---- group: Simulation / Domains
number_slider_10 = Slider(0, range=0..0.1)
num_11 = Number(matrix_shrinkage_factor_bottom)
num_12 = Number(matrix_shrinkage_factor_top)
subtraction_5 = Subtraction(A=num_12, B=number_slider_10)
addition_4 = Addition(A=num_12, B=number_slider_10)
dom_4 = ConstructDomain(DomainStart=subtraction_5, DomainEnd=addition_4)

subtraction_6 = Subtraction(A=num_11, B=number_slider_10)
addition_5 = Addition(A=num_11, B=number_slider_10)

dom_5 = ConstructDomain(DomainStart=subtraction_6, DomainEnd=addition_5)

# ---- group: Simulation / Mat Shrinkage
map_shrinkage_4 = MapShrinkage(curve=mat_top, curve_2=boundry, target=dom_4)

map_shrinkage_5 = MapShrinkage(curve=mat_bot, curve_2=boundry, target=dom_5)

# ---- group: Simulation / Top
rodtopfiber = Rod(
    Polyline=shatter_2,
    LengthFactor=fiber_shrinkage_factor_top,
    AngleFactor=1,
    AxialStrength=axialfiber,
    BendStrength=bendingfiber)
rodtopmatrix = Rod(Polyline=shatter, LengthFactor=map_shrinkage_4, AngleFactor=1, AxialStrength=map_shrinkage, BendStrength=bendingmatrix)

# ---- group: Simulation / Bottom
rodbottomfiber = Rod(
    Polyline=shatter_4,
    LengthFactor=fiber_shrinkage_factor_bottom,
    AngleFactor=1,
    AxialStrength=axialfiber,
    BendStrength=bendingfiber)
rodbottommatrix = Rod(
    Polyline=shatter_3,
    LengthFactor=map_shrinkage_5,
    AngleFactor=1,
    AxialStrength=map_shrinkage_2,
    BendStrength=bendingmatrix)

# ---- group: Simulation
rodtoptobot = Rod(Polyline=ln, LengthFactor=1, AngleFactor=1, AxialStrength=map_shrinkage_3, BendStrength=bendingweb)
entwine = Entwine(
    Branch00=rodtopfiber,
    Branch01=rodtopmatrix,
    Branch02=rodtoptobot,
    Branch03=rodbottomfiber,
    Branch04=rodbottommatrix,
    Branch05=rodbotzipper,
    Branch06=graft(spc),
    Branch07=anchor,
    Branch08=load,
    FlattenInputs=True)

panel_3 = Panel(map_shrinkage_5)
zombiesolver = ZombieSolver(GoalObjects=entwine, Threshold=raise_by_power, Tolerance=raise_by_power_2, MaxIterations=_8_m)  # -> I, V, O
geo = Geometry(zombiesolver.O)
panel_4 = Panel(zombiesolver.I)
unflatten = UnflattenTree(Tree=geo, Guide=entwine)
bang = ExplodeTree(Data=unflatten)  # -> Branch0, Branch1, Branch2, Branch3, Branch4, Branch5, Branch6, Branch7, Branch8
data = Data(bang.Branch1)
data_2 = Data(bang.Branch2)
data_3 = Data(bang.Branch4)
data_4 = Data(bang.Branch0)
data_5 = Data(bang.Branch3)

# ---- group: Simulation / Get Sample Points
unflatten_2 = UnflattenTree(Tree=bang.Branch5, Guide=rodbotzipper)
trim = TrimTree(Tree=unflatten_2, Depth=1)
item = ListItem(List=trim, Index=0, Wrap=True)  # -> flatten(Item)
end = EndPoints(Curve=item)  # -> Start, End
sample_points = Data(end.Start)

# ---- group: Simulation / Mesh total z difference
pdecon = Deconstruct(Point=sample_points)  # -> XComponent, YComponent, ZComponent
sort = SortList(Keys=pdecon.ZComponent)  # -> Keys, ValuesA
lng = ListLength(List=sort.Keys)
item_2 = ListItem(List=sort.Keys, Index=expr("x-1", lng), Wrap=True)
item_3 = ListItem(List=sort.Keys, Index=0, Wrap=True)
subtraction_7 = Subtraction(A=item_2, B=item_3)
panel_5 = Panel(subtraction_7)

# ---- group: Simulation (continued)
height = Panel(panel_5)
division_3 = Division(A=z_difference, B=subtraction_7)
percantage_of_z = Panel(division_3)

# ---- group: Simulation / Lofted Surface
partition = PartitionList(List=flatten(sample_points), Size=expr("x+1", num_5))
intcrv = Interpolate(Vertices=partition, Degree=4, Periodic=False, KnotStyle=1)  # -> flatten(Curve), Length, Domain
loft = Loft(Curves=intcrv.Curve, Options={Adjust=False, Closed=False, LoftEnds=0, LoftSimp=0, LoftType=0, Rebuild=10, Refit=0.01})

# ----
L = ClusterOutput(loft)

# ==== cluster Simulation_2

# ---- group: Simulation
swatch = ColourSwatch(SwatchColor=RGBA(0, 72, 255, 179))
swatch_2 = ColourSwatch(SwatchColor=RGBA(255, 196, 0, 179))
swatch_3 = ColourSwatch(SwatchColor=RGBA(191, 194, 201, 201))
setgroup = SetGroupProperties(
    Group=["Grasshopper.Kernel.Types.GH_ObjectWrapper", "Grasshopper.Kernel.Types.GH_ObjectWrapper", "Grasshopper.Kernel.Types.GH_ObjectWrapper", "Grasshopper.Kernel.Types.GH_ObjectWrapper", "Grasshopper.Kernel.Types.GH_ObjectWrapper"],
    Color=ColourSwatch(SwatchColor=RGBA(255, 0, 153, 179)))

number_of_columns = Slider(2, range=1..10)
number_of_rows = Slider(4, range=1..10)

# ---- group: Simulation / Shrinkage Amounts
thickness = Slider(0.32, range=0.2..0.5)

# ---- group: Simulation / Basic Shape Inputs
list = ValueList({"Plate": 0, "Ribbon": 1, "Free-Form": 2}, selected="Ribbon")
list_2 = ValueList({"Pixelization": 0, "Adaptive Pattern": 1}, selected="Pixelization")
free_form_curve = Curve(<curve referenced from the Rhino model>)

# ---- group: Simulation
surface_x_size = Slider(20, range=1..100)
surface_y_size = Slider(40, range=1..101)

# ---- group: Simulation / Shrinkage Amounts
matrix_shrinkage_factor_top = Slider(0.976, range=0..1)
fiber_shrinkage_factor_top = Slider(1, range=0..1.1)

fiber_shrinkage_factor_bottom = Slider(1, range=0..1.1)
matrix_shrinkage_factor_bottom = Slider(0.977, range=0..1)

# ----
B = ClusterInput()
num = ClusterInput()
B_2 = ClusterInput()
num_2 = ClusterInput()

# ---- group: Simulation / Simulation Parameters / Fiber Factors
axialfiber = Slider(40, range=0..50)
bendingfiber = Slider(10, range=0..50)

# ---- group: Simulation / Simulation Parameters / Matrix Factors
axialmatrix = Slider(50, range=0..100)
bendingmatrix = Slider(10, range=0..50)

# ---- group: Simulation / Simulation Parameters / Web Factors
axialweb = Slider(100, range=0..1000)
bendingweb = Slider(50, range=0..50)

# ---- group: Simulation / Solver Parameters
pattern_scale = Slider(12, range=4..20)
tolerance_factor_10_x = Slider(6, range=1..20)
threshold_factor_10_x = Slider(12, range=8..20)

# ----
connect_angles = ClusterInput()

# ---- group: Simulation / Matrix Strengh
number_slider = Slider(0, range=0..100)
num_3 = Number(axialmatrix)
subtraction = Subtraction(A=num_3, B=number_slider)
addition = Addition(A=num_3, B=number_slider)
dom = ConstructDomain(DomainStart=addition, DomainEnd=subtraction)

# ---- group: Simulation / Sample Points / accuracy of sample points depends on this
number_slider_2 = Slider(10, range=0..10)

# ---- group: Simulation / Match
number_slider_3 = Slider(25, range=0..100)

# ---- group: Move
number_slider_4 = Slider(36, range=0..1000)
number_slider_5 = Slider(38, range=0..1000)

# ----
number_slider_6 = ClusterOutput(number_slider_4)
number_slider_7 = ClusterOutput(number_slider_5)

# ---- group: Simulation
# SELF-MORPHING SIMULATOR
# Insert Fiber Orientation
normal = Number()
distance = Number()
average_dot_product_of_normals = Panel(normal)
mesh = Mesh(<mesh referenced from the Rhino model>)
z_difference = Panel()
swatch_4 = ColourSwatch(SwatchColor=RGB(0, 0, 0))
chamfer_distance = Panel(distance)
num_4 = Number(num)
division = Division(A=num_4, B=B_2)
num_5 = Number(num_2)
division_2 = Division(A=num_5, B=B)
num_6 = Number(division)
num_7 = Number(division_2)
connect_angles_2 = Number(connect_angles)
circular_variance = Python3Script(angles=connect_angles_2)  # -> out, variance; inputs angles: list of Double; same code as circular_variance
sqr = Square(Value=circular_variance.variance)
subtraction_2 = Subtraction(A=Slider(1, range=0..1), B=sqr)
multiplication = Multiplication(A=axialweb, B=subtraction_2)
panel = Panel(multiplication)
subtraction_3 = Subtraction(A=Slider(180, range=0..1000), B=connect_angles_2)
panel_2 = Panel(subtraction_2)
number_slider_8 = Slider(10, range=0..10)
bar_graph = BarGraph(BarColor=RGB(255, 0, 90))
bar_graph_2 = BarGraph(BarColor=RGB(255, 0, 90))
rod = Rod(LengthFactor=1, AngleFactor=1, AxialStrength=10, BendStrength=1)
_1_h = Slider(5000000, range=0..10000000)
_8_m = Slider(1000000, range=0..1000000)
_4_m = Slider(500000, range=0..1000000)
_50_s = Slider(100000, range=0..1000000)
_25_s = Slider(50000, range=0..1000000)
_10_s = Slider(20000, range=0..100000)
_5_s = Slider(10000, range=0..10000)
raise_by_power = RaiseByPower(A=threshold_factor_10_x)
raise_by_power_2 = RaiseByPower(A=tolerance_factor_10_x)

# ---- group: Simulation / Final Fiber Orientation
connect_fiber_orientation_here = Panel(connect_angles_2)
addition_2 = Addition(A=connect_fiber_orientation_here, B=Slider(90, range=0..100))
_90_to_everythin = Panel(addition_2)
num_8 = Number(connect_fiber_orientation_here)
num_9 = Number(_90_to_everythin)

# ---- group: Simulation
multiplication_2 = Multiplication(A=num_6, B=num_7)
genes = GenePool(Decimals=0, Maximum=180, Minimum=0, Value=[0, 90, 90, 90, 90, 90])
pool_controller = GenePoolController(GenePool=genes, Count=multiplication_2, Range=Slider(180, range=0..1000), Decimal=0, Randomness=0.1)

cluster = Cluster(
    srfxsize=num_4,
    base_shape_idx=list,
    srfysize=num_5,
    thickness=thickness,
    pattern_values_top=num_8,
    B=num_6,
    pattern_values_bottom=num_9,
    ex=num_6,
    ey=num_7,
    free_form_crv=free_form_curve,
    B_2=num_7)  # -> B_3, thickness_3, pattern_values_top_3, C, pattern_values_bottom_3
gate_cluster = GateCluster(
    G_6=list_2,
    _0_6=cluster.C,
    G=list_2,
    _0=cluster.pattern_values_top_3,
    G_2=list_2,
    _0_2=cluster.pattern_values_bottom_3,
    G_3=list_2,
    _0_3=num_7,
    G_4=list_2,
    _0_4=num_6,
    G_5=list_2,
    _0_5=cluster.B_3)  # -> s_0_6, s_0, s_0_2, s_0_3, s_0_4, s_0_5
boundry = Curve(cluster.B_3)

# ---- group: Simulation / Moves layer according to thickness
Z = UnitZ(Factor=expr("-x/2", cluster.thickness_3))
move_bottom = Move(Geometry=gate_cluster.s_0_6, Motion=Z)  # -> Geometry, Transform

# ---- group: Simulation / Top Layer Processing / Moves layer according to thickness
Z_2 = UnitZ(Factor=expr("x/2", cluster.thickness_3))
move_top = Move(Geometry=gate_cluster.s_0_6, Motion=Z_2)  # -> Geometry, Transform

# ---- group: Simulation / Sample Points / Sample Points Input
sdivide = DivideSurface(Surface=gate_cluster.s_0_5, UCount=num_4, VCount=num_5)  # -> Points, Normals, Parameters

# ---- group: Simulation / Top Layer Processing
expression = Expression(x=gate_cluster.s_0, Expression="(x+90)%180")
hatchtopfiber = GhPythonScript(
    n_rows=gate_cluster.s_0_3,
    n_cols=gate_cluster.s_0_4,
    boundaries=move_top.Geometry,
    scale=pattern_scale,
    angles=gate_cluster.s_0)  # -> out, boundary_curves, pattern, scale, angles, names, news, geos; inputs boundaries: list of Curve, angles: list; same code as hatchtopfiber
hatchtopmatrix = GhPythonScript(
    n_rows=gate_cluster.s_0_3,
    n_cols=gate_cluster.s_0_4,
    boundaries=move_top.Geometry,
    scale=pattern_scale,
    angles=expression)  # -> out, boundary_curves, pattern, scale, angles, names, news, geos; inputs boundaries: list of Curve, angles: list; same code as hatchtopfiber
merge = Merge(Data1=hatchtopfiber.geos, Data2=hatchtopmatrix.geos)

# ---- group: Simulation (continued)
area = Area(Geometry=hatchtopfiber.boundary_curves)  # -> Area, Centroid

# ---- group: Simulation / Bottom Layer Processing
expression_2 = Expression(x=gate_cluster.s_0_2, Expression="(x+90)%180")
hatchbotfiber = GhPythonScript(
    n_rows=gate_cluster.s_0_3,
    n_cols=gate_cluster.s_0_4,
    boundaries=move_bottom.Geometry,
    scale=pattern_scale,
    angles=expression_2)  # -> out, boundary_curves, pattern, scale, angles, names, news, geos; inputs boundaries: list of Curve, angles: list; same code as hatchtopfiber
hatchbotfiber_2 = GhPythonScript(
    n_rows=gate_cluster.s_0_3,
    n_cols=gate_cluster.s_0_4,
    boundaries=move_bottom.Geometry,
    scale=pattern_scale,
    angles=gate_cluster.s_0_2)  # -> out, boundary_curves, pattern, scale, angles, names, news, geos; inputs boundaries: list of Curve, angles: list; same code as hatchtopfiber
merge_2 = Merge(Data1=hatchbotfiber_2.geos, Data2=hatchbotfiber.geos)

# ---- group: Simulation / Frame Intersection
explode = Explode(Curve=simplify(graft(hatchtopfiber.boundary_curves)), Recursive=True)  # -> flatten(Segments), Vertices
python = GhPythonScript(boundary_lines=explode.Segments)  # -> filtered_boundaries; inputs boundary_lines: list of Curve; same code as python
python_2 = GhPythonScript(boundaries=python, pattern_lines=flatten(merge))  # -> intersection_pts; inputs boundaries: list of Curve, pattern_lines: list of Curve; same code as python_2

# ---- group: Simulation / Zipper
explode_2 = Explode(Curve=simplify(graft(hatchbotfiber_2.boundary_curves)), Recursive=True)  # -> flatten(Segments), Vertices
python_3 = GhPythonScript(boundary_lines=explode_2.Segments)  # -> filtered_boundaries; inputs boundary_lines: list of Curve; same code as python
python_4 = GhPythonScript(boundaries=python_3, pattern_lines=flatten(merge_2))  # -> intersection_pts; inputs boundaries: list of Curve, pattern_lines: list of Curve; same code as python_2

# ---- group: Simulation / Fiber-Matrix Intersection
python_5 = GhPythonScript(fiber_lines=hatchtopfiber.geos, matrix_lines=hatchtopmatrix.geos)  # -> fiber_intersection_pts, matrix_intersection_pts; inputs fiber_lines: list of Curve, matrix_lines: list of Curve; same code as python_5
graft = GraftTree(Tree=hatchtopmatrix.geos, IncludeEmptyLists=True, IncludeNullItems=True)
c_script = CSharpScript(x=python_5.matrix_intersection_pts)  # -> A; same code as c_script
graft_2 = GraftTree(Tree=hatchtopfiber.geos, IncludeEmptyLists=True, IncludeNullItems=True)
c_script_2 = CSharpScript(x=python_5.fiber_intersection_pts)  # -> A; same code as c_script
crv_cp = CurveClosestPoint(Point=c_script, Curve=graft)  # -> Point, Parameter, Distance
crv_cp_2 = CurveClosestPoint(Point=c_script_2, Curve=graft_2)  # -> Point, Parameter, Distance
shatter = Shatter(Curve=graft, Parameters=crv_cp.Parameter)  # -> simplify(Segments)
shatter_2 = Shatter(Curve=graft_2, Parameters=crv_cp_2.Parameter)  # -> simplify(Segments)

# ---- group: Simulation / Bottom Layer Processing / Fiber-Matrix Intersection
python_6 = GhPythonScript(fiber_lines=hatchbotfiber_2.geos, matrix_lines=hatchbotfiber.geos)  # -> fiber_intersection_pts, matrix_intersection_pts; inputs fiber_lines: list of Curve, matrix_lines: list of Curve; same code as python_5
graft_3 = GraftTree(Tree=hatchbotfiber.geos, IncludeEmptyLists=True, IncludeNullItems=True)
c_script_3 = CSharpScript(x=python_6.matrix_intersection_pts)  # -> A; same code as c_script
graft_4 = GraftTree(Tree=hatchbotfiber_2.geos, IncludeEmptyLists=True, IncludeNullItems=True)
c_script_4 = CSharpScript(x=python_6.fiber_intersection_pts)  # -> A; same code as c_script
crv_cp_3 = CurveClosestPoint(Point=c_script_3, Curve=graft_3)  # -> Point, Parameter, Distance
crv_cp_4 = CurveClosestPoint(Point=c_script_4, Curve=graft_4)  # -> Point, Parameter, Distance
shatter_3 = Shatter(Curve=graft_3, Parameters=crv_cp_3.Parameter)  # -> simplify(Segments)
shatter_4 = Shatter(Curve=graft_4, Parameters=crv_cp_4.Parameter)  # -> simplify(Segments)

# ---- group: Simulation / Middle Mesh
removeduplicatepoints = GhPythonScript(x=flatten(python_2))  # -> pts; inputs x: list of Point3d; same code as removeduplicatepoints
removeduplicatepoints_2 = GhPythonScript(x=flatten(python_4))  # -> pts; inputs x: list of Point3d; same code as removeduplicatepoints
pt = Point(flatten([removeduplicatepoints, crv_cp_2.Point]))
pt_2 = Point(flatten([removeduplicatepoints_2, crv_cp_4.Point]))
cps = ClosestPoints(Point=flatten(pt_2), Cloud=flatten(pt), Count=Slider(10, range=0..10))  # -> simplify(ClosestPoint), CPIndex, Distance
ln = Line(StartPoint=simplify(graft(pt_2)), EndPoint=cps.ClosestPoint)  # -> flatten(Line)

# ---- group: Simulation / Sample Points
srf_cp = SurfaceClosestPoint(Point=sdivide.Points, Surface=cluster.B_3)  # -> Point, UVPoint, Distance
pt_3 = Point([pt, pt_2])
cps_2 = ClosestPoints(Point=flatten(sdivide.Points), Cloud=flatten(pt_3), Count=number_slider_2)  # -> simplify(ClosestPoint), CPIndex, Distance
ln_2 = Line(StartPoint=simplify(graft(sdivide.Points)), EndPoint=cps_2.ClosestPoint)
rodbotzipper = Rod(
    Polyline=ln_2,
    LengthFactor=1,
    AngleFactor=1,
    AxialStrength=Slider(0.001, range=0..1),
    BendStrength=Slider(0.001, range=0..50))

# ---- group: Simulation / Floor
scale = Scale(Geometry=gate_cluster.s_0_5, Center=Point(0, 0, 0), Factor=Slider(2, range=-10..10))  # -> Geometry, Transform
dom_2 = ConstructDomain(DomainStart=Slider(-10, range=-10..10), DomainEnd=Slider(0, range=-10..10))
merge_3 = Merge(Data1=crv_cp_2.Point, Data2=crv_cp.Point, Data3=cps.ClosestPoint, Data4=pt, Data5=crv_cp_4.Point, Data6=crv_cp_3.Point)  # -> flatten(Result)
boxrec = BoxRectangle(Rectangle=scale.Geometry, Height=dom_2)
duppt = RemoveDuplicatePts(Points=merge_3, Tolerance=0.01)
box_corners = BoxCorners(Box=boxrec)  # -> CornerA, CornerB, CornerC, CornerD, CornerE, CornerF, CornerG, CornerH
merge_4 = Merge(Data1=box_corners.CornerE, Data2=box_corners.CornerF, Data3=box_corners.CornerG, Data4=box_corners.CornerH)
anchor = Anchor(Point=merge_4, Strength=Slider(100000000, range=0..100000000))
spc = SolidPointCollide(Points=duppt, Solid=boxrec, Interior=False, Unidirectional=True, Strength=1)

# ---- group: Simulation / Gravity
Z_3 = UnitZ(Factor=Slider(0.0001, range=0..1))
rev = Reverse(Vector=Z_3)
load = Load(Point=duppt, ForceVector=rev, Weighting=1)

# ---- group: Simulation / Web Strengh
number_slider_9 = Slider(100, range=0..200)
num_10 = Number(axialweb)
subtraction_4 = Subtraction(A=num_10, B=number_slider_9)
addition_3 = Addition(A=num_10, B=number_slider_9)

# ---- group: Simulation (continued)
clip_1 = Python3Script(d1=subtraction_4, d2=addition_3)  # -> out, d1, d2; inputs d1: Int32, d2: Int32; same code as clip_1
mat_bot = Curve(shatter_3)
mat_top = Curve(shatter)

# ---- group: Simulation / Web Strengh (continued)
dom_3 = ConstructDomain(DomainStart=clip_1.d1, DomainEnd=clip_1.d2)

# ---- group: Simulation / Mat Strength
map_shrinkage = MapShrinkage(curve=mat_top, curve_2=boundry, target=dom)

# ---- group: Simulation / Mat Strengh
map_shrinkage_2 = MapShrinkage(curve=mat_bot, curve_2=boundry, target=dom)

# ---- group: Simulation / Web Strengh
map_shrinkage_3 = MapShrinkage(curve=ln, curve_2=boundry, target=dom_3)

# ---- group: Simulation (continued)
bar_graph_3 = BarGraph(map_shrinkage, BarColor=RGB(255, 0, 90))

# ---- group: Simulation / Domains
number_slider_10 = Slider(0, range=0..0.1)
num_11 = Number(matrix_shrinkage_factor_bottom)
num_12 = Number(matrix_shrinkage_factor_top)
subtraction_5 = Subtraction(A=num_12, B=number_slider_10)
addition_4 = Addition(A=num_12, B=number_slider_10)
dom_4 = ConstructDomain(DomainStart=subtraction_5, DomainEnd=addition_4)

subtraction_6 = Subtraction(A=num_11, B=number_slider_10)
addition_5 = Addition(A=num_11, B=number_slider_10)

dom_5 = ConstructDomain(DomainStart=subtraction_6, DomainEnd=addition_5)

# ---- group: Simulation / Mat Shrinkage
map_shrinkage_4 = MapShrinkage(curve=mat_top, curve_2=boundry, target=dom_4)

map_shrinkage_5 = MapShrinkage(curve=mat_bot, curve_2=boundry, target=dom_5)

# ---- group: Simulation / Top
rodtopfiber = Rod(
    Polyline=shatter_2,
    LengthFactor=fiber_shrinkage_factor_top,
    AngleFactor=1,
    AxialStrength=axialfiber,
    BendStrength=bendingfiber)
rodtopmatrix = Rod(Polyline=shatter, LengthFactor=map_shrinkage_4, AngleFactor=1, AxialStrength=map_shrinkage, BendStrength=bendingmatrix)

# ---- group: Simulation / Bottom
rodbottomfiber = Rod(
    Polyline=shatter_4,
    LengthFactor=fiber_shrinkage_factor_bottom,
    AngleFactor=1,
    AxialStrength=axialfiber,
    BendStrength=bendingfiber)
rodbottommatrix = Rod(
    Polyline=shatter_3,
    LengthFactor=map_shrinkage_5,
    AngleFactor=1,
    AxialStrength=map_shrinkage_2,
    BendStrength=bendingmatrix)

# ---- group: Simulation
rodtoptobot = Rod(Polyline=ln, LengthFactor=1, AngleFactor=1, AxialStrength=map_shrinkage_3, BendStrength=bendingweb)
entwine = Entwine(
    Branch00=rodtopfiber,
    Branch01=rodtopmatrix,
    Branch02=rodtoptobot,
    Branch03=rodbottomfiber,
    Branch04=rodbottommatrix,
    Branch05=rodbotzipper,
    Branch06=graft(spc),
    Branch07=anchor,
    Branch08=load,
    FlattenInputs=True)

panel_3 = Panel(map_shrinkage_5)
zombiesolver = ZombieSolver(GoalObjects=entwine, Threshold=raise_by_power, Tolerance=raise_by_power_2, MaxIterations=_8_m)  # -> I, V, O
geo = Geometry(zombiesolver.O)
panel_4 = Panel(zombiesolver.I)
unflatten = UnflattenTree(Tree=geo, Guide=entwine)
bang = ExplodeTree(Data=unflatten)  # -> Branch0, Branch1, Branch2, Branch3, Branch4, Branch5, Branch6, Branch7, Branch8
data = Data(bang.Branch1)
data_2 = Data(bang.Branch2)
data_3 = Data(bang.Branch4)
data_4 = Data(bang.Branch0)
data_5 = Data(bang.Branch3)

# ---- group: Simulation / Get Sample Points
unflatten_2 = UnflattenTree(Tree=bang.Branch5, Guide=rodbotzipper)
trim = TrimTree(Tree=unflatten_2, Depth=1)
item = ListItem(List=trim, Index=0, Wrap=True)  # -> flatten(Item)
end = EndPoints(Curve=item)  # -> Start, End
sample_points = Data(end.Start)

# ---- group: Simulation / Mesh total z difference
pdecon = Deconstruct(Point=sample_points)  # -> XComponent, YComponent, ZComponent
sort = SortList(Keys=pdecon.ZComponent)  # -> Keys, ValuesA
lng = ListLength(List=sort.Keys)
item_2 = ListItem(List=sort.Keys, Index=expr("x-1", lng), Wrap=True)
item_3 = ListItem(List=sort.Keys, Index=0, Wrap=True)
subtraction_7 = Subtraction(A=item_2, B=item_3)
panel_5 = Panel(subtraction_7)

# ---- group: Simulation (continued)
height = Panel(panel_5)
division_3 = Division(A=z_difference, B=subtraction_7)
percantage_of_z = Panel(division_3)

# ---- group: Simulation / Lofted Surface
partition = PartitionList(List=flatten(sample_points), Size=expr("x+1", num_5))
intcrv = Interpolate(Vertices=partition, Degree=4, Periodic=False, KnotStyle=1)  # -> flatten(Curve), Length, Domain
loft = Loft(Curves=intcrv.Curve, Options={Adjust=False, Closed=False, LoftEnds=0, LoftSimp=0, LoftType=0, Rebuild=10, Refit=0.01})

# ----
L = ClusterOutput(loft)

# ==== cluster DecreaseResolution
pt = ClusterInput()
int = ClusterInput()
pt_2 = Point(simplify(pt))
int_2 = Integer(simplify(int))
lng = ListLength(List=pt_2)
item = ListItem(List=flatten(lng), Index=0, Wrap=True)
division = Division(A=item, B=int_2)
round = Round(Number=division)  # -> Nearest, Floor, Ceiling
tstat = TreeStatistics(Tree=pt_2)  # -> Paths, Length, Count
series = Series(Start=0, Step=int_2, Count=round.Ceiling)
division_2 = Division(A=tstat.Count, B=int_2)
item_2 = ListItem(List=pt_2, Index=series, Wrap=True)  # -> simplify(Item)
round_2 = Round(Number=division_2)  # -> Nearest, Floor, Ceiling
series_2 = Series(Start=0, Step=int_2, Count=round_2.Ceiling)
branch = TreeBranch(Tree=item_2, Path=series_2, MaintainPaths=True)
B = ClusterOutput(branch)

# ==== cluster RaiseByPower
A = ClusterInput()
multiplication = Multiplication(A=A, B=-1)
pow = Power(A=Slider(10, range=0..10), B=multiplication)
R = ClusterOutput(pow)

# ==== cluster GateCluster
G = ClusterInput()
_0 = ClusterInput()
_1 = ClusterInput()
G_2 = ClusterInput()
_0_2 = ClusterInput()
_1_2 = ClusterInput()
G_3 = ClusterInput()
_0_3 = ClusterInput()
_1_3 = ClusterInput()
G_4 = ClusterInput()
_0_4 = ClusterInput()
G_5 = ClusterInput()
_0_5 = ClusterInput()
_1_4 = ClusterInput()
G_6 = ClusterInput()
_0_6 = ClusterInput()
_1_5 = ClusterInput()

# ---- group: Adaptive or Pixelization Gate / Shape's Dimensions
num = Number(1)
filter = StreamFilter(Gate=G_3, Stream0=_0_3, Stream1=_1_3)
filter_2 = StreamFilter(Gate=G_4, Stream0=_0_4, Stream1=num)

# ---- group: Adaptive or Pixelization Gate
filter_top = StreamFilter(Gate=G, Stream0=flatten(_0), Stream1=_1)
filter_bot = StreamFilter(Gate=G_2, Stream0=flatten(_0_2), Stream1=_1_2)
filter_srf = StreamFilter(Gate=G_5, Stream0=_0_5, Stream1=_1_4)
filter_patch_curves = StreamFilter(Gate=G_6, Stream0=_0_6, Stream1=_1_5)

# ----
s_0 = ClusterOutput(filter_top)
s_0_2 = ClusterOutput(filter_bot)
s_0_3 = ClusterOutput(filter)
s_0_4 = ClusterOutput(filter_2)
s_0_5 = ClusterOutput(filter_srf)
s_0_6 = ClusterOutput(filter_patch_curves)

# ==== cluster Cluster
free_form_crv = ClusterInput()
base_shape_idx = ClusterInput()
B = ClusterInput()
B_2 = ClusterInput()
ex = ClusterInput()
ey = ClusterInput()
srfxsize = ClusterInput()
thickness = ClusterInput()
srfysize = ClusterInput()
pattern_values_top = ClusterInput()
pattern_values_bottom = ClusterInput()

# ---- group: Cluster Inputs
srfxsize_2 = Number(srfxsize)
thickness_2 = Number(thickness)
srfysize_2 = Number(srfysize)
pattern_values_top_2 = Number(simplify(graft(pattern_values_top)))
pattern_values_bottom_2 = Number(simplify(graft(pattern_values_bottom)))

# ---- group: Build Mesh
dom = ConstructDomain(DomainStart=expr("-x/2", srfxsize_2), DomainEnd=expr("x/2", srfxsize_2))
dom_2 = ConstructDomain(DomainStart=expr("-x/2", srfysize_2), DomainEnd=expr("x/2", flatten(srfysize_2)))
boundary = BoundarySurfaces(FreeFormCrv=free_form_crv)
cir = Circle(Plane=PlaneXY(0, 0, 0), Radius=expr("x/2", srfxsize_2))
planesrf1 = PlaneSurface(Plane=PlaneXY(0, 0, 0), XSize=dom, YSize=dom_2)
boundary_2 = BoundarySurfaces(Edges=cir)
filter = StreamFilter(BaseShapeIdx=base_shape_idx, Stream0=boundary_2, Stream1=planesrf1, Stream2=boundary)
srf = Surface(filter)
Z = UnitZ(Thickness=thickness_2)
gate = StreamGate(Stream=srf, Gate=0)  # -> Target0, Target1

# ---- group: Grid
brec = BoundingRectangle(Geometry=srf, Plane=PlaneXY(0, 0, 0), Axis=0, Slide=0, Union=True)  # -> Bounding, DimensionX, DimensionY
pt = ConstructPoint(XCoordinate=expr("-x/2", brec.DimensionX), YCoordinate=expr("-x/2", brec.DimensionY), ZCoordinate=0)
division = Division(A=brec.DimensionX, B=B)
division_2 = Division(A=brec.DimensionY, B=B_2)
recgrid = Rectangular(Plane=pt, SizeX=division, SizeY=division_2, ExtentX=ex, ExtentY=ey)  # -> flatten(Cells), flatten(Points)

# ----
B_3 = ClusterOutput(brec.Bounding)
C = ClusterOutput(recgrid.Cells)
thickness_3 = ClusterOutput(thickness_2)
pattern_values_top_3 = ClusterOutput(pattern_values_top_2)
pattern_values_bottom_3 = ClusterOutput(pattern_values_bottom_2)

# ==== cluster MapShrinkage

# ---- group: To boundry
curve = ClusterInput()
curve_middle = CurveMiddle(Curve=curve)
curve_2 = ClusterInput()
curve_closest_point = CurveClosestPoint(Point=curve_middle, Curve=curve_2)  # -> Point, Parameter, Distance
multiplication = Multiplication(A=curve_closest_point.Distance, B=curve_closest_point.Distance)
sqrt = SquareRoot(Value=curve_closest_point.Distance)

# ---- group: To corners
control_polygon = ControlPolygon(Curve=curve_2)  # -> Polygon, Points
closest_point = ClosestPoint(Point=curve_middle, Cloud=control_polygon.Points)  # -> ClosestPoint, CPIndex, Distance
multiplication_2 = Multiplication(A=closest_point.Distance, B=closest_point.Distance)
number = Number(multiplication_2)

# ----
number_2 = Number(curve_closest_point.Distance)
subtraction = Subtraction(A=number_2)
text_tag = TextTag(Location=curve_middle, Text=subtraction)
bounds = Bounds(Numbers=flatten(subtraction))
target = ClusterInput()
remap_numbers = RemapNumbers(Value=subtraction, Source=bounds, Target=target)  # -> Mapped, Clipped
mapped = ClusterOutput(remap_numbers.Mapped)
