# Grasshopper definition Loop-for-Testing-Predictions.gh (Grasshopper 1.0.8)
# plug-ins: CORE.Toolbox.Grasshopper, Heteroptera, MeshEdit Components, Pufferfish, Anemone, PTComponentLibrary, LunchBox, MetaHopper

number_slider = Slider(5, range=0..10)  # disabled

# ----
# Loop Start
button = Button()
number_slider_2 = Slider(0, range=0..1000)
loop_start = LoopStart(Repeat=Slider(50, range=0..10000), Trigger=button, Data=number_slider_2)  # -> port, Counter, flatten(Data)

rec = DataRecorder(loop_start.Data, DataLimit=-10, RecordData=True)
rec_2 = DataRecorder(loop_start.Counter, DataLimit=-10, RecordData=True)
number_slider_3 = Slider(1, range=0..10)  # disabled
panel = Panel(rec)
panel_2 = Panel(rec_2)

swatch = ColourSwatch(SwatchColor=RGBA(191, 194, 201, 201))
swatch_2 = ColourSwatch(SwatchColor=RGBA(0, 72, 255, 179))
swatch_3 = ColourSwatch(SwatchColor=RGBA(255, 196, 0, 179))
# SELF-MORPHING SIMULATOR
setgroup = SetGroupProperties(
    Group=["Grasshopper.Kernel.Types.GH_ObjectWrapper", "Grasshopper.Kernel.Types.GH_ObjectWrapper", "Grasshopper.Kernel.Types.GH_ObjectWrapper", "Grasshopper.Kernel.Types.GH_ObjectWrapper", "Grasshopper.Kernel.Types.GH_ObjectWrapper"],
    Color=ColourSwatch(SwatchColor=RGBA(255, 0, 153, 179)))

# ---- group: Shrinkage Amounts
thickness = Slider(0.32, range=0.2..0.5)

# ---- group: Basic Shape Inputs
list = ValueList({"Plate": 0, "Ribbon": 1, "Free-Form": 2}, selected="Ribbon")
list_2 = ValueList({"Pixelization": 0, "Adaptive Pattern": 1}, selected="Pixelization")
free_form_curve = Curve(<curve referenced from the Rhino model>)

surface_x_size = Slider(30, range=1..100)
surface_y_size = Slider(30, range=1..101)

# ---- group: Attractor points bounds
number_slider_4 = Slider(1, range=0..1)  # disabled
a_b_x = Multiplication(A=surface_x_size, B=number_slider_3)  # disabled
a_b_y = Multiplication(A=surface_y_size, B=number_slider_3)  # disabled
x_recommended_number_for_slider = Panel(a_b_x)  # disabled
y_recommended_number_for_slider = Panel(a_b_y)  # disabled
number_slider_5 = Slider(0, range=0..10)  # disabled

# ---- group: Basic Shape Inputs
number_of_rows = Slider(3, range=1..10)
number_of_columns = Slider(3, range=1..10)

# ----
# Insert Fiber Orientation
multiplication = Multiplication(A=number_of_columns, B=number_of_rows)
genes = GenePool(Decimals=0, Maximum=180, Minimum=0, Value=[45, 90, 90, 90, 90, 90, 90, 90, 90])
pool_controller = GenePoolController(GenePool=genes, Count=multiplication, Range=Slider(180, range=0..1000), Decimal=0, Randomness=0.1)

# ---- group: Shrinkage Amounts
fiber_shrinkage_factor_top = Slider(1, range=0..1.1)
matrix_shrinkage_factor_top = Slider(0.976, range=0..1)

fiber_shrinkage_factor_bottom = Slider(1, range=0..1.1)
matrix_shrinkage_factor_bottom = Slider(0.977, range=0..1)

# ----
# Loop
# Random Matrix
number_slider_6 = Slider(1, range=0..100)  # disabled
python_top_random_gal = GhPythonScript(increment=number_slider_6, num_rows=number_of_rows, num_cols=number_of_columns, seed=loop_start.Data)  # -> flatten(result_lst), seed; disabled
# ---------- python_top_random_gal: Python ----------
"""Provides a scripting component.
    Inputs:
        increment: increment of degrees to use

    Output:
        result_list: array of numbers between 0-180 in increments by iput"""

__author__ = "user"
__version__ = "2023.11.01"

import rhinoscriptsyntax as rs
import ghpythonlib.treehelpers as th
import random


random.seed(seed)

list_of_possible_angles = []
result_lst = []

num = 0

while num < 180:
    list_of_possible_angles.append(num)
#    print("loop ", num)
    num = int(num + increment)


num_pixels=int(num_rows*num_cols)
print(num_pixels)

for pixel in range(num_pixels):
    i =random.randint(0,len(list_of_possible_angles)-1)
    angle = list_of_possible_angles[i]
    result_lst.append(angle)

print(result_lst)
# ---------- end python_top_random_gal ----------
random_fiber_orientations = Panel(python_top_random_gal.result_lst)  # disabled

number_slider_7 = Slider(16, range=0..100)  # disabled

# ---- group: Create attractors between points
neg = Negative(Value=x_recommended_number_for_slider)  # disabled
neg_2 = Negative(Value=y_recommended_number_for_slider)  # disabled
neg_3 = Negative(Value=number_slider_5)  # disabled
number_slider_8 = Slider(1, range=0..10)  # disabled
number_slider_9 = Slider(4, range=0..10)  # disabled
dom = ConstructDomain(DomainStart=neg, DomainEnd=x_recommended_number_for_slider)  # disabled
dom_2 = ConstructDomain(DomainStart=neg_2, DomainEnd=y_recommended_number_for_slider)  # disabled
dom_3 = ConstructDomain(DomainStart=neg_3, DomainEnd=number_slider_5)  # disabled
py3 = Python3Script(
    seed=loop_start.Data,
    x_bounds=dom,
    y_bounds=dom_2,
    z_bounds=dom_3,
    min_points=number_slider_8,
    max_points=number_slider_9)  # -> flatten(num_points), points; inputs min_points: Int32, max_points: Int32; disabled
# ---------- py3: Python ----------
import random
import rhinoscriptsyntax as rs

random.seed(seed)
def generate_random_points(num_points, x_bounds, y_bounds, z_bounds):
    points = []
    for _ in range(num_points):
        x = round(random.uniform(x_bounds[0], x_bounds[1]), 2)
        y = round(random.uniform(y_bounds[0], y_bounds[1]), 2)
        z = round(random.uniform(z_bounds[0], z_bounds[1]), 2)
        point = rs.CreatePoint(x, y, z)
        points.append(point)
    return points


num_points= random.randint(min_points, max_points)

# Generate the random points
points = generate_random_points(num_points, x_bounds, y_bounds, z_bounds)

print(num_points)
# ---------- end py3 ----------

# ---- group: Simulation Parameters / Fiber Factors
axialfiber = Slider(40, range=0..50)
bendingfiber = Slider(10, range=0..50)

# ---- group: Simulation Parameters / Matrix Factors
axialmatrix = Slider(50, range=0..100)
bendingmatrix = Slider(10, range=0..50)

# ---- group: Simulation Parameters / Web Factors
axialweb = Slider(100, range=0..1000)
bendingweb = Slider(50, range=0..50)

# ---- group: Solver Parameters
pattern_scale = Slider(12, range=4..20)
threshold_factor_10_x = Slider(12, range=8..20)
tolerance_factor_10_x = Slider(6, range=1..20)

# ----
number_slider_10 = Slider(1, range=0..100)
dots = DotDisplay(Point=py3.points, Colour=RGB(0, 0, 0), Size=1)  # disabled

# ---- group: Init mesh
Y = Number(surface_y_size)
X = Number(surface_x_size)
rectangle = Rectangle(Plane=PlaneXY(0, 0, 0), XSize=X, YSize=Y, Radius=0)  # -> Rectangle, Length
vec = VectorXYZ(XComponent=expr("x*-0.5", X), YComponent=expr("x*-0.5", Y), ZComponent=0)  # -> Vector, Length
move = Move(Geometry=rectangle.Rectangle, Motion=vec.Vector)  # -> Geometry, Transform
srf = Surface(move.Geometry)
mesh_uv = MeshSurface(Surface=srf, UCount=X, VCount=Y, Overhang=True, Equalize=False)
demesh = DeconstructMesh(Mesh=mesh_uv)  # -> Vertices, Faces, Colours, Normals

# ----
seed = Number(loop_start.Data)

# ---- group: Get random points to load / Number of points
number_slider_11 = Slider(3, range=0..10)
number_slider_12 = Slider(6, range=0..10)

# ---- group: Get random points to load
dom_4 = ConstructDomain(DomainStart=number_slider_11, DomainEnd=number_slider_12)
random = Random(Range=dom_4, Number=1, Seed=seed, Integers=True)
lng = ListLength(List=demesh.Vertices)
dom_5 = ConstructDomain(DomainStart=Slider(0, range=0..10), DomainEnd=lng)
random_2 = Random(Range=dom_5, Number=random, Seed=seed, Integers=True)
item = ListItem(List=demesh.Vertices, Index=random_2, Wrap=True)

# ---- group: Get random vectors
panel_3 = Panel("""1
-1
1
-1
1
-1
1
-1
1
-1
1
-1
1
-1
1
-1
1
-1
1
-1
1
-1
1
-1
1
-1
1
-1
1
-1""")
lng_2 = ListLength(List=panel_3)
subtraction = Subtraction(A=lng_2, B=random)
reduce = RandomReduce(List=panel_3, Reduction=subtraction, Seed=seed)

# ---- group: Get random weight
dom_6 = ConstructDomain(DomainStart=Slider(1, range=0..10), DomainEnd=Slider(80, range=0..10000))
random_3 = Random(Range=dom_6, Number=random, Seed=seed)

# ---- group: Solver
Z = UnitZ(Factor=reduce)
edgelengths = EdgeLengths(Mesh=mesh_uv, LengthFactor=1, Strength=100000)
smooth = Smooth(M=mesh_uv, Strength=Slider(3000, range=0..10000))
load = Load(Point=item, ForceVector=Z, Weighting=random_3)
show = Show(G=mesh_uv)
merge = Merge(Data1=show, Data2=smooth, Data3=edgelengths, Data4=load)
zombiesolver = ZombieSolver(GoalObjects=merge, Threshold=1e-10, Tolerance=0.0001, MaxIterations=50000)  # -> I, V, O

# ---- group: Get Surface
item_2 = ListItem(List=zombiesolver.O, Index=0, Wrap=True)
demesh_2 = DeconstructMesh(Mesh=item_2)  # -> Vertices, Faces, Colours, Normals
srfgrid = SurfaceFromPoints(Points=demesh_2.Vertices, UCount=expr("x+1", X), Interpolate=False)

# ---- group: Random surface
srf_2 = Surface(srfgrid)

# ----
srf_3 = Surface(srf_2)

# ---- group: Orient Surface to XY plane
number_slider_13 = Slider(5, range=0..10)
divide_surface = DivideSurface(Surface=srf_3, UCount=number_slider_13, VCount=number_slider_13)  # -> Points, Normals, Parameters
area = Area(Geometry=srf_3)  # -> Area, Centroid
evalsrf = EvaluateSurface(Surface=srf_3, Point=divide_surface.Parameters)  # -> Point, Normal, UDirection, VDirection, Frame
average_plane = AveragePlane(Planes=flatten(evalsrf.Frame))
xy = XYPlane(Origin=Point(0, 0, 0))
orient = Orient(Geometry=srf_3, Source=area.Centroid, Target=xy)  # -> Geometry, Transform

# ---- group: Get Curvature / Test
dim = Dimensions(Surface=orient.Geometry)  # -> UDimension, VDimension
rebuildsrf = RebuildSurface(Surface=orient.Geometry, UDegree=3, VDegree=3, UNumber=dim.UDimension, VNumber=dim.VDimension)

# ---- group: Get Curvature / Move if needed
Y_2 = UnitY(Factor=Slider(0, range=-100..100))
move_2 = Move(Geometry=orient.Geometry, Motion=Y_2)  # -> Geometry, Transform

# ----
preview = CustomPreview(Material={diffuse=RGB(221, 160, 221), emission=RGB(66, 48, 66), shine=0.5, specular=RGB(255, 255, 255), transparency=0})

# ---- group: Matrix Strengh
number_slider_14 = Slider(0, range=0..100)  # disabled
num = Number(axialmatrix)  # disabled
subtraction_2 = Subtraction(A=num, B=number_slider_14)  # disabled
addition = Addition(A=num, B=number_slider_14)  # disabled
dom_7 = ConstructDomain(DomainStart=addition, DomainEnd=subtraction_2)  # disabled

# ---- group: Sample Points / accuracy of sample points depends on this
number_slider_15 = Slider(10, range=0..10)  # disabled

# ---- group: Inputs
model_path_lab_pc = Panel("C:\Gal_Msc\Ipublic-repo\inverse-model-frustrated-composites\saved_models\legendary-sun-inverse.pkl")
number_slider_16 = Slider(8, range=0..10)
patch_size = Slider(10, range=0..10)
path = FilePath(model_path_lab_pc)

# ---- group: Inputs / Should match training set
number_slider_17 = Slider(5, range=0..20)
number_slider_18 = Slider(1, range=0..2)
smoothing_method = Panel("uniform")

# ---- group: Inputs / Normalization Values - should match training
# 2. Define Inputs
max_smooth = Panel("""0.25
0.25
0.25
0.25
0.25
0.25
0.25
0.25""")
min_smooth = Panel("""-0.25
-0.25
-0.25
-0.25
-0.25
-0.25
-0.25
-0.25""")

# ---- group: Get Average Per Patch / bigger = more weight to the center of the patch
w = Slider(5, range=0.1..50)

# ----
_1_h = Slider(5000000, range=0..10000000)  # disabled
_8_m = Slider(1000000, range=0..1000000)  # disabled
_4_m = Slider(500000, range=0..1000000)  # disabled
_50_s = Slider(100000, range=0..1000000)  # disabled
_25_s = Slider(50000, range=0..1000000)  # disabled
_10_s = Slider(20000, range=0..100000)  # disabled
_5_s = Slider(10000, range=0..10000)  # disabled
swatch_4 = ColourSwatch(SwatchColor=RGB(0, 0, 0))  # disabled
raise_by_power = RaiseByPower(A=threshold_factor_10_x)  # disabled
raise_by_power_2 = RaiseByPower(A=tolerance_factor_10_x)  # disabled
panel_4 = Panel("pC:\Users\User\OneDrive - Technion\Masters\Inverse Design Model\Tests\opt_adam_250805_3030.xlsx")  # disabled
panel_5 = Panel(number_slider_2)  # disabled
num_2 = Number(loop_start.Counter)  # disabled
number_slider_19 = Slider(8, range=0..20)
xl_out = WriteToExcel(LocationAddress="A1", Clear=0, Stream=False)  # disabled
excelwrite = ExcelWriter(WriteExcelData=True, WorkbookPath=panel_4, WorksheetName="Sheet1", ClearSheet=True, DataStruct=False)  # disabled

# ---- group: remap
number_slider_20 = Slider(10, range=0..100)  # disabled
number_slider_21 = Slider(30, range=0..100)  # disabled
number_slider_22 = Slider(0, range=0..100)  # disabled
number_slider_23 = Slider(179, range=0..1000)  # disabled
dom_8 = ConstructDomain(DomainStart=number_slider_20, DomainEnd=number_slider_21)  # disabled
dom_9 = ConstructDomain(DomainStart=number_slider_22, DomainEnd=number_slider_23)  # disabled

# ---- group: get distance
number_of_attraction_points = Panel(py3.num_points)  # disabled

# ---- group: Attractor points but MULTIPICATIONS AND SINUS
bnd = Bounds()  # disabled
current_bounds = Panel(bnd)  # disabled
number_slider_24 = Slider(-1, range=-10..10)  # disabled
number_slider_25 = Slider(1, range=-10..10)  # disabled
dom_10 = ConstructDomain(DomainStart=number_slider_24, DomainEnd=number_slider_25)  # disabled

# ---- group: round
panel_6 = Panel(number_slider_6)  # disabled

# ---- group: Build Mesh
boundary = BoundarySurfaces(FreeFormCrv=free_form_curve)  # disabled

# ---- group: Cluster Inputs
srfxsize = Number(surface_x_size)  # disabled
thickness_2 = Number(thickness)  # disabled
srfysize = Number(surface_y_size)  # disabled

# ---- group: Build Mesh (continued)
dom_11 = ConstructDomain(DomainStart=expr("-x/2", srfxsize), DomainEnd=expr("x/2", srfxsize))  # disabled
dom_12 = ConstructDomain(DomainStart=expr("-x/2", srfysize), DomainEnd=expr("x/2", flatten(srfysize)))  # disabled
cir = Circle(Plane=PlaneXY(0, 0, 0), Radius=expr("x/2", srfxsize))  # disabled
planesrf1 = PlaneSurface(Plane=PlaneXY(0, 0, 0), XSize=dom_11, YSize=dom_12)  # disabled
boundary_2 = BoundarySurfaces(Edges=cir)  # disabled
filter = StreamFilter(BaseShapeIdx=list, Stream0=boundary_2, Stream1=planesrf1, Stream2=boundary)  # disabled
srf_4 = Surface(filter)  # disabled
Z_2 = UnitZ(Thickness=thickness_2)  # disabled
gate = StreamGate(Stream=srf_4, Gate=0)  # -> Target0, Target1; disabled

# ---- group: Grid
brec = BoundingRectangle(Geometry=srf_4, Plane=PlaneXY(0, 0, 0), Axis=0, Slide=0, Union=True)  # -> Bounding, DimensionX, DimensionY; disabled
pt = ConstructPoint(XCoordinate=expr("-x/2", brec.DimensionX), YCoordinate=expr("-x/2", brec.DimensionY), ZCoordinate=0)  # disabled
division = Division(A=brec.DimensionX, B=number_of_columns)  # disabled
division_2 = Division(A=brec.DimensionY, B=number_of_rows)  # disabled
recgrid = Rectangular(Plane=pt, SizeX=division, SizeY=division_2, ExtentX=number_of_columns, ExtentY=number_of_rows)  # -> flatten(Cells), flatten(Points); disabled

# ----
area_patches = Area(Geometry=recgrid.Cells)  # -> Area, graft(Centroid); disabled

# ---- group: get distance (continued)
dist = Distance(PointA=area_patches.Centroid, PointB=py3.points)  # disabled
ma = MassAddition(Input=dist)  # -> Result, PartialResults; disabled
division_3 = Division(A=ma.Result, B=number_of_attraction_points)  # -> flatten(Result); disabled

# ---- group: Attractor points but MULTIPICATIONS AND SINUS (continued)
mm = MassMultiplication(Input=dist)  # -> flatten(Result), PartialResults; disabled
sin = Sine(Value=mm.Result)  # disabled
panel_7 = Panel(sin)  # disabled
remap = RemapNumbers(Value=panel_7, Source=dom_10, Target=dom_9)  # -> flatten(Mapped), Clipped; disabled
panel_8 = Panel(remap.Mapped)  # disabled
roundf = RoundToFactor(NumberX=panel_8, Factor=panel_6, RoundType=0)  # -> Rounded, Difference, MultiplierR, MultiplierX; disabled
panel_9 = Panel(roundf.Rounded)  # disabled

# ---- group: remap (continued)
remap_2 = RemapNumbers(Value=division_3, Source=dom_8, Target=dom_9)  # -> flatten(Mapped), Clipped; disabled
panel_10 = Panel(remap_2.Mapped)  # disabled

# ----
bnd_2 = Bounds(Numbers=flatten(division_3))  # disabled
dedomain = DeconstructDomain(Domain=bnd_2)  # -> Start, End; disabled
panel_11 = Panel(dedomain.Start)  # disabled
panel_12 = Panel(dedomain.End)  # disabled
# Attractor Points
current_bounds_2 = Panel(bnd_2)  # disabled

# ---- group: round (continued)
roundf_2 = RoundToFactor(NumberX=panel_10, Factor=panel_6, RoundType=0)  # -> Rounded, Difference, MultiplierR, MultiplierX; disabled
panel_13 = Panel(roundf_2.Rounded)  # disabled

# ----
tag = TextTag(Location=flatten(area_patches.Centroid), Text=panel_13)  # disabled

remove_outliers = Python3Script(list_of_angles=roundf_2.Rounded)  # -> out_list_of_angles; inputs list_of_angles: list of Int32; disabled
# ---------- remove_outliers: Python ----------
"""Grasshopper Script"""

out_list_of_angles=[]
angles_changed = []

for angle in list_of_angles:
    #print(angle)
    if angle>=180:
        angle = angle-180
        if angle >= 180:
            angle = 179
    elif angle<0:
        angle = angle+180
        if angle<0:
            angle = 0
    out_list_of_angles.append(angle)


#print(out_list_of_angles)
# ---------- end remove_outliers ----------
panel_14 = Panel(remove_outliers)  # disabled

connect_angles = Number(remove_outliers)

# ---- group: Final Fiber Orientation
connect_fiber_orientation_here = Panel(connect_angles)
addition_2 = Addition(A=connect_fiber_orientation_here, B=Slider(90, range=0..100))
_90_to_everythin = Panel(addition_2)
num_3 = Number(connect_fiber_orientation_here)
num_4 = Number(_90_to_everythin)

# ---- group: Cluster Inputs (continued)
pattern_values_bottom = Number(simplify(graft(num_4)))  # disabled
pattern_values_top = Number(simplify(graft(num_3)))  # disabled

# ----
boundry = Curve(brec.Bounding)  # disabled
gate_cluster = GateCluster(
    G_6=list_2,
    _0_6=recgrid.Cells,
    G=list_2,
    _0=pattern_values_top,
    G_2=list_2,
    _0_2=pattern_values_bottom,
    G_3=list_2,
    _0_3=number_of_rows,
    G_4=list_2,
    _0_4=number_of_columns,
    G_5=list_2,
    _0_5=brec.Bounding)  # -> s_0_6, s_0, s_0_2, s_0_3, s_0_4, s_0_5; disabled

# ---- group: Bottom Layer Processing / Moves layer according to thickness
Z_3 = UnitZ(Factor=expr("-x/2", thickness_2))  # disabled
move_bottom = Move(Geometry=gate_cluster.s_0_6, Motion=Z_3)  # -> Geometry, Transform; disabled

# ---- group: Top Layer Processing / Moves layer according to thickness
Z_4 = UnitZ(Factor=expr("x/2", thickness_2))  # disabled
move_top = Move(Geometry=gate_cluster.s_0_6, Motion=Z_4)  # -> Geometry, Transform; disabled

# ---- group: Sample Points / Sample Points Input
sdivide = DivideSurface(Surface=gate_cluster.s_0_5, UCount=surface_x_size, VCount=surface_y_size)  # -> Points, Normals, Parameters; disabled

# ---- group: Top Layer Processing
expression = Expression(x=gate_cluster.s_0, Expression="(x+90)%180")  # disabled
hatchtopfiber = GhPythonScript(
    n_rows=gate_cluster.s_0_3,
    n_cols=gate_cluster.s_0_4,
    boundaries=move_top.Geometry,
    scale=pattern_scale,
    angles=gate_cluster.s_0)  # -> out, boundary_curves, pattern, scale, angles, names, news, geos; inputs boundaries: list of Curve, angles: list; disabled; same code as hatchtopfiber
hatchtopmatrix = GhPythonScript(
    n_rows=gate_cluster.s_0_3,
    n_cols=gate_cluster.s_0_4,
    boundaries=move_top.Geometry,
    scale=pattern_scale,
    angles=expression)  # -> out, boundary_curves, pattern, scale, angles, names, news, geos; inputs boundaries: list of Curve, angles: list; disabled; same code as hatchtopfiber
merge_2 = Merge(Data1=hatchtopfiber.geos, Data2=hatchtopmatrix.geos)  # disabled

# ---- group: Bottom Layer Processing
expression_2 = Expression(x=gate_cluster.s_0_2, Expression="(x+90)%180")  # disabled
hatchbotfiber = GhPythonScript(
    n_rows=gate_cluster.s_0_3,
    n_cols=gate_cluster.s_0_4,
    boundaries=move_bottom.Geometry,
    scale=pattern_scale,
    angles=expression_2)  # -> out, boundary_curves, pattern, scale, angles, names, news, geos; inputs boundaries: list of Curve, angles: list; disabled; same code as hatchtopfiber
hatchbotfiber_2 = GhPythonScript(
    n_rows=gate_cluster.s_0_3,
    n_cols=gate_cluster.s_0_4,
    boundaries=move_bottom.Geometry,
    scale=pattern_scale,
    angles=gate_cluster.s_0_2)  # -> out, boundary_curves, pattern, scale, angles, names, news, geos; inputs boundaries: list of Curve, angles: list; disabled; same code as hatchtopfiber
merge_3 = Merge(Data1=hatchbotfiber_2.geos, Data2=hatchbotfiber.geos)  # disabled

# ----
ptcenter = CenterGrid(Grid=sdivide.Points)  # disabled

# ---- group: Frame Intersection
explode = Explode(Curve=simplify(graft(hatchtopfiber.boundary_curves)), Recursive=True)  # -> flatten(Segments), Vertices; disabled
python = GhPythonScript(boundary_lines=explode.Segments)  # -> filtered_boundaries; inputs boundary_lines: list of Curve; disabled; same code as python
python_2 = GhPythonScript(boundaries=python, pattern_lines=flatten(merge_2))  # -> intersection_pts; inputs boundaries: list of Curve, pattern_lines: list of Curve; disabled; same code as python_2

# ---- group: Zipper
explode_2 = Explode(Curve=simplify(graft(hatchbotfiber_2.boundary_curves)), Recursive=True)  # -> flatten(Segments), Vertices; disabled
python_3 = GhPythonScript(boundary_lines=explode_2.Segments)  # -> filtered_boundaries; inputs boundary_lines: list of Curve; disabled; same code as python
python_4 = GhPythonScript(boundaries=python_3, pattern_lines=flatten(merge_3))  # -> intersection_pts; inputs boundaries: list of Curve, pattern_lines: list of Curve; disabled; same code as python_2

# ---- group: Fiber-Matrix Intersection
python_5 = GhPythonScript(fiber_lines=hatchtopfiber.geos, matrix_lines=hatchtopmatrix.geos)  # -> fiber_intersection_pts, matrix_intersection_pts; inputs fiber_lines: list of Curve, matrix_lines: list of Curve; disabled; same code as python_5
graft = GraftTree(Tree=hatchtopmatrix.geos, IncludeEmptyLists=True, IncludeNullItems=True)  # disabled
c_script = CSharpScript(x=python_5.matrix_intersection_pts)  # -> A; disabled; same code as c_script
graft_2 = GraftTree(Tree=hatchtopfiber.geos, IncludeEmptyLists=True, IncludeNullItems=True)  # disabled
c_script_2 = CSharpScript(x=python_5.fiber_intersection_pts)  # -> A; disabled; same code as c_script
crv_cp = CurveClosestPoint(Point=c_script, Curve=graft)  # -> Point, Parameter, Distance; disabled
crv_cp_2 = CurveClosestPoint(Point=c_script_2, Curve=graft_2)  # -> Point, Parameter, Distance; disabled
shatter = Shatter(Curve=graft, Parameters=crv_cp.Parameter)  # -> simplify(Segments); disabled
shatter_2 = Shatter(Curve=graft_2, Parameters=crv_cp_2.Parameter)  # -> simplify(Segments); disabled

# ---- group: Bottom Layer Processing / Fiber-Matrix Intersection
python_6 = GhPythonScript(fiber_lines=hatchbotfiber_2.geos, matrix_lines=hatchbotfiber.geos)  # -> fiber_intersection_pts, matrix_intersection_pts; inputs fiber_lines: list of Curve, matrix_lines: list of Curve; disabled; same code as python_5
graft_3 = GraftTree(Tree=hatchbotfiber.geos, IncludeEmptyLists=True, IncludeNullItems=True)  # disabled
c_script_3 = CSharpScript(x=python_6.matrix_intersection_pts)  # -> A; disabled; same code as c_script
graft_4 = GraftTree(Tree=hatchbotfiber_2.geos, IncludeEmptyLists=True, IncludeNullItems=True)  # disabled
c_script_4 = CSharpScript(x=python_6.fiber_intersection_pts)  # -> A; disabled; same code as c_script
crv_cp_3 = CurveClosestPoint(Point=c_script_3, Curve=graft_3)  # -> Point, Parameter, Distance; disabled
crv_cp_4 = CurveClosestPoint(Point=c_script_4, Curve=graft_4)  # -> Point, Parameter, Distance; disabled
shatter_3 = Shatter(Curve=graft_3, Parameters=crv_cp_3.Parameter)  # -> simplify(Segments); disabled
shatter_4 = Shatter(Curve=graft_4, Parameters=crv_cp_4.Parameter)  # -> simplify(Segments); disabled

# ----
mat_top = Curve(shatter)  # disabled
mat_bot = Curve(shatter_3)  # disabled

# ---- group: Mat Strength
map_shrinkage = MapShrinkage(curve=mat_top, curve_2=boundry, target=dom_7)  # disabled

# ---- group: Mat Strengh
map_shrinkage_2 = MapShrinkage(curve=mat_bot, curve_2=boundry, target=dom_7)  # disabled

# ---- group: Middle Mesh
removeduplicatepoints = GhPythonScript(x=flatten(python_2))  # -> pts; inputs x: list of Point3d; disabled; same code as removeduplicatepoints
removeduplicatepoints_2 = GhPythonScript(x=flatten(python_4))  # -> pts; inputs x: list of Point3d; disabled; same code as removeduplicatepoints
number_slider_26 = Slider(10, range=0..10)  # disabled
pt_2 = Point(flatten([removeduplicatepoints, crv_cp_2.Point]))  # disabled
pt_3 = Point(flatten([removeduplicatepoints_2, crv_cp_4.Point]))  # disabled
cps = ClosestPoints(Point=flatten(pt_3), Cloud=flatten(pt_2), Count=number_slider_26)  # -> simplify(ClosestPoint), CPIndex, Distance; disabled
ln = Line(StartPoint=simplify(graft(pt_3)), EndPoint=cps.ClosestPoint)  # -> flatten(Line); disabled

# ---- group: Sample Points
srf_cp = SurfaceClosestPoint(Point=ptcenter, Surface=brec.Bounding)  # -> Point, UVPoint, Distance; disabled
pt_4 = Point([pt_2, pt_3])  # disabled
number_slider_27 = Slider(0.001, range=0..1)  # disabled
number_slider_28 = Slider(0.001, range=0..50)  # disabled
cps_2 = ClosestPoints(Point=flatten(ptcenter), Cloud=flatten(pt_4), Count=number_slider_15)  # -> simplify(ClosestPoint), CPIndex, Distance; disabled
ln_2 = Line(StartPoint=simplify(graft(ptcenter)), EndPoint=cps_2.ClosestPoint)  # disabled
rodbotzipper = Rod(Polyline=ln_2, LengthFactor=1, AngleFactor=1, AxialStrength=number_slider_27, BendStrength=number_slider_28)  # disabled

# ---- group: Floor
number_slider_29 = Slider(2, range=-10..10)  # disabled
number_slider_30 = Slider(-10, range=-10..10)  # disabled
number_slider_31 = Slider(0, range=-10..10)  # disabled
scale = Scale(Geometry=gate_cluster.s_0_5, Center=Point(0, 0, 0), Factor=number_slider_29)  # -> Geometry, Transform; disabled
dom_13 = ConstructDomain(DomainStart=number_slider_30, DomainEnd=number_slider_31)  # disabled
merge_4 = Merge(Data1=crv_cp_2.Point, Data2=crv_cp.Point, Data3=cps.ClosestPoint, Data4=pt_2, Data5=crv_cp_4.Point, Data6=crv_cp_3.Point)  # -> flatten(Result); disabled
boxrec = BoxRectangle(Rectangle=scale.Geometry, Height=dom_13)  # disabled
duppt = RemoveDuplicatePts(Points=merge_4, Tolerance=0.01)  # disabled
box_corners = BoxCorners(Box=boxrec)  # -> CornerA, CornerB, CornerC, CornerD, CornerE, CornerF, CornerG, CornerH; disabled
merge_5 = Merge(Data1=box_corners.CornerE, Data2=box_corners.CornerF, Data3=box_corners.CornerG, Data4=box_corners.CornerH)  # disabled
number_slider_32 = Slider(100000000, range=0..100000000)  # disabled
anchor = Anchor(Point=merge_5, Strength=number_slider_32)  # disabled
spc = SolidPointCollide(Points=duppt, Solid=boxrec, Interior=False, Unidirectional=True, Strength=1)  # disabled

# ---- group: Gravity
number_slider_33 = Slider(0.0001, range=0..1)  # disabled
Z_5 = UnitZ(Factor=number_slider_33)  # disabled
rev = Reverse(Vector=Z_5)  # disabled
load_2 = Load(Point=duppt, ForceVector=rev, Weighting=1)  # disabled

# ---- group: Get Curvature
dim_2 = Dimensions(Surface=rebuildsrf)  # -> UDimension, VDimension
roundf_3 = RoundToFactor(NumberX=dim_2.VDimension, Factor=patch_size, RoundType=0)  # -> Rounded, Difference, MultiplierR, MultiplierX
roundf_4 = RoundToFactor(NumberX=dim_2.UDimension, Factor=patch_size, RoundType=0)  # -> Rounded, Difference, MultiplierR, MultiplierX
panel_15 = Panel(roundf_4.Rounded)
panel_16 = Panel(roundf_3.Rounded)

# ----
ptsrfdomnum = SurfaceDomainNumber(Surface=orient.Geometry, UNumber=roundf_4.Rounded, VNumber=roundf_3.Rounded)
flip = FlipMatrix(Data=ptsrfdomnum)

# ---- group: Get Curvature (continued)
ptcenter_2 = CenterGrid(Grid=flip, Surface=orient.Geometry)
points = PointList(Points=flatten(flip))

# ---- group: Get Curvature / Only neede for "classic" inverse - not smooth
srf_cp_2 = SurfaceClosestPoint(Point=ptcenter_2, Surface=move_2.Geometry)  # -> Point, UVPoint, Distance
curvature = PrincipalCurvature(Surface=move_2.Geometry, Point=srf_cp_2.UVPoint)  # -> Frame, flatten(Maximum), flatten(Minimum), flatten(MaxDirection), flatten(MinDirection)
devec_min = DeconstructVector(Vector=flatten(curvature.MinDirection))  # -> XComponent, YComponent, ZComponent
devec_max = DeconstructVector(Vector=flatten(curvature.MaxDirection))  # -> XComponent, YComponent, ZComponent
merge_all = Merge(
    Data1=graft(curvature.Maximum),
    Data2=graft(curvature.Minimum),
    Data3=graft(devec_max.XComponent),
    Data4=graft(devec_max.YComponent),
    Data5=graft(devec_max.ZComponent),
    Data6=graft(devec_min.XComponent),
    Data7=graft(devec_min.YComponent),
    Data8=graft(devec_min.ZComponent))

# ----
model_path_24_layers = Panel("C:\Gal_Msc\Ipublic-repo\inverse-model-frustrated-composites\saved_models\glowing-river.pkl")
number_slider_34 = Slider(3, range=0..10)
max = Panel("""20.4
20.4
20.0""")
min = Panel("""-20.4
-20.4
-0.2""")
number_slider_35 = Slider(1, range=0..1)
target_pt = Point(ptcenter_2)
flip_2 = FlipMatrix(Data=target_pt)  # -> simplify(Data)

# ---- group: Optimizer
number_slider_36 = Slider(1000, range=0..10000)
flatten = FlattenTree(Tree=flip_2, Path="{0}")
forward_optimization_xyz = Python3Script(
    labels_max=max,
    labels_min=min,
    x_cm=roundf_4.Rounded,
    y_cm=roundf_3.Rounded,
    patch_x=patch_size,
    patch_y=patch_size,
    n_of_features_channels=number_slider_34,
    n_of_labels_channels=number_slider_35,
    model_path=model_path_24_layers,
    step_num=number_slider_36,
    target=flatten)  # -> out, pred_prev, target_prev, angles_out; inputs labels_max: list of Double, labels_min: list of Double, x_cm: Int32, y_cm: Int32, patch_x: Int32, patch_y: Int32, n_of_features_channels: Int32, n_of_labels_channels: Int32, step_num: Int32, target: list of Point3d; disabled
# ---------- forward_optimization_xyz: Python ----------
# ┌───────────────────────────────────────────────────────────────────────────┐
# │                      Imports and Definitions                              │
# └───────────────────────────────────────────────────────────────────────────┘
# venv: forward_prediction_XYZ
# r: numpy, torch, matplotlib, pathlib, open3d, wandb

import time
import os

import wandb
import numpy as np
import torch 
import torch.nn as nn
from torch.optim.lr_scheduler import ReduceLROnPlateau
from Grasshopper import DataTree
from Grasshopper.Kernel.Data import GH_Path
import matplotlib
import matplotlib.pyplot as plt
matplotlib.use('Agg')  # Use a non-interactive backend
from pathlib import Path
import torch.nn.functional as F
import Rhino.Geometry as rg
import open3d as o3d
from scipy.stats import qmc

features_channels = n_of_labels_channels 
labels_channels =  n_of_features_channels 

step_num = 10000

# ┌───────────────────────────────────────────────────────────────────────────┐
# │                               Functions                                   │
# └───────────────────────────────────────────────────────────────────────────┘

def duplicate_pixel_data(input_data, x_cm, y_cm, patch_x, patch_y, fortran_order=False):
    """
    Duplicates coarse grid values into patches in a larger tensor.
    
    Args:
        input_data (list, np.ndarray, or torch.Tensor): Either flat or 2D grid of values.
        x_cm (int): Width of output grid.
        y_cm (int): Height of output grid.
        patch_x (int): Width of each patch.
        patch_y (int): Height of each patch.
        fortran_order (bool): Whether to interpret flat input in column-major (Fortran) order.

    Returns:
        torch.Tensor: 4D tensor of shape (1, 1, y_cm, x_cm) with duplicated values.
    """
    num_patches_y = y_cm // patch_y
    num_patches_x = x_cm // patch_x
    expected_size = num_patches_y * num_patches_x

    # Convert input to torch tensor
    if isinstance(input_data, torch.Tensor):
        tensor_input = input_data
    elif isinstance(input_data, np.ndarray):
        tensor_input = torch.tensor(input_data, dtype=torch.float32)
    elif isinstance(input_data, list):
        tensor_input = torch.tensor(input_data, dtype=torch.float32)
    else:
        raise TypeError("Unsupported input type")

    # Handle flat input: reshape into 2D grid
    if tensor_input.dim() == 1:
        assert tensor_input.numel() == expected_size, f"Expected {expected_size} values, got {tensor_input.numel()}"
        if fortran_order:
            np_input = tensor_input.numpy().reshape((num_patches_y, num_patches_x), order='F')
            tensor_input = torch.tensor(np_input, dtype=torch.float32)
        else:
            tensor_input = tensor_input.view(num_patches_y, num_patches_x)

    final_tensor = torch.zeros((1, 1, y_cm, x_cm), dtype=torch.float32)

    for i in range(num_patches_y):
        for j in range(num_patches_x):
            row_start = i * patch_y
            row_end = row_start + patch_y
            col_start = j * patch_x
            col_end = col_start + patch_x
            final_tensor[:, 0, row_start:row_end, col_start:col_end] = tensor_input[i, j]


    return final_tensor


def duplicate_pixel_data_torch(input_data, x_cm, y_cm, patch_x, patch_y, fortran_order=False):
    num_patches_y = y_cm // patch_y
    num_patches_x = x_cm // patch_x
    expected_size = num_patches_y * num_patches_x

    # --- 1. Convert input to tensor (keeps gradient if it's already a Parameter)
    if not isinstance(input_data, torch.Tensor):
        tensor_input = torch.tensor(input_data, dtype=torch.float32)
    else:
        tensor_input = input_data

    # --- 2. Reshape flat input to 2D grid if needed
    if tensor_input.dim() == 1:
        assert tensor_input.numel() == expected_size, \
            f"Expected {expected_size} values, got {tensor_input.numel()}"
        if fortran_order:
            tensor_input = tensor_input.view(num_patches_x, num_patches_y).T
        else:
            tensor_input = tensor_input.view(num_patches_y, num_patches_x)

    # --- 3. Expand each value into its patch (vectorized)
    # Add channel/batch dims: (1, 1, num_patches_y, num_patches_x)
    tensor_input = tensor_input.unsqueeze(0).unsqueeze(0)

    # Expand along height and width
    tensor_expanded = tensor_input.repeat_interleave(patch_y, dim=2).repeat_interleave(patch_x, dim=3)
    # tensor_expanded now has shape (1, 1, y_cm, x_cm)

    return tensor_expanded


def tensor_to_spatial_tree(tensor):
    """
    Converts a [1, C, H, W] tensor into a DataTree[float] with each {h,w} as a branch
    containing C channel values.
    """
    tree = DataTree[float]()
    tensor = tensor.detach().squeeze(0)  # shape: [C, H, W]
    C, H, W = tensor.shape
    print(f"tensor shape before conversion: {C}, {H}, {W}")

    for y in range(H):
        for x in range(W):
            path = GH_Path(y, x)
            for ch in range(C):
                tree.Add(float(tensor[ch, y, x]), path)

    return tree

def chamfer_loss_with_registration(predicted, target):
    # Flatten from (1,3,x,y) to (N,3)
    P = predicted.permute(0, 2, 3, 1).reshape(-1, 3)
    Q = target.permute(0, 2, 3, 1).reshape(-1, 3)

    # Align predicted to target  - Simple
    P_aligned = rough_align(P, Q)
    # P_aligned, R, t = torch_icp(P, Q, iters=8, blend=0.3)
    # P_aligned = P


    # Compute Chamfer
    diff = P_aligned.unsqueeze(1) - Q.unsqueeze(0)  # (N, N, 3)
    dist = torch.sum(diff**2, dim=2)
    min_P_to_Q = dist.min(dim=1)[0]
    min_Q_to_P = dist.min(dim=0)[0]
    loss = min_P_to_Q.mean() + min_Q_to_P.mean()

    #  RESHAPE back to (1, 3, y, x) for preview
    y_dim, x_dim = predicted.shape[2], predicted.shape[3]
    prediction_aligned_grid = P_aligned.T.reshape(1, 3, y_dim, x_dim)

    return loss, prediction_aligned_grid

def chamfer_loss_weighted_edges(predicted, target, edge_weight=50.0):
    """
    Chamfer loss with additional emphasis on edge points.
    `edge_weight`: multiplier applied to loss for boundary points only.
    """
    # Flatten from (1, 3, H, W) to (N, 3)
    B, C, H, W = predicted.shape
    P = predicted.permute(0, 2, 3, 1).reshape(-1, 3)  # (B*H*W, 3)
    Q = target.permute(0, 2, 3, 1).reshape(-1, 3)

    # Align predicted to target
    P_aligned = rough_align(P, Q)

    # Create edge masks (1 if boundary, 0 otherwise) for both predicted and target
    edge_mask = torch.zeros((H, W), dtype=torch.bool, device=predicted.device)
    edge_mask[0, :] = edge_mask[-1, :] = edge_mask[:, 0] = edge_mask[:, -1] = True
    edge_mask_flat = edge_mask.flatten()

    # Compute Chamfer distances
    diff = P_aligned.unsqueeze(1) - Q.unsqueeze(0)  # (N, N, 3)
    dist = torch.sum(diff**2, dim=2)

    min_P_to_Q = dist.min(dim=1)[0]
    min_Q_to_P = dist.min(dim=0)[0]

    # Apply weights to boundary points
    weights_P = torch.ones_like(min_P_to_Q)
    weights_P[edge_mask_flat] *= edge_weight

    weights_Q = torch.ones_like(min_Q_to_P)
    weights_Q[edge_mask_flat] *= edge_weight

    loss = (min_P_to_Q * weights_P).mean() + (min_Q_to_P * weights_Q).mean()

    # Reshape aligned prediction back for visualization
    prediction_aligned_grid = P_aligned.T.reshape(1, 3, H, W)

    return loss, prediction_aligned_grid


def rough_align(P, Q):
    """
    Roughly aligns P to Q by:
    - Matching centers
    - Building orientation from P only
    - Reusing orientation for Q (so identical clouds don’t get rotated)
    """

    # print("\n--- Rough Farthest-Edge Align (Safe) Debug ---")

    # 1. Compute centers
    P_center = P.mean(0, keepdim=True)
    Q_center = Q.mean(0, keepdim=True)
    # P_centered = P - P_center
    # Q_centered = Q - Q_center
    P_centered = P 
    Q_centered = Q 

    # 2. Use farthest point pair on P to define primary axis
    diffP = P_centered.unsqueeze(1) - P_centered.unsqueeze(0)
    distP = torch.sum(diffP ** 2, dim=2)
    iP, jP = torch.nonzero(distP == distP.max(), as_tuple=True)
    idxP1, idxP2 = iP[0].item(), jP[0].item()

    xP = (P_centered[idxP2] - P_centered[idxP1])
    xP = xP / torch.norm(xP)

    # 3. Secondary axis from P
    maskP = torch.ones(len(P_centered), dtype=torch.bool)
    maskP[[idxP1, idxP2]] = False
    subP = P_centered[maskP]
    diffP2 = subP.unsqueeze(1) - subP.unsqueeze(0)
    distP2 = torch.sum(diffP2 ** 2, dim=2)
    iP2, jP2 = torch.nonzero(distP2 == distP2.max(), as_tuple=True)
    idxP3, idxP4 = iP2[0].item(), jP2[0].item()
    yP_raw = subP[idxP4] - subP[idxP3]

    yP = yP_raw - torch.dot(yP_raw, xP) * xP
    yP = yP / torch.norm(yP)

    # 4. Build right-handed frame from P
    zP = torch.cross(xP, yP)
    frame_P = torch.stack([xP, yP, zP], dim=1)

    # ✅ Use the SAME frame for Q (no recalculation)
    frame_Q = frame_P.clone()

    # print("Frame P:\n", frame_P)
    # print("Frame Q (reused):\n", frame_Q)

    # 5. Rotation (now guaranteed identity if geometry is identical)
    R = frame_Q @ frame_P.T
    # print("Rotation matrix R:\n", R)
    # print("det(R):", torch.det(R).item())

    # 6. Translation
    t = Q_center - P_center @ R
    # print("Translation vector t:", t.tolist())

    # 7. Apply
    P_aligned = P @ R + t

    return P_aligned

def pointlist3d_to_tensor_grid(pointlist3d, x, y):
    """
    Converts a Point3d list into a (1, 3, x, y) tensor.
    Assumes point list is ordered row-major or column-major to match the grid.
    """
    coords = [[pt.X, pt.Y, pt.Z] for pt in pointlist3d]
    tensor = torch.tensor(coords, dtype=torch.float32)   # (N, 3)
    tensor = tensor.T.reshape(1, 3, y, x)  # now matches model output shape
    return tensor

def register_pointclouds_gh(P_list, Q_list, distance_threshold=0.01):
    """
    Aligns point cloud P onto Q using:
      1. Center translation
      2. Fast Global Registration
      3. ICP refinement

    Inputs:
        P_list: list of rg.Point3d (source)
        Q_list: list of rg.Point3d (target)
        distance_threshold: ICP max correspondence distance

    Outputs:
        aligned_points: list of rg.Point3d (P aligned to Q)
        final_transformation: 4x4 numpy array
    """

    print("\n--- GH Registration Debug ---")

    # --- 1. Convert GH points to numpy arrays ---
    P_np = np.array([[pt.X, pt.Y, pt.Z] for pt in P_list], dtype=np.float64)
    Q_np = np.array([[pt.X, pt.Y, pt.Z] for pt in Q_list], dtype=np.float64)

    # --- 2. Compute centers ---
    P_center = P_np.mean(axis=0)
    Q_center = Q_np.mean(axis=0)
    print("P center:", P_center, "Q center:", Q_center)

    P_centered = P_np - P_center
    Q_centered = Q_np - Q_center

    # --- 3. Build Open3D point clouds ---
    pcd_P = o3d.geometry.PointCloud()
    pcd_Q = o3d.geometry.PointCloud()
    pcd_P.points = o3d.utility.Vector3dVector(P_centered)
    pcd_Q.points = o3d.utility.Vector3dVector(Q_centered)

    # --- 4. Estimate normals (for registration) ---
    pcd_P.estimate_normals(o3d.geometry.KDTreeSearchParamHybrid(radius=0.1, max_nn=30))
    pcd_Q.estimate_normals(o3d.geometry.KDTreeSearchParamHybrid(radius=0.1, max_nn=30))

    # --- 5. Compute FPFH features for Fast Global Registration ---
    radius_feature = 0.25
    pcd_P_fpfh = o3d.pipelines.registration.compute_fpfh_feature(
        pcd_P, o3d.geometry.KDTreeSearchParamHybrid(radius=radius_feature, max_nn=100)
    )
    pcd_Q_fpfh = o3d.pipelines.registration.compute_fpfh_feature(
        pcd_Q, o3d.geometry.KDTreeSearchParamHybrid(radius=radius_feature, max_nn=100)
    )

    # --- 6. Fast Global Registration ---
    fgr_result = o3d.pipelines.registration.registration_fgr_based_on_feature_matching(
        pcd_P, pcd_Q, pcd_P_fpfh, pcd_Q_fpfh,
        o3d.pipelines.registration.FastGlobalRegistrationOption(
            maximum_correspondence_distance=distance_threshold
        )
    )
    print("FGR transformation:\n", fgr_result.transformation)

    # --- 7. ICP refinement ---
    icp_result = o3d.pipelines.registration.registration_icp(
        pcd_P, pcd_Q, distance_threshold,
        fgr_result.transformation,
        o3d.pipelines.registration.TransformationEstimationPointToPlane()
    )
    print("ICP refined transformation:\n", icp_result.transformation)

    # --- 8. Apply final transformation ---
    P_registered = np.asarray(pcd_P.points)
    P_registered_h = np.hstack((P_registered, np.ones((P_registered.shape[0], 1))))  # (N,4)
    P_transformed = (icp_result.transformation @ P_registered_h.T).T[:, :3]

    # --- 9. Add back Q’s center (since we centered earlier) ---
    P_aligned = P_transformed + Q_center

    # --- 10. Convert back to GH Point3d ---
    aligned_points = [rg.Point3d(float(x), float(y), float(z)) for x, y, z in P_aligned]

    return aligned_points, icp_result.transformation


def one_time_open3d_align(predicted, target):
    """
    Runs Open3D once to coarsely align target to predicted.
    Returns: transformed_target (torch.Tensor, same shape as target)
    """
    # Flatten from (1, 3, x, y) -> (N, 3)
    P = predicted.permute(0, 2, 3, 1).reshape(-1, 3).detach().cpu().numpy()
    Q = target.permute(0, 2, 3, 1).reshape(-1, 3).detach().cpu().numpy()

    # Convert to GH Point3d for the existing registration function
    P_points = [rg.Point3d(float(x), float(y), float(z)) for x, y, z in P]
    Q_points = [rg.Point3d(float(x), float(y), float(z)) for x, y, z in Q]

    aligned_points, transform = register_pointclouds_gh(P_points, Q_points)

    # Convert aligned target back to Torch tensor
    Q_aligned_np = np.array([[pt.X, pt.Y, pt.Z] for pt in aligned_points], dtype=np.float32)
    Q_aligned = torch.tensor(Q_aligned_np, dtype=target.dtype, device=target.device)

    # Reshape back to (1, 3, y, x)
    y_dim, x_dim = target.shape[2], target.shape[3]
    Q_aligned_grid = Q_aligned.T.reshape(1, 3, y_dim, x_dim)

    return Q_aligned_grid


def torch_icp(P, Q, iters=3, blend=0.2):
    """
    Differentiable ICP with controllable step size.
    blend: 0-1, fraction of ICP transform to apply each iteration.
    """
    R_total = torch.eye(3, device=P.device, dtype=P.dtype)
    t_total = torch.zeros(1, 3, device=P.device, dtype=P.dtype)

    P_aligned = P

    for i in range(iters):
        # Find correspondences
        diff = P_aligned.unsqueeze(1) - Q.unsqueeze(0)
        dist = (diff**2).sum(dim=2)
        idx = dist.argmin(dim=1)
        Q_matched = Q[idx]

        # Centroids
        P_mean = P_aligned.mean(0, keepdim=True)
        Q_mean = Q_matched.mean(0, keepdim=True)

        # Solve for R, t
        P_centered = P_aligned - P_mean
        Q_centered = Q_matched - Q_mean
        H = P_centered.T @ Q_centered
        U, S, Vt = torch.linalg.svd(H)
        R = Vt.T @ U.T
        if torch.det(R) < 0:
            Vt[-1, :] *= -1
            R = Vt.T @ U.T
        t = Q_mean - P_mean @ R

        # ✅ Blended update
        R_step = (1-blend) * torch.eye(3, device=P.device) + blend * R
        t_step = blend * t

        # Apply the “partial” transform
        P_aligned = P_aligned @ R_step + t_step

        # Accumulate transform
        R_total = R_step @ R_total
        t_total = (t_step @ R_total) + t_total

    return P_aligned, R_total, t_total

def wrap_angles_to_180(angles):
    angles_mod = torch.remainder(angles, 360.0)
    wrapped = torch.where(angles_mod > 180.0, 360.0 - angles_mod, angles_mod)
    return wrapped


def lhs_generate_candidates(num_candidates, num_angles):
    """
    Generate candidate angle sets in [0,180] using Latin Hypercube Sampling.
    """
    sampler = qmc.LatinHypercube(d=num_angles)
    samples = sampler.random(num_candidates)  # values in [0,1]
    angles = torch.tensor(samples * 180.0, dtype=torch.float32)
    return angles

def evaluate_candidates(angles_candidates, model, target_normalized):
    """
    Evaluate each LHS candidate by computing the loss through the model.
    Return the best angle set and its loss.
    """
    best_loss = float("inf")
    best_angles = None

    for i in range(angles_candidates.shape[0]):
        candidate = angles_candidates[i]

        # Prepare input grid
        candidate_grid = duplicate_pixel_data_torch(
            candidate,
            x_cm=x_cm,
            y_cm=y_cm,
            patch_x=patch_x,
            patch_y=patch_y,
            fortran_order=True
        )

        # Forward pass
        prediction = model(candidate_grid / 180.0)

        # Compute loss
        # loss, _ = chamfer_loss_with_registration(prediction, target_normalized)
        loss, _ = chamfer_loss_weighted_edges(prediction, target_normalized)
        loss = loss * 100
        loss_val = loss.item()

        if loss_val < best_loss:
            best_loss = loss_val
            best_angles = candidate.clone()

    return best_angles, best_loss


def tensors_to_pointlists(prediction, target):
    """
    Convert model prediction and target (shape: (1, 3, y, x)) into
    two flat lists of Rhino Point3d for Grasshopper visualization.

    Args:
        prediction: torch.Tensor of shape (1, 3, y, x)
        target: torch.Tensor of shape (1, 3, y, x)

    Returns:
        pred_points (list[rg.Point3d]), target_points (list[rg.Point3d])
    """
    # Move to CPU and remove batch dim
    pred_np = prediction.detach().cpu().numpy().squeeze()   # (3, y, x)
    target_np = target.detach().cpu().numpy().squeeze()     # (3, y, x)

    y_dim, x_dim = pred_np.shape[1], pred_np.shape[2]
    pred_points, target_points = [], []

    for i in range(y_dim):
        for j in range(x_dim):
            # predicted point
            px, py, pz = pred_np[:, i, j]
            pred_points.append(rg.Point3d(float(px), float(py), float(pz)))

            # target point
            tx, ty, tz = target_np[:, i, j]
            target_points.append(rg.Point3d(float(tx), float(ty), float(tz)))

    return pred_points, target_points
# ┌───────────────────────────────────────────────────────────────────────────┐
# │                             Model Class                                   │
# └───────────────────────────────────────────────────────────────────────────┘

class OurVgg16InstanceNorm2d24lay(torch.nn.Module):
    def __init__(self, dropout=0.3):
        super().__init__()
        self.features = torch.nn.Sequential(
            # Stage 1
            self.block(features_channels, 64),
            self.block(64, 64),
            self.block(64, 64),
            self.block(64, 64, dropout),

            # Stage 2
            self.block(64, 128),
            self.block(128, 128),
            self.block(128, 128),
            self.block(128, 128, dropout),

            # Stage 3
            self.block(128, 256),
            self.block(256, 256),
            self.block(256, 256),
            self.block(256, 256, dropout),

            # Stage 4
            self.block(256, 512),
            self.block(512, 512),
            self.block(512, 512),
            self.block(512, 512, dropout),

            # Stage 5
            self.block(512, 768),
            self.block(768, 768),
            self.block(768, 768),
            self.block(768, 768, dropout),

            # Stage 6
            self.block(768, 1024),
            self.block(1024, 1024),
            self.block(1024, 1024),
            self.block(1024, 1024, dropout),
        )
        self.output_conv = torch.nn.Conv2d(1024, labels_channels, 3, padding=1)
        self.sigmoid = torch.nn.Sigmoid()

    def block(self, in_ch, out_ch, apply_dropout=False):
        layers = [
            torch.nn.Conv2d(in_ch, out_ch, kernel_size=3, padding=1),
            torch.nn.InstanceNorm2d(out_ch),
            torch.nn.ReLU()
        ]
        if apply_dropout:
            layers.append(torch.nn.Dropout())
        return torch.nn.Sequential(*layers)

    def forward(self, x):
        x = self.features(x)
        x = self.output_conv(x)
        x = self.sigmoid(x)
        return x
# ┌───────────────────────────────────────────────────────────────────────────┐
# │                        Main Code - Optimization                           │
# └───────────────────────────────────────────────────────────────────────────┘

gh_has_run = False

torch.manual_seed(42)
import random, numpy as np
random.seed(42)
np.random.seed(42)


# Make sure component only runs once
if gh_has_run == False:
    print("✅ First run – running optimization loop")
    gh_has_run = True



    device = torch.device("cuda" if torch.cuda.is_available() else "cpu")
    print(f"Using device: {device}")

    # 🚀 1. Initialize wandb run
    os.environ["WANDB_MODE"] = "disabled" # Disable wandb
    os.environ["WANDB_DIR"] = os.path.expanduser("~/wandb")
    wandb.init(
        project="GH-optimization",
        dir=os.environ["WANDB_DIR"],
        config={
            "step_num": step_num,
            "registration_type": "basic",   # or "open3d" etc.
        }
    )




    # Define the Model
    t0 = time.time()
    model = OurVgg16InstanceNorm2d24lay()
    model.load_state_dict(torch.load(model_path, map_location=device))
    model.eval()  # ensure correct evaluation mode
    model.to(device)
    print("Model init time:", time.time() - t0, "seconds")


    # Convert target to tensor
    target = pointlist3d_to_tensor_grid(target, x=x_cm, y=y_cm)

    # Normalize the target
    labels_max_tensor = torch.tensor(labels_max, dtype=torch.float32).view(1, -1, 1, 1)
    labels_min_tensor = torch.tensor(labels_min, dtype=torch.float32).view(1, -1, 1, 1)

    target_normalized = (target - labels_min_tensor) / (labels_max_tensor - labels_min_tensor + 1e-8)
    target_normalized = target_normalized.to(device)

    print(target.shape)
    print(target_normalized)


    # Step 3: Model inference
    start_time = time.time()


    # 1. Initialize angles 
    num_angles = int((x_cm / patch_x) * (y_cm / patch_y))

    #LHS
    # Step 1: Generate candidates
    num_candidates = 5000
    angles_candidates = lhs_generate_candidates(num_candidates, num_angles).to(device)

    # Step 2: Evaluate candidates
    print("Evaluating LHS candidates...")
    best_angles, best_loss = evaluate_candidates(angles_candidates, model, target_normalized)

    print(f"✅ Best candidate found with loss={best_loss:.6f}")
    # Step 3: Use best_angles to initialize optimizer
    angles = torch.nn.Parameter(best_angles, requires_grad=True)

    #  Initiate with "initial_angles"
    # initial_angles_tensor = torch.tensor(initial_angles, dtype=torch.float32, device=device)
    # angles = torch.nn.Parameter(initial_angles_tensor)

    # # all 90
    # angles = torch.nn.Parameter(torch.full((num_angles,), 90.0, dtype=torch.float32, device=device))


    # 🔹 Run Open3D once
    angles_grid_temp = duplicate_pixel_data_torch(angles, 
                                        x_cm=x_cm, 
                                        y_cm=y_cm, 
                                        patch_x=patch_x, 
                                        patch_y=patch_y, 
                                        fortran_order=True).to(device)

    prediction = model(angles_grid_temp/180.0) 
    target_aligned = one_time_open3d_align(prediction, target_normalized)

    print("✅ Target point cloud aligned once with Open3D")

    # Init prediction_alinged so it's not local 
    prediction_aligned = None

    # Stage 1: Adam exploration
    pre_lr = 0.01
    best_loss = 1000
    optimizer = torch.optim.Adam([angles], lr=pre_lr, amsgrad=True)
    wandb.config.update({"pre optimizer": optimizer.__class__.__name__, "pre lr": pre_lr}, allow_val_change=True)
    for step in range(step_num):
        optimizer.zero_grad()
        wrapped_angles = wrap_angles_to_180(angles)

        prediction = model(duplicate_pixel_data_torch(
                                                    wrapped_angles,
                                                    x_cm=x_cm,
                                                    y_cm=y_cm,
                                                    patch_x=patch_x,
                                                    patch_y=patch_y,
                                                    fortran_order=True) / 180.0)

        # loss, prediction_aligned = chamfer_loss_with_registration(prediction, target_normalized)
        loss, prediction_aligned = chamfer_loss_weighted_edges(prediction, target_normalized)

        loss = loss * 100
        loss.backward()
        optimizer.step()

        # Track best result
        if loss.item() < best_loss:
            best_loss = loss.item()
            best_angles = angles.clone()
            best_prediction = prediction_aligned
            
        if step % 100 == 0:
            print(f"Adam step: {step}, loss: {loss}")
    print(f"loss after Adam: {best_loss}")


    # 2. Set up main optimizer
    lr = 0.001
    momentum = 0.9
    max_iter = 20
    history_size = 10

    optimizer = torch.optim.LBFGS([angles], lr=lr, max_iter=max_iter, history_size=history_size)


    # 🔢 store optimizer info in wandb
    wandb.config.update({"optimizer": optimizer.__class__.__name__, "momentum": momentum, "lr": lr, "history size optimizer": history_size, "max iter optimizer": max_iter}, allow_val_change=True)
    
    
    # # # 4. Optimization loop
    # for step in range(step_num):
    #     # 🔹 LBFGS requires a closure it can call many times internally
    #     def closure():
    #         optimizer.zero_grad()
            
    #         # Build input grid
    #         angles_grid = duplicate_pixel_data_torch(
    #             angles,
    #             x_cm=x_cm,
    #             y_cm=y_cm,
    #             patch_x=patch_x,
    #             patch_y=patch_y,
    #             fortran_order=True
    #         )
    #         normalized_tensor = angles_grid / 180.0

    #         # Forward + loss
    #         prediction = model(normalized_tensor)

    #         # loss, _ = chamfer_loss_with_registration(prediction, target_normalized)
    #         loss, _ = chamfer_loss_weighted_edges(prediction, target_normalized)
            
    #         loss = loss * 100

    #         loss.backward()

    #         with torch.no_grad():
    #             angles.clamp_(0.0, 180.0)

    #         return loss

    #     # ✅ LBFGS step (closure will be called many times internally)
    #     final_loss = optimizer.step(closure)

    #     # # ✅ Clamp angles after step
    #     # with torch.no_grad():
    #     #     angles.clamp_(0.0, 180.0)

    #     # 🔁 Recompute prediction ONCE per step (final output after LBFGS step)
    #     angles_grid = duplicate_pixel_data_torch(
    #         angles,
    #         x_cm=x_cm,
    #         y_cm=y_cm,
    #         patch_x=patch_x,
    #         patch_y=patch_y,
    #         fortran_order=True
    #     )
    #     prediction = model(angles_grid / 180.0)
    #     # loss, prediction_aligned = chamfer_loss_with_registration(prediction, target_normalized)
    #     loss, prediction_aligned = chamfer_loss_weighted_edges(prediction, target_normalized)
        
    #     loss = loss * 100

    #     # 📊 Print/log only ONCE per step
    #     if step % 50 == 0:
    #         print(f"Step {step}: loss={loss.item():.6f}")
    #     wandb.log({"step": step, "loss": loss.item()})


    # 3. Preview
    scale_factor = 100.0  
    prediction_aligned = best_prediction

    prediction_aligned = prediction_aligned.float() * scale_factor
    target_normalized = target_normalized.float() * scale_factor
    pred_prev, target_prev = tensors_to_pointlists(prediction_aligned, target_normalized)


    end_time = time.time()

    angles = best_angles
    optimized_angles = angles.detach().cpu().numpy()  # convert to numpy
    print(f"optimized angles: {optimized_angles}")


    print(f"Optimization time: {end_time - start_time:.4f} seconds")

    # 🔚 Log final results
    wandb.log({"final_loss": loss.item(), "total_time_sec": end_time - start_time, "angles":optimized_angles})

    wandb.finish()

    # ✅ Wrap angles so they are in [0,180]
    final_angles = wrap_angles_to_180(angles)

    # ✅ Round to nearest int
    rounded_angles = torch.round(final_angles).to(torch.int)

    # ✅ Convert to Python list for Grasshopper
    angles_out = rounded_angles.cpu().numpy().tolist()


else:
    print("♻️ GH re-ran component but skipping loop")
# ---------- end forward_optimization_xyz ----------
panel_17 = Panel(forward_optimization_xyz.out)

# ----
# 3.Predict
inverse_prediction_smooth = Python3Script(
    features_max=max_smooth,
    features_min=min_smooth,
    x_cm=roundf_4.Rounded,
    y_cm=roundf_3.Rounded,
    n_of_features_channels=number_slider_16,
    model_path=path,
    xyz=simplify(ptcenter_2),
    sigma=number_slider_18,
    smoothing_method=smoothing_method,
    surface=rebuildsrf,
    rebuild_divide=number_slider_17)  # -> out, prediction, similarity_score, confidence_score, Z_smooth_out, X_out, Y_out; inputs features_max: list of Double, features_min: list of Double, dataset_mean: list of Double, dataset_std: list of Double, x_cm: Int32, y_cm: Int32, n_of_features_channels: Int32, xyz: tree of Point3d, sigma: Double, surface: Surface, rebuild_divide: Int32
# ---------- inverse_prediction_smooth: Python ----------
# ┌───────────────────────────────────────────────────────────────────────────┐
# │                      Imports and Definitions                              │
# └───────────────────────────────────────────────────────────────────────────┘
# venv: inverse_prediction_smooth
# r: numpy, pandas, torch, scipy
import ghpythonlib.treehelpers as th
import numpy as np
import torch 
import pandas as pd
from torch import nn
from scipy.ndimage import gaussian_filter
from scipy.ndimage import uniform_filter
from scipy.signal import savgol_filter
from scipy.interpolate import RectBivariateSpline
import torch.nn.functional as Functional

features_channels = n_of_features_channels 



# ┌───────────────────────────────────────────────────────────────────────────┐
# │                               Functions                                   │
# └───────────────────────────────────────────────────────────────────────────┘

def get_shape(lst):
    shape = []
    while isinstance(lst, list):
        shape.append(len(lst))
        lst = lst[0] if lst else []
    return tuple(shape)

def smooth_savgol(Z, sigma):
    window = int(2 * sigma + 1)
    if window % 2 == 0:
        window += 1
    Z_smooth = savgol_filter(Z, window_length=window, polyorder=2, axis=0)
    Z_smooth = savgol_filter(Z_smooth, window_length=window, polyorder=2, axis=1)
    # print(Z_smooth)
    return Z_smooth

def smooth_bilateral(Z, sigma):
    # Normalize and convert to 8-bit for OpenCV
    Z_norm = (Z - np.min(Z)) / (np.max(Z) - np.min(Z)) * 255
    Z_8bit = np.uint8(Z_norm)
    smoothed = cv2.bilateralFilter(Z_8bit, d=9, sigmaColor=75, sigmaSpace=sigma)
    return smoothed.astype(float) / 255 * (np.max(Z) - np.min(Z)) + np.min(Z)


def rebuild_full_surface_and_resample(X, Y, Z, coarse_shape):
    """
    Rebuilds the full surface Z using a coarse bivariate spline,
    and resamples it back to the original resolution using that smoothed fit.

    Parameters:
    - X, Y, Z: Original surface arrays (shape nx x ny)
    - coarse_shape: Tuple (u, v) — resolution of the smoothing surface

    Returns:
    - X_resampled, Y_resampled, Z_smooth: All shape (nx, ny)
    """
    nx, ny = X.shape

    u = max(3, coarse_shape[0])
    v = max(3, coarse_shape[1])

    # Extract coordinate vectors (structured grid assumption)
    x_vec = X[0, :]
    y_vec = Y[:, 0]

    # Step 1: Interpolate original surface
    spline_orig = RectBivariateSpline(y_vec, x_vec, Z)

    # Step 2: Sample coarse version of the surface
    x_coarse = np.linspace(x_vec.min(), x_vec.max(), u)
    y_coarse = np.linspace(y_vec.min(), y_vec.max(), v)
    Z_coarse = spline_orig(y_coarse, x_coarse)

    # Step 3: Fit new spline on coarse grid (this becomes the smoothed surface)
    kx = min(3, len(x_coarse) - 1)
    ky = min(3, len(y_coarse) - 1)
    spline_smooth = RectBivariateSpline(y_coarse, x_coarse, Z_coarse, kx=kx, ky=ky)


    # Step 4: Resample smoothed surface on original fine grid
    Z_smooth = spline_smooth(y_vec, x_vec)

    return X.copy(), Y.copy(), Z_smooth

def pad_tensor(max_h,max_w,tensor):

    """
    Pads a tensor of shape [1, C, H, W] to [1, C, 40, 40] using zero-padding.
    """


    _, _, h, w = tensor.shape
    pad_h = max_h - h
    pad_w = max_w - w

    return Functional.pad(tensor, (0, pad_w, 0, pad_h), mode='constant', value=0)

# ┌───────────────────────────────────────────────────────────────────────────┐
# │                             Model Class                                   │
# └───────────────────────────────────────────────────────────────────────────┘

class OurVgg16Old(torch.nn.Module):
    def __init__(self, dropout=0.3):
        super(OurVgg16, self).__init__()

        self.conv_1 = torch.nn.Conv2d(in_channels=features_channels, out_channels=64, kernel_size=3, padding=1)
        self.conv_2 = torch.nn.Conv2d(in_channels=64, out_channels=128, kernel_size=3, padding=1)
        self.conv_3 = torch.nn.Conv2d(in_channels=128, out_channels=128, kernel_size=3, padding=1)
        self.conv_4 = torch.nn.Conv2d(in_channels=128, out_channels=256, kernel_size=3, padding=1)
        self.conv_5 = torch.nn.Conv2d(in_channels=256, out_channels=256, kernel_size=3, padding=1)
        self.conv_6 = torch.nn.Conv2d(in_channels=256, out_channels=512, kernel_size=3, padding=1)
        self.conv_7 = torch.nn.Conv2d(in_channels=512, out_channels=512, kernel_size=3, padding=1)
        self.conv_8 = torch.nn.Conv2d(in_channels=512, out_channels=512, kernel_size=3, padding=1)
        self.conv_9 = torch.nn.Conv2d(in_channels=512, out_channels=512, kernel_size=3, padding=1)
        self.conv_10 = torch.nn.Conv2d(in_channels=512, out_channels=256, kernel_size=3, padding=1)
        self.conv_11 = torch.nn.Conv2d(in_channels=256, out_channels=256, kernel_size=3, padding=1)
        self.conv_12 = torch.nn.Conv2d(256, 128, kernel_size=3, padding=1)
        self.conv_13 = torch.nn.Conv2d(128, 128, kernel_size=3, padding=1)
        self.conv_14 = torch.nn.Conv2d(128, 1, kernel_size=3, padding=1)

        self.batch_norm_1 = torch.nn.BatchNorm2d(num_features=64)
        self.batch_norm_2 = torch.nn.BatchNorm2d(num_features=128)
        self.batch_norm_3 = torch.nn.BatchNorm2d(num_features=128)
        self.batch_norm_4 = torch.nn.BatchNorm2d(num_features=256)
        self.batch_norm_5 = torch.nn.BatchNorm2d(num_features=256)
        self.batch_norm_6 = torch.nn.BatchNorm2d(num_features=512)
        self.batch_norm_7 = torch.nn.BatchNorm2d(num_features=512)
        self.batch_norm_8 = torch.nn.BatchNorm2d(num_features=512)
        self.batch_norm_9 = torch.nn.BatchNorm2d(num_features=512)
        self.batch_norm_10 = torch.nn.BatchNorm2d(num_features=256)
        self.batch_norm_11 = torch.nn.BatchNorm2d(num_features=256)
        self.batch_norm_12 = torch.nn.BatchNorm2d(num_features=128)
        self.batch_norm_13 = torch.nn.BatchNorm2d(num_features=128)
        self.batch_norm_14 = torch.nn.BatchNorm2d(num_features=1)

        self.relu = torch.nn.ReLU()
        self.dropout = torch.nn.Dropout(p=dropout)
        self.sigmoid = nn.Sigmoid()

    def forward(self, x):
        x = self.conv_1(x); x = self.batch_norm_1(x); x = self.relu(x)
        x = self.conv_2(x); x = self.batch_norm_2(x); x = self.relu(x)
        x = self.conv_3(x); x = self.batch_norm_3(x); x = self.relu(x)
        x = self.conv_4(x); x = self.batch_norm_4(x); x = self.relu(x)
        x = self.conv_5(x); x = self.batch_norm_5(x); x = self.relu(x)
        x = self.conv_6(x); x = self.batch_norm_6(x); x = self.relu(x)
        x = self.conv_7(x); x = self.batch_norm_7(x); x = self.relu(x)
        x = self.conv_8(x); x = self.batch_norm_8(x); x = self.relu(x)
        x = self.conv_9(x); x = self.batch_norm_9(x); x = self.relu(x)
        x = self.conv_10(x); x = self.batch_norm_10(x); x = self.relu(x)
        x = self.conv_11(x); x = self.batch_norm_11(x); x = self.relu(x)
        x = self.conv_12(x); x = self.batch_norm_12(x); x = self.relu(x)
        x = self.conv_13(x); x = self.batch_norm_13(x); x = self.relu(x)
        x = self.conv_14(x); x = self.sigmoid(x)
        return x

class OurVgg16(torch.nn.Module):
    def __init__(self, dropout=0.3):
        super(OurVgg16, self).__init__()

        self.conv_1 = torch.nn.Conv2d(in_channels=features_channels, out_channels=64, kernel_size=3, padding=1)
        self.conv_2 = torch.nn.Conv2d(in_channels=64, out_channels=128, kernel_size=3, padding=1)
        self.conv_3 = torch.nn.Conv2d(in_channels=128, out_channels=128, kernel_size=3, padding=1)
        self.conv_4 = torch.nn.Conv2d(in_channels=128, out_channels=256, kernel_size=3, padding=1)
        self.conv_5 = torch.nn.Conv2d(in_channels=256, out_channels=256, kernel_size=3, padding=1)
        self.conv_6 = torch.nn.Conv2d(in_channels=256, out_channels=512, kernel_size=3, padding=1)
        self.conv_7 = torch.nn.Conv2d(in_channels=512, out_channels=512, kernel_size=3, padding=1)
        self.conv_8 = torch.nn.Conv2d(in_channels=512, out_channels=512, kernel_size=3, padding=1)
        self.conv_9 = torch.nn.Conv2d(in_channels=512, out_channels=512, kernel_size=3, padding=1)
        self.conv_10 = torch.nn.Conv2d(in_channels=512, out_channels=256, kernel_size=3, padding=1)
        self.conv_11 = torch.nn.Conv2d(in_channels=256, out_channels=256, kernel_size=3, padding=1)
        self.conv_12 = torch.nn.Conv2d(256, 128, kernel_size=3, padding=1)
        self.conv_13 = torch.nn.Conv2d(128, 128, kernel_size=3, padding=1)
        # self.conv_14 = torch.nn.Conv2d(128, labels_channels, kernel_size=3, padding=1)

        # Testing FC layer
        self.conv_fc1 = torch.nn.Conv2d(128, 512, kernel_size=3, padding=1)
        self.norm_fc1 = torch.nn.BatchNorm2d(512)
        self.relu_fc1 = torch.nn.ReLU()
        self.drop_fc1 = torch.nn.Dropout(p=dropout)
        self.conv_fc2 = torch.nn.Conv2d(512, labels_channels, kernel_size=1)


        self.batch_norm_1 = torch.nn.BatchNorm2d(num_features=64)
        self.batch_norm_2 = torch.nn.BatchNorm2d(num_features=128)
        self.batch_norm_3 = torch.nn.BatchNorm2d(num_features=128)
        self.batch_norm_4 = torch.nn.BatchNorm2d(num_features=256)
        self.batch_norm_5 = torch.nn.BatchNorm2d(num_features=256)
        self.batch_norm_6 = torch.nn.BatchNorm2d(num_features=512)
        self.batch_norm_7 = torch.nn.BatchNorm2d(num_features=512)
        self.batch_norm_8 = torch.nn.BatchNorm2d(num_features=512)
        self.batch_norm_9 = torch.nn.BatchNorm2d(num_features=512)
        self.batch_norm_10 = torch.nn.BatchNorm2d(num_features=256)
        self.batch_norm_11 = torch.nn.BatchNorm2d(num_features=256)
        self.batch_norm_12 = torch.nn.BatchNorm2d(num_features=128)
        self.batch_norm_13 = torch.nn.BatchNorm2d(num_features=128)
        # self.batch_norm_14 = torch.nn.BatchNorm2d(num_features=1)


        self.relu = torch.nn.ReLU()
        self.dropout = torch.nn.Dropout(p=dropout)

        self.sigmoid = nn.Sigmoid()

    def forward(self, x):
        x = self.conv_1(x)
        x = self.batch_norm_1(x)
        x = self.relu(x)
        # x = self.dropout(x)

        x = self.conv_2(x)
        x = self.batch_norm_2(x)
        x = self.relu(x)
        # x = self.dropout(x)

        x = self.conv_3(x)
        x = self.batch_norm_3(x)
        x = self.relu(x)
        # x = self.dropout(x)

        x = self.conv_4(x)
        x = self.batch_norm_4(x)
        x = self.relu(x)
        # x = self.dropout(x)

        x = self.conv_5(x)
        x = self.batch_norm_5(x)
        x = self.relu(x)
        # x = self.dropout(x)

        x = self.conv_6(x)
        x = self.batch_norm_6(x)
        x = self.relu(x)
        # x = self.dropout(x)

        x = self.conv_7(x)
        x = self.batch_norm_7(x)
        x = self.relu(x)
        # x = self.dropout(x)

        x = self.conv_8(x)
        x = self.batch_norm_8(x)
        x = self.relu(x)
        # x = self.dropout(x)

        x = self.conv_9(x)
        x = self.batch_norm_9(x)
        x = self.relu(x)
        # x = self.dropout(x)

        x = self.conv_10(x)
        x = self.batch_norm_10(x)
        x = self.relu(x)
        # x = self.dropout(x)

        x = self.conv_11(x)
        x = self.batch_norm_11(x)
        x = self.relu(x)
        # x = self.dropout(x)

        x = self.conv_12(x)
        x = self.batch_norm_12(x)
        x = self.relu(x)
        # x = self.dropout(x)

        x = self.conv_13(x)
        x = self.batch_norm_13(x)
        x = self.relu(x)
        # x = self.dropout(x)
        # print(f"after conv13 {x.shape}")

        # x = self.conv_14(x)
        # x = self.batch_norm_14(x)
        # x = self.relu(x)
        # x = self.dropout(x)
        # print(f"after conv14 {x.shape}")

        # Testing FC layer
        x = self.conv_fc1(x)
        x = self.norm_fc1(x)
        x = self.relu_fc1(x)
        x = self.drop_fc1(x)
        x = self.conv_fc2(x)

        x = self.sigmoid(x)


        return x

# ┌───────────────────────────────────────────────────────────────────────────┐
# │                           Main Code                                       │
# └───────────────────────────────────────────────────────────────────────────┘

labels_channels = 1
# Flatten XYZ tree to list of Point3d
xyz_flat = [pt for i in range(xyz.BranchCount) for pt in xyz.Branch(i)]
xyz_array = np.array([[pt.X, pt.Y, pt.Z] for pt in xyz_flat])

X = xyz_array[:, 0].reshape((y_cm, x_cm), order='F')
Y = xyz_array[:, 1].reshape((y_cm, x_cm), order='F')
Z = xyz_array[:, 2].reshape((y_cm, x_cm), order='F')

# Smooth Z using selected method
if smoothing_method == 'gaussian':
    Z_smooth = gaussian_filter(Z, sigma=sigma)
    # print("    Applied Gaussian smoothing")
elif smoothing_method == 'uniform':
    Z_smooth = uniform_filter(Z, size=int(2 * sigma + 1))
    # print("    Applied uniform smoothing")
elif smoothing_method == 'median':
    Z_smooth = median_filter(Z, size=int(2 * sigma + 1))
    # print("    Applied median smoothing")
elif smoothing_method == 'savgol':
    Z_smooth = smooth_savgol(Z, sigma)
    print("    Applied savgol smoothing")
elif smoothing_method == 'bilateral':
    Z_smooth = smooth_bilateral(Z, sigma)
elif smoothing_method == 'anisotropic':
    Z_smooth = denoise_tv_chambolle(Z, weight=sigma)
elif smoothing_method == 'rebuild':
    rebuild_shape = (x_cm // rebuild_divide, y_cm // rebuild_divide)
    X, Y, Z_smooth = rebuild_full_surface_and_resample(X, Y, Z, rebuild_shape)
else:
    raise ValueError(f"Unsupported smoothing method: {smoothing_method}")

print(Z_smooth.shape)
Z_smooth_out = th.list_to_tree(Z_smooth.tolist())
X_out = th.list_to_tree(X.tolist())
Y_out = th.list_to_tree(Y.tolist())

# UV parameter extraction
uv_flat = [surface.ClosestPoint(pt) for pt in xyz_flat]
uv_array = np.array([[uv[1], uv[2]] for uv in uv_flat])

U = uv_array[:, 0].reshape((y_cm, x_cm), order='F')
V = uv_array[:, 1].reshape((y_cm, x_cm), order='F')

# Derivatives in U,V parameterization
du = dv = 1.0
Zu, Zv = np.gradient(Z_smooth, du, dv)
Zuu, Zuv = np.gradient(Zu, du, dv)
_, Zvv = np.gradient(Zv, du, dv)

# Fundamental forms (U,V)
E = Zu**2 + 1
F = Zu * Zv
G = Zv**2 + 1
L = Zuu
M = Zuv
N = Zvv

# Curvature computation

denom = E * G - F**2
sqrt_term = np.sqrt(np.clip((L * G - 2 * M * F + N * E)**2 - 4 * denom * (L * N - M**2), a_min=0, a_max=None))
k1 = ((L * G - 2 * M * F + N * E) + sqrt_term) / (2 * denom)
k2 = ((L * G - 2 * M * F + N * E) - sqrt_term) / (2 * denom)

# Max/Min curvature and vectors
k1_flat = k1.flatten(order='F')
k2_flat = k2.flatten(order='F')
use_k1_as_max = np.abs(k1_flat) >= np.abs(k2_flat)
max_curv = np.where(use_k1_as_max, k1_flat, k2_flat)
min_curv = np.where(use_k1_as_max, k2_flat, k1_flat)

# Principal directions remain XYZ-based for simplicity
# (original XYZ-based derivatives Zx,Zy needed here)
dx = dy = 1.0
Zx, Zy = np.gradient(Z_smooth, dx, dy)
Zxx, Zxy = np.gradient(Zx, dx, dy)
_, Zyy = np.gradient(Zy, dx, dy)

principal_dirs_max = np.zeros((y_cm, x_cm, 3))
principal_dirs_min = np.zeros((y_cm, x_cm, 3))

for ix in range(y_cm):
    for iy in range(x_cm):
        H = np.array([[Zxx[ix, iy], Zxy[ix, iy]], [Zxy[ix, iy], Zyy[ix, iy]]])
        eigvals, eigvecs = np.linalg.eigh(H)
        idx = np.argsort(np.abs(eigvals))[::-1]
        v_max = eigvecs[:, idx[0]]
        v_min = eigvecs[:, idx[1]]
        dzdx, dzdy = Zx[ix, iy], Zy[ix, iy]
        normal = np.array([-dzdx, -dzdy, 1.0])
        normal /= np.linalg.norm(normal)
        d_max = np.array([v_max[0], v_max[1], v_max[0]*dzdx + v_max[1]*dzdy])
        d_min = np.array([v_min[0], v_min[1], v_min[0]*dzdx + v_min[1]*dzdy])
        d_max -= np.dot(d_max, normal) * normal
        d_min -= np.dot(d_min, normal) * normal
        principal_dirs_max[ix, iy] = d_max / np.linalg.norm(d_max)
        principal_dirs_min[ix, iy] = d_min / np.linalg.norm(d_min)
max_vecs = (principal_dirs_max * np.abs(max_curv).reshape((y_cm, x_cm), order='F')[:, :, np.newaxis]).reshape(-1, 3, order='F')
min_vecs = (principal_dirs_min * np.abs(min_curv).reshape((y_cm, x_cm), order='F')[:, :, np.newaxis]).reshape(-1, 3, order='F')

# Rebuild curvature array
curvature_array = np.zeros((len(xyz_flat), 8))
curvature_array[:, 0] = max_curv
curvature_array[:, 1] = min_curv
curvature_array[:, 2:5] = max_vecs
curvature_array[:, 5:8] = min_vecs
print("Curvature array shape:", curvature_array.shape)

# Reshape and stack
reshaped_channels = [np.reshape(curvature_array[:, i], (y_cm, x_cm), order='F') for i in range(n_of_features_channels)]
feature_array = np.stack(reshaped_channels, axis=-1)
print("Feature array shape (H, W, C):", feature_array.shape)

# Convert to Tensor
feature_tensor = torch.from_numpy(feature_array).unsqueeze(0).permute(0, 3, 1, 2).float()
print("Feature tensor shape (B, C, H, W):", feature_tensor.shape)

# Normalize
min_tensor = torch.tensor(features_min).view(1, 8, 1, 1)
max_tensor = torch.tensor(features_max).view(1, 8, 1, 1)
feature_tensor = (feature_tensor - min_tensor) / (max_tensor - min_tensor)
print("Normalization complete.")

# 🟡 Save original size before padding
_, _, orig_h, orig_w = feature_tensor.shape


# Pad normalized input to match training shape
feature_tensor = pad_tensor(40,40, feature_tensor)

# Load and predict
model = OurVgg16()
model.load_state_dict(torch.load(model_path, map_location=torch.device('cpu')))
model.eval()
print("Model loaded and set to eval mode.")

# Step 3: Model inference
import time
start_time = time.time()
with torch.no_grad():
    prediction = model(feature_tensor)
    print("Prediction shape:", prediction.shape)
end_time = time.time()
print(f"Inference time: {end_time - start_time:.4f} seconds")
# crop
prediction = prediction[:, :, :orig_h, :orig_w]


denorm_prediction = prediction * 180.0
prediction_np = denorm_prediction.squeeze().numpy()
prediction = prediction_np.flatten(order='F').tolist()
print("Prediction complete and flattened.")
# ---------- end inverse_prediction_smooth ----------
forward_optimization_direct = Python3Script(
    labels_max=max,
    labels_min=min,
    x_cm=roundf_4.Rounded,
    y_cm=roundf_3.Rounded,
    patch_x=patch_size,
    patch_y=patch_size,
    n_of_features_channels=number_slider_34,
    n_of_labels_channels=number_slider_35,
    model_path=model_path_24_layers,
    step_num=number_slider_36,
    target=flatten)  # -> out, pred_prev, target_prev, angles_out; inputs labels_max: list of Double, labels_min: list of Double, x_cm: Int32, y_cm: Int32, patch_x: Int32, patch_y: Int32, n_of_features_channels: Int32, n_of_labels_channels: Int32, step_num: Int32, target: list of Point3d; disabled
# ---------- forward_optimization_direct: Python ----------
# ┌───────────────────────────────────────────────────────────────────────────┐
# │                      Imports and Definitions                              │
# └───────────────────────────────────────────────────────────────────────────┘
# venv: forward_prediction_XYZ opt
# r: numpy, torch, matplotlib, pathlib, open3d, nlopt

import time
import os


import numpy as np
import torch 
import torch.nn as nn
from torch.optim.lr_scheduler import ReduceLROnPlateau
from Grasshopper import DataTree
from Grasshopper.Kernel.Data import GH_Path
import matplotlib
import matplotlib.pyplot as plt
matplotlib.use('Agg')  # Use a non-interactive backend
from pathlib import Path
import torch.nn.functional as F
import Rhino.Geometry as rg
import open3d as o3d
from scipy.stats import qmc
import nlopt

features_channels = n_of_labels_channels 
labels_channels =  n_of_features_channels 

step_num = 10000

# ┌───────────────────────────────────────────────────────────────────────────┐
# │                               Functions                                   │
# └───────────────────────────────────────────────────────────────────────────┘

def duplicate_pixel_data(input_data, x_cm, y_cm, patch_x, patch_y, fortran_order=False):
    """
    Duplicates coarse grid values into patches in a larger tensor.
    
    Args:
        input_data (list, np.ndarray, or torch.Tensor): Either flat or 2D grid of values.
        x_cm (int): Width of output grid.
        y_cm (int): Height of output grid.
        patch_x (int): Width of each patch.
        patch_y (int): Height of each patch.
        fortran_order (bool): Whether to interpret flat input in column-major (Fortran) order.

    Returns:
        torch.Tensor: 4D tensor of shape (1, 1, y_cm, x_cm) with duplicated values.
    """
    num_patches_y = y_cm // patch_y
    num_patches_x = x_cm // patch_x
    expected_size = num_patches_y * num_patches_x

    # Convert input to torch tensor
    if isinstance(input_data, torch.Tensor):
        tensor_input = input_data
    elif isinstance(input_data, np.ndarray):
        tensor_input = torch.tensor(input_data, dtype=torch.float32)
    elif isinstance(input_data, list):
        tensor_input = torch.tensor(input_data, dtype=torch.float32)
    else:
        raise TypeError("Unsupported input type")

    # Handle flat input: reshape into 2D grid
    if tensor_input.dim() == 1:
        assert tensor_input.numel() == expected_size, f"Expected {expected_size} values, got {tensor_input.numel()}"
        if fortran_order:
            np_input = tensor_input.numpy().reshape((num_patches_y, num_patches_x), order='F')
            tensor_input = torch.tensor(np_input, dtype=torch.float32)
        else:
            tensor_input = tensor_input.view(num_patches_y, num_patches_x)

    final_tensor = torch.zeros((1, 1, y_cm, x_cm), dtype=torch.float32)

    for i in range(num_patches_y):
        for j in range(num_patches_x):
            row_start = i * patch_y
            row_end = row_start + patch_y
            col_start = j * patch_x
            col_end = col_start + patch_x
            final_tensor[:, 0, row_start:row_end, col_start:col_end] = tensor_input[i, j]


    return final_tensor


def duplicate_pixel_data_torch(input_data, x_cm, y_cm, patch_x, patch_y, fortran_order=False):
    num_patches_y = y_cm // patch_y
    num_patches_x = x_cm // patch_x
    expected_size = num_patches_y * num_patches_x

    # --- 1. Convert input to tensor (keeps gradient if it's already a Parameter)
    if not isinstance(input_data, torch.Tensor):
        tensor_input = torch.tensor(input_data, dtype=torch.float32)
    else:
        tensor_input = input_data

    # --- 2. Reshape flat input to 2D grid if needed
    if tensor_input.dim() == 1:
        assert tensor_input.numel() == expected_size, \
            f"Expected {expected_size} values, got {tensor_input.numel()}"
        if fortran_order:
            tensor_input = tensor_input.view(num_patches_x, num_patches_y).T
        else:
            tensor_input = tensor_input.view(num_patches_y, num_patches_x)

    # --- 3. Expand each value into its patch (vectorized)
    # Add channel/batch dims: (1, 1, num_patches_y, num_patches_x)
    tensor_input = tensor_input.unsqueeze(0).unsqueeze(0)

    # Expand along height and width
    tensor_expanded = tensor_input.repeat_interleave(patch_y, dim=2).repeat_interleave(patch_x, dim=3)
    # tensor_expanded now has shape (1, 1, y_cm, x_cm)

    return tensor_expanded


def tensor_to_spatial_tree(tensor):
    """
    Converts a [1, C, H, W] tensor into a DataTree[float] with each {h,w} as a branch
    containing C channel values.
    """
    tree = DataTree[float]()
    tensor = tensor.detach().squeeze(0)  # shape: [C, H, W]
    C, H, W = tensor.shape
    print(f"tensor shape before conversion: {C}, {H}, {W}")

    for y in range(H):
        for x in range(W):
            path = GH_Path(y, x)
            for ch in range(C):
                tree.Add(float(tensor[ch, y, x]), path)

    return tree

def chamfer_loss_with_registration(predicted, target):
    # Flatten from (1,3,x,y) to (N,3)
    P = predicted.permute(0, 2, 3, 1).reshape(-1, 3)
    Q = target.permute(0, 2, 3, 1).reshape(-1, 3)

    # Align predicted to target  - Simple
    P_aligned = rough_align(P, Q)
    # P_aligned, R, t = torch_icp(P, Q, iters=8, blend=0.3)
    # P_aligned = P


    # Compute Chamfer
    diff = P_aligned.unsqueeze(1) - Q.unsqueeze(0)  # (N, N, 3)
    dist = torch.sum(diff**2, dim=2)
    min_P_to_Q = dist.min(dim=1)[0]
    min_Q_to_P = dist.min(dim=0)[0]
    loss = min_P_to_Q.mean() + min_Q_to_P.mean()

    #  RESHAPE back to (1, 3, y, x) for preview
    y_dim, x_dim = predicted.shape[2], predicted.shape[3]
    prediction_aligned_grid = P_aligned.T.reshape(1, 3, y_dim, x_dim)

    return loss, prediction_aligned_grid

def chamfer_loss_weighted_edges(predicted, target, edge_weight=50.0):
    """
    Chamfer loss with additional emphasis on edge points.
    `edge_weight`: multiplier applied to loss for boundary points only.
    """
    # Flatten from (1, 3, H, W) to (N, 3)
    B, C, H, W = predicted.shape
    P = predicted.permute(0, 2, 3, 1).reshape(-1, 3)  # (B*H*W, 3)
    Q = target.permute(0, 2, 3, 1).reshape(-1, 3)

    # Align predicted to target
    P_aligned = rough_align(P, Q)
    # P_aligned = P

    # Create edge masks (1 if boundary, 0 otherwise) for both predicted and target
    edge_mask = torch.zeros((H, W), dtype=torch.bool, device=predicted.device)
    edge_mask[0, :] = edge_mask[-1, :] = edge_mask[:, 0] = edge_mask[:, -1] = True
    edge_mask_flat = edge_mask.flatten()

    # Compute Chamfer distances
    diff = P_aligned.unsqueeze(1) - Q.unsqueeze(0)  # (N, N, 3)
    dist = torch.sum(diff**2, dim=2)

    min_P_to_Q = dist.min(dim=1)[0]
    min_Q_to_P = dist.min(dim=0)[0]

    # Apply weights to boundary points
    weights_P = torch.ones_like(min_P_to_Q)
    weights_P[edge_mask_flat] *= edge_weight

    weights_Q = torch.ones_like(min_Q_to_P)
    weights_Q[edge_mask_flat] *= edge_weight

    loss = (min_P_to_Q * weights_P).mean() + (min_Q_to_P * weights_Q).mean()

    # Reshape aligned prediction back for visualization
    prediction_aligned_grid = P_aligned.T.reshape(1, 3, H, W)

    return loss, prediction_aligned_grid


def rough_align(P, Q):
    """
    Roughly aligns P to Q by:
    - Matching centers
    - Building orientation from P only
    - Reusing orientation for Q (so identical clouds don’t get rotated)
    """

    # print("\n--- Rough Farthest-Edge Align (Safe) Debug ---")

    # 1. Compute centers
    P_center = P.mean(0, keepdim=True)
    Q_center = Q.mean(0, keepdim=True)
    # P_centered = P - P_center
    # Q_centered = Q - Q_center
    P_centered = P 
    Q_centered = Q 

    # 2. Use farthest point pair on P to define primary axis
    diffP = P_centered.unsqueeze(1) - P_centered.unsqueeze(0)
    distP = torch.sum(diffP ** 2, dim=2)
    iP, jP = torch.nonzero(distP == distP.max(), as_tuple=True)
    idxP1, idxP2 = iP[0].item(), jP[0].item()

    xP = (P_centered[idxP2] - P_centered[idxP1])
    xP = xP / torch.norm(xP)

    # 3. Secondary axis from P
    maskP = torch.ones(len(P_centered), dtype=torch.bool)
    maskP[[idxP1, idxP2]] = False
    subP = P_centered[maskP]
    diffP2 = subP.unsqueeze(1) - subP.unsqueeze(0)
    distP2 = torch.sum(diffP2 ** 2, dim=2)
    iP2, jP2 = torch.nonzero(distP2 == distP2.max(), as_tuple=True)
    idxP3, idxP4 = iP2[0].item(), jP2[0].item()
    yP_raw = subP[idxP4] - subP[idxP3]

    yP = yP_raw - torch.dot(yP_raw, xP) * xP
    yP = yP / torch.norm(yP)

    # 4. Build right-handed frame from P
    zP = torch.cross(xP, yP)
    frame_P = torch.stack([xP, yP, zP], dim=1)

    # ✅ Use the SAME frame for Q (no recalculation)
    frame_Q = frame_P.clone()

    # print("Frame P:\n", frame_P)
    # print("Frame Q (reused):\n", frame_Q)

    # 5. Rotation (now guaranteed identity if geometry is identical)
    R = frame_Q @ frame_P.T
    # print("Rotation matrix R:\n", R)
    # print("det(R):", torch.det(R).item())

    # 6. Translation
    t = Q_center - P_center @ R
    # print("Translation vector t:", t.tolist())

    # 7. Apply
    P_aligned = P @ R + t

    return P_aligned

def pointlist3d_to_tensor_grid(pointlist3d, x, y):
    """
    Converts a Point3d list into a (1, 3, x, y) tensor.
    Assumes point list is ordered row-major or column-major to match the grid.
    """
    coords = [[pt.X, pt.Y, pt.Z] for pt in pointlist3d]
    tensor = torch.tensor(coords, dtype=torch.float32)   # (N, 3)
    tensor = tensor.T.reshape(1, 3, y, x)  # now matches model output shape
    return tensor

def register_pointclouds_gh(P_list, Q_list, distance_threshold=0.01):
    """
    Aligns point cloud P onto Q using:
      1. Center translation
      2. Fast Global Registration
      3. ICP refinement

    Inputs:
        P_list: list of rg.Point3d (source)
        Q_list: list of rg.Point3d (target)
        distance_threshold: ICP max correspondence distance

    Outputs:
        aligned_points: list of rg.Point3d (P aligned to Q)
        final_transformation: 4x4 numpy array
    """

    print("\n--- GH Registration Debug ---")

    # --- 1. Convert GH points to numpy arrays ---
    P_np = np.array([[pt.X, pt.Y, pt.Z] for pt in P_list], dtype=np.float64)
    Q_np = np.array([[pt.X, pt.Y, pt.Z] for pt in Q_list], dtype=np.float64)

    # --- 2. Compute centers ---
    P_center = P_np.mean(axis=0)
    Q_center = Q_np.mean(axis=0)
    print("P center:", P_center, "Q center:", Q_center)

    P_centered = P_np - P_center
    Q_centered = Q_np - Q_center

    # --- 3. Build Open3D point clouds ---
    pcd_P = o3d.geometry.PointCloud()
    pcd_Q = o3d.geometry.PointCloud()
    pcd_P.points = o3d.utility.Vector3dVector(P_centered)
    pcd_Q.points = o3d.utility.Vector3dVector(Q_centered)

    # --- 4. Estimate normals (for registration) ---
    pcd_P.estimate_normals(o3d.geometry.KDTreeSearchParamHybrid(radius=0.1, max_nn=30))
    pcd_Q.estimate_normals(o3d.geometry.KDTreeSearchParamHybrid(radius=0.1, max_nn=30))

    # --- 5. Compute FPFH features for Fast Global Registration ---
    radius_feature = 0.25
    pcd_P_fpfh = o3d.pipelines.registration.compute_fpfh_feature(
        pcd_P, o3d.geometry.KDTreeSearchParamHybrid(radius=radius_feature, max_nn=100)
    )
    pcd_Q_fpfh = o3d.pipelines.registration.compute_fpfh_feature(
        pcd_Q, o3d.geometry.KDTreeSearchParamHybrid(radius=radius_feature, max_nn=100)
    )

    # --- 6. Fast Global Registration ---
    fgr_result = o3d.pipelines.registration.registration_fgr_based_on_feature_matching(
        pcd_P, pcd_Q, pcd_P_fpfh, pcd_Q_fpfh,
        o3d.pipelines.registration.FastGlobalRegistrationOption(
            maximum_correspondence_distance=distance_threshold
        )
    )
    print("FGR transformation:\n", fgr_result.transformation)

    # --- 7. ICP refinement ---
    icp_result = o3d.pipelines.registration.registration_icp(
        pcd_P, pcd_Q, distance_threshold,
        fgr_result.transformation,
        o3d.pipelines.registration.TransformationEstimationPointToPlane()
    )
    print("ICP refined transformation:\n", icp_result.transformation)

    # --- 8. Apply final transformation ---
    P_registered = np.asarray(pcd_P.points)
    P_registered_h = np.hstack((P_registered, np.ones((P_registered.shape[0], 1))))  # (N,4)
    P_transformed = (icp_result.transformation @ P_registered_h.T).T[:, :3]

    # --- 9. Add back Q’s center (since we centered earlier) ---
    P_aligned = P_transformed + Q_center

    # --- 10. Convert back to GH Point3d ---
    aligned_points = [rg.Point3d(float(x), float(y), float(z)) for x, y, z in P_aligned]

    return aligned_points, icp_result.transformation


def one_time_open3d_align(predicted, target):
    """
    Runs Open3D once to coarsely align target to predicted.
    Returns: transformed_target (torch.Tensor, same shape as target)
    """
    # Flatten from (1, 3, x, y) -> (N, 3)
    P = predicted.permute(0, 2, 3, 1).reshape(-1, 3).detach().cpu().numpy()
    Q = target.permute(0, 2, 3, 1).reshape(-1, 3).detach().cpu().numpy()

    # Convert to GH Point3d for the existing registration function
    P_points = [rg.Point3d(float(x), float(y), float(z)) for x, y, z in P]
    Q_points = [rg.Point3d(float(x), float(y), float(z)) for x, y, z in Q]

    aligned_points, transform = register_pointclouds_gh(P_points, Q_points)

    # Convert aligned target back to Torch tensor
    Q_aligned_np = np.array([[pt.X, pt.Y, pt.Z] for pt in aligned_points], dtype=np.float32)
    Q_aligned = torch.tensor(Q_aligned_np, dtype=target.dtype, device=target.device)

    # Reshape back to (1, 3, y, x)
    y_dim, x_dim = target.shape[2], target.shape[3]
    Q_aligned_grid = Q_aligned.T.reshape(1, 3, y_dim, x_dim)

    return Q_aligned_grid


def torch_icp(P, Q, iters=3, blend=0.2):
    """
    Differentiable ICP with controllable step size.
    blend: 0-1, fraction of ICP transform to apply each iteration.
    """
    R_total = torch.eye(3, device=P.device, dtype=P.dtype)
    t_total = torch.zeros(1, 3, device=P.device, dtype=P.dtype)

    P_aligned = P

    for i in range(iters):
        # Find correspondences
        diff = P_aligned.unsqueeze(1) - Q.unsqueeze(0)
        dist = (diff**2).sum(dim=2)
        idx = dist.argmin(dim=1)
        Q_matched = Q[idx]

        # Centroids
        P_mean = P_aligned.mean(0, keepdim=True)
        Q_mean = Q_matched.mean(0, keepdim=True)

        # Solve for R, t
        P_centered = P_aligned - P_mean
        Q_centered = Q_matched - Q_mean
        H = P_centered.T @ Q_centered
        U, S, Vt = torch.linalg.svd(H)
        R = Vt.T @ U.T
        if torch.det(R) < 0:
            Vt[-1, :] *= -1
            R = Vt.T @ U.T
        t = Q_mean - P_mean @ R

        # ✅ Blended update
        R_step = (1-blend) * torch.eye(3, device=P.device) + blend * R
        t_step = blend * t

        # Apply the “partial” transform
        P_aligned = P_aligned @ R_step + t_step

        # Accumulate transform
        R_total = R_step @ R_total
        t_total = (t_step @ R_total) + t_total

    return P_aligned, R_total, t_total

def wrap_angles_to_180(angles):
    angles_mod = torch.remainder(angles, 360.0)
    wrapped = torch.where(angles_mod > 180.0, 360.0 - angles_mod, angles_mod)
    return wrapped


def lhs_generate_candidates(num_candidates, num_angles):
    """
    Generate candidate angle sets in [0,180] using Latin Hypercube Sampling.
    """
    sampler = qmc.LatinHypercube(d=num_angles)
    samples = sampler.random(num_candidates)  # values in [0,1]
    angles = torch.tensor(samples * 180.0, dtype=torch.float32)
    return angles

def evaluate_candidates(angles_candidates, model, target_normalized):
    """
    Evaluate each LHS candidate by computing the loss through the model.
    Return the best angle set and its loss.
    """
    best_loss = float("inf")
    best_angles = None

    for i in range(angles_candidates.shape[0]):
        candidate = angles_candidates[i]

        # Prepare input grid
        candidate_grid = duplicate_pixel_data_torch(
            candidate,
            x_cm=x_cm,
            y_cm=y_cm,
            patch_x=patch_x,
            patch_y=patch_y,
            fortran_order=True
        )

        # Forward pass
        prediction = model(candidate_grid / 180.0)

        # Compute loss
        # loss, _ = chamfer_loss_with_registration(prediction, target_normalized)
        loss, _ = chamfer_loss_weighted_edges(prediction, target_normalized)
        loss = loss * 100
        loss_val = loss.item()

        if loss_val < best_loss:
            best_loss = loss_val
            best_angles = candidate.clone()

    return best_angles, best_loss


def tensors_to_pointlists(prediction, target):
    """
    Convert model prediction and target (shape: (1, 3, y, x)) into
    two flat lists of Rhino Point3d for Grasshopper visualization.

    Args:
        prediction: torch.Tensor of shape (1, 3, y, x)
        target: torch.Tensor of shape (1, 3, y, x)

    Returns:
        pred_points (list[rg.Point3d]), target_points (list[rg.Point3d])
    """
    # Move to CPU and remove batch dim
    pred_np = prediction.detach().cpu().numpy().squeeze()   # (3, y, x)
    target_np = target.detach().cpu().numpy().squeeze()     # (3, y, x)

    y_dim, x_dim = pred_np.shape[1], pred_np.shape[2]
    pred_points, target_points = [], []

    for i in range(y_dim):
        for j in range(x_dim):
            # predicted point
            px, py, pz = pred_np[:, i, j]
            pred_points.append(rg.Point3d(float(px), float(py), float(pz)))

            # target point
            tx, ty, tz = target_np[:, i, j]
            target_points.append(rg.Point3d(float(tx), float(ty), float(tz)))

    return pred_points, target_points
# ┌───────────────────────────────────────────────────────────────────────────┐
# │                             Model Class                                   │
# └───────────────────────────────────────────────────────────────────────────┘

class OurVgg16InstanceNorm2d24lay(torch.nn.Module):
    def __init__(self, dropout=0.3):
        super().__init__()
        self.features = torch.nn.Sequential(
            # Stage 1
            self.block(features_channels, 64),
            self.block(64, 64),
            self.block(64, 64),
            self.block(64, 64, dropout),

            # Stage 2
            self.block(64, 128),
            self.block(128, 128),
            self.block(128, 128),
            self.block(128, 128, dropout),

            # Stage 3
            self.block(128, 256),
            self.block(256, 256),
            self.block(256, 256),
            self.block(256, 256, dropout),

            # Stage 4
            self.block(256, 512),
            self.block(512, 512),
            self.block(512, 512),
            self.block(512, 512, dropout),

            # Stage 5
            self.block(512, 768),
            self.block(768, 768),
            self.block(768, 768),
            self.block(768, 768, dropout),

            # Stage 6
            self.block(768, 1024),
            self.block(1024, 1024),
            self.block(1024, 1024),
            self.block(1024, 1024, dropout),
        )
        self.output_conv = torch.nn.Conv2d(1024, labels_channels, 3, padding=1)
        self.sigmoid = torch.nn.Sigmoid()

    def block(self, in_ch, out_ch, apply_dropout=False):
        layers = [
            torch.nn.Conv2d(in_ch, out_ch, kernel_size=3, padding=1),
            torch.nn.InstanceNorm2d(out_ch),
            torch.nn.ReLU()
        ]
        if apply_dropout:
            layers.append(torch.nn.Dropout())
        return torch.nn.Sequential(*layers)

    def forward(self, x):
        x = self.features(x)
        x = self.output_conv(x)
        x = self.sigmoid(x)
        return x
# ┌───────────────────────────────────────────────────────────────────────────┐
# │                        Main Code - Optimization                           │
# └───────────────────────────────────────────────────────────────────────────┘

torch.manual_seed(42)
import random, numpy as np
random.seed(42)
np.random.seed(42)

device = torch.device("cuda" if torch.cuda.is_available() else "cpu")
print(f"Using device: {device}")

# Define the Model
start_time = time.time()
model = OurVgg16InstanceNorm2d24lay()
model.load_state_dict(torch.load(model_path, map_location=device))
model.eval()  # ensure correct evaluation mode
model.to(device)

# Convert target to tensor
target = pointlist3d_to_tensor_grid(target, x=x_cm, y=y_cm)

# Normalize the target
labels_max_tensor = torch.tensor(labels_max, dtype=torch.float32).view(1, -1, 1, 1)
labels_min_tensor = torch.tensor(labels_min, dtype=torch.float32).view(1, -1, 1, 1)

target_normalized = (target - labels_min_tensor) / (labels_max_tensor - labels_min_tensor + 1e-8)
target_normalized = target_normalized.to(device)
print(f"Target shape: {target.shape}")


# 1. Initialize angles 
num_angles = int((x_cm / patch_x) * (y_cm / patch_y))

#LHS
# Step 1: Generate candidates
num_candidates = 5000
angles_candidates = lhs_generate_candidates(num_candidates, num_angles).to(device)

# Step 2: Evaluate candidates
print("Evaluating LHS candidates...")
best_angles, best_loss = evaluate_candidates(angles_candidates, model, target_normalized)

print(f" Best candidate found with loss={best_loss:.6f}")
# Step 3: Use best_angles to initialize optimizer
angles = torch.nn.Parameter(best_angles, requires_grad=True)

# 🔹 Run Open3D once
angles_grid_temp = duplicate_pixel_data_torch(angles, 
                                    x_cm=x_cm, 
                                    y_cm=y_cm, 
                                    patch_x=patch_x, 
                                    patch_y=patch_y, 
                                    fortran_order=True).to(device)

prediction = model(angles_grid_temp/180.0) 
target_aligned = one_time_open3d_align(prediction, target_normalized)
print(" Target point cloud aligned once with Open3D")


# Step 2: Evaluate candidates again after aligment
print("Evaluating LHS candidates...")
best_angles, best_loss = evaluate_candidates(angles_candidates, model, target_aligned)
print(f" Best candidate found after aligment with loss={best_loss:.6f}")

# Init prediction_alinged so it's not local 
prediction_aligned = None

call_counter = {'count': 0}  # use mutable object to hold counter

def objective_function(x, grad=None):
    call_counter['count'] += 1

    with torch.no_grad():
        angles_tensor = torch.tensor(x, dtype=torch.float32, device=device)
        wrapped_angles = wrap_angles_to_180(angles_tensor)
        angles_grid = duplicate_pixel_data_torch(wrapped_angles,
                                                 x_cm=x_cm,
                                                 y_cm=y_cm,
                                                 patch_x=patch_x,
                                                 patch_y=patch_y,
                                                 fortran_order=True).to(device)
        pred = model(angles_grid / 180.0)
        loss, _ = chamfer_loss_weighted_edges(pred, target_normalized)
        loss_value = float(loss.item()) * 100.0

    if call_counter['count'] % 100 == 0:
        print(f"NLOpt step {call_counter['count']} – loss: {loss_value:.6f}")

    return loss_value


# Set up NLOpt optimizer
opt = nlopt.opt(nlopt.GN_DIRECT_L, num_angles)
opt.set_lower_bounds([0.0] * num_angles)
opt.set_upper_bounds([180.0] * num_angles)
opt.set_min_objective(objective_function)
opt.set_maxeval(3000)

initial_guess = best_angles.detach().cpu().numpy().tolist()  # from LHS stage
x_best = opt.optimize(initial_guess)
final_loss = opt.last_optimum_value()


final_angles = torch.tensor(x_best, dtype=torch.float32, device=device)
wrapped_angles = wrap_angles_to_180(final_angles)

# Forward pass for preview
angles_grid = duplicate_pixel_data_torch(wrapped_angles,
                                         x_cm=x_cm,
                                         y_cm=y_cm,
                                         patch_x=patch_x,
                                         patch_y=patch_y,
                                         fortran_order=True).to(device)
prediction = model(angles_grid / 180.0)
final_loss, prediction_aligned = chamfer_loss_weighted_edges(prediction, target_normalized)
# Final output formatting

print(f"✅ NLOpt optimization complete. Loss: {final_loss:.6f}")

# 3. Preview
scale_factor = 100.0  
# prediction_aligned = prediction

prediction_aligned = prediction_aligned.float() * scale_factor
target_normalized = target_normalized.float() * scale_factor
pred_prev, target_prev = tensors_to_pointlists(prediction_aligned, target_normalized)
end_time = time.time()

angles = final_angles  # from NLOpt output
optimized_angles = angles.detach().cpu().numpy()

print(f"optimized angles: {optimized_angles}")
print(f"Optimization time: {end_time - start_time:.4f} seconds")

# ✅ Wrap angles so they are in [0,180]
final_angles = wrap_angles_to_180(angles)

# ✅ Round to nearest int
rounded_angles = torch.round(final_angles).to(torch.int)

# ✅ Convert to Python list for Grasshopper
angles_out = rounded_angles.cpu().numpy().tolist()
# ---------- end forward_optimization_direct ----------
pt_5 = Point(forward_optimization_direct.pred_prev)
pt_6 = Point(forward_optimization_direct.target_prev)
prediction = Number(inverse_prediction_smooth.prediction)

# ---- group: Optimizer
pt_7 = Point(pt_5)
swatch_5 = ColourSwatch(SwatchColor=RGBA(25, 0, 255, 115))
pt_8 = Point(pt_6)
preview_2 = CustomPreview(Geometry=pt_7, Material=swatch_5)
preview_3 = CustomPreview(Geometry=pt_8, Material=ColourSwatch(SwatchColor=RGBA(255, 0, 0, 114)))

# ----
panel_18 = Panel(forward_optimization_direct.angles_out)

# ---- group: Get Average Per Patch
item_3 = ListItem(List=flatten(flip), Index=0, Wrap=True)
int = Integer(roundf_4.Rounded)
int_2 = Integer(roundf_3.Rounded)
int_3 = Integer(prediction)
patch_average = Python3Script(
    angles=int_3,
    x_cm=int,
    y_cm=int_2,
    patch_x=patch_size,
    patch_y=patch_size,
    is_weighted=Toggle(True),
    weight=w,
    is_concentric=Toggle(True))  # -> out, patches_avgs, flat_avg; inputs angles: list of Double, x_cm: Int32, patch_x: Int32, patch_y: Int32, is_weighted: Boolean, weight: Double, is_concentric: Boolean
# ---------- patch_average: Python ----------
# r: numpy
# venv: patch_average

"""
Compute averaged values over patches in a 2D angle grid, with optional spatial weighting.

This script processes a flattened list of angles arranged in a (y_cm, x_cm) grid, dividing it into patches of size (patch_y, patch_x). 
Each patch's average is computed, optionally using either concentric (layered) or Gaussian-like spatial weighting.

Parameters:
- angles: flat list of angle values (0–180), ordered column-first (Fortran-style).
- y_cm, x_cm: dimensions of the grid.
- patch_y, patch_x: height and width of each patch.
- is_weighted: if True, use weighted averaging; otherwise, use simple mean.
- weight: float value > 0 controlling how strongly the weighting favors the patch center.
    - For concentric: higher = more center-heavy decay by layer.
    - For radial (Gaussian-like): higher = sharper falloff from center to edges.
- is_concentric: 
    - If True: uses concentric shell (layer-based) weighting — all pixels in a ring around the center have the same weight.
    - If False: uses radial (Euclidean distance) Gaussian-style decay.

Returns:
- flat_avg: list of patch-averaged values, flattened column-first.
- Prints patch locations, involved indices, raw values, and calculated averages for debugging.
"""

import numpy as np

grid = np.array(angles).reshape((y_cm, x_cm), order='F')  # (15, 20)

patch_avgs = []
for i in range(0, y_cm, patch_y):
    row = []
    for j in range(0, x_cm, patch_x):
        patch = grid[i:i+patch_y, j:j+patch_x]
        if is_concentric:
            if is_weighted:
                cy, cx = patch.shape[0] // 2, patch.shape[1] // 2
                yy, xx = np.meshgrid(np.arange(patch.shape[0]), np.arange(patch.shape[1]), indexing='ij')
                
                # Compute concentric "layer" distances (Manhattan shells)
                layer = np.maximum(np.abs(yy - cy), np.abs(xx - cx))  # same layer = same weight
                
                # Assign weights: inner layers get higher weights
                decay = np.power(1.0 / weight, layer)
                
                # Normalize so the sum of weights is 1
                decay /= np.sum(decay)
                
                # Weighted average
                avg = np.sum(patch * decay)
            else:
                avg = np.mean(patch)
        else:
            if is_weighted:
                cy, cx = patch.shape[0] // 2, patch.shape[1] // 2
                yy, xx = np.meshgrid(np.arange(patch.shape[0]), np.arange(patch.shape[1]), indexing='ij')
                distances = np.sqrt((yy - cy)**2 + (xx - cx)**2)
                max_dist = np.sqrt(cy**2 + cx**2) or 1
                decay = np.exp(-weight * (distances / max_dist)**2)
                decay /= np.sum(decay)  # normalize to sum=1
                avg = np.sum(patch * decay)
            else:
                avg = np.mean(patch)


        # Calculate original flat indices from angles
        indices = []
        for dy in range(patch_y):
            for dx in range(patch_x):
                iy = i + dy
                jx = j + dx
                if iy < y_cm and jx < x_cm:
                    flat_index = iy * x_cm + jx
                    indices.append(flat_index)

        print(f"Patch (row={i//patch_y}, col={j//patch_x})")
        print(f"  Flat indices: {indices}")
        print(f"  Values: {[angles[k] for k in indices]}")
        print(f"  Average: {avg}")
        row.append(avg)
    patch_avgs.append(row)

flat_avg = np.array(patch_avgs).flatten(order='F').tolist()
# ---------- end patch_average ----------
division_4 = Division(A=roundf_4.Rounded, B=patch_size)
division_5 = Division(A=roundf_3.Rounded, B=patch_size)
recgrid_2 = Rectangular(Plane=item_3, SizeX=patch_size, SizeY=patch_size, ExtentX=division_4, ExtentY=division_5)  # -> flatten(Cells), flatten(Points)
area_2 = Area(Geometry=recgrid_2.Cells)  # -> Area, Centroid
panel_19 = Panel(patch_average.flat_avg)
round = Round(Number=patch_average.flat_avg)  # -> Nearest, Floor, Ceiling

# ---- group: Get Flat Grid
rectangle_2 = Rectangle(Plane=item_3, XSize=roundf_4.Rounded, YSize=roundf_3.Rounded, Radius=0)  # -> Rectangle, Length
sdivide_2 = DivideSurface(Surface=rectangle_2.Rectangle, UCount=roundf_4.Rounded, VCount=roundf_3.Rounded)  # -> Points, Normals, Parameters
ptcell = Cellulate(Grid=sdivide_2.Points)  # -> Wires, Cells, flatten(Meshes)
area_3 = MeshArea(Mesh=ptcell.Meshes)  # -> Area, Centroid

# ----
panel_20 = Panel(forward_optimization_xyz.angles_out)

optimized_python_component = Number(forward_optimization_direct.angles_out)
optimized_pycharm = Relay()  # disabled

patch_predictions = Integer(round.Nearest)

number_slider_37 = Slider(5, range=0..100)  # disabled
number_slider_38 = Slider(10, range=0..10)  # disabled
hatch = ModelHatch(
    Boundary=recgrid_2.Cells,
    HatchPattern=<geometry referenced from the Rhino model>,
    Rotation=patch_predictions,
    Scale=number_slider_37,
    ShowBoundary=True)  # -> Hatch, Boundary, Plane, HatchPattern, BasePoint, Rotation, Scale, ShowBoundary, Background, FillStyle; disabled
swatch_6 = ColourSwatch(SwatchColor=RGB(0, 0, 0))  # disabled
preview_4 = CustomPreview(Geometry=hatch.Hatch, Material=swatch_6)  # disabled

# ---- group: Visulization Per Pixel
round_2 = Round(Number=prediction)  # -> Nearest, Floor, Ceiling; disabled
gradient = Gradient(
    LowerLimit=0,
    UpperLimit=180,
    Parameter=round_2.Nearest,
    stops=[0: RGB(243, 57, 0), 0.1: RGB(236, 27, 60), 0.2: RGB(210, 0, 118), 0.3: RGB(103, 0, 120), 0.4: RGB(39, 72, 161), 0.5: RGB(1, 192, 229), 0.6: RGB(18, 178, 90), 0.7: RGB(79, 186, 8), 0.8: RGB(220, 237, 32), 0.9: RGB(247, 159, 20), 1: RGB(243, 57, 0)])  # disabled
# 4. Preview Fiber Prediction
ptcell_2 = Cellulate(Grid=flip)  # -> Wires, Cells, flatten(Meshes)
preview_5 = CustomPreview(Geometry=flatten(ptcell.Meshes), Material=gradient)  # disabled
tag_2 = TextTag(Location=flatten(area_3.Centroid), Text=round_2.Nearest, Colour=swatch_4)  # disabled

# ---- group: Visualization Per Patch(Average)
gradient_2 = Gradient(
    LowerLimit=0,
    UpperLimit=180,
    Parameter=patch_predictions,
    stops=[0: RGB(243, 57, 0), 0.1: RGB(236, 27, 60), 0.2: RGB(210, 0, 118), 0.3: RGB(103, 0, 120), 0.4: RGB(39, 72, 161), 0.5: RGB(1, 192, 229), 0.6: RGB(18, 178, 90), 0.7: RGB(79, 186, 8), 0.8: RGB(220, 237, 32), 0.9: RGB(247, 159, 20), 1: RGB(243, 57, 0)])  # disabled
srf_5 = Surface(recgrid_2.Cells)  # disabled
preview_6 = CustomPreview(Geometry=srf_5, Material=gradient_2)  # disabled
tag_3 = TextTag(Location=area_2.Centroid, Text=patch_predictions, Colour=swatch_4)  # disabled

# ---- group: Confidence
# ~0: Very similar
# >2 or 3: Outlier
similarity_to_dataset = Panel(inverse_prediction_smooth.similarity_score)  # disabled

# 1 = High Confidence
# 0 = Low Confidence
confidence = Panel(inverse_prediction_smooth.confidence_score)  # disabled

# ----
# 5. Simulation
simulation = Simulation(num=roundf_4.Rounded, num_2=roundf_3.Rounded, B_2=patch_size, B=patch_size, connect_angles=patch_predictions)  # -> L, number_slider_6, number_slider_7

# ---- group: Display Smoothing
number_slider_39 = Slider(0, range=0..100)  # disabled
number_slider_40 = Slider(0.5, range=0..1)  # disabled
pt_9 = ConstructPoint(
    XCoordinate=inverse_prediction_smooth.X_out,
    YCoordinate=inverse_prediction_smooth.Y_out,
    ZCoordinate=inverse_prediction_smooth.Z_smooth_out)  # disabled
orient_2 = Orient(Source=area.Centroid, Target=xy)  # -> Geometry, Transform; disabled
dist_2 = Distance(PointA=simplify(orient_2.Geometry), PointB=simplify(pt_9))  # -> flatten(Distance); disabled
gradient_3 = Gradient(
    LowerLimit=number_slider_39,
    UpperLimit=number_slider_40,
    Parameter=dist_2,
    stops=[0: RGB(0, 128, 0), 0.5: RGB(255, 255, 0), 1: RGB(255, 0, 0)])  # disabled
preview_7 = CustomPreview(Geometry=flatten(pt_9), Material=flatten(gradient_3))  # disabled

# ----
number_slider_41 = Slider(25, range=0..100)
sdivide_3 = DivideSurface(Surface=simulation.L, UCount=number_slider_41, VCount=number_slider_41)  # -> Points, Normals, Parameters
sdivide_4 = DivideSurface(Surface=srf_3, UCount=number_slider_41, VCount=number_slider_41)  # -> flatten(Points), Normals, Parameters
cp = ClosestPoint(Point=sdivide_3.Points, Cloud=sdivide_4.Points)  # -> ClosestPoint, CPIndex, flatten(Distance)
avr = Average(Input=cp.Distance)
panel_21 = Panel(avr)

# ---- group: Display Smoothing / OG
swatch_7 = ColourSwatch(SwatchColor=RGB(187, 255, 0))  # disabled
preview_8 = CustomPreview(Geometry=orient_2.Geometry, Material=swatch_7)  # disabled

# ---- group: Display Smoothing / After Smoothing
swatch_8 = ColourSwatch(SwatchColor=RGB(188, 153, 224))  # disabled
preview_9 = CustomPreview(Geometry=pt_9, Material=swatch_8)  # disabled

# ---- group: Display Smoothing / Middle
swatch_9 = ColourSwatch(SwatchColor=RGB(0, 17, 255))  # disabled
preview_10 = CustomPreview(Geometry=ptcenter_2, Material=swatch_9)  # disabled

# ---- group: Web Strengh
number_slider_42 = Slider(100, range=0..200)  # disabled
num_5 = Number(axialweb)  # disabled
subtraction_3 = Subtraction(A=num_5, B=number_slider_42)  # disabled
addition_3 = Addition(A=num_5, B=number_slider_42)  # disabled

# ----
clip_1 = Python3Script(d1=subtraction_3, d2=addition_3)  # -> out, d1, d2; inputs d1: Int32, d2: Int32; disabled; same code as clip_1

# ---- group: Web Strengh (continued)
dom_14 = ConstructDomain(DomainStart=clip_1.d1, DomainEnd=clip_1.d2)  # disabled

map_shrinkage_3 = MapShrinkage(curve=ln, curve_2=boundry, target=dom_14)  # disabled

# ---- group: Domains
number_slider_43 = Slider(0, range=0..0.1)  # disabled
num_6 = Number(matrix_shrinkage_factor_bottom)  # disabled
num_7 = Number(matrix_shrinkage_factor_top)  # disabled
subtraction_4 = Subtraction(A=num_7, B=number_slider_43)  # disabled
addition_4 = Addition(A=num_7, B=number_slider_43)  # disabled
dom_15 = ConstructDomain(DomainStart=subtraction_4, DomainEnd=addition_4)  # disabled

subtraction_5 = Subtraction(A=num_6, B=number_slider_43)  # disabled
addition_5 = Addition(A=num_6, B=number_slider_43)  # disabled

dom_16 = ConstructDomain(DomainStart=subtraction_5, DomainEnd=addition_5)  # disabled

# ---- group: Mat Shrinkage
map_shrinkage_4 = MapShrinkage(curve=mat_top, curve_2=boundry, target=dom_15)  # disabled

map_shrinkage_5 = MapShrinkage(curve=mat_bot, curve_2=boundry, target=dom_16)  # disabled

# ----
panel_22 = Panel(map_shrinkage_5)  # disabled

# ---- group: Top
rodtopfiber = Rod(
    Polyline=shatter_2,
    LengthFactor=fiber_shrinkage_factor_top,
    AngleFactor=1,
    AxialStrength=axialfiber,
    BendStrength=bendingfiber)  # disabled
rodtopmatrix = Rod(Polyline=shatter, LengthFactor=map_shrinkage_4, AngleFactor=1, AxialStrength=map_shrinkage, BendStrength=bendingmatrix)  # disabled

# ---- group: Bottom
rodbottomfiber = Rod(
    Polyline=shatter_4,
    LengthFactor=fiber_shrinkage_factor_bottom,
    AngleFactor=1,
    AxialStrength=axialfiber,
    BendStrength=bendingfiber)  # disabled
rodbottommatrix = Rod(
    Polyline=shatter_3,
    LengthFactor=map_shrinkage_5,
    AngleFactor=1,
    AxialStrength=map_shrinkage_2,
    BendStrength=bendingmatrix)  # disabled

# ----
rodtoptobot = Rod(Polyline=ln, LengthFactor=1, AngleFactor=1, AxialStrength=map_shrinkage_3, BendStrength=bendingweb)  # disabled
entwine = Entwine(
    Branch00=rodtopfiber,
    Branch01=rodtopmatrix,
    Branch02=rodtoptobot,
    Branch03=rodbottomfiber,
    Branch04=rodbottommatrix,
    Branch05=rodbotzipper,
    Branch06=graft(spc),
    Branch07=anchor,
    Branch08=load_2,
    FlattenInputs=True)  # disabled

zombiesolver_2 = ZombieSolver(GoalObjects=entwine, Threshold=raise_by_power, Tolerance=raise_by_power_2, MaxIterations=_8_m)  # -> I, V, O; disabled

# ---- group: Get Surface
geo = Geometry(zombiesolver_2.O)  # disabled
unflatten = UnflattenTree(Tree=geo, Guide=entwine)  # disabled
bang = ExplodeTree(Data=unflatten)  # -> Branch0, Branch1, Branch2, Branch3, Branch4, Branch5, Branch6, Branch7, Branch8; disabled
data = Data(bang.Branch1)  # disabled
data_2 = Data(bang.Branch2)  # disabled
data_3 = Data(bang.Branch3)  # disabled
data_4 = Data(bang.Branch4)  # disabled
data_5 = Data(bang.Branch0)  # disabled

# ----
panel_23 = Panel(zombiesolver_2.I)  # disabled

# ---- group: Get Surface / Get Sample Points
unflatten_2 = UnflattenTree(Tree=bang.Branch5, Guide=rodbotzipper)  # disabled
trim = TrimTree(Tree=unflatten_2, Depth=1)  # disabled
item_4 = ListItem(List=trim, Index=0, Wrap=True)  # -> flatten(Item); disabled
end = EndPoints(Curve=item_4)  # -> Start, End; disabled
sample_points = Data(end.Start)  # disabled

# ----
sort = SortList(Keys=cp.Distance)  # -> Keys, ValuesA
lng_3 = ListLength(List=sort.Keys)
graft_5 = GraftTree(Tree=panel_14, IncludeEmptyLists=True, IncludeNullItems=True)
graft_6 = GraftTree(Tree=data_5, IncludeEmptyLists=True, IncludeNullItems=True)
graft_7 = GraftTree(Tree=patch_predictions, IncludeEmptyLists=True, IncludeNullItems=True)
item_5 = ListItem(List=sort.Keys, Index=0, Wrap=True)
item_6 = ListItem(List=lng_3, Index=0, Wrap=True)
rec_3 = DataRecorder(avr, DataLimit=-10, RecordData=True)
rec_4 = DataRecorder(graft(graft_6), DataLimit=-10, RecordData=True)
rec_5 = DataRecorder(item_6, DataLimit=-10, RecordData=True)
rec_6 = DataRecorder(graft_7, DataLimit=-10, RecordData=True)
rec_7 = DataRecorder(item_5, DataLimit=-10, RecordData=True)
rec_8 = DataRecorder(graft(graft_5), DataLimit=-10, RecordData=True)
loss = Panel(rec_3)
panel_24 = Panel(rec_5)
highest = Panel(rec_7)
panel_25 = Panel(rec_4)
original_angles = Panel(rec_8)
predicted_angles = Panel(rec_6)

# ---- group: Get Surface / Lofted Surface
partition = PartitionList(List=flatten(sample_points), Size=expr("x", surface_y_size))  # disabled
intcrv = Interpolate(Vertices=partition, Degree=4, Periodic=False, KnotStyle=1)  # -> flatten(Curve), Length, Domain; disabled
loft = Loft(Curves=intcrv.Curve, Options={Adjust=False, Closed=False, LoftEnds=0, LoftSimp=0, LoftType=0, Rebuild=10, Refit=0.01})  # disabled

# ---- group: Random Simulated Surface
# Testing Model Results
# 1. Set Surface
srf_6 = Surface(loft)

# ----
srf_cp_3 = SurfaceClosestPoint(Point=sample_points, Surface=loft)  # -> Point, UVPoint, Distance; disabled
prune = PruneTree(Tree=simplify(predicted_angles), Minimum=3, Maximum=0)
write_to_excel = WriteToExcel(
    hello=panel_5,
    counter=num_2,
    top_shrinkage=matrix_shrinkage_factor_top,
    thickness=thickness,
    bottom_shrinkage=matrix_shrinkage_factor_bottom,
    iteration=loop_start.Counter,
    rows=number_of_rows,
    cols=number_of_columns,
    u=surface_y_size,
    v=surface_x_size,
    angles=connect_angles,
    output_sample_pt=simplify(sample_points),
    imput_sample_pt=simplify(ptcenter),
    input_uv=simplify(srf_cp.UVPoint),
    srf=loft,
    output_uv=srf_cp_3.UVPoint)  # disabled
branch = TreeBranch(Tree=simplify(prune), Path=number_slider_19, MaintainPaths=True)
branch_2 = TreeBranch(Tree=simplify(original_angles), Path=number_slider_19, MaintainPaths=True)
panel_26 = Panel(branch)
panel_27 = Panel(branch_2)

# ---- group: Optimizer
# 3.5.Predict Optimizer
pt_10 = Point([<point referenced from the Rhino model> x600])
pt_11 = Point([<point referenced from the Rhino model> x600])

# ---- group: Optimizer / Registration that works but isn't differentiable
pc_registration = Python3Script(P=pt_10, Q=pt_11)  # -> out, P_aligned, transform; inputs P: list of Point3d, Q: list of Point3d; disabled
# ---------- pc_registration: Python ----------
# venv: registration
# r: numpy, torch, open3d

import Rhino.Geometry as rg
import open3d as o3d
import numpy as np

def register_pointclouds_gh(P_list, Q_list, distance_threshold=0.01):
    """
    Aligns point cloud P onto Q using:
      1. Center translation
      2. Fast Global Registration
      3. ICP refinement

    Inputs:
        P_list: list of rg.Point3d (source)
        Q_list: list of rg.Point3d (target)
        distance_threshold: ICP max correspondence distance

    Outputs:
        aligned_points: list of rg.Point3d (P aligned to Q)
        final_transformation: 4x4 numpy array
    """

    print("\n--- GH Registration Debug ---")

    # --- 1. Convert GH points to numpy arrays ---
    P_np = np.array([[pt.X, pt.Y, pt.Z] for pt in P_list], dtype=np.float64)
    Q_np = np.array([[pt.X, pt.Y, pt.Z] for pt in Q_list], dtype=np.float64)

    # --- 2. Compute centers ---
    P_center = P_np.mean(axis=0)
    Q_center = Q_np.mean(axis=0)
    print("P center:", P_center, "Q center:", Q_center)

    P_centered = P_np - P_center
    Q_centered = Q_np - Q_center

    # --- 3. Build Open3D point clouds ---
    pcd_P = o3d.geometry.PointCloud()
    pcd_Q = o3d.geometry.PointCloud()
    pcd_P.points = o3d.utility.Vector3dVector(P_centered)
    pcd_Q.points = o3d.utility.Vector3dVector(Q_centered)

    # --- 4. Estimate normals (for registration) ---
    pcd_P.estimate_normals(o3d.geometry.KDTreeSearchParamHybrid(radius=0.1, max_nn=30))
    pcd_Q.estimate_normals(o3d.geometry.KDTreeSearchParamHybrid(radius=0.1, max_nn=30))

    # --- 5. Compute FPFH features for Fast Global Registration ---
    radius_feature = 0.25
    pcd_P_fpfh = o3d.pipelines.registration.compute_fpfh_feature(
        pcd_P, o3d.geometry.KDTreeSearchParamHybrid(radius=radius_feature, max_nn=100)
    )
    pcd_Q_fpfh = o3d.pipelines.registration.compute_fpfh_feature(
        pcd_Q, o3d.geometry.KDTreeSearchParamHybrid(radius=radius_feature, max_nn=100)
    )

    # --- 6. Fast Global Registration ---
    fgr_result = o3d.pipelines.registration.registration_fgr_based_on_feature_matching(
        pcd_P, pcd_Q, pcd_P_fpfh, pcd_Q_fpfh,
        o3d.pipelines.registration.FastGlobalRegistrationOption(
            maximum_correspondence_distance=distance_threshold
        )
    )
    print("FGR transformation:\n", fgr_result.transformation)

    # --- 7. ICP refinement ---
    icp_result = o3d.pipelines.registration.registration_icp(
        pcd_P, pcd_Q, distance_threshold,
        fgr_result.transformation,
        o3d.pipelines.registration.TransformationEstimationPointToPlane()
    )
    print("ICP refined transformation:\n", icp_result.transformation)

    # --- 8. Apply final transformation ---
    P_registered = np.asarray(pcd_P.points)
    P_registered_h = np.hstack((P_registered, np.ones((P_registered.shape[0], 1))))  # (N,4)
    P_transformed = (icp_result.transformation @ P_registered_h.T).T[:, :3]

    # --- 9. Add back Q’s center (since we centered earlier) ---
    P_aligned = P_transformed + Q_center

    # --- 10. Convert back to GH Point3d ---
    aligned_points = [rg.Point3d(float(x), float(y), float(z)) for x, y, z in P_aligned]

    return aligned_points, icp_result.transformation


P_aligned, transform = register_pointclouds_gh(P, Q)
# ---------- end pc_registration ----------

# ---- group: Optimizer (continued)
preview_11 = CustomPreview(Geometry=pc_registration.P_aligned, Material=swatch_5)

# ---- group: Get differences
area_4 = Area(Geometry=move_2.Geometry)  # -> Area, Centroid; disabled
area_5 = Area(Geometry=simulation.L)  # -> Area, Centroid; disabled
sdivide_5 = DivideSurface(Surface=simulation.L, UCount=roundf_4.Rounded, VCount=roundf_3.Rounded)  # -> Points, Normals, Parameters; disabled
ptcell_3 = Cellulate(Grid=sdivide_5.Points)  # -> Wires, Cells, Meshes; disabled
mesh = Mesh(ptcell_2.Meshes)  # disabled
area_6 = MeshArea(Mesh=ptcell_3.Meshes)  # -> Area, Centroid; disabled
area_7 = MeshArea(Mesh=mesh)  # -> Area, Centroid; disabled
dist_3 = Distance(PointA=area_7.Centroid, PointB=flatten(area_6.Centroid))  # disabled

# ----
vec2pt = Vector2Pt(PointA=area_5.Centroid, PointB=area_4.Centroid, Unitize=False)  # -> Vector, Length; disabled

# ---- group: Get differences (continued)
# 6. Analyse Results
move_3 = Move(Geometry=simulation.L, Motion=vec2pt.Vector)  # -> Geometry, Transform; disabled

# ----
number_slider_44 = Slider(1, range=0..100)  # disabled
number_slider_45 = Slider(0, range=0..100)  # disabled
gradient_4 = Gradient(
    LowerLimit=number_slider_45,
    UpperLimit=number_slider_44,
    Parameter=dist_3,
    stops=[0: RGB(0, 128, 0), 0.5: RGB(255, 255, 0), 1: RGB(255, 0, 0)])  # disabled
preview_12 = CustomPreview(Geometry=flatten(ptcell_3.Meshes), Material=flatten(gradient_4))  # disabled

# ---- group: Seed
item_7 = ListItem(List=patch_predictions, Index=Slider(0, range=0..100), Wrap=True)
random_4 = Random(Range=Domain(0, 100), Number=1, Seed=item_7)

# ----
addition_6 = Addition(A=item_7, B=1)

# ---- group: Seed (continued)
multiplication_2 = Multiplication(A=avr, B=random_4, C=addition_6)
rec_9 = DataRecorder(multiplication_2, DataLimit=-10, RecordData=True)
panel_28 = Panel(rec_9)

# ---- group: Make the seed the counter
multiplication_3 = Multiplication(A=multiplication_2, B="0")
addition_7 = Addition(A=multiplication_3, B=loop_start.Counter)
panel_29 = Panel(addition_7)

# ----
num_8 = Number(multiplication_2)
num_9 = Number(addition_7)

toggle = BooleanToggle(False)  # disabled
loop_end = LoopEnd(port=loop_start.port, Exit=toggle, Data=num_9, TimeOutVal=0, pausedState=False, state="Output last")  # disabled

rec_10 = DataRecorder(loop_end, DataLimit=-10, RecordData=True)  # disabled
panel_30 = Panel(rec_10)  # disabled

# ==== cluster RaiseByPower
A = ClusterInput()
multiplication = Multiplication(A=A, B=-1)
pow = Power(A=Slider(10, range=0..10), B=multiplication)
R = ClusterOutput(pow)

# ==== cluster WriteToExcel
rows = ClusterInput()
cols = ClusterInput()
u = ClusterInput()
v = ClusterInput()
angles = ClusterInput()
imput_sample_pt = ClusterInput()
output_sample_pt = ClusterInput()
input_uv = ClusterInput()
output_uv = ClusterInput()
division = Division(A=u, B=rows)
division_2 = Division(A=v, B=cols)

output_sample_pt_2 = Point(simplify(output_sample_pt))
imput_sample_pt_2 = Point(simplify(imput_sample_pt))
input_uv_2 = Data(input_uv)
output_uv_2 = Data(output_uv)

input_angles_and_borders = Python3Script(rows=rows, cols=cols, u=u, v=v, angles=angles, patch_size_u=division, patch_size_v=division_2)  # -> out, angles_output, border_output, pt_num; inputs rows: Int32, cols: Int32, u: Int32, v: Int32, angles: list of Int32, patch_size_u: Int32, patch_size_v: Int32
# ---------- input_angles_and_borders: Python ----------
# """Grasshopper Script"""
# import System
# import Rhino
# import Grasshopper
# import rhinoscriptsyntax as rs

# angles_output=[]
# pt_num=u*v
# angle=0
# x=1


# for col in range(cols):
#     x = patch_size
#     for j in range(x):
#         for row in range(rows):
#             for i in range(x):
#                 angles_output.append(angles[row+(col*rows)])



# #print("border: " + str(border_output) + str(len(border_output)))
# print("angles: " + str(angles_output)+ str(len(angles_output)))


"""Grasshopper Script"""
import System
import Rhino
import Grasshopper
import rhinoscriptsyntax as rs

angles_output = []
pt_num = u * v
angle = 0

for col in range(cols):
    for j in range(patch_size_v):
        for row in range(rows):
            for i in range(patch_size_u):
                angles_output.append(angles[row + (col * rows)])
                
print("angles: " + str(angles_output) + str(len(angles_output)))
# ---------- end input_angles_and_borders ----------
flatten = FlattenTree(Tree=output_sample_pt_2, Path="{0}")
flatten_2 = FlattenTree(Tree=imput_sample_pt_2, Path="{0}")

# ---- group: check that input and output points match
number_slider = Slider(0, range=0..336)
item = ListItem(List=flatten, Index=number_slider, Wrap=True)
item_2 = ListItem(List=flatten_2, Index=number_slider, Wrap=True)

# ----
srf = ClusterInput()

# ---- group: Output Surface
srf_2 = Surface(srf)

# ---- group: Rebuild
rebuild_surface = RebuildSurface(Surface=srf_2, CountU=Slider(5, range=0..100), CountV=Slider(8, range=0..100))

# ---- group: Fiber Direction Bottom
addition = Addition(A=input_angles_and_borders.angles_output, B=Slider(90, range=0..100))

# ----
# Analyze Simulation Result
bottom_shrinkage = ClusterInput()  # Bottom Shrinkage
top_shrinkage = ClusterInput()
thickness = ClusterInput()  # Thickness

fiber_direction_top = Integer(input_angles_and_borders.angles_output)
border = Integer(input_angles_and_borders.border_output)

# ---- group: point curvature
curvature = PrincipalCurvature(Surface=rebuild_surface, Point=flatten(output_uv_2))  # -> simplify(graft(Frame)), simplify(graft(Maximum)), simplify(graft(Minimum)), simplify(graft(MaxDirection)), simplify(graft(MinDirection))

# ---- group: movement vector
vec2pt = Vector2Pt(PointA=flatten_2, PointB=flatten, Unitize=False)  # -> simplify(graft(Vector)), simplify(graft(Length))

# ---- group: point location
pdecon = Deconstruct(Point=flatten)  # -> simplify(graft(XComponent)), simplify(graft(YComponent)), simplify(graft(ZComponent))

# ---- group: Added Values
evalsrf = EvaluateSurface(Surface=srf_2, Point=output_uv_2)  # -> Point, simplify(graft(Normal)), simplify(graft(UDirection)), simplify(graft(VDirection)), Frame
pt = Point(evalsrf.Point)
vdisex = VectorDisplayEx(Point=flatten(pt), Vector=flatten(evalsrf.VDirection), Colour=flatten(evalsrf.Normal), Width=2)
panel = Panel("Normal Vector")
panel_2 = Panel("U Vector")
panel_3 = Panel("V Vector")

# ----
num_of_points = Number(input_angles_and_borders.pt_num)
dup = DuplicateData(Data=bottom_shrinkage, Number=num_of_points, Order=True)
dup_2 = DuplicateData(Data=top_shrinkage, Number=num_of_points, Order=True)
dup_3 = DuplicateData(Data=thickness, Number=num_of_points, Order=True)

# ---- group: view curvature
number_slider_2 = Slider(12, range=0..100)  # disabled
multiplication = Multiplication(A=curvature.Maximum, B=number_slider_2)  # disabled
amp = Amplitude(Vector=curvature.MaxDirection, Amplitude=multiplication)  # disabled
vdisex_2 = VectorDisplayEx(Point=flatten(output_sample_pt_2), Vector=flatten(amp), Colour=flatten(curvature.MaxDirection), Width=2)  # disabled

# ----
iteration = ClusterInput()
uv = Point(flatten(input_uv_2))
iteration_2 = Integer(iteration)
vdisex_3 = VectorDisplayEx(Point=flatten, Vector=flatten(curvature.MaxDirection), Colour=flatten(curvature.MaxDirection), Width=2)
crv = ClusterInput()

# ---- group: time based seed
second = Trigger(Interval=30000, TimerInterval=30000, Target=time)
time = Time("Now")
panel_4 = Panel(time)
time_to_number = GhPythonScript(time=panel_4)  # -> seed
# ---------- time_to_number: Python ----------
__author__ = "user"
__version__ = "2023.11.15"

import rhinoscriptsyntax as rs
import re


time = time[-10:]
time = re.sub(r'[^0-9]', '', time)
seed = int(time)
print(seed)
# ---------- end time_to_number ----------

# ----
hello = ClusterInput()  # hello
panel_5 = Panel(hello)

merge = Merge(
    Data1=vec2pt.Vector,
    Data2=vec2pt.Length,
    Data3=curvature.Maximum,
    Data4=curvature.Minimum,
    Data5=curvature.MaxDirection,
    Data6=curvature.MinDirection,
    Data7=pdecon.XComponent,
    Data8=pdecon.YComponent,
    Data9=pdecon.ZComponent,
    Data10=evalsrf.Normal,
    Data11=evalsrf.UDirection,
    Data12=evalsrf.VDirection)  # -> simplify(Result)
merge_2 = Merge(
    Data1="Movement Vector Direction",
    Data2="Movement Vector Length",
    Data3="Max Curvature Length",
    Data4="Min Curvature Length",
    Data5="Max Curvature Direction",
    Data6="Min Curvature Direction",
    Data7="Location X",
    Data8="Location Y",
    Data9="Location Z",
    Data10=panel,
    Data11=panel_2,
    Data12=panel_3)  # -> simplify(Result)
# Write Output to Excel
concat = Concatenate(FragmentA="C:\DATASET\Dataset_Output_", FragmentB=panel_5, FragmentC=".xlsx")
path = FilePath(concat)
button = Button()
flip = FlipMatrix(Data=merge)
concat_2 = Concatenate(FragmentA="Iteration ", FragmentB=iteration_2)
excelwrite = ExcelWrite(
    WriteExcelData=Toggle(True),
    WorkbookPath=path,
    WorksheetName=concat_2,
    ColumnHeadings=merge_2,
    Data=flip,
    ClearSheet=Toggle(True),
    DataStruct=False)

panel_6 = Panel(excelwrite)
rec = DataRecorder(concat_2, DataLimit=-10, RecordData=True)
len = TextLength(Text=panel_6)
panel_7 = Panel(rec)
dom = ConstructDomain(DomainStart="-100", DomainEnd="100")
counter = ClusterInput()  # Counter for seed randomality purposes
random = Random(Range=Domain(0, 30), Number=1, Seed=time_to_number)

panel_8 = Panel("Location Z")
panel_9 = Panel("Location X")
panel_10 = Panel("Location Y")
merge_3 = Merge(
    Data1=simplify(graft(fiber_direction_top)),
    Data2=simplify(graft(dup_2)),
    Data3=simplify(graft(dup_3)),
    Data4=simplify(graft(addition)),
    Data5=simplify(graft(dup)),
    Data6=simplify(graft(uv)))  # -> simplify(Result)
merge_4 = Merge(Data1="Top Angle", Data2="Top Shrinkage", Data3="Mid Width", Data4="Bottom Angle", Data5="Bottom Shrinkage", Data6="UV")  # -> simplify(Result)
flip_2 = FlipMatrix(Data=merge_3)
concat_3 = Concatenate(FragmentA="Iteration ", FragmentB=iteration_2)

concat_4 = Concatenate(FragmentA="C:\DATASET\Dataset_Input_", FragmentB=panel_5, FragmentC=".xlsx")

path_2 = FilePath(concat_4)
excelwrite_2 = ExcelWrite(
    WriteExcelData=Toggle(True),
    WorkbookPath=path_2,
    WorksheetName=concat_3,
    ColumnHeadings=merge_4,
    Data=flip_2,
    ClearSheet=Toggle(True),
    DataStruct=False)

panel_11 = Panel(merge_3)
panel_12 = Panel(excelwrite_2)
rec_2 = DataRecorder(concat_3, DataLimit=-10, RecordData=True)
len_2 = TextLength(Text=panel_12)
panel_13 = Panel(rec_2)

# ---- group: baking
multiplication_2 = Multiplication(A=Slider(20, range=0..100), B=iteration_2)
X = UnitX(Factor=multiplication_2)
toggle = BooleanToggle(True)

# ----
crv_2 = Curve(flatten(crv))
geometry_to_bake = Geometry(crv_2)

# ---- group: baking (continued)
move = Move(Geometry=geometry_to_bake, Motion=X)  # -> Geometry, Transform

# ----
bake_attr = BakeAttributes(Geometry=move.Geometry, Bake=toggle)  # disabled

# ---- group: replace the seed by clock
random_2 = Random(Range=Domain(0, 10000), Number=1, Seed=time_to_number)
item_3 = ListItem(List=move.Geometry, Index=random_2, Wrap=True)

# ----
len_3 = Length(Curve=item_3)
ma = MassAddition(Input=flatten([len_3, len_2, len, time_to_number]))  # -> Result, PartialResults
division_3 = Division(A=ma.Result, B=random)

# ---- group: replace the seed by clock
concat_5 = Concatenate(FragmentA=item_3, FragmentB=division_3, FragmentC=panel_6, FragmentD=panel_12)
guid_to_number = GhPythonScript(guid=concat_5)  # -> seed
# ---------- guid_to_number: Python ----------
__author__ = "user"
__version__ = "2023.11.15"

import rhinoscriptsyntax as rs
import re
import math



seed = re.sub(r'[^0-9]', '', guid)
seed = int(seed)
seed = math.sqrt(seed)/1000000000000
print(seed)
# ---------- end guid_to_number ----------

# ---- group: ensure of seed
dom_2 = ConstructDomain(DomainStart="-100000", DomainEnd="100000")
random_3 = Random(Domain=dom_2, Num="1", Seed=time_to_number, Sort=0)  # -> Int, D
random_4 = Random(Range=dom, Number=1, Seed=counter)
addition_2 = Addition(A=guid_to_number, B=random_3.D)
multiplication_3 = Multiplication(A=addition_2, B=random_4)

# ----
seed = ClusterOutput(multiplication_3)

# ==== cluster GateCluster
G = ClusterInput()
_0 = ClusterInput()
_1 = ClusterInput()
G_2 = ClusterInput()
_0_2 = ClusterInput()
_1_2 = ClusterInput()
G_3 = ClusterInput()
_0_3 = ClusterInput()
_1_3 = ClusterInput()
G_4 = ClusterInput()
_0_4 = ClusterInput()
G_5 = ClusterInput()
_0_5 = ClusterInput()
_1_4 = ClusterInput()
G_6 = ClusterInput()
_0_6 = ClusterInput()
_1_5 = ClusterInput()

# ---- group: Adaptive or Pixelization Gate / Shape's Dimensions
num = Number(1)
filter = StreamFilter(Gate=G_3, Stream0=_0_3, Stream1=_1_3)
filter_2 = StreamFilter(Gate=G_4, Stream0=_0_4, Stream1=num)

# ---- group: Adaptive or Pixelization Gate
filter_top = StreamFilter(Gate=G, Stream0=flatten(_0), Stream1=_1)
filter_bot = StreamFilter(Gate=G_2, Stream0=flatten(_0_2), Stream1=_1_2)
filter_srf = StreamFilter(Gate=G_5, Stream0=_0_5, Stream1=_1_4)
filter_patch_curves = StreamFilter(Gate=G_6, Stream0=_0_6, Stream1=_1_5)

# ----
s_0 = ClusterOutput(filter_top)
s_0_2 = ClusterOutput(filter_bot)
s_0_3 = ClusterOutput(filter)
s_0_4 = ClusterOutput(filter_2)
s_0_5 = ClusterOutput(filter_srf)
s_0_6 = ClusterOutput(filter_patch_curves)

# ==== cluster MapShrinkage

# ---- group: To boundry
curve = ClusterInput()
curve_middle = CurveMiddle(Curve=curve)
curve_2 = ClusterInput()
curve_closest_point = CurveClosestPoint(Point=curve_middle, Curve=curve_2)  # -> Point, Parameter, Distance
multiplication = Multiplication(A=curve_closest_point.Distance, B=curve_closest_point.Distance)
sqrt = SquareRoot(Value=curve_closest_point.Distance)

# ---- group: To corners
control_polygon = ControlPolygon(Curve=curve_2)  # -> Polygon, Points
closest_point = ClosestPoint(Point=curve_middle, Cloud=control_polygon.Points)  # -> ClosestPoint, CPIndex, Distance
multiplication_2 = Multiplication(A=closest_point.Distance, B=closest_point.Distance)
number = Number(multiplication_2)

# ----
number_2 = Number(curve_closest_point.Distance)
subtraction = Subtraction(A=number_2)
text_tag = TextTag(Location=curve_middle, Text=subtraction)
bounds = Bounds(Numbers=flatten(subtraction))
target = ClusterInput()
remap_numbers = RemapNumbers(Value=subtraction, Source=bounds, Target=target)  # -> Mapped, Clipped
mapped = ClusterOutput(remap_numbers.Mapped)

# ==== cluster Simulation

# ---- group: Simulation
swatch = ColourSwatch(SwatchColor=RGBA(0, 72, 255, 179))
swatch_2 = ColourSwatch(SwatchColor=RGBA(191, 194, 201, 201))
swatch_3 = ColourSwatch(SwatchColor=RGBA(255, 196, 0, 179))
setgroup = SetGroupProperties(
    Group=["Grasshopper.Kernel.Types.GH_ObjectWrapper", "Grasshopper.Kernel.Types.GH_ObjectWrapper", "Grasshopper.Kernel.Types.GH_ObjectWrapper", "Grasshopper.Kernel.Types.GH_ObjectWrapper", "Grasshopper.Kernel.Types.GH_ObjectWrapper"],
    Color=ColourSwatch(SwatchColor=RGBA(255, 0, 153, 179)))

number_of_columns = Slider(2, range=1..10)
number_of_rows = Slider(4, range=1..10)

# ---- group: Simulation / Shrinkage Amounts
thickness = Slider(0.32, range=0.2..0.5)

# ---- group: Simulation / Basic Shape Inputs
list = ValueList({"Plate": 0, "Ribbon": 1, "Free-Form": 2}, selected="Ribbon")
list_2 = ValueList({"Pixelization": 0, "Adaptive Pattern": 1}, selected="Pixelization")
free_form_curve = Curve(<curve referenced from the Rhino model>)

# ---- group: Simulation
surface_x_size = Slider(20, range=1..100)
surface_y_size = Slider(40, range=1..101)

# ---- group: Simulation / Shrinkage Amounts
fiber_shrinkage_factor_top = Slider(1, range=0..1.1)
matrix_shrinkage_factor_top = Slider(0.976, range=0..1)

fiber_shrinkage_factor_bottom = Slider(1, range=0..1.1)
matrix_shrinkage_factor_bottom = Slider(0.977, range=0..1)

# ----
B = ClusterInput()
num = ClusterInput()
B_2 = ClusterInput()
num_2 = ClusterInput()

# ---- group: Simulation / Simulation Parameters / Web Factors
axialweb = Slider(100, range=0..1000)
bendingweb = Slider(50, range=0..50)

# ---- group: Simulation / Simulation Parameters / Fiber Factors
axialfiber = Slider(40, range=0..50)
bendingfiber = Slider(10, range=0..50)

# ---- group: Simulation / Simulation Parameters / Matrix Factors
axialmatrix = Slider(50, range=0..100)
bendingmatrix = Slider(10, range=0..50)

# ---- group: Simulation / Solver Parameters
pattern_scale = Slider(12, range=4..20)
threshold_factor_10_x = Slider(12, range=8..20)
tolerance_factor_10_x = Slider(6, range=1..20)

# ----
connect_angles = ClusterInput()

# ---- group: Simulation / Matrix Strengh
number_slider = Slider(0, range=0..100)
num_3 = Number(axialmatrix)
subtraction = Subtraction(A=num_3, B=number_slider)
addition = Addition(A=num_3, B=number_slider)
dom = ConstructDomain(DomainStart=addition, DomainEnd=subtraction)

# ---- group: Simulation / Sample Points / accuracy of sample points depends on this
number_slider_2 = Slider(10, range=0..10)

# ----
bottom = Bottom(AddBottom=False, RemoveBottom=False)

# ---- group: Simulation / Match
number_slider_3 = Slider(25, range=0..100)

# ---- group: Move
number_slider_4 = Slider(36, range=0..1000)
number_slider_5 = Slider(38, range=0..1000)

# ----
number_slider_6 = ClusterOutput(number_slider_4)
number_slider_7 = ClusterOutput(number_slider_5)

# ---- group: Simulation
# SELF-MORPHING SIMULATOR
# Insert Fiber Orientation
normal = Number()
distance = Number()
average_dot_product_of_normals = Panel(normal)
mesh = Mesh(<mesh referenced from the Rhino model>)
z_difference = Panel()
swatch_4 = ColourSwatch(SwatchColor=RGB(0, 0, 0))
chamfer_distance = Panel(distance)
num_4 = Number(num)
division = Division(A=num_4, B=B_2)
num_5 = Number(num_2)
division_2 = Division(A=num_5, B=B)
num_6 = Number(division)
num_7 = Number(division_2)
connect_angles_2 = Number(connect_angles)
circular_variance = Python3Script(angles=connect_angles_2)  # -> out, variance; inputs angles: list of Double
# ---------- circular_variance: Python ----------
import math


def circular_variance(angles):
    if not angles:
        return 0  # Handle empty list

    # Map angles to [0, 180) and double them to handle 0° = 180°
    doubled_radians = [math.radians((a % 180) * 2) for a in angles]
    
    # Calculate the sum of unit vectors
    sum_sin = sum(math.sin(r) for r in doubled_radians)
    sum_cos = sum(math.cos(r) for r in doubled_radians)
    
    # Calculate mean resultant length
    R = math.sqrt(sum_sin**2 + sum_cos**2) / len(angles)
    
    # Circular variance (0 = no variation, 1 = max variation)
    variance = 1 - R
    return variance


variance = circular_variance(angles)
# ---------- end circular_variance ----------
sqr = Square(Value=circular_variance.variance)
subtraction_2 = Subtraction(A=Slider(1, range=0..1), B=sqr)
multiplication = Multiplication(A=axialweb, B=subtraction_2)
panel = Panel(multiplication)
subtraction_3 = Subtraction(A=Slider(180, range=0..1000), B=connect_angles_2)
panel_2 = Panel(subtraction_2)
number_slider_8 = Slider(10, range=0..10)
bar_graph = BarGraph(BarColor=RGB(255, 0, 90))
bar_graph_2 = BarGraph(BarColor=RGB(255, 0, 90))
rod = Rod(LengthFactor=1, AngleFactor=1, AxialStrength=10, BendStrength=1)
_1_h = Slider(5000000, range=0..10000000)
_8_m = Slider(1000000, range=0..1000000)
_4_m = Slider(500000, range=0..1000000)
_50_s = Slider(100000, range=0..1000000)
_25_s = Slider(50000, range=0..1000000)
_10_s = Slider(20000, range=0..100000)
_5_s = Slider(10000, range=0..10000)
raise_by_power = RaiseByPower(A=threshold_factor_10_x)
raise_by_power_2 = RaiseByPower(A=tolerance_factor_10_x)

# ---- group: Simulation / Final Fiber Orientation
connect_fiber_orientation_here = Panel(connect_angles_2)
addition_2 = Addition(A=connect_fiber_orientation_here, B=Slider(90, range=0..100))
_90_to_everythin = Panel(addition_2)
num_8 = Number(connect_fiber_orientation_here)
num_9 = Number(_90_to_everythin)

# ---- group: Simulation
multiplication_2 = Multiplication(A=num_6, B=num_7)
genes = GenePool(Decimals=0, Maximum=180, Minimum=0, Value=[0, 90, 90, 90, 90, 90, 90, 90, 90])
pool_controller = GenePoolController(GenePool=genes, Count=multiplication_2, Range=Slider(180, range=0..1000), Decimal=0, Randomness=0.1)

cluster = Cluster(
    srfxsize=num_4,
    base_shape_idx=list,
    srfysize=num_5,
    thickness=thickness,
    pattern_values_top=num_8,
    B=num_6,
    pattern_values_bottom=num_9,
    ex=num_6,
    ey=num_7,
    free_form_crv=free_form_curve,
    B_2=num_7)  # -> B_3, thickness_3, pattern_values_top_3, C, pattern_values_bottom_3
gate_cluster = GateCluster(
    G_6=list_2,
    _0_6=cluster.C,
    G=list_2,
    _0=cluster.pattern_values_top_3,
    G_2=list_2,
    _0_2=cluster.pattern_values_bottom_3,
    G_3=list_2,
    _0_3=num_7,
    G_4=list_2,
    _0_4=num_6,
    G_5=list_2,
    _0_5=cluster.B_3)  # -> s_0_6, s_0, s_0_2, s_0_3, s_0_4, s_0_5
boundry = Curve(cluster.B_3)

# ---- group: Simulation / Moves layer according to thickness
Z = UnitZ(Factor=expr("-x/2", cluster.thickness_3))
move_bottom = Move(Geometry=gate_cluster.s_0_6, Motion=Z)  # -> Geometry, Transform

# ---- group: Simulation / Top Layer Processing / Moves layer according to thickness
Z_2 = UnitZ(Factor=expr("x/2", cluster.thickness_3))
move_top = Move(Geometry=gate_cluster.s_0_6, Motion=Z_2)  # -> Geometry, Transform

# ---- group: Simulation / Sample Points / Sample Points Input
sdivide = DivideSurface(Surface=gate_cluster.s_0_5, UCount=num_4, VCount=num_5)  # -> Points, Normals, Parameters

# ---- group: Simulation / Top Layer Processing
expression = Expression(x=gate_cluster.s_0, Expression="(x+90)%180")
hatchtopfiber = GhPythonScript(
    n_rows=gate_cluster.s_0_3,
    n_cols=gate_cluster.s_0_4,
    boundaries=move_top.Geometry,
    scale=pattern_scale,
    angles=gate_cluster.s_0)  # -> out, boundary_curves, pattern, scale, angles, names, news, geos; inputs boundaries: list of Curve, angles: list
# ---------- hatchtopfiber: Python ----------
__author__ = "Yitzchak Vaknin"
__version__ = "2023.08.31"

import Rhino.Geometry as rg
import Rhino as rh
import rhinoscriptsyntax as rs
import Grasshopper as gh
import scriptcontext as sc
import inspect
import math

#hatche patterns:
hatches = ["Solid","Single Line","Double Line",
"Triple Line","Dashed Line",
"Square Grid","Triangle Grid",
"Plus Grid", "Squares"]


def listToTree(nestedList):
    """Convert a nested python iterable to a datatree."""
    dt = gh.DataTree[object]()
    for i,l in enumerate(nestedList):
        dt.AddRange(l,gh.Kernel.Data.GH_Path(i))
    return dt

def listToTree_2D(nestedList):
    """Convert a nested python iterable to a datatree."""
    dt = gh.DataTree[object]()
    for i,l in enumerate(nestedList):
        for j,val in enumerate(l):
            dt.AddRange(val,gh.Kernel.Data.GH_Path(i))
    return dt

def HatchInfo(rows, cols):
    sc.doc = rh.RhinoDoc.ActiveDoc
    pattern = 1
    hname = hatches[pattern]
    geos = list()
    news = list()
    # iterate on cells:
    for i in range(0, int(rows*cols)):
        local_boundary_curves = list()
        local_geos = list()
        new = rg.Hatch.Create(boundaries[i], pattern, math.radians(angles[i]), scale)
        news.append(new)
        for j, n in enumerate(new):
            g = rg.Hatch.CreateDisplayGeometry(n, rh.DocObjects.HatchPattern.Defaults.Hatch1, 1)
            local_geos.append(g[1])
        geos.append(local_geos)
    geos = listToTree_2D(geos)
    return boundaries, pattern, scale, angles, hname, news, geos

boundary_curves, pattern, scale, angles, names, news, geos = HatchInfo(n_rows, n_cols)
# ---------- end hatchtopfiber ----------
hatchtopmatrix = GhPythonScript(
    n_rows=gate_cluster.s_0_3,
    n_cols=gate_cluster.s_0_4,
    boundaries=move_top.Geometry,
    scale=pattern_scale,
    angles=expression)  # -> out, boundary_curves, pattern, scale, angles, names, news, geos; inputs boundaries: list of Curve, angles: list; same code as hatchtopfiber
merge = Merge(Data1=hatchtopfiber.geos, Data2=hatchtopmatrix.geos)

# ---- group: Simulation (continued)
area = Area(Geometry=hatchtopfiber.boundary_curves)  # -> Area, Centroid

# ---- group: Simulation / Bottom Layer Processing
expression_2 = Expression(x=gate_cluster.s_0_2, Expression="(x+90)%180")
hatchbotfiber = GhPythonScript(
    n_rows=gate_cluster.s_0_3,
    n_cols=gate_cluster.s_0_4,
    boundaries=move_bottom.Geometry,
    scale=pattern_scale,
    angles=expression_2)  # -> out, boundary_curves, pattern, scale, angles, names, news, geos; inputs boundaries: list of Curve, angles: list; same code as hatchtopfiber
hatchbotfiber_2 = GhPythonScript(
    n_rows=gate_cluster.s_0_3,
    n_cols=gate_cluster.s_0_4,
    boundaries=move_bottom.Geometry,
    scale=pattern_scale,
    angles=gate_cluster.s_0_2)  # -> out, boundary_curves, pattern, scale, angles, names, news, geos; inputs boundaries: list of Curve, angles: list; same code as hatchtopfiber
merge_2 = Merge(Data1=hatchbotfiber_2.geos, Data2=hatchbotfiber.geos)

# ---- group: Simulation / Frame Intersection
explode = Explode(Curve=simplify(graft(hatchtopfiber.boundary_curves)), Recursive=True)  # -> flatten(Segments), Vertices
python = GhPythonScript(boundary_lines=explode.Segments)  # -> filtered_boundaries; inputs boundary_lines: list of Curve
# ---------- python: Python ----------
__author__ = "Yitzchak Vaknin"
__version__ = "2023.02.26"

import rhinoscriptsyntax as rs

def filter_duplicate_boundaries(boundary_lines):
    filtered_boundaries = dict()
    for j, frame_line in enumerate(boundary_lines):
        edges = [rs.CurveStartPoint(frame_line), rs.CurveEndPoint(frame_line)]
        sorted_edges = sorted(edges, key=lambda x: (x[0], x[1]))
        frame_key = str(sorted_edges[0]) + "_" + str(sorted_edges[1])
#        print("frame line number {}, {}".format(j, frame_key))
        if frame_key not in filtered_boundaries:
            filtered_boundaries[frame_key] = frame_line
    return list(filtered_boundaries.values())

filtered_boundaries = filter_duplicate_boundaries(boundary_lines)
# ---------- end python ----------
python_2 = GhPythonScript(boundaries=python, pattern_lines=flatten(merge))  # -> intersection_pts; inputs boundaries: list of Curve, pattern_lines: list of Curve
# ---------- python_2: Python ----------
__author__ = "Yitzchak Vaknin"
__version__ = "2023.02.11"

import rhinoscriptsyntax as rs
import Grasshopper as gh

def listToTree(nestedList):
    """Convert a nested python iterable to a datatree."""
    dt = gh.DataTree[object]()
    for i,l in enumerate(nestedList):
        dt.AddRange(l,gh.Kernel.Data.GH_Path(i))
    return dt

def listToTree_2D(nestedList):
    """Convert a nested python iterable to a datatree."""
    dt = gh.DataTree[object]()
    for i,l in enumerate(nestedList):
        for j,val in enumerate(l):
            dt.AddRange(val,gh.Kernel.Data.GH_Path(i))
    return dt

def ccx_old(boundary, pattern_lines):
#    boundary_ctrl_pts = rs.CurvePoints(boundary)
    splited_lines = rs.ExplodeCurves(boundary)
    intersection_pts = list()
    for j, frame_line in enumerate(splited_lines):
        print("frame line number {}, {}".format(j, frame_line))
        local_intersection_pts = list()
        start = rs.CurveStartPoint(frame_line)
        local_intersection_pts.append(start)
        for i, pattern_line in enumerate(pattern_lines):
            print("pattern line number {}, {}".format(i, pattern_line))
            intersection_list = rs.CurveCurveIntersection(frame_line, pattern_line)
            if intersection_list is None:
                print "Selected curves do not intersect."
            else:
                for intersection in intersection_list:
                    local_intersection_pts.append(intersection[1])
                    if intersection[0] == 1:
                        print "Point"
                        print "Intersection point on first curve: ", intersection[1]
                        print "Intersection point on second curve: ", intersection[3]
                        print "First curve parameter: ", intersection[5]
                        print "Second curve parameter: ", intersection[7]
                    else:
                        print "Overlap"
                        print "Intersection start point on first curve: ", intersection[1]
                        print "Intersection end point on first curve: ", intersection[2]
                        print "Intersection start point on second curve: ", intersection[3]
                        print "Intersection end point on second curve: ", intersection[4]
                        print "First curve parameter range: ", intersection[5], " to ", intersection[6]
                        print "Second curve parameter range: ", intersection[7], " to ", intersection[8]
        intersection_pts.append(local_intersection_pts)
    return intersection_pts
#    return intersection_pts, splited_lines

def ccx_test(boundary, pattern_lines):
    intersection_pts = list()
    for j, frame_line in enumerate(boundary):
#        print("frame line number {}, {}".format(j, frame_line))
        local_intersection_pts = list()
        start = rs.CurveStartPoint(frame_line)
        local_intersection_pts.append(start)
        for i, pattern_line in enumerate(pattern_lines):
#            print("pattern line number {}, {}".format(i, pattern_line))
            intersection_list = rs.CurveCurveIntersection(frame_line, pattern_line)
            if intersection_list is None:
                x = 1
#                print "Selected curves do not intersect."
            else:
                for intersection in intersection_list:
                    local_intersection_pts.append(intersection[1])
#                    if intersection[0] == 1:
#                        print "Point"
#                        print "Intersection point on first curve: ", intersection[1]
#                        print "Intersection point on second curve: ", intersection[3]
#                        print "First curve parameter: ", intersection[5]
#                        print "Second curve parameter: ", intersection[7]
#                    else:
#                        print "Overlap"
#                        print "Intersection start point on first curve: ", intersection[1]
#                        print "Intersection end point on first curve: ", intersection[2]
#                        print "Intersection start point on second curve: ", intersection[3]
#                        print "Intersection end point on second curve: ", intersection[4]
#                        print "First curve parameter range: ", intersection[5], " to ", intersection[6]
#                        print "Second curve parameter range: ", intersection[7], " to ", intersection[8]
        intersection_pts.append(local_intersection_pts)
    return intersection_pts

def ccx(boundary_lines, pattern_lines):
    intersection_pts = dict()
    for j, frame_line in enumerate(boundary_lines):
        frame_key = str(rs.CurveStartPoint(frame_line)) + "_" + str(rs.CurveEndPoint(frame_line))
        print("frame line number {}, {}".format(j, frame_key))
        local_intersection_pts = list()
#        start = rs.CurveStartPoint(frame_line)
        local_intersection_pts.append(start)
        for i, pattern_line in enumerate(pattern_lines):
#            print("pattern line number {}, {}".format(i, pattern_line))
            intersection_list = rs.CurveCurveIntersection(frame_line, pattern_line)
            if intersection_list is None:
                print "Selected curves do not intersect."
            else:
                for intersection in intersection_list:
                    local_intersection_pts.append(intersection[1])
                    if intersection[0] == 1:
                        print "Point"
                        print "Intersection point on first curve: ", intersection[1]
                        print "Intersection point on second curve: ", intersection[3]
                        print "First curve parameter: ", intersection[5]
                        print "Second curve parameter: ", intersection[7]
                    else:
                        print "Overlap"
                        print "Intersection start point on first curve: ", intersection[1]
                        print "Intersection end point on first curve: ", intersection[2]
                        print "Intersection start point on second curve: ", intersection[3]
                        print "Intersection end point on second curve: ", intersection[4]
                        print "First curve parameter range: ", intersection[5], " to ", intersection[6]
                        print "Second curve parameter range: ", intersection[7], " to ", intersection[8]
        intersection_pts.append(local_intersection_pts)
    return intersection_pts

intersection_pts = listToTree(ccx_test(boundaries, pattern_lines))
# ---------- end python_2 ----------

# ---- group: Simulation / Zipper
explode_2 = Explode(Curve=simplify(graft(hatchbotfiber_2.boundary_curves)), Recursive=True)  # -> flatten(Segments), Vertices
python_3 = GhPythonScript(boundary_lines=explode_2.Segments)  # -> filtered_boundaries; inputs boundary_lines: list of Curve; same code as python
python_4 = GhPythonScript(boundaries=python_3, pattern_lines=flatten(merge_2))  # -> intersection_pts; inputs boundaries: list of Curve, pattern_lines: list of Curve; same code as python_2

# ---- group: Simulation / Fiber-Matrix Intersection
python_5 = GhPythonScript(fiber_lines=hatchtopfiber.geos, matrix_lines=hatchtopmatrix.geos)  # -> fiber_intersection_pts, matrix_intersection_pts; inputs fiber_lines: list of Curve, matrix_lines: list of Curve
# ---------- python_5: Python ----------
__author__ = "Yitzchak Vaknin"
__version__ = "2023.02.11"

import rhinoscriptsyntax as rs
import Grasshopper as gh
import copy
import ghpythonlib.treehelpers as th

def listToTree(nestedList):
    """Convert a nested python iterable to a datatree."""
    dt = gh.DataTree[object]()
    for i,l in enumerate(nestedList):
        dt.AddRange(l,gh.Kernel.Data.GH_Path(i))
    return dt

def listToTree_2D(nestedList):
    """Convert a nested python iterable to a datatree."""
    dt = gh.DataTree[object]()
    for i,l in enumerate(nestedList):
        print(i)
        for j,val in enumerate(l):
            dt.AddRange(val, gh.Kernel.Data.GH_Path(i, j))
    return dt

def ccx_matrix(fiber_lines, matrix_lines):
    intersection_pts_cycle = list()
    intersection_pts = list()
    for j, matrix_line in enumerate(matrix_lines):
        curve_intersection_pts = list()
        for i, fiber_line in enumerate(fiber_lines):
            intersection_list = rs.CurveCurveIntersection(matrix_line, fiber_line)
            if intersection_list is None:
                x = 1
            else:
                for intersection in intersection_list:
                    curve_intersection_pts.append(intersection[1])
        intersection_pts.append(curve_intersection_pts)
    intersection_pts_cycle.append(copy.copy(intersection_pts))
    for _ in range(len(intersection_pts)):
        intersection_pts.pop(0)
    return intersection_pts_cycle[0]

def ccx_fiber(fiber_lines, matrix_lines):
    intersection_pts_cycle = list()
    intersection_pts = list()
    for i, fiber_line in enumerate(fiber_lines):
        curve_intersection_pts = list()
        for j, matrix_line in enumerate(matrix_lines):
            intersection_list = rs.CurveCurveIntersection(matrix_line, fiber_line)
            if intersection_list is None:
                x = 1
            else:
                for intersection in intersection_list:
                    curve_intersection_pts.append(intersection[1])
        intersection_pts.append(curve_intersection_pts)
    intersection_pts_cycle.append(copy.copy(intersection_pts))
    for _ in range(len(intersection_pts)):
        intersection_pts.pop(0)
    return intersection_pts_cycle[0]
#intersection_pts = th.list_to_tree(ccx_matrix(fiber_lines, matrix_lines)[0])
#th.list_to_tree()
#print(len(intersection_pts[0]))
fiber_intersection_pts = ccx_fiber(fiber_lines, matrix_lines)
matrix_intersection_pts = ccx_matrix(fiber_lines, matrix_lines)
# ---------- end python_5 ----------
graft = GraftTree(Tree=hatchtopmatrix.geos, IncludeEmptyLists=True, IncludeNullItems=True)
c_script = CSharpScript(x=python_5.matrix_intersection_pts)  # -> A
# ---------- c_script: C# ----------
    A = x;
# ---------- end c_script ----------
graft_2 = GraftTree(Tree=hatchtopfiber.geos, IncludeEmptyLists=True, IncludeNullItems=True)
c_script_2 = CSharpScript(x=python_5.fiber_intersection_pts)  # -> A; same code as c_script
crv_cp = CurveClosestPoint(Point=c_script, Curve=graft)  # -> Point, Parameter, Distance
crv_cp_2 = CurveClosestPoint(Point=c_script_2, Curve=graft_2)  # -> Point, Parameter, Distance
shatter = Shatter(Curve=graft, Parameters=crv_cp.Parameter)  # -> simplify(Segments)
shatter_2 = Shatter(Curve=graft_2, Parameters=crv_cp_2.Parameter)  # -> simplify(Segments)

# ---- group: Simulation / Bottom Layer Processing / Fiber-Matrix Intersection
python_6 = GhPythonScript(fiber_lines=hatchbotfiber_2.geos, matrix_lines=hatchbotfiber.geos)  # -> fiber_intersection_pts, matrix_intersection_pts; inputs fiber_lines: list of Curve, matrix_lines: list of Curve; same code as python_5
graft_3 = GraftTree(Tree=hatchbotfiber.geos, IncludeEmptyLists=True, IncludeNullItems=True)
c_script_3 = CSharpScript(x=python_6.matrix_intersection_pts)  # -> A; same code as c_script
graft_4 = GraftTree(Tree=hatchbotfiber_2.geos, IncludeEmptyLists=True, IncludeNullItems=True)
c_script_4 = CSharpScript(x=python_6.fiber_intersection_pts)  # -> A; same code as c_script
crv_cp_3 = CurveClosestPoint(Point=c_script_3, Curve=graft_3)  # -> Point, Parameter, Distance
crv_cp_4 = CurveClosestPoint(Point=c_script_4, Curve=graft_4)  # -> Point, Parameter, Distance
shatter_3 = Shatter(Curve=graft_3, Parameters=crv_cp_3.Parameter)  # -> simplify(Segments)
shatter_4 = Shatter(Curve=graft_4, Parameters=crv_cp_4.Parameter)  # -> simplify(Segments)

# ---- group: Simulation / Middle Mesh
removeduplicatepoints = GhPythonScript(x=flatten(python_2))  # -> pts; inputs x: list of Point3d
# ---------- removeduplicatepoints: Python ----------
__author__ = "Yitzchak Vaknin"
__version__ = "2023.09.10"

import rhinoscriptsyntax as rs

def filter_duplicate_points(pts_lst):
    filtered_pts = dict()
    for i, pt in enumerate(pts_lst):
        pt_key = str(pt[0]) + "_" + str(pt[1]) + "_" + str(pt[2])
        if pt_key not in filtered_pts:
            filtered_pts[pt_key] = pt
    return list(filtered_pts.values())

pts = filter_duplicate_points(x)
# ---------- end removeduplicatepoints ----------
removeduplicatepoints_2 = GhPythonScript(x=flatten(python_4))  # -> pts; inputs x: list of Point3d; same code as removeduplicatepoints
pt = Point(flatten([removeduplicatepoints, crv_cp_2.Point]))
pt_2 = Point(flatten([removeduplicatepoints_2, crv_cp_4.Point]))
cps = ClosestPoints(Point=flatten(pt_2), Cloud=flatten(pt), Count=Slider(10, range=0..10))  # -> simplify(ClosestPoint), CPIndex, Distance
ln = Line(StartPoint=simplify(graft(pt_2)), EndPoint=cps.ClosestPoint)  # -> flatten(Line)

# ---- group: Simulation / Sample Points
srf_cp = SurfaceClosestPoint(Point=sdivide.Points, Surface=cluster.B_3)  # -> Point, UVPoint, Distance
pt_3 = Point([pt, pt_2])
cps_2 = ClosestPoints(Point=flatten(sdivide.Points), Cloud=flatten(pt_3), Count=number_slider_2)  # -> simplify(ClosestPoint), CPIndex, Distance
ln_2 = Line(StartPoint=simplify(graft(sdivide.Points)), EndPoint=cps_2.ClosestPoint)
rodbotzipper = Rod(
    Polyline=ln_2,
    LengthFactor=1,
    AngleFactor=1,
    AxialStrength=Slider(0.001, range=0..1),
    BendStrength=Slider(0.001, range=0..50))

# ---- group: Simulation / Floor
scale = Scale(Geometry=gate_cluster.s_0_5, Center=Point(0, 0, 0), Factor=Slider(2, range=-10..10))  # -> Geometry, Transform
dom_2 = ConstructDomain(DomainStart=Slider(-10, range=-10..10), DomainEnd=Slider(0, range=-10..10))
merge_3 = Merge(Data1=crv_cp_2.Point, Data2=crv_cp.Point, Data3=cps.ClosestPoint, Data4=pt, Data5=crv_cp_4.Point, Data6=crv_cp_3.Point)  # -> flatten(Result)
boxrec = BoxRectangle(Rectangle=scale.Geometry, Height=dom_2)
duppt = RemoveDuplicatePts(Points=merge_3, Tolerance=0.01)
box_corners = BoxCorners(Box=boxrec)  # -> CornerA, CornerB, CornerC, CornerD, CornerE, CornerF, CornerG, CornerH
merge_4 = Merge(Data1=box_corners.CornerE, Data2=box_corners.CornerF, Data3=box_corners.CornerG, Data4=box_corners.CornerH)
anchor = Anchor(Point=merge_4, Strength=Slider(100000000, range=0..100000000))
spc = SolidPointCollide(Points=duppt, Solid=boxrec, Interior=False, Unidirectional=True, Strength=1)

# ---- group: Simulation / Gravity
Z_3 = UnitZ(Factor=Slider(0.0001, range=0..1))
rev = Reverse(Vector=Z_3)
load = Load(Point=duppt, ForceVector=rev, Weighting=1)

# ---- group: Simulation / Web Strengh
number_slider_9 = Slider(100, range=0..200)
num_10 = Number(axialweb)
subtraction_4 = Subtraction(A=num_10, B=number_slider_9)
addition_3 = Addition(A=num_10, B=number_slider_9)

# ---- group: Simulation (continued)
clip_1 = Python3Script(d1=subtraction_4, d2=addition_3)  # -> out, d1, d2; inputs d1: Int32, d2: Int32
# ---------- clip_1: Python ----------
"""Grasshopper Script"""
a = "Hello Python 3 in Grasshopper!"
print(a)
if d1 < 1:
    d1 = 1
    print("d1 = 1")

if d2 < 1:
    d2 = 1
    print("d2 = 1")
# ---------- end clip_1 ----------
mat_top = Curve(shatter)
mat_bot = Curve(shatter_3)

# ---- group: Simulation / Web Strengh (continued)
dom_3 = ConstructDomain(DomainStart=clip_1.d1, DomainEnd=clip_1.d2)

# ---- group: Simulation / Mat Strength
map_shrinkage = MapShrinkage(curve=mat_top, curve_2=boundry, target=dom)

# ---- group: Simulation / Mat Strengh
map_shrinkage_2 = MapShrinkage(curve=mat_bot, curve_2=boundry, target=dom)

# ---- group: Simulation / Web Strengh
map_shrinkage_3 = MapShrinkage(curve=ln, curve_2=boundry, target=dom_3)

# ---- group: Simulation (continued)
bar_graph_3 = BarGraph(map_shrinkage, BarColor=RGB(255, 0, 90))

# ---- group: Simulation / Domains
number_slider_10 = Slider(0, range=0..0.1)
num_11 = Number(matrix_shrinkage_factor_bottom)
num_12 = Number(matrix_shrinkage_factor_top)
subtraction_5 = Subtraction(A=num_12, B=number_slider_10)
addition_4 = Addition(A=num_12, B=number_slider_10)
dom_4 = ConstructDomain(DomainStart=subtraction_5, DomainEnd=addition_4)

subtraction_6 = Subtraction(A=num_11, B=number_slider_10)
addition_5 = Addition(A=num_11, B=number_slider_10)

dom_5 = ConstructDomain(DomainStart=subtraction_6, DomainEnd=addition_5)

# ---- group: Simulation / Mat Shrinkage
map_shrinkage_4 = MapShrinkage(curve=mat_top, curve_2=boundry, target=dom_4)

map_shrinkage_5 = MapShrinkage(curve=mat_bot, curve_2=boundry, target=dom_5)

# ---- group: Simulation / Top
rodtopfiber = Rod(
    Polyline=shatter_2,
    LengthFactor=fiber_shrinkage_factor_top,
    AngleFactor=1,
    AxialStrength=axialfiber,
    BendStrength=bendingfiber)
rodtopmatrix = Rod(Polyline=shatter, LengthFactor=map_shrinkage_4, AngleFactor=1, AxialStrength=map_shrinkage, BendStrength=bendingmatrix)

# ---- group: Simulation / Bottom
rodbottomfiber = Rod(
    Polyline=shatter_4,
    LengthFactor=fiber_shrinkage_factor_bottom,
    AngleFactor=1,
    AxialStrength=axialfiber,
    BendStrength=bendingfiber)
rodbottommatrix = Rod(
    Polyline=shatter_3,
    LengthFactor=map_shrinkage_5,
    AngleFactor=1,
    AxialStrength=map_shrinkage_2,
    BendStrength=bendingmatrix)

# ---- group: Simulation
rodtoptobot = Rod(Polyline=ln, LengthFactor=1, AngleFactor=1, AxialStrength=map_shrinkage_3, BendStrength=bendingweb)
entwine = Entwine(
    Branch00=rodtopfiber,
    Branch01=rodtopmatrix,
    Branch02=rodtoptobot,
    Branch03=rodbottomfiber,
    Branch04=rodbottommatrix,
    Branch05=rodbotzipper,
    Branch06=graft(spc),
    Branch07=anchor,
    Branch08=load,
    FlattenInputs=True)

# ----
solver = Solver(GoalObjects=entwine, Reset=Button(), Threshold=raise_by_power, Tolerance=raise_by_power_2, On=Toggle(False))  # -> I, V, O

# ---- group: Simulation (continued)
panel_3 = Panel(map_shrinkage_5)
zombiesolver = ZombieSolver(GoalObjects=entwine, Threshold=raise_by_power, Tolerance=raise_by_power_2, MaxIterations=_8_m)  # -> I, V, O
geo = Geometry(zombiesolver.O)
panel_4 = Panel(zombiesolver.I)
unflatten = UnflattenTree(Tree=geo, Guide=entwine)
bang = ExplodeTree(Data=unflatten)  # -> Branch0, Branch1, Branch2, Branch3, Branch4, Branch5, Branch6, Branch7, Branch8
data = Data(bang.Branch1)
data_2 = Data(bang.Branch0)
data_3 = Data(bang.Branch2)
data_4 = Data(bang.Branch3)
data_5 = Data(bang.Branch4)

# ---- group: Simulation / Get Sample Points
unflatten_2 = UnflattenTree(Tree=bang.Branch5, Guide=rodbotzipper)
trim = TrimTree(Tree=unflatten_2, Depth=1)
item = ListItem(List=trim, Index=0, Wrap=True)  # -> flatten(Item)
end = EndPoints(Curve=item)  # -> Start, End
sample_points = Data(end.Start)

# ---- group: Simulation / Mesh total z difference
pdecon = Deconstruct(Point=sample_points)  # -> XComponent, YComponent, ZComponent
sort = SortList(Keys=pdecon.ZComponent)  # -> Keys, ValuesA
lng = ListLength(List=sort.Keys)
item_2 = ListItem(List=sort.Keys, Index=expr("x-1", lng), Wrap=True)
item_3 = ListItem(List=sort.Keys, Index=0, Wrap=True)
subtraction_7 = Subtraction(A=item_2, B=item_3)
panel_5 = Panel(subtraction_7)

# ---- group: Simulation (continued)
height = Panel(panel_5)
division_3 = Division(A=z_difference, B=subtraction_7)
percantage_of_z = Panel(division_3)

# ----
curvepreview = CurvePreview(Curve=data_2, Width=Slider(2, range=1..4), Color=ColourSwatch(SwatchColor=RGB(0, 0, 0)), Mode=0, TopMost=False)

# ---- group: Simulation / Lofted Surface
partition = PartitionList(List=flatten(sample_points), Size=expr("x+1", num_5))
intcrv = Interpolate(Vertices=partition, Degree=4, Periodic=False, KnotStyle=1)  # -> flatten(Curve), Length, Domain
loft = Loft(Curves=intcrv.Curve, Options={Adjust=False, Closed=False, LoftEnds=0, LoftSimp=0, LoftType=0, Rebuild=10, Refit=0.01})

# ----
dots = DotDisplay(Point=sample_points, Colour=ColourSwatch(SwatchColor=RGB(94, 46, 64)), Size=Slider(0.082, range=0..5))
L = ClusterOutput(loft)
preview = CustomPreview(Geometry=loft, Material=ColourSwatch(SwatchColor=RGBA(217, 132, 155, 22)))

# ==== cluster Cluster
free_form_crv = ClusterInput()
base_shape_idx = ClusterInput()
B = ClusterInput()
B_2 = ClusterInput()
ex = ClusterInput()
ey = ClusterInput()
srfxsize = ClusterInput()
thickness = ClusterInput()
srfysize = ClusterInput()
pattern_values_top = ClusterInput()
pattern_values_bottom = ClusterInput()

# ---- group: Cluster Inputs
srfxsize_2 = Number(srfxsize)
thickness_2 = Number(thickness)
srfysize_2 = Number(srfysize)
pattern_values_top_2 = Number(simplify(graft(pattern_values_top)))
pattern_values_bottom_2 = Number(simplify(graft(pattern_values_bottom)))

# ---- group: Build Mesh
dom = ConstructDomain(DomainStart=expr("-x/2", srfxsize_2), DomainEnd=expr("x/2", srfxsize_2))
dom_2 = ConstructDomain(DomainStart=expr("-x/2", srfysize_2), DomainEnd=expr("x/2", flatten(srfysize_2)))
boundary = BoundarySurfaces(FreeFormCrv=free_form_crv)
cir = Circle(Plane=PlaneXY(0, 0, 0), Radius=expr("x/2", srfxsize_2))
planesrf1 = PlaneSurface(Plane=PlaneXY(0, 0, 0), XSize=dom, YSize=dom_2)
boundary_2 = BoundarySurfaces(Edges=cir)
filter = StreamFilter(BaseShapeIdx=base_shape_idx, Stream0=boundary_2, Stream1=planesrf1, Stream2=boundary)
srf = Surface(filter)
Z = UnitZ(Thickness=thickness_2)
gate = StreamGate(Stream=srf, Gate=0)  # -> Target0, Target1

# ---- group: Grid
brec = BoundingRectangle(Geometry=srf, Plane=PlaneXY(0, 0, 0), Axis=0, Slide=0, Union=True)  # -> Bounding, DimensionX, DimensionY
pt = ConstructPoint(XCoordinate=expr("-x/2", brec.DimensionX), YCoordinate=expr("-x/2", brec.DimensionY), ZCoordinate=0)
division = Division(A=brec.DimensionX, B=B)
division_2 = Division(A=brec.DimensionY, B=B_2)
recgrid = Rectangular(Plane=pt, SizeX=division, SizeY=division_2, ExtentX=ex, ExtentY=ey)  # -> flatten(Cells), flatten(Points)

# ----
B_3 = ClusterOutput(brec.Bounding)
C = ClusterOutput(recgrid.Cells)
thickness_3 = ClusterOutput(thickness_2)
pattern_values_top_3 = ClusterOutput(pattern_values_top_2)
pattern_values_bottom_3 = ClusterOutput(pattern_values_bottom_2)
